# Grasshopper definition SVGLayout.gh (Grasshopper 1.0.7)
# plug-ins: Python, Human, RhinoCodePluginGH, ClipperComponents

dpipeline = DynamicGeometryPipeline(
    LayerFilter="2",
    TypeFilter="Curve",
    NameFilter="*",
    GroupByLayer=False,
    GroupByType=False,
    IncludeHidden=True,
    IncludeLocked=True,
    enableFullPath=False,
    listenToAttributes=True)
cluster = Cluster(A=dpipeline)  # -> name, udv
data = Data(cluster.name)
json = CreateJSON(K="class", V=data)
polyoffset = PolylineOffset(
    Polylines=dpipeline,
    Distance=4,
    Plane=Plane(origin=(0, 0, 0), x=(0, 0, 0), y=(0, 0, 0)),
    Tolerance=0.01,
    ClosedFillet=2,
    OpenFillet=1,
    Miter=2)  # -> Contour, Holes
item = ListItem(List=flatten(json), Index=0, Wrap=True)
fillet = Fillet(Curve=polyoffset.Contour, Radius=20)
fillet_2 = Fillet(Curve=polyoffset.Holes, Radius=20)
dpipeline_2 = DynamicGeometryPipeline(
    LayerFilter="Layer 02",
    TypeFilter="Curve",
    NameFilter="*",
    GroupByLayer=False,
    GroupByType=False,
    IncludeHidden=True,
    IncludeLocked=True,
    enableFullPath=False,
    listenToAttributes=True)
group = Group(Objects=flatten([dpipeline, fillet_2]))
xy = XYPlane(Origin=Point(0, 0, 0))
path = FilePath("E:\mydev\redback\components\SVGLayout.py")
pt = ConstructPoint(XCoordinate=0, YCoordinate=0, ZCoordinate=0)
prot = RotatePlane(Plane=xy, Angle=degrees(Slider(0, range=0..50)))
file = ReadFile(File=path, PerLineParse=False)
cluster_2 = Cluster(A=dpipeline)  # -> name, flatten(udv)
xy_2 = XYPlane(Origin=pt)
python = GhPythonScript(Code=file, P=prot, D="A3 (L)", S="1:1")  # -> Out, L, R
A = Text("A3 (L)")
sort = SortList(Keys=cluster_2.udv, ValuesA=dpipeline)  # -> Keys, ValuesA
preset_standard_page_sizes = Panel("""A5 (L),210,148
A5 (P),148,210
A4 (L),297,210
A4 (P),210,297
A3 (L),420,297
A3 (P),297,420
A2 (L),594,420
A2 (P),420,594
A1 (L),841,594
A1 (P),594,841
A0 (L),1189,841
A0 (P),841,1189""")
svg_layout = SVGLayout(P=prot, D="A3 (L)", S="1:1")  # -> Layout, Rectangle
svg_layout_2 = SVGLayout(P=xy_2, D="A3 (L)", S="1:1")  # -> Layout, Rectangle
# *{fill:None;}
# .plane,.y,.x{fill:#ffc200;
# stroke:#aa240d;
# stroke-width:0.8px;}
# .page{
# fill:#fff;
# stroke:#bbb;
# stroke-width:0.8px;}
series = Series(Start=0, Step=1, Count=1)
crv = Curve(python.R)
panel = Panel(""".hello{display:none;}
.world{display:inherit;}""")
group_2 = Group(Objects=dpipeline)
panel_2 = Panel("""*{
fill:none;
stroke:magenta;
stroke-width:0.2mm;
}""")
panel_3 = Panel(svg_layout_2.Layout)
rec = Rectangle(crv)
wrapper = Geo2Ar(G=dpipeline_2)
panel_4 = Panel(python.L)
split = TextSplit(Text=preset_standard_page_sizes, Separators=",")
wrapper_2 = Geo2Ar(G=dpipeline)
item_2 = ListItem(List=split, Index=0, Wrap=True)  # -> flatten(Item)
py3 = Python3Script(G=group_2)  # -> out, J; inputs G: list, P: list
# ---------- py3: Python ----------
import sys
import importlib
path = r"X:\93_Development\PackageManager\redback\py"

if path not in sys.path:
    sys.path.append(path) # Adds higher directory to python modules path.
import pyArchiJSON as arch
arch = importlib.reload(arch)
import json
import rhinoscriptsyntax as rs

rs.ArcCenterPoint
if not P:
    P = []

fillP = ["{}"]*len(G)
for i, prop in enumerate(P):
	fillP[i] = prop

print(G,fillP)

#arch.Convert(G[0],fillP[0])

#print(G)
P = list(map(lambda g,p: arch.Convert(g,p), G,fillP))

	
J = json.dumps({"type":"FeatureCollection", "features":P})
# ---------- end py3 ----------
py3_2 = Python3Script(x="testing\testing_control_%03d.svg", y=series)  # -> out, a
# ---------- py3_2: Python ----------
"""Grasshopper Script"""
a = "Hello Python 3 in Grasshopper!"
print(a)
a = x%y
# ---------- end py3_2 ----------
py3_3 = Python3Script(x="testing\testing_%03d.svg", y=series)  # -> out, a; same code as py3_2
svg = SVGGenerator(J=wrapper_2, L=svg_layout.Layout, C=panel)  # -> SVG, LOG
toggle = BooleanToggle(True)
rel_path = RelativePath(R=graft(py3_3.a))  # -> FullPath, DirectoryPath, FileName
rel_path_2 = RelativePath(R=graft(py3_2.a))  # -> FullPath, DirectoryPath, FileName
py3_4 = Python3Script(J=wrapper, L=svg_layout.Layout, C=panel_2)  # -> out, S
# ---------- py3_4: Python ----------
import sys
import importlib
path = r"X:\93_Development\PackageManager\redback\py"

if path not in sys.path:
    sys.path.append(path) # Adds higher directory to python modules path.
import pySVGMaker as svg
svg = importlib.reload(svg)
import json

archiJSON = J


archiJSON = json.loads(archiJSON)
layout = L
css = C



outTest = svg.archiJsonToSVG(archiJSON,layout,css)
print(outTest)

S = outTest
# ---------- end py3_4 ----------
py3_5 = Python3Script(J=py3.J, L=svg_layout.Layout, C=panel)  # -> out, S
# ---------- py3_5: Python ----------
import sys
import importlib
path = r"X:\93_Development\PackageManager\redback\py"

if path not in sys.path:
    sys.path.append(path) # Adds higher directory to python modules path.
import pySVGMaker as svg
svg = importlib.reload(svg)
import json

archiJSON = J


archiJSON = json.loads(archiJSON)
layout = L
css = C



outTest = svg.archiJsonToSVG(archiJSON,layout,css)
#print(outTest)

S = outTest
# ---------- end py3_5 ----------
write = WriteFile(R=toggle, C=py3_4.S, P=rel_path_2.DirectoryPath, N=rel_path_2.FileName)
write_2 = WriteFile(R=toggle, C=py3_5.S, P=rel_path.DirectoryPath, N=rel_path.FileName)
panel_5 = Panel(py3.J)
tstat = TreeStatistics(Tree=A)  # -> Paths, Length, Count
svg_plane_by_page = RDB_SVGPlaneByPage(plane=PlaneXY(0, 0, 0), scale="1:500", position=True)  # -> json_layout, preview
py3_6 = Python3Script(x=write)  # -> out, x
# ---------- py3_6: Python ----------
# r: svglib
from svglib.svglib import svg2rlg
from reportlab.graphics import renderPDF, renderPM

drawing = svg2rlg(x)
x = x.replace(".svg",".pdf")
scale = (4961/842)
print(scale)
drawing.scale(scale,scale)
drawing.height = scale*drawing.height
drawing.width = scale*drawing.width



renderPDF.drawToFile(drawing, x)
#x = x.replace(".pdf",".png")
#renderPM.drawToFile(drawing, x, fmt="PNG")
# ---------- end py3_6 ----------
py3_7 = Python3Script(x=write_2)  # -> out, x; same code as py3_6
branch = TreeBranch(Tree=A, Path=tstat.Paths, MaintainPaths=False)
split_2 = TextSplit(Text="1:1", Separators=":")
panel_6 = Panel(py3_5.S)
item_3 = ListItem(List=split_2, Index=0, Wrap=True)  # -> Item, Item1
unit_checker = PythonScript()  # -> out, a; same code as unit_checker
pos = Boolean(Toggle(True))
division = Division(A=item_3.Item1, B=unit_checker.out)

# ---- group: Choose location of centre
panel_7 = Panel("""1,1
0.5,0.5""")
item_4 = ListItem(List=panel_7, Index=pos, Wrap=True)

# ----
num = Number(division)
split_3 = TextSplit(Text=item_4, Separators=",")
plane = Data(prot)
dispatch = Dispatch(List=split_3, DispatchPattern=[True, False])  # -> ListA, ListB
scale = Number(flatten(num))

# ---- group: Find which Page Size is being called and pick it from list
mindex = MemberIndex(Set=item_2, Member=simplify(A))  # -> simplify(Index), Count
item_5 = ListItem(List=preset_standard_page_sizes, Index=mindex.Index, Wrap=True)  # -> simplify(Item)

# ----
tstat_2 = TreeStatistics(Tree=item_5)  # -> Paths, Length, Count
branch_2 = TreeBranch(Tree=item_5, Path=tstat_2.Paths, MaintainPaths=False)

# ---- group: Find which Page Size is being called and pick it from list (continued)
merge = Merge(Data1=simplify(branch_2), Data2=simplify(branch))
item_6 = ListItem(List=merge, Index=0, Wrap=True)

# ---- group: Extract Dimensions
split_4 = TextSplit(Text=item_6, Separators=",")
item_7 = ListItem(List=reverse(split_4), Index=[0, 1], Wrap=True)  # -> reverse(Item)
num_2 = Number(item_7)

# ---- group: Convert to Scale
expression = Expression(x=num_2, y=num, Expression="x*y")

# ----
dispatch_2 = Dispatch(List=expression, DispatchPattern=[True, False])  # -> ListA, ListB

# ---- group: Create domains
dom = ConstructDomain(DomainStart=expr("-x", dispatch_2.ListB), DomainEnd=0)
dom_2 = ConstructDomain(DomainStart=expr("-x", dispatch_2.ListA), DomainEnd=0)

# ---- group: Remap to match centre pt location
remap = RemapNumbers(Value=dispatch.ListB, Source=Domain(0, 1), Target=dom)  # -> Mapped, Clipped
remap_2 = RemapNumbers(Value=dispatch.ListA, Source=Domain(0, 1), Target=dom_2)  # -> Mapped, Clipped

# ---- group: Adjust Centre Plane
pt_2 = PointOriented(BasePlane=plane, UComponent=remap_2.Mapped, VComponent=expr("-x", remap.Mapped), WComponent=0)
pl_origin = PlaneOrigin(Base=plane, Origin=pt_2)

# ----
expression_2 = Expression(x=remap_2.Mapped, y=dispatch_2.ListA, Expression="x+y")
expression_3 = Expression(x=remap.Mapped, y=dispatch_2.ListB, Expression="x+y")

# ---- group: Create Adjusted Domain
dom_3 = ConstructDomain(DomainStart=remap_2.Mapped, DomainEnd=expression_2)
dom_4 = ConstructDomain(DomainStart=remap.Mapped, DomainEnd=expression_3)

# ----
y_dim = Domain(dom_3)
x_dim = Domain(dom_4)
plane_2 = Plane(flatten(pl_origin))
dims = Number(flatten(num_2))
neg = Negative(Value=x_dim)
python_2 = PythonScript(PLANE=plane_2, PAGE=dims, SCALE=scale)  # -> JSON; inputs PAGE: list; same code as python

# ---- group: Construct Crv
rectangle = Rectangle(Plane=plane, XSize=y_dim, YSize=neg, Radius=0)  # -> Rectangle, Length

# ----
json_2 = Data(python_2)
preview = PREVIEW(rectangle.Rectangle)  # Previews the page curve
json_layout = JSONLAYOUT(json_2)  # Layout JSON containing Plane, Page, Scale

# ==== cluster RDB_SVGPlaneByPage: Makes a layout json for svg
page_size = ClusterInput()  # Size of Page. Input a page size from A5-A0 followed by the orientation (P) or (L), Example: 'A1 (P)'. Alternatively, input dimensions, eg. '500,500'
plane = ClusterInput()  # Orientation and Location of Page
scale = ClusterInput()  # Scale of Page
position = ClusterInput()  # Position of Plane relative to the page. True = Plane at Centre, False = Plane at Top Left
A = Text(page_size)
preset_standard_page_sizes = Panel("""A5 (L),210,148
A5 (P),148,210
A4 (L),297,210
A4 (P),210,297
A3 (L),420,297
A3 (P),297,420
A2 (L),594,420
A2 (P),420,594
A1 (L),841,594
A1 (P),594,841
A0 (L),1189,841
A0 (P),841,1189""")
split = TextSplit(Text=preset_standard_page_sizes, Separators=",")
item = ListItem(List=split, Index=0, Wrap=True)  # -> flatten(Item)
tstat = TreeStatistics(Tree=A)  # -> Paths, Length, Count
branch = TreeBranch(Tree=A, Path=tstat.Paths, MaintainPaths=False)
split_2 = TextSplit(Text=scale, Separators=":")
item_2 = ListItem(List=split_2, Index=0, Wrap=True)  # -> Item, Item1
unit_checker = PythonScript()  # -> out, a
# ---------- unit_checker: Python ----------
import rhinoscriptsyntax as rs
import scriptcontext as sc

a=sc.doc.ModelUnitSystem
a = str(a)
if a == "Millimeters":
    print 1
elif a == "Meters":
    print 1000
else:
    print "Use the metric system"
# ---------- end unit_checker ----------
pos = Boolean(position)
division = Division(A=item_2.Item1, B=unit_checker.out)

# ---- group: Choose location of centre
panel = Panel("""1,1
0.5,0.5""")
item_3 = ListItem(List=panel, Index=pos, Wrap=True)

# ----
num = Number(division)
split_3 = TextSplit(Text=item_3, Separators=",")
plane_2 = Data(plane)
dispatch = Dispatch(List=split_3, DispatchPattern=[True, False])  # -> ListA, ListB
scale_2 = Number(flatten(num))

# ---- group: Find which Page Size is being called and pick it from list
mindex = MemberIndex(Set=item, Member=simplify(A))  # -> simplify(Index), Count
item_4 = ListItem(List=preset_standard_page_sizes, Index=mindex.Index, Wrap=True)  # -> simplify(Item)

# ----
tstat_2 = TreeStatistics(Tree=item_4)  # -> Paths, Length, Count
branch_2 = TreeBranch(Tree=item_4, Path=tstat_2.Paths, MaintainPaths=False)

# ---- group: Find which Page Size is being called and pick it from list (continued)
merge = Merge(Data1=simplify(branch_2), Data2=simplify(branch))
item_5 = ListItem(List=merge, Index=0, Wrap=True)

# ---- group: Extract Dimensions
split_4 = TextSplit(Text=item_5, Separators=",")
item_6 = ListItem(List=reverse(split_4), Index=[0, 1], Wrap=True)  # -> reverse(Item)
num_2 = Number(item_6)

# ---- group: Convert to Scale
expression = Expression(x=num_2, y=num, Expression="x*y")

# ----
dispatch_2 = Dispatch(List=expression, DispatchPattern=[True, False])  # -> ListA, ListB

# ---- group: Create domains
dom = ConstructDomain(DomainStart=expr("-x", dispatch_2.ListB), DomainEnd=0)
dom_2 = ConstructDomain(DomainStart=expr("-x", dispatch_2.ListA), DomainEnd=0)

# ---- group: Remap to match centre pt location
remap = RemapNumbers(Value=dispatch.ListB, Source=Domain(0, 1), Target=dom)  # -> Mapped, Clipped
remap_2 = RemapNumbers(Value=dispatch.ListA, Source=Domain(0, 1), Target=dom_2)  # -> Mapped, Clipped

# ---- group: Adjust Centre Plane
pt = PointOriented(BasePlane=plane_2, UComponent=remap_2.Mapped, VComponent=expr("-x", remap.Mapped), WComponent=0)
pl_origin = PlaneOrigin(Base=plane_2, Origin=pt)

# ----
expression_2 = Expression(x=remap_2.Mapped, y=dispatch_2.ListA, Expression="x+y")
expression_3 = Expression(x=remap.Mapped, y=dispatch_2.ListB, Expression="x+y")

# ---- group: Create Adjusted Domain
dom_3 = ConstructDomain(DomainStart=remap_2.Mapped, DomainEnd=expression_2)
dom_4 = ConstructDomain(DomainStart=remap.Mapped, DomainEnd=expression_3)

# ----
x_dim = Domain(dom_4)
y_dim = Domain(dom_3)
plane_3 = Plane(flatten(pl_origin))
dims = Number(flatten(num_2))
neg = Negative(Value=x_dim)
python = PythonScript(PLANE=plane_3, PAGE=dims, SCALE=scale_2)  # -> JSON; inputs PAGE: list
# ---------- python: Python ----------
import Rhino as r
import rhinoscriptsyntax as rs
import json
p = PLANE
o = {"plane":[[p.Origin[0],p.Origin[1],p.Origin[2]],[p.XAxis[0],p.XAxis[1],p.XAxis[2]],[p.YAxis[0],p.YAxis[1],p.YAxis[2]]], "page":PAGE, "scale":SCALE}
JSON = json.dumps(o)
# ---------- end python ----------

# ---- group: Construct Crv
rectangle = Rectangle(Plane=plane_2, XSize=y_dim, YSize=neg, Radius=0)  # -> Rectangle, Length

# ----
json = Data(python)
preview = ClusterOutput(rectangle.Rectangle)  # Previews the page curve
json_layout = ClusterOutput(json)  # Layout JSON containing Plane, Page, Scale

# ==== cluster Cluster
A = ClusterInput()
objatts = ObjectAttributes(ObjectOrAttributes=graft(A))  # -> Name, LayerName, LayerFullPath, Color, MaterialName, LinetypeName, GroupIndices, PlotWeight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
name = ClusterOutput(objatts.Name)
udv = ClusterOutput(objatts.UserDataValues)
