# Grasshopper definition RelPath.gh (Grasshopper 1.0.7)
# plug-ins: Python

path = FilePath("E:\mydev\redback\components\CreateJson.py")
path_2 = FilePath("E:\mydev\redback\components\StripPath.py")
panel = Panel(".\hello.txt")
panel_2 = Panel("C:\temp")
file = ReadFile(File=path, PerLineParse=False)
file_2 = ReadFile(File=path_2, PerLineParse=False)
python = GhPythonScript(Code=file, K="D", V="ABC")  # -> Out, J
python_2 = GhPythonScript(Code=file_2, P=Toggle(True))  # -> Out, F, A, B
rel_path = RelativePath(D=Toggle(True), R=".\Hello\Doc.txt")  # -> FullPath, DirectoryPath, FileName
panel_3 = Panel(python.J)
panel_4 = Panel(rel_path.FullPath)
