# Grasshopper definition Write File.gh (Grasshopper 1.0.7)

# Component Info - Copy to Notepad: ICML Generator
# ICML
# Takes JSON data formated as a lists of lists and creates a InCopy Markup Language format of a table.
# Redback
# Table
# 89da792a-24b2-41fa-a674-20d9df2b5b6f
python = GhPythonScript()  # -> a
# ---------- python: Python ----------
from ghpythonlib.componentbase import dotnetcompiledcomponent as component
import Grasshopper, GhPython
import System
import Rhino
import rhinoscriptsyntax as rs

class MyComponent(component):
    def __new__(cls):
        instance = Grasshopper.Kernel.GH_Component.__new__(cls,
            "Write File", "Write File", """Writes a File to a location""", "Redback", "Util")
        return instance
    
    def get_ComponentGuid(self):
        return System.Guid("148c6730-b468-426d-99f0-6ae0ce160029")
    
    def SetUpParam(self, p, name, nickname, description):
        p.Name = name
        p.NickName = nickname
        p.Description = description
        p.Optional = True
    
    def RegisterInputParams(self, pManager):
        p = GhPython.Assemblies.MarshalParam()
        self.SetUpParam(p, "CONTENT", "CONTENT", "Script variable Python")
        p.Access = Grasshopper.Kernel.GH_ParamAccess.list
        self.Params.Input.Add(p)
        
        p = GhPython.Assemblies.MarshalParam()
        self.SetUpParam(p, "FILEPATH", "FILEPATH", "Script variable Python")
        p.Access = Grasshopper.Kernel.GH_ParamAccess.item
        self.Params.Input.Add(p)
        
        p = GhPython.Assemblies.MarshalParam()
        self.SetUpParam(p, "FILENAME", "FILENAME", "Script variable Python")
        p.Access = Grasshopper.Kernel.GH_ParamAccess.item
        self.Params.Input.Add(p)
        
        p = GhPython.Assemblies.MarshalParam()
        self.SetUpParam(p, "ACTIVATE", "ACTIVATE", "Script variable Python")
        p.Access = Grasshopper.Kernel.GH_ParamAccess.item
        self.Params.Input.Add(p)
        
    
    def RegisterOutputParams(self, pManager):
        pass    
    def SolveInstance(self, DA):
        p0 = self.marshal.GetInput(DA, 0)
        p1 = self.marshal.GetInput(DA, 1)
        p2 = self.marshal.GetInput(DA, 2)
        p3 = self.marshal.GetInput(DA, 3)
        result = self.RunScript(p0, p1, p2, p3)

        
    def get_Internal_Icon_24x24(self):
        o = "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"
        return System.Drawing.Bitmap(System.IO.MemoryStream(System.Convert.FromBase64String(o)))

    
    def RunScript(self, CONTENT, FILEPATH, FILENAME, ACTIVATE):
        """Provides a scripting component.
            Inputs:
                x: The x script variable
                y: The y script variable
            Output:
                a: The a output variable"""
        
        __author__ = "s-abutler"
        __version__ = "2018.09.10"
        
        import rhinoscriptsyntax as rs
        from json import dumps
        def check(o):
        #    print(str(type(o)))
        #    return o
            if str(type(o)) == "<type 'dict'>":
                return dumps(o)
            else:
                return o
        if ACTIVATE:
            con = list(map(lambda u: check(u), CONTENT))
            conwrite = "\n".join(con)
            dir = FILEPATH+"\\"+FILENAME
            with open(dir,'w') as f:
                f.write(conwrite)
        
        # return outputs if you have them; here I try it for you:
        return 


import GhPython
import System

class AssemblyInfo(GhPython.Assemblies.PythonAssemblyInfo):
    def get_AssemblyName(self):
        return "Write File"
    
    def get_AssemblyDescription(self):
        return """"""

    def get_AssemblyVersion(self):
        return "0.1"

    def get_AuthorName(self):
        return ""
    
    def get_Id(self):
        return System.Guid("f25c10cf-3159-4de1-88e5-60fa77ca3e35")
# ---------- end python ----------
write_file = GhPythonScript()  # inputs CONTENT: list
# ---------- write_file: Python ----------
from ghpythonlib.componentbase import executingcomponent as component
import Grasshopper, GhPython
import System
import Rhino
import rhinoscriptsyntax as rs

class MyComponent(component):
    
    def RunScript(self, CONTENT, FILEPATH, FILENAME, ACTIVATE):
        """Provides a scripting component.
            Inputs:
                x: The x script variable
                y: The y script variable
            Output:
                a: The a output variable"""
        
        __author__ = "s-abutler"
        __version__ = "2018.09.10"
        
        import rhinoscriptsyntax as rs
        from json import dumps
        def check(o):
        #    print(str(type(o)))
        #    return o
            if str(type(o)) == "<type 'dict'>":
                return dumps(o)
            else:
                return o
        if ACTIVATE:
            con = list(map(lambda u: check(u), CONTENT))
            conwrite = "\n".join(con)
            dir = FILEPATH+"\\"+FILENAME
            with open(dir,'w') as f:
                f.write(conwrite)
        
        # return outputs if you have them; here I try it for you:
        return
# ---------- end write_file ----------
python_2 = GhPythonScript()  # -> Out, A
