# Grasshopper definition LineDrawing.gh (Grasshopper 1.0.8)
# plug-ins: RhinoCodePluginGH, Human, Python

crv = Curve([<curve referenced from the Rhino model> x24])
lng = ListLength(List=crv)
lng_2 = ListLength(List=crv)
dom = ConstructDomain(DomainStart=Slider(-5, range=-5..5), DomainEnd=Slider(0, range=-5..5))
random = Random(Range=Domain(0, 1), Number=lng, Seed=7456)
random_2 = Random(Range=Domain(0, 1), Number=lng_2, Seed=234)
remap = RemapNumbers(Value=random_2, Source=Domain(0, 1), Target=dom)  # -> Mapped, Clipped
remap_2 = RemapNumbers(Value=random, Source=Domain(0, 1), Target=dom)  # -> Mapped, Clipped
ext = ExtendCurve(Curve=crv, Type=0, Start=remap.Mapped, End=remap_2.Mapped)
number_slider = Slider(2, range=0..50)
Y = UnitY(Factor=1)
pt = ConstructPoint(XCoordinate=0, YCoordinate=0, ZCoordinate=0)
amp = Amplitude(Vector=Y, Amplitude=expr("-x/2", number_slider))
line = LineSDL(Start=pt, Direction=Y, Length=number_slider)
hframe = HorizontalFrame(Curve=reparameterize(ext), Parameter=0)
move = Move(Geometry=line, Motion=amp)  # -> Geometry, Transform
orient = Orient(Geometry=move.Geometry, Source=PlaneXY(0, 0, 0), Target=hframe)  # -> Geometry, Transform
swp1 = Sweep1(Rail=graft(ext), Sections=graft(orient.Geometry), Miter=1)
object = ModelObject(Geometry=swp1)  # -> Object, Geometry, Name, Layer, Visibility, Display, Drafting, Render
cache = ContentCache(Content=object.Object)
dpipeline = DynamicGeometryPipeline(
    LayerFilter="Layer 04",
    TypeFilter="Curve",
    NameFilter="*",
    GroupByLayer=False,
    GroupByType=False,
    IncludeHidden=True,
    IncludeLocked=True,
    enableFullPath=False,
    listenToAttributes=True)
dpipeline_2 = DynamicGeometryPipeline(
    LayerFilter="Layer 01",
    TypeFilter="Curve",
    NameFilter="*",
    GroupByLayer=False,
    GroupByType=False,
    IncludeHidden=True,
    IncludeLocked=True,
    enableFullPath=False,
    listenToAttributes=True)
list = ValueList({"Solid", "Hatch1", "Hatch2", "Hatch3", "HatchDash", "Grid", "Grid60", "Plus", "Squares"}, selected="Plus")
number_slider_2 = Slider(10, range=0..100)
scale = Scale(Geometry=dpipeline, Center=Point(0, 0, 0), Factor=1)  # -> Geometry, Transform
crv_2 = Curve(<curve referenced from the Rhino model>)
scale_2 = Scale(Geometry=dpipeline_2, Center=Point(0, 0, 0), Factor=1)  # -> Geometry, Transform
explode = Explode(Curve=scale.Geometry, Recursive=True)  # -> flatten(Segments), Vertices
explode_2 = Explode(Curve=scale_2.Geometry, Recursive=True)  # -> flatten(Segments), Vertices
panel = Panel("""Brep
Extrusion""")
dpipeline_3 = DynamicGeometryPipeline(
    LayerFilter="Layer 04",
    TypeFilter="Curve",
    NameFilter="*",
    GroupByLayer=False,
    GroupByType=False,
    IncludeHidden=True,
    IncludeLocked=True,
    enableFullPath=False,
    listenToAttributes=True)
dpipeline_4 = DynamicGeometryPipeline(
    LayerFilter="Layer 04",
    TypeFilter="Curve",
    NameFilter="*",
    GroupByLayer=False,
    GroupByType=False,
    IncludeHidden=True,
    IncludeLocked=True,
    enableFullPath=False,
    listenToAttributes=True)
createhatch = CreateHatch(Bake=False, Curves=crv_2, HatchPatternName=list, HatchScale=number_slider_2, HatchRotation=Slider(45, range=0..100))  # -> HatchGeometry, HatchObjects
createhatch_2 = CreateHatch(Bake=False, Curves=crv_2, HatchPatternName=list, HatchScale=number_slider_2, HatchRotation=Slider(100, range=0..100))  # -> HatchGeometry, HatchObjects; disabled
viewports = QueryViewports(Name="ABC", AutoUpdateState=True)
explode_3 = Explode(Curve=dpipeline_3, Recursive=True)  # -> Segments, Vertices
topoly = CurveToPolyline(Curve=crv_2, ToleranceDistance=0.1, ToleranceAngle=0, MaxEdge=20)  # -> Polyline, Segments
explode_4 = Explode(Curve=dpipeline_4, Recursive=True)  # -> Segments, Vertices
dpipeline_5 = DynamicGeometryPipeline(
    LayerFilter="Layer 04",
    TypeFilter=panel,
    NameFilter="*",
    GroupByLayer=False,
    GroupByType=False,
    IncludeHidden=True,
    IncludeLocked=True,
    enableFullPath=False,
    listenToAttributes=True)
flip = FlipCurve(Curve=createhatch_2.HatchGeometry)  # -> Curve, Flag; disabled
explode_5 = Explode(Curve=topoly.Polyline, Recursive=True)  # -> Segments, Vertices
subcrv = SubCurve(BaseCurve=reparameterize(createhatch.HatchGeometry), Domain=Slider(0.037, range=0..1))
subcrv_2 = SubCurve(BaseCurve=reparameterize(flip.Curve), Domain=Slider(0.034, range=0..1))
lng_3 = ListLength(List=explode.Segments)
lng_4 = ListLength(List=explode.Segments)
dom_2 = ConstructDomain(DomainStart=Slider(0, range=-5..5), DomainEnd=Slider(1, range=-5..5))
dom_3 = ConstructDomain(DomainStart=Slider(0, range=-5..5), DomainEnd=Slider(0.5, range=-5..5))
random_3 = Random(Range=Domain(0, 1), Number=lng_3, Seed=7456)
random_4 = Random(Range=Domain(0, 1), Number=lng_4, Seed=234)
crv_3 = Curve(explode_2.Segments)
lng_5 = ListLength(List=crv_3)
lng_6 = ListLength(List=crv_3)
random_5 = Random(Range=Domain(0, 1), Number=lng_5, Seed=7456)
random_6 = Random(Range=Domain(0, 1), Number=lng_6, Seed=234)
remap_3 = RemapNumbers(Value=random_4, Source=Domain(0, 1), Target=dom_2)  # -> Mapped, Clipped
remap_4 = RemapNumbers(Value=random_3, Source=Domain(0, 1), Target=dom_2)  # -> Mapped, Clipped
make2d = Make2D(Geometry=dpipeline_5, View=viewports, TangentEdges=False, TangentSeams=False, AutoComputeMake2D=True)  # -> VisibleCurves, VisibleIndex, VisibleType, HiddenCurves, HiddenIndex, HiddenType
remap_5 = RemapNumbers(Value=random_6, Source=Domain(0, 1), Target=dom_3)  # -> Mapped, Clipped
remap_6 = RemapNumbers(Value=random_5, Source=Domain(0, 1), Target=dom_3)  # -> Mapped, Clipped
number_slider_3 = Slider(0, range=0..10)
number_slider_4 = Slider(1, range=0..10)
ext_2 = ExtendCurve(Curve=explode.Segments, Type=0, Start=remap_3.Mapped, End=remap_4.Mapped)
ext_3 = ExtendCurve(Curve=crv_3, Type=0, Start=remap_5.Mapped, End=remap_6.Mapped)
crv_4 = Curve(make2d.VisibleCurves)
dom_4 = ConstructDomain(DomainStart=expr("-x", number_slider_3), DomainEnd=expr("x", number_slider_3))
X = UnitX(Factor=5000)
lng_7 = ListLength(List=ext_2)
dom_5 = ConstructDomain(DomainStart=expr("-x", number_slider_4), DomainEnd=expr("x", number_slider_4))
lng_8 = ListLength(List=ext_3)
scale_3 = Scale(Geometry=crv_4, Center=Point(0, 0, 0), Factor=0.5)  # -> Geometry, Transform
random_7 = Random(Range=dom_4, Number=lng_7, Seed=2)
hframe_2 = HorizontalFrame(Curve=reparameterize(ext_2), Parameter=0.5)
random_8 = Random(Range=dom_5, Number=lng_8, Seed=2)
hframe_3 = HorizontalFrame(Curve=reparameterize(ext_3), Parameter=0.5)
move_2 = Move(Geometry=scale_3.Geometry, Motion=X)  # -> Geometry, Transform
rel_path = RelativePath(R="\Artline210_Medium_0.6_Freehand")  # -> FullPath, DirectoryPath, FileName
rotate = Rotate(Geometry=ext_2, Angle=degrees(random_7), Plane=hframe_2)  # -> flatten(Geometry), Transform
dir = DirectoryContents(FolderPath=rel_path.DirectoryPath, Filter="*", IncludeSubfolders=False)  # -> FilePaths, FileNames
rotate_2 = Rotate(Geometry=ext_3, Angle=degrees(random_8), Plane=hframe_3)  # -> flatten(Geometry), Transform
tmatch = MatchText(Text=dir.FilePaths, RegEx="\.png$", Case=True)
crv_5 = Curve([<curve referenced from the Rhino model> x11])
dispatch = Dispatch(List=dir.FilePaths, DispatchPattern=tmatch)  # -> ListA, ListB
dispatch_2 = Dispatch(List=dir.FileNames, DispatchPattern=tmatch)  # -> ListA, ListB
crv_6 = Curve([<curve referenced from the Rhino model> x11])
split = TextSplit(Text=dispatch_2.ListA, Separators="_")
expression = Expression(x="0.5", y="2", Expression="x/y")
expression_2 = Expression(x="3", y="2", Expression="x/y")
l0 = Start(0.5)
item = ListItem(List=split, Index=-2, Wrap=True)
int = Integer(item)
len = Length(Curve=rotate.Geometry)
len_2 = Length(Curve=rotate_2.Geometry)
ext_4 = ExtendCurve(Curve=rotate.Geometry, Type=0, Start=l0, End=l0)
clean = CleanTree(RemoveNulls=True, RemoveInvalid=True, RemoveEmpty=True, Tree=int)  # -> flatten(Tree)
ext_5 = ExtendCurve(Curve=rotate_2.Geometry, Type=0, Start=expression, End=expression)
number_slider_5 = Slider(3, range=0..50)
expression_3 = Expression(x=len_2, y="2", Expression="x*y")
sort = SortList(Keys=clean, ValuesA=clean)  # -> Keys, ValuesA
Y_2 = UnitY(Factor=1)
pt_2 = ConstructPoint(XCoordinate=0, YCoordinate=0, ZCoordinate=0)
Y_3 = UnitY(Factor=1)
null = NullItem(Item=int)  # -> NullFlags, InvalidFlags, Description
pt_3 = ConstructPoint(XCoordinate=0, YCoordinate=0, ZCoordinate=0)
cset = CreateSet(List=sort.ValuesA)  # -> Set, Map
eval = EvaluateLength(Curve=ext_4, Length=0, Normalized=True)  # -> Point, Tangent, Parameter
eval_2 = EvaluateLength(Curve=ext_5, Length=0, Normalized=True)  # -> Point, Tangent, Parameter
amp_2 = Amplitude(Vector=Y_2, Amplitude=expr("-x/2", number_slider_5))
line_2 = LineSDL(Start=pt_2, Direction=Y_2, Length=number_slider_5)
xy = XYPlane(Origin=eval.Point)
amp_3 = Amplitude(Vector=Y_3, Amplitude=expr("-x/2", expression_2))
line_3 = LineSDL(Start=pt_3, Direction=Y_3, Length=expression_2)
xy_2 = XYPlane(Origin=eval_2.Point)
dispatch_3 = Dispatch(List=graft(item), DispatchPattern=null.NullFlags)  # -> ListA, flatten(ListB)
dispatch_4 = Dispatch(List=graft(dispatch.ListA), DispatchPattern=null.NullFlags)  # -> ListA, flatten(ListB)
int_2 = Integer(0)
align = AlignPlane(Plane=xy, Direction=eval.Tangent)  # -> Plane, Angle
mindex = MemberIndex(Set=sort.ValuesA, Member=cset.Set)  # -> Index, Count
move_3 = Move(Geometry=line_2, Motion=amp_2)  # -> Geometry, Transform
align_2 = AlignPlane(Plane=xy_2, Direction=eval_2.Tangent)  # -> Plane, Angle
move_4 = Move(Geometry=line_3, Motion=amp_3)  # -> Geometry, Transform
merge = Merge(Data1=flatten(int_2), Data2=flatten(cset.Set))
consec = ConsecutiveDomains(Numbers=merge, Additive=False)
fdom = FindDomain(Domains=consec, Number=len, Strict=False)  # -> Index, Neighbour
fdom_2 = FindDomain(Domains=consec, Number=expression_3, Strict=False)  # -> Index, Neighbour
orient_2 = Orient(Geometry=move_3.Geometry, Source=PlaneXY(0, 0, 0), Target=align.Plane)  # -> Geometry, Transform
item_2 = ListItem(List=mindex.Index, Index=0, Wrap=True)
ipy2 = IronPython2Script(x=dispatch_4.ListB, y=dispatch_2.ListA)  # -> out, a
# ---------- ipy2: IronPython ----------
import Rhino as rh
import Rhino.Render as rr
import Rhino.DocObjects as rd
import scriptcontext as sc
import rhinoscriptsyntax as rs
import os.path
import System.Drawing as sd
sc.doc = rh.RhinoDoc.ActiveDoc

bitmap_texture_type_guid = rr.ContentUuids.BitmapTextureType
pbr_material_type_guid = rr.ContentUuids.PhysicallyBasedMaterialType

main_texture = rr.RenderContentType.NewContentFromTypeId(bitmap_texture_type_guid)
#metal_white_texture = rr.RenderContentType.NewContentFromTypeId(bitmap_texture_type_guid)

main_texture_location = x
#metal_white_texture_location = main_texture_location.replace('.jpg','_metalwhite.jpg')
#if not os.path.isfile(metal_white_texture_location):
    ##exit()

main_texture.Filename = main_texture_location
#metal_white_texture.Filename = metal_white_texture_location

main_simulated_texture = main_texture.SimulatedTexture(rr.RenderTexture.TextureGeneration.Allow)
#metal_white_simulated_texture = metal_white_texture.SimulatedTexture(rr.RenderTexture.TextureGeneration.Allow)

# first create an empty PBR material
pbr_rm = rr.RenderContentType.NewContentFromTypeId(pbr_material_type_guid)

# to get to a Rhino.DocObjects.PhysicallyBasedMaterial we need to simulate the
# render material first.
sim = pbr_rm.SimulatedMaterial(rr.RenderTexture.TextureGeneration.Allow)

# from the simulated material we can get the Rhino.DocObjects.PhysicallyBasedMaterial
pbr = sim.PhysicallyBased

# now we have an instance of a type that has all the API you need to set the PBR
# properties. 
print(dir(pbr))
print(sd.Color.FromArgb.__doc__)
#print(dir(rd.TextureType))
#pbr.SetTexture(main_simulated_texture.Texture(), rd.TextureType.PBR_BaseColor)
pbr.BaseColor= rh.Display.Color4f.FromArgb(0,0,0,0)
pbr.SetTexture(main_simulated_texture.Texture(), rd.TextureType.Opacity)
#pbr.Metallic = 1.0
#pbr.SetTexture(metal_white_simulated_texture.Texture(), rd.TextureType.PBR_Metallic)
#pbr.Roughness = 0.58
#pbr.SpecularTint = 1.0
#pbr.Anisotropic = 0.90
#pbr.AnisotropicRotation = 0.25
#pbr.Sheen = 0.10
#pbr.SheenTint = 0.90

# convert it back to RenderMaterial
new_pbr = rr.RenderMaterial.FromMaterial(pbr.Material, sc.doc)
# Set a good name
new_pbr.Name = str(y)

# Add it to the document
sc.doc.RenderMaterials.Add(new_pbr)

# Assign to objects
sc.doc = ghdoc
# ---------- end ipy2 ----------
join = TextJoin(Text=mindex.Index, Join=",")  # -> flatten(Result)
item_3 = ListItem(List=join, Index=fdom.Index, Wrap=True)
orient_3 = Orient(Geometry=move_4.Geometry, Source=PlaneXY(0, 0, 0), Target=align_2.Plane)  # -> Geometry, Transform
Z = UnitZ(Factor=1)
Z_2 = UnitZ(Factor=1)
swp1_2 = Sweep1(Rail=graft(ext_4), Sections=graft(orient_2.Geometry), Miter=1)  # -> simplify(Brep)
split_2 = TextSplit(Text=item_3, Separators=",")
tstat = TreeStatistics(Tree=split_2)  # -> Paths, Length, Count
swp1_3 = Sweep1(Rail=graft(ext_5), Sections=graft(orient_3.Geometry), Miter=1)  # -> simplify(Brep)
item_4 = ListItem(List=dispatch_2.ListA, Index=0, Wrap=True)
material = CreateMaterial(
    Diffuse=ColourSwatch(SwatchColor=RGB(0, 0, 0)),
    Specular=RGB(255, 255, 255),
    Emission=RGB(0, 0, 0),
    Transparency=0,
    Shine=0)
material_2 = CreateMaterial(
    Diffuse=ColourSwatch(SwatchColor=RGB(0, 0, 0)),
    Specular=RGB(255, 255, 255),
    Emission=RGB(0, 0, 0),
    Transparency=0,
    Shine=0)
item_5 = ListItem(List=dispatch_2.ListA, Index=item_2, Wrap=True)  # -> flatten(Item)
item_6 = ListItem(List=item_5, Index=fdom_2.Index, Wrap=True)
lng_9 = ListLength(List=tstat.Paths)
materials = QueryModelMaterials(Name=item_6, AutoUpdateState=True)  # -> flatten(Materials)
move_5 = Move(Geometry=swp1_2, Motion=Z)  # -> Geometry, Transform
move_6 = Move(Geometry=swp1_3, Motion=Z_2)  # -> Geometry, Transform
series = Series(Start=0, Step=1, Count=lng_9)
item_7 = ListItem(List=dispatch_2.ListA, Index=mindex.Index, Wrap=True)
shift = ShiftList(List=split_2, Shift=graft(series), Wrap=True)
series_2 = Series(Start=0, Step=1, Count=2)
series_3 = Series(Start=0, Step=1, Count=2)
dedomain = DeconstructDomain(Domain=item_3)  # -> Start, End
int_3 = Integer(1)
int_4 = Integer(1)
item_8 = ListItem(List=shift, Index=0, Wrap=True)
object_material = RenderMaterial(Source=1, Material=materials)  # -> ObjectMaterial, Source, Material
render = RenderAttributes(ObjectMaterial=object_material.ObjectMaterial)  # -> graft(Render), ObjectMaterial, CastsShadows, ReceivesShadows
object_2 = ModelObject(Geometry=move_6.Geometry, Render=simplify(render.Render))  # -> flatten(Object), Geometry, Name, Layer, Visibility, Display, Drafting
graft = GraftTree(Tree=object_2.Object, IncludeEmptyLists=True, IncludeNullItems=True)
item_9 = ListItem(List=flatten(object_2.Object), Index=1, Wrap=True)
cset_2 = CreateSet(List=dedomain.End)  # -> Set, Map
item_10 = ListItem(List=dispatch_2.ListA, Index=item_8, Wrap=True)
int_5 = Integer(1)
int_6 = Integer(1)
materials_2 = QueryModelMaterials(Name=item_10, AutoUpdateState=True)  # -> flatten(Materials)
ipy2_2 = IronPython2Script(x=cset_2.Set)  # -> out, a; disabled
# ---------- ipy2_2: IronPython ----------
import Rhino 
import scriptcontext as sc

sc.doc = Rhino.RhinoDoc.ActiveDoc

bmtex = Rhino.Render.RenderContentType.NewContentFromTypeId(Rhino.Render.ContentUuids.BitmapTextureType)
bmtex.Filename = r"X:\93_Development\graphicSamples\Artline200_Fine_0.4_Freehand\%03dmm-000.png"%(x)

simtex = bmtex.SimulatedTexture(Rhino.Render.RenderTexture.TextureGeneration.Allow)

#
#print(Rhino.Render.ContentUuids.PhysicallyBasedMaterialType)

# first create an empty PBR material
pbr_rm = Rhino.Render.RenderContentType.NewContentFromTypeId(Rhino.Render.ContentUuids.PhysicallyBasedMaterialType)

# to get to a Rhino.DocObjects.PhysicallyBasedMaterial we need to simulate the
# render material first.
sim = pbr_rm.SimulatedMaterial(Rhino.Render.RenderTexture.TextureGeneration.Allow)

# from the simulated material we can get the Rhino.DocObjects.PhysicallyBasedMaterial
pbr = sim.PhysicallyBased;

# now we have an instance of a type that has all the API you need to set the PBR
# properties. For simple glass we set color to white, opacity to 0 and opacity
# IOR to 1.52
pbr.Opacity = 1.0
pbr.OpacityIOR = 1.52
pbr.BaseColor = Rhino.Display.Color4f.Black

print(dir(pbr))
print(pbr.SetTexture.__doc__)
print(dir(Rhino.DocObjects.TextureType))
#PBR_Alpha
#pbr.SetTexture(simtex.Texture(), Rhino.DocObjects.TextureType.PBR_BaseColor)
pbr.SetTexture(simtex.Texture(), Rhino.DocObjects.TextureType.PBR_Alpha)

# convert it back to RenderMaterial
new_pbr = Rhino.Render.RenderMaterial.FromMaterial(pbr.Material, sc.doc)
# Set a good name
new_pbr.Name = str(int(x))

# Add it to the document
sc.doc.RenderMaterials.Add(new_pbr)

sc.doc = ghdoc
# ---------- end ipy2_2 ----------
cache_2 = ContentCache(Content=object_2.Object, Action=int_6)
object_material_2 = RenderMaterial(Source=1, Material=materials_2)  # -> ObjectMaterial, Source, Material
render_2 = RenderAttributes(ObjectMaterial=object_material_2.ObjectMaterial)  # -> graft(Render), ObjectMaterial, CastsShadows, ReceivesShadows
object_3 = ModelObject(Geometry=move_5.Geometry, Render=simplify(render_2.Render))  # -> flatten(Object), Geometry, Name, Layer, Visibility, Display, Drafting
graft_2 = GraftTree(Tree=object_3.Object, IncludeEmptyLists=True, IncludeNullItems=True)
item_11 = ListItem(List=flatten(object_3.Object), Index=1, Wrap=True)
cache_3 = ContentCache(Content=object_3.Object, Action=int_5)
panel_2 = Panel(item_3)
