# Grasshopper definition sampler.gh (Grasshopper 1.0.8)
# plug-ins: RhinoCodePluginGH, Human, Redback-Beta.GH, Python

dpipeline = DynamicGeometryPipeline(
    LayerFilter="Sample Lines",
    TypeFilter="Curve",
    NameFilter="*",
    GroupByLayer=False,
    GroupByType=False,
    IncludeHidden=True,
    IncludeLocked=True,
    enableFullPath=False,
    listenToAttributes=True)
crv = Curve(dpipeline)
number_slider = Slider(0.5, range=0..10)
hframe = HorizontalFrame(Curve=reparameterize(crv), Parameter=0)
number_slider_2 = Slider(3.5, range=0..10)
len = Length(Curve=crv)
expression = Expression(x=len, y=number_slider, Expression="x+y")
expression_2 = Expression(x=number_slider, Expression="-x")
dom = ConstructDomain(DomainStart=expr("-x/2", number_slider_2), DomainEnd=expr("x/2", number_slider_2))
dom_2 = ConstructDomain(DomainStart=expression_2, DomainEnd=expression)
dedomain = DeconstructDomain(Domain=dom)  # -> Start, End
dedomain_2 = DeconstructDomain(Domain=dom_2)  # -> Start, End
planesrf = PlaneSurface(Plane=hframe, XSize=dom_2, YSize=dom)
panel = Panel("X:\93_Development\PackageManager\redback\graphicSamples\20250403153905218_0001.png")
expression_3 = Expression(x=dedomain.Start, y=dedomain.End, Expression="y-x")
expression_4 = Expression(x=dedomain_2.Start, y=dedomain_2.End, Expression="y-x")
srf = Surface(<surface referenced from the Rhino model>)
evalsrf = EvaluateSurface(Surface=reparameterize(planesrf), Point=Point(0.5, 0.5, 0))  # -> Point, Normal, UDirection, VDirection, Frame
bbox = BoundingBox(Content=srf, Plane=PlaneXY(0, 0, 0))  # -> Box, Box_2
expression_5 = Expression(x=expression_4, y=expression_3, Expression="Format(\"{0},{1}\", ceiling(x), ceiling(y))")
debox = DeconstructBox(Box=bbox.Box)  # -> Plane, X, Y, Z
rectangle = Rectangle(Plane=debox.Plane, XSize=debox.X, YSize=debox.Y, Radius=0)  # -> Rectangle, Length
image_objet = IronPython2Script(RE=rectangle.Rectangle, IP=panel)  # -> IO
# ---------- image_objet: IronPython ----------
#### Constants ####
global __var__
__var__ = {
	"guid":"53cc467c-f4e5-4782-ac66-a8ce3084f988",
	
	"name":"Image Object",
	"nickname":"Image Object",
	"description":"Creates an image object that can be parsed by archJSON",
	"icon": "ghContent\\Icon-ImageObject.png",

	"tabname":"Redback",
	"section":"ArchJSON",

	"inputs":[
		{"name":"Rectangle",		"nickname":"R",	"objectAccess":"item",	"description":"", },
		{"name":"Image",			"nickname":"I",	"objectAccess":"item",	"description":"", },
	],
	"outputs":[
		{"name":"Image Object",		"nickname":"O",	"description":"archJSON Text Object"},
	]
}
__author__ = "Andrew.Butler"
__version__ = "2024.02.02"

R = RE
I = IP

import rhinoscriptsyntax as rs
import Rhino as r
import os



class archJSONImage:
    def __init__(self, rec, img):
        p = rs.CurvePoints(rec)
        self.location = rs.PlaneFromPoints(p[0],p[1],p[2])
        self.bounds = rs.BoundingBox(rec,self.location,False)
        self.width = self.bounds[2][0]
        self.height = self.bounds[2][1]
        self.img = str(img)
        self.fileDirectory, self.fileName = os.path.split(self.img)
    def __str__(self):
        return "<ArchJSON Image>: %s"%(self.fileName)

IO = archJSONImage(R,I)
# ---------- end image_objet ----------
int = Integer(len)
py3 = Python3Script(x=int)  # -> out, a
# ---------- py3: Python ----------
a = "%03d"%(x)
# ---------- end py3 ----------
svg_layout = SVGLayout(Plane=evalsrf.Frame, Dimensions=expression_5, Scale="1:1", Location=Toggle(True))  # -> graft(L), R
geo2arch = IronPython2Script(GE=image_objet, PR="{}")  # -> JO; inputs GE: list, PR: list of String
# ---------- geo2arch: IronPython ----------
#### Constants ####
global __var__
__var__ = {
	"guid":"d276cba6-c7bd-4860-8d09-1c6b23a620d4",
	
	"name":"Geo2Ar",
	"nickname":"Wrapper",
	"description":"Wraps and joins text with selected data characters",
	"icon": "ghContent\\Icon-Geo2ArchiJSON.png",

	"tabname":"Redback",
	"section":"ArchJSON",

	"inputs":[
		{"name":"Geometry",			"nickname":"G",	"objectAccess":"list", "objectType":"GenericObject"	,"description":"List of Geometry to convert", },
		{"name":"Properties",		"nickname":"P",	"objectAccess":"list", "objectType":"String"		,"description":"List of Properties per geometry", },
	],
	"outputs":[
		{"name":"JSON",	"nickname":"J",	"description":"ArchiJSON representing the geometry"},
		#{"name":"CHECKGEOM", "nickname":"CHECKGEOM", "description":"ArchiJSON representing the geometry"},
		#{"name":"LOG", "nickname":"LOG", "description":"ArchiJSON representing the geometry"}
	]
}
__author__ = "Andrew.Butler"
__version__ = "2024.02.02"
import rhinoscriptsyntax as rs
import Rhino as rh
import scriptcontext as sc
import Grasshopper as g
import ghpythonlib as ghp
import json
#LOG = []
CHECKGEOM = []
#document = sc.doc
#sc.doc = rh.RhinoDoc.ActiveDoc
#sc.doc = ghdoc


def Point(geom,prop=None):
	pt = rs.coerce3dpoint(geom)
	pt = [pt[0],pt[1],pt[2]]
	if prop:
		pt = {"type":"Feature","geometry":{'coordinates':pt, 'type': 'Point'}}
		pt['properties'] = json.loads(prop)
		return pt
	else:
		return pt
def convertToRPT (geom):
	pt = rh.Geometry.Point3d(geom[0],geom[1],geom[2])
	return pt
def PointCollection(geom,prop=None):
	t = geom
	pts = map(lambda g: Point(g), t)
	crv = {"type":"Feature","geometry":{'coordinates':pts, 'type': 'PointCollection'}}
	if prop:
		crv['properties'] = json.loads(prop)
	#print(crv)
	return crv
	
def CurveCollection(geom,prop=None):
	t = geom
	#print('geom', geom)
	crvs = map(lambda g: Curve(g), t)
	#print("CURVE COLLECTION--- ", crvs)
	crvCol = {"type":"Feature","geometry":{'coordinates':crvs, 'type': 'CurveCollection'}}
	if prop:
		crvCol['properties'] = json.loads(prop)
	return crvCol
	
#    t = rs.CurvePoints(crvs)
#    tc = rs.ClosedCurveOrientation(crvs)
#    if tc == 0: tc = False
#    else: tc = True
#    tdeg = rs.CurveDegree(crvs)
#    tcPo = len(t)
#    #print("tdeg: ",tdeg)
#    #print("tcPo: ",tcPo)
#    pts = map(lambda g: Point(g), t)
#    crv = {"type":"Feature","geometry":{'coordinates':pts, 'type': 'CurveCollection','closed':tc}}
#    if tdeg == 1 and tc: del crv['geometry']['coordinates'][-1]
#    if tdeg == 1 and tcPo == 2  : crv['geometry']['type']='Line'
#    if tdeg >= 2                : crv['geometry']['type']='Spline'
#    if tdeg == 2 and tcPo == 3  :
#        #print("3ARC")
#        crv['geometry']['type']='Arc'
#    if tdeg == 2 and tcPo == 5  :
#        #print("5ARC")
#        arc = rs.AddArc3Pt(pts[0],pts[4],pts[2])
#        pt0 = convertToRPT(pts[0])
#        pt2 = convertToRPT(pts[2])
#        pt4 = convertToRPT(pts[4])
#        arc = rh.Geometry.Arc(startPoint = pt0, pointOnInterior = pt2, endPoint = pt4)
#        crv['geometry']['type']='Arc'
#        #print(crv['geometry']['coordinates'])
#        del crv['geometry']['coordinates'][3]
#        del crv['geometry']['coordinates'][1]
#    if prop:
#        crv['properties'] = json.loads(prop)
#    #print(crvcollection)
#    return crvcollection

def Plane(geom,prop=None):
	pln = {"type":"Feature","geometry":{'coordinates':[geom.XAxis.X,geom.YAxis.X,geom.ZAxis.X,geom.OriginX,geom.XAxis.Y,geom.YAxis.Y,geom.ZAxis.Y,geom.OriginY,geom.XAxis.Z,geom.YAxis.Z,geom.ZAxis.Z,geom.OriginZ,0,0,0,1], 'type': 'Xform'}}
	if prop:
		pln['properties'] = json.loads(prop)
	return pln
def Text(geom,prop=None):
	#print("TEXT")
	text = Plane(geom.location,prop)
	text['geometry']['type']="Text"
	text['geometry']['content']=geom.content
	return text
def Image(geom,prop=None):
	#print("Image")
	##print(dir(geom))
	image = Plane(geom.location,prop)
	image['geometry']['type']="Image"
	image['geometry']['image']=geom.img
	image['geometry']['width']=geom.width
	image['geometry']['height']=geom.height
	return image
def Curve(geom,prop=None):
	#print("Curve def")
	#print(geom, type(geom))
	if type(geom).__name__ == "Line":
		geom = ghp.components.RebuildCurve(geom,1,3,False)
	if type(geom).__name__ == "Circle":
		geom = geom.ToNurbsCurve()
	try:
		t = rs.CurvePoints(geom)
	except:
		t = []
	
	#print(t)
	#check if curve closed
	tc = rs.ClosedCurveOrientation(geom)
	if tc == 0: tc = False
	else: tc = True
	##print(dir(geom))
	#split = rs.ExplodeCurves(geom, True)
	##print(rs.CurveDegree(geom))
	#split = ghp.components.Explode(,True)
	##print("Split",split)
	tdeg = rs.CurveDegree(geom)
	tcPo = len(t)
	isArc = rs.IsArc(geom)
	isCirc = rs.IsCircle(geom)
	
	##print("isCirc: ",isCirc)
	pts = map(lambda g: Point(g), t) #object to points
	#print(pts)
	crv = {"type":"Feature","geometry":{'coordinates':pts, 'type': 'Spline','closed':tc, "deg":tdeg}}
	#print("tdeg: "+str(tdeg))
	#print("tcPo: "+str(tcPo))
	#print(crv)
	#print("isArc",isArc)
	#print("----------------------------------")
	if tdeg == 1 and tc  : del crv['geometry']['coordinates'][-1]
	if tdeg == 1 and tcPo == 2  : crv['geometry']['type']='Line'
	if tdeg >= 2                : crv['geometry']['type']='Spline'
	if tdeg == 2 and tcPo == 3  :
		#print("3ARC")
		crv['geometry']['deg']=tdeg
		# crv['geometry']['type']='Arc'
	#if tdeg == 2 and tcPo == 5  :
		#arc = rs.AddArc3Pt(pts[0],pts[4],pts[2])
		#pt0 = convertToRPT(pts[0])
		#pt2 = convertToRPT(pts[2])
		#pt4 = convertToRPT(pts[4])
		#arc = rh.Geometry.Arc(startPoint = pt0, pointOnInterior = pt2, endPoint = pt4)
		
		##print(crv['geometry']['coordinates'])
		#del crv['geometry']['coordinates'][3]
		#del crv['geometry']['coordinates'][1]
	if isArc:
		cpt = rs.ArcCenterPoint(geom)
		testCrvPts = rs.CurvePoints(geom)
		testCrvPts.append(testCrvPts[0])
		testCrv = rs.AddPolyline(testCrvPts)
		try:    isBig = bool(rs.PointInPlanarClosedCurve(cpt, testCrv))
		except: isBig = False
		cpt = Point(cpt)
		crd = rs.ArcRadius(geom)
		cang = rs.ArcAngle(geom)
		##print("cang",cang)
		crv['geometry']['type']='Arc'
		crv['geometry']['radius'] = crd
		crv['geometry']['isBig'] = isBig
		crv['geometry']['center'] = cpt
		crv['geometry']['angle'] = cang
	if isCirc:
		cpt = Point(rs.CircleCenterPoint(geom))
		crd = rs.CircleRadius(geom)
		crv['geometry']['type']='Circle'
		crv['geometry']['coordinates'] = cpt
		crv['geometry']['radius'] = crd
	if prop:
		crv['properties'] = json.loads(prop)
	#if not isArc and crv["geometry"]['type'] == "Arc":
		#crv['geometry']['type']='Spline'
#    if tdeg >= 2:
	#print (crv)
	return crv
def PolyCurve(geom, prop=None):
	##print(geom)
	
	#print("PolyCurve def")
	#print(geom, type(geom))
	if str(type(geom)) != "<type 'List[object]'>":
		geom = [geom]
	polyCurveParts = []
	#for d in dir(geom):
	#    #print(d)

	for part in geom:
		#print(part)
		tc = rs.ClosedCurveOrientation(part)
		part = part.Explode()
		curves = list(map(lambda x: Curve(x, {})["geometry"], part))
		polycrvPart = {"type":"Feature","geometry":{'coordinates':curves, 'type': 'PolyCurvePart','closed':tc}}
		polyCurveParts.append(polycrvPart)
	polycrv = {"type":"Feature","geometry":{'coordinates':polyCurveParts, 'type': 'PolyCurve'}}
	if prop:
		polycrv['properties'] = json.loads(prop)
	return polycrv

	return crvCol
otype = {
		"PolyCurve": Curve,
		"Line": Curve,
		"LineCurve": Curve,
		"NurbsCurve": Curve,
		"ArcCurve": Curve,
		"Circle": Curve,
		"PolylineCurve": Curve,
		"0": "Unknown object",
		"1": Point,
		"2": "PointCloud",
		"3": PointCollection,
		"4": Curve,
		"5": Plane,
		"6": Text,
		"7": CurveCollection,
		"8": "Surface",
		"9": Image,
		"16": "Polysurface",
		"32": "Mesh",
		"256": "Light",
		"512": "Annotation",
		"4096": "Instance reference",
		"8192": "Text dot",
		"16384": "Grip",
		"32768": "Detail",
		"65536": "Hatch",
		"131072": "Morph control",
		"134217728": "Cage",
		"268435456": "Phantom",
		"536870912": "Clipping plane",
		"1073741824": "Extrusion"}
def Convert(geom,prop):
	#print("START CONVERT")
	#print("SC",geom, type(geom))
	ot = otype["1"]
	try:
		#print(type(geom))
		#print("-"*100)
		ot = otype[str(type(geom).__name__)]
		try:
			if ot.__name__ == "Curve":
				try:
					ngeom = rs.coercegeometry(geom)
					ngeom = ghp.components.Explode(geom, True)
					ngeom = ghp.components.JoinCurves(geom["segments"],True)
					geom = ngeom
				except Exception as e:
					pass
				#print("after explode",geom)
				othertype = str(type(geom))
				##print("othertype", othertype)
				if othertype == "<type 'PolyCurve'>":
					ot = PolyCurve
					##print("POLYCURVE")
				if othertype == "<type 'Line'>":
					ot = Curve
		except Exception as e:
			#print("e",e)
			pass
		
		
	except Exception as e:
		#print("1:", e)
		#ot = otype[type(geom)]
		othertype = str(type(geom))
		print("othertype" ,othertype)
		if othertype == "<type 'List[object]'>":
			"object is in a List"
			innertype = str(type(geom[0]))
			#print("innertype",innertype,)
			#if innertype=="<type 'PolylineCurve'>":
				##print("PCrv")
				#ot = otype["7"]
			#if innertype=="<type 'PolyCurve'>":
				##print("PolyCrv")
				#ot = PolyCurve
			if "Curve" in innertype:
				#print("PCrv")
				ot = otype["7"]
			if innertype=="<type 'Point3d'>":
				#print("PT3D")
				ot = otype["3"]
		if othertype == "<type 'Plane'>":
			ot = otype["5"]
		othertype = str(geom.__class__.__name__)
		#print("othertype" ,othertype)
		if othertype == "archJSONText":
			ot = otype["6"]
		if othertype == "archJSONImage":
			ot = otype["9"]
		if othertype == "<type 'instance'>":
			if geom.type == "text":
				ot = otype["6"]
			if geom.type == "image":
				ot = otype["9"]
	#print("OBJECT TYPE ---- ", ot)
	#print("GEOM ---- ", geom,type(geom))
	return(ot(geom,prop)
		)

if not PR:
    PR = ["{}"]
fillP = ["{}"]*len(GE)
for i, prop in enumerate(PR):
	fillP[i] = prop


PR = list(PR)
fullProps = [PR[-1]]*len(GE)

for i in range(len(PR)):
    fullProps[i] = PR[i]

features = list(map(lambda g,p: Convert(g,p), GE,fullProps))

	
JO = json.dumps({"type":"FeatureCollection", "features":features})

#class dictionaryObject(dict):
	#pass
	#def __str__(self):
		#return "<d>"

#dictTest = dictionaryObject({"hello":"world"})

#print(dir(dictTest))
#print(dictTest.__str__)

#DO = dictTest
# ---------- end geo2arch ----------
cset = CreateSet(List=py3.a)  # -> Set, Map
mindex = MemberIndex(Set=py3.a, Member=cset.Set)  # -> Index, Count
svg = SVGGenerator(JO=geo2arch, LA=svg_layout.L)
tstat = TreeStatistics(Tree=svg)  # -> Paths, Length, Count
lng = ListLength(List=tstat.Paths)
series = Series(Start=0, Step=1, Count=lng)
lng_2 = ListLength(List=mindex.Index)
series_2 = Series(Start=0, Step=1, Count=lng_2)
py3_2 = Python3Script(x=series_2)  # -> out, a; same code as py3
unflatten = UnflattenTree(Tree=mindex.Index, Guide=int)
unflatten_2 = UnflattenTree(Tree=py3_2.a, Guide=int)
sort = SortList(Keys=unflatten, ValuesA=unflatten_2)  # -> Keys, ValuesA
expression_6 = Expression(x="Artline210_Medium_0.6_Freehand", y=py3.a, z=sort.ValuesA, Expression="Format(\"{0}_{1}_{2}\", x, y,z)")
rep = ReplaceText(Text="Artline210_Medium_0.6_Freehand\#.svg", Find="#", Replace=expression_6, RecursiveReplace=False)  # -> simplify(graft(Result))
rel_path = RelativePath(R=rep)  # -> FullPath, DirectoryPath, FileName
write = WriteFile(R=Toggle(True), C=svg, P=rel_path.DirectoryPath, N=rel_path.FileName)
item = ListItem(List=flatten(write), Index=0, Wrap=True)
panel_2 = Panel(item)
panel_3 = Panel(expression_6)
