# Grasshopper definition Install Redback.gh (Grasshopper 1.0.8)
# plug-ins: RhinoCodePluginGH

ipy2 = IronPython2Script(RUN=Toggle(False))  # -> LOG, RAN
# ---------- ipy2: IronPython ----------
import Rhino as rh
import rhinoscriptsyntax as rs
import time
RAN = False
if RUN:
    settings = rh.PlugIns.PlugIn.GetPluginSettings(rh.RhinoApp.CurrentRhinoId, False)

    s = settings.GetChild("Options").GetChild("PackageManager")
    #sourceString = s.GetString("Sources")
    sourceString = ""
    #sources = ["https://yak.rhino3d.com"]
    
    sources = [s.GetString("Sources")]
    sources = sources+[r"\\sydsrv01\Projects\Computational Design Group\93_Development\PackageManager", r"\\sydsrv01\Projects\Computational Design Group\93_Development\PackageManager\redback\rh8Project\build\rh8"]

    for sr in sources:
        if sr not in sourceString:
            if sourceString == "":
                sourceString = sr
            else:
                sourceString = sourceString+";"+ sr
            print(sourceString)
    s.SetString("Sources", sourceString)
    RAN = True
# ---------- end ipy2 ----------
dam = DataDam(DataA=ipy2.RAN, BufferDelay=20000000, BufferMode=2)
ipy2_2 = IronPython2Script(RUN=dam)  # -> LOG, RAN
# ---------- ipy2_2: IronPython ----------
import Rhino as rh
import rhinoscriptsyntax as rs
import time
RAN = False
if RUN:
    rs.Command("-PackageManager S Redback")
    RAN = True
# ---------- end ipy2_2 ----------
