# Grasshopper definition install.gh (Grasshopper 1.0.7)

python = GhPythonScript()  # -> LOG
# ---------- python: Python ----------
from ghpythonlib.componentbase import executingcomponent as component
import Grasshopper, GhPython
import System
import Rhino


class MyComponent(component):
    
    def RunScript(self, RUN):
        """Provides a scripting component.
            Inputs:
                x: The x script variable
                y: The y script variable
            Output:
                a: The a output variable"""
        
        __author__ = "Andrew.Butler"
        __version__ = "2024.02.05"
        import urllib

        url = "https://codeload.github.com/sephbin/redback/zip/refs/tags/v0.0.2"
        
        ziploc = r'C:\Users\Andrew.Butler\AppData\Roaming\Redback\package.zip'
        urllib.urlretrieve(url, ziploc )
        
        import zipfile
        import os
        import shutil
        with zipfile.ZipFile(ziploc, 'r') as zip_ref:
            zip_ref.extractall(ziploc.replace("\package.zip",""))
        shutil.rmtree(r"C:\Users\Andrew.Butler\AppData\Roaming\Redback\src")
        os.rename(r"C:\Users\Andrew.Butler\AppData\Roaming\Redback\redback-0.0.2", r"C:\Users\Andrew.Butler\AppData\Roaming\Redback\src")
        LOG = []
        
        shutil.rmtree(r"C:\Users\Andrew.Butler\AppData\Roaming\Grasshopper\Libraries\Redback")
        os.mkdir(r"C:\Users\Andrew.Butler\AppData\Roaming\Grasshopper\Libraries\Redback")
        for root, dirs, files in os.walk(r"C:\Users\Andrew.Butler\AppData\Roaming\Redback\src"):
            for file in files:
                if file.endswith(".ghpy"):
                    os.rename(os.path.join(root,file),os.path.join(r"C:\Users\Andrew.Butler\AppData\Roaming\Grasshopper\Libraries\Redback",file))
        # return outputs if you have them; here I try it for you:
        LOG.append("Restart Rhino")
        return LOG
# ---------- end python ----------
panel = Panel(python)
