# Grasshopper definition 210916_PlanPeoplePopulating.gh (Grasshopper 1.0.7)
# plug-ins: Human, Pufferfish

panel = Panel("""Curve
Point""")
# Getting Geometry
panel_2 = Panel("People")
dpipeline = DynamicGeometryPipeline(
    LayerFilter=panel_2,
    TypeFilter=panel,
    NameFilter="*",
    GroupByLayer=False,
    GroupByType=False,
    IncludeHidden=True,
    IncludeLocked=True,
    enableFullPath=True,
    listenToAttriubtes=True)
crv = Curve(dpipeline)
# Points Vs Curves
null = NullItem(Item=crv)  # -> NullFlags, InvalidFlags, Description
bool = Boolean(invert(null.NullFlags))
dispatch = Dispatch(List=dpipeline, DispatchPattern=bool)  # -> ListA, ListB
crv_2 = Curve(dispatch.ListA)
pt = Point(dispatch.ListB)
# Closed VS Open Curves
curves = Curve(crv_2)
area = Area(Geometry=curves)  # -> Area, Centroid
null_2 = NullItem(Item=area.Area)  # -> NullFlags, InvalidFlags, Description
dispatch_2 = Dispatch(List=curves, DispatchPattern=null_2.NullFlags)  # -> ListA, ListB
closed_curve = Curve(dispatch_2.ListB)
open_curve = Curve(graft(dispatch_2.ListA))
clumpmaker = ClumpMaker(crv=closed_curve, size_of_clumps=Slider(50, range=0..1000))
spread = Spread(A=closed_curve)
spread_2 = Spread_2(A=open_curve)
clumps = Curve(simplify(clumpmaker))
spread_3 = Boolean(simplify(spread))
len = Length(Curve=open_curve)
spread_4 = Number(spread_2)
dispatch_3 = Dispatch(List=clumps, DispatchPattern=spread_3)  # -> ListA, ListB
panel_3 = Panel("""0
0.1
0.2
0.3
1""")
panel_4 = Panel("""0
0
100
0
0""")
# Open Curves
division = Division(A=len, B=spread_4)
# Closed Curves
wetakethese = Curve(dispatch_3.ListA)
notake = Curve(dispatch_3.ListB)
distrubutioncrv = DistrubutionCrv(t=panel_3, F=panel_4)  # -> crv_2, L
lng = ListLength(List=flatten(division))
random = Random(Range="100", Number=lng, Seed=2)  # -> simplify(graft(Random))
boundary = BoundarySurfaces(Edges=wetakethese)
pframe = PerpFrame(Curve=reparameterize(open_curve), Parameter="0.5")
random_2 = Random(Range=len, Number=division, Seed=random)
area_2 = Area(Geometry=boundary)  # -> Area, Centroid
distributioncrv = Curve(distrubutioncrv.crv_2)
baseline = Curve(distrubutioncrv.L)
deplane = DeconstructPlane(Plane=pframe)  # -> Origin, simplify(XAxis), simplify(YAxis), ZAxis
peopleoffsetfromline = Panel("0.2")
eval = EvaluateCurve(Curve=simplify(open_curve), Parameter=simplify(random_2))  # -> Point, Tangent, Angle
peopleclumpiness = PeopleClumpiness(data=area_2.Area, C=distributioncrv, crv=baseline, A=Slider(10, range=1.5..30), B=Slider(30, range=1.5..30))
_2waydom = TwoWayDomain(Extent=peopleoffsetfromline, Direction=True)
lng_2 = ListLength(List=eval.Point)
seed = Panel("33")
data = Data(peopleclumpiness)
random_3 = Random(Range=_2waydom, Number=lng_2, Seed=seed)
division_2 = Division(A=area_2.Area, B=data)
amp = Amplitude(Vector=simplify(deplane.YAxis), Amplitude=random_3)
popgeo = PopulateGeometry(Geometry=boundary, Count=division_2, Seed=1)
cullpt = CullDuplicates(Points=flatten(popgeo), Tolerance=0.1, CullMode=1)  # -> Points, Indices, Valence
move = Move(Geometry=eval.Point, Motion=amp)  # -> Geometry, Transform
# Merge All People
points = Point(pt)
panel_5 = Panel("""Points
Lines
Curves""")
entwine = Entwine(Branch00=flatten(points), Branch01=flatten(move.Geometry), Branch02=flatten(cullpt.Points), FlattenInputs=True)  # -> simplify(Result)
group = Group(Objects=entwine)  # -> flatten(Group)
merge = Merge(Data1=Toggle(False), Data2=Toggle(False), Data3=Toggle(True))  # -> flatten(Result)
dispatch_4 = Dispatch(List=group, DispatchPattern=merge)  # -> ListA, ListB
ungroup = Ungroup(Group=dispatch_4.ListA)
dpipeline_2 = DynamicGeometryPipeline(
    LayerFilter="Context",
    TypeFilter="Curve",
    NameFilter="*",
    GroupByLayer=False,
    GroupByType=False,
    IncludeHidden=True,
    IncludeLocked=True,
    enableFullPath=True,
    listenToAttriubtes=True)
# People No Go Zones
pt_2 = Point(ungroup)
incurves = PointInCurves(Point=pt_2, Curves=dpipeline_2)  # -> Relationship, Index, Point
equals = Equality(FirstNumber=incurves.Relationship, SecondNumber=2)  # -> Equality, Inequality
dispatch_5 = Dispatch(List=pt_2, DispatchPattern=equals.Equality)  # -> ListA, ListB
pt_3 = Point(dispatch_5.ListB)
group_2 = Group(Objects=pt_3)
weave = Weave(Pattern=merge, Stream0=dispatch_4.ListB, Stream1=group_2, NullGaps=False)  # -> graft(Weave)
ungroup_2 = Ungroup(Group=weave)  # -> simplify(Objects)
cullpt_2 = CullDuplicates(Points=flatten(ungroup_2), Tolerance=0.1, CullMode=1)  # -> Points, Indices, Valence
# People Size
smallestpeorson = Panel("2")
largestperson = Panel("3")
lng_3 = ListLength(List=cullpt_2.Points)
dom = ConstructDomain(DomainStart=smallestpeorson, DomainEnd=largestperson)
random_4 = Random(Range=dom, Number=lng_3, Seed=2)
cir = Circle(Plane=cullpt_2.Points, Radius=random_4)
people = Circle(cir)
# Points Of Intrest
dpipeline_3 = DynamicGeometryPipeline(
    LayerFilter="PointsOfIntrest",
    TypeFilter="Point",
    NameFilter="*",
    GroupByLayer=False,
    GroupByType=False,
    IncludeHidden=True,
    IncludeLocked=True,
    enableFullPath=False,
    listenToAttriubtes=True)
people_2 = Data(people)
lookatme = LookAtMe(pt=dpipeline_3, people=people_2)  # -> num_3, crv_3
crv_3 = Curve(flatten(lookatme.crv_3))
num = Number(flatten(lookatme.num_3))
# SVG Output Location
file_path = Panel("\\sydsrv01\projects\Computational Design Group\03_Resources\Rendering\People\SVGs")
# PNG People / Shadows Location
panel_6 = Panel("K:\Computational Design Group\03_Resources\Rendering\People\PersonLibrary128x128px\`\Person_`.png")
panel_7 = Panel("K:\Computational Design Group\03_Resources\Rendering\People\PersonLibrary128x128px\`\Person_`_Shadow_~.png")
division_3 = Division(A=num, B="10")
# Page Properties
panel_8 = Panel("Page")
subtraction = Subtraction(A="36", B=division_3)
dpipeline_4 = DynamicGeometryPipeline(
    LayerFilter=panel_8,
    TypeFilter="Point",
    NameFilter="*",
    GroupByLayer=False,
    GroupByType=False,
    IncludeHidden=True,
    IncludeLocked=True,
    enableFullPath=True,
    listenToAttriubtes=True)
# Shadow Direction
shadowangle = ControlKnob(Decimals=2, Limit=True, Maximum=360, Minimum=0, Range=360, Value=272.97)
# Write SVG
toggle = BooleanToggle(False)
paper = Panel("A1 (P)")
drawing_scale = Panel("200")
top_left_corner_point = Point(dpipeline_4)
bbox = BoundingBox(Content=flatten(crv_3), Plane=PlaneXY(0, 0, 0))  # -> Box, Box_2
box = EvaluateBox(Box=bbox.Box, UParameter=0.5, VParameter=0.5, WParameter=0.5)  # -> Plane, Point, Include
debox = DeconstructBox(Box=bbox.Box)  # -> Plane, X, Y, Z
dedomain = DeconstructDomain(Domain=debox.X)  # -> Start, End
series = Series(Start=0, Step="10", Count="36")
expression = Expression(x=dedomain.Start, y=dedomain.End, Expression="y-x")
int = Integer(series)
expression_2 = Expression(x=int, Expression="Format(\"000{0}\", x)")
circle = CircleCNR(Center=box.Point, Normal=Vector(0, 0, 1), Radius=expr("x/2", expression))
int_2 = Integer(subtraction)
chars = Characters(Text=expression_2)  # -> reverse(Result), Unicode
# Person and Shadow Picking
expression_3 = Expression(x=int_2, Expression="x*10")
darc = DeconstructArc(Arc=circle)  # -> BasePlane, Radius, Angle
item = ListItem(List=chars.Result, Index=[0, 1, 2, 3], Wrap=True)  # -> reverse(Item)
dom_2 = ConstructDomain(DomainStart="1", DomainEnd="27")
lng_4 = ListLength(List=crv_3)
# PNG Frames
pt_4 = Point(darc.BasePlane)
seed_2 = Panel("20")
expression_4 = Expression(x=shadowangle, y=expression_3, Expression="((360-x)-y)/10")
join = TextJoin(Text=item)  # -> flatten(Result)
random_5 = Random(Range=dom_2, Number=lng_4, Seed=seed_2)
circle_2 = CircleCNR(Center=pt_4, Normal=Vector(0, 0, 1), Radius=darc.Radius)
round = Round(Number=random_5)  # -> Nearest, Floor, Ceiling
rep = ReplaceText(Text=panel_6, Find="~", Replace=join, RecursiveReplace=False)  # -> flatten(Result)
bbox_2 = BoundingBox(Content=circle_2, Plane=PlaneXY(0, 0, 0))  # -> Box, Box_2
int_3 = Integer(join)
debox_2 = DeconstructBox(Box=bbox_2.Box)  # -> Plane, X, Y, Z
item_2 = ListItem(List=rep, Index=expression_4, Wrap=True)
expression_5 = Expression(x=int_3, Expression="(x/10)+1")
long = LongestList(ListA=item_2, ListB=round.Nearest, PaddingMode=4)  # -> ListA, ListB
rectangle = Rectangle(Plane=debox_2.Plane, XSize=debox_2.X, YSize=debox_2.Y, Radius=0)  # -> Rectangle, Length
rep_2 = ReplaceText(Text=panel_7, Find="~", Replace=expression_5, RecursiveReplace=False)  # -> flatten(Result)
rep_3 = ReplaceText(Text=long.ListA, Find="`", Replace=long.ListB, RecursiveReplace=False)  # -> flatten(Result)
area_3 = Area(Geometry=rectangle.Rectangle)  # -> Area, Centroid
tree_scale_factor = Slider(1.5, range=1..5)
item_3 = ListItem(List=rep_2, Index=expression_4, Wrap=True)
rotate = Rotate(Geometry=rectangle.Rectangle, Angle=degrees(expression_3), Plane=area_3.Centroid)  # -> Geometry, Transform
long_2 = LongestList(ListA=item_3, ListB=round.Nearest, PaddingMode=4)  # -> ListA, ListB
scale = Scale(Geometry=rotate.Geometry, Center=area_3.Centroid, Factor=tree_scale_factor)  # -> Geometry, Transform
rep_4 = ReplaceText(Text=long_2.ListA, Find="`", Replace=long_2.ListB, RecursiveReplace=False)  # -> flatten(Result)
xy = XYPlane(Origin=top_left_corner_point)
svg_plane_by_page = RDB_SVGPlaneByPage(plane=xy, page_size=paper, scale=drawing_scale, position=Toggle(False))  # -> json_layout, preview
# Writing SVG
crv_4 = Curve(svg_plane_by_page.preview)
image = IMAGE(rec=scale.Geometry, img=rep_4)  # -> flatten(O)
image_2 = IMAGE(rec=scale.Geometry, img=rep_3)  # -> flatten(O)
toggle_2 = BooleanToggle(False)
geo2archijson = Geo2ArchiJSON(G=image, output_type=toggle_2)
geo2archijson_2 = Geo2ArchiJSON(G=image_2, output_type=toggle_2)
draw = DrawSVG(objects=geo2archijson_2, layout=svg_plane_by_page.json_layout)  # -> simplify(svg)
draw_2 = DrawSVG(objects=geo2archijson, layout=svg_plane_by_page.json_layout)  # -> simplify(svg)
write_file = WRITEFILE(content=draw_2, filepath=file_path, filename="Shadows.svg", activate=toggle)
write_file_2 = WRITEFILE(content=draw, filepath=file_path, filename="People.svg", activate=toggle)

# ==== cluster ClumpMaker
size_of_clumps = ClusterInput()  # Size of Clumps
crv = ClusterInput()
crv_2 = Curve(crv)
boundary = BoundarySurfaces(Edges=graft(crv_2))
area = Area(Geometry=boundary)  # -> Area, Centroid
division = Division(A=area.Area, B=size_of_clumps)
popgeo = PopulateGeometry(Geometry=boundary, Count=division, Seed=1)
voronoi = Voronoi(Points=flatten(popgeo), BruteForceOverride=False)
trim = TrimWithRegions(Curve=flatten(voronoi), Regions=graft(crv_2))  # -> Inside, Outside
crv_3 = Curve(trim.Inside)
explode = Explode(Curve=crv_3, Recursive=True)  # -> Segments, Vertices
pline = PolyLine(Vertices=explode.Vertices, Closed=invert(False))
cls = Closed(Curve=pline)  # -> Closed, Periodic
dispatch = Dispatch(List=pline, DispatchPattern=cls.Closed)  # -> ListA, ListB
crv_4 = Curve(simplify(dispatch.ListA))
shift = ShiftPaths(Data=crv_4, Offset=-1)
D = ClusterOutput(shift)

# ==== cluster IMAGE: Creates a Redback image object
rec = ClusterInput()
img = ClusterInput()
python = GhPythonScript(REC=rec, IMG=img)  # -> O
# ---------- python: Python ----------
__author__ = "s-abutler"
__version__ = "2018.09.10"

import rhinoscriptsyntax as rs
import Rhino as r




class image:
    def __init__(self, rec, img):
        p = rs.CurvePoints(rec)
        self.location = rs.PlaneFromPoints(p[0],p[1],p[2])
        self.bounds = rs.BoundingBox(rec,self.location,False)
        self.width = self.bounds[2][0]
        self.height = self.bounds[2][1]
        self.img = str(img)
        self.type = "image"

O = image(REC,IMG)
# ---------- end python ----------
O = ClusterOutput(python)

# ==== cluster WRITEFILE: Writes files, also checks for python objects and converts them to text before writing.
activate = ClusterInput()
content = ClusterInput()
filename = ClusterInput()
filepath = ClusterInput()
python = GhPythonScript(CONTENT=content, FILEPATH=filepath, FILENAME=filename, ACTIVATE=activate)  # inputs CONTENT: list
# ---------- python: Python ----------
__author__ = "s-abutler"
__version__ = "2018.09.10"

import rhinoscriptsyntax as rs
from json import dumps
def check(o):
#    print(str(type(o)))
#    return o
    if str(type(o)) == "<type 'dict'>":
        return dumps(o)
    else:
        return o
if ACTIVATE:
    con = list(map(lambda u: check(u), CONTENT))
    conwrite = "\n".join(con)
    dir = FILEPATH+"\\"+FILENAME
    write = True
    try:
        check = open(dir,'r')
        checktext = check.read()
        check.close()
        write = checktext != conwrite
    except:
        write = True
    if write:
        with open(dir,'w') as f:
            f.write(conwrite)
            print("SAVED")
# ---------- end python ----------

# ==== cluster Geo2ArchiJSON: Converts Geometry to ArchiJSON. Version 18.09.10
G = ClusterInput()
output_type = ClusterInput()  # Output Type: 0 = PythonDictionary; 1=JSON String
properties = ClusterInput()  # Properties as a JSON to sync with Geometry. Use JSON Component to build properties. Need to include 'zindex'
int = Integer(output_type)
G_2 = Data(G)
long = LongestList(ListA=G_2, ListB=properties, PaddingMode=2)  # -> ListA, ListB
python = PythonScript(G=long.ListA, P=long.ListB, T=int)  # -> O; inputs G: list, P: list
# ---------- python: Python ----------
import rhinoscriptsyntax as rs
import Rhino as r
import Grasshopper as g
import json
log = []
def Point(geom,prop=None):
    pt = rs.coerce3dpoint(geom)
    pt = [pt[0],pt[1],pt[2]]
    if prop:
        pt = {"type":"Feature","geometry":{'coordinates':pt, 'type': 'point'}}
        pt['properties'] = json.loads(prop)
        return pt
    else:
        return pt
def convertToRPT (geom):
    pt = r.Geometry.Point3d(geom[0],geom[1],geom[2])
    return pt
def PointCollection(geom,prop=None):
    t = geom
    pts = map(lambda g: Point(g), t)
    crv = {"type":"Feature","geometry":{'coordinates':pts, 'type': 'pointcollection'}}
    if prop:
        crv['properties'] = json.loads(prop)
    print(crv)
    return crv
def CurveCollection(geom,prop=None):
    pass
    t = rs.CurvePoints(geom)
    tc = rs.ClosedCurveOrientation(geom)
    if tc == 0: tc = False
    else: tc = True
    tdeg = rs.CurveDegree(geom)
    tcPo = len(t)
    print("tdeg: "+str(tdeg))
    print("tcPo: "+str(tcPo))
    pts = map(lambda g: Point(g), t)
    crv = {"type":"Feature","geometry":{'coordinates':pts, 'type': 'CurveCollection','closed':tc}}
    if tdeg == 1 and tc  : del crv['geometry']['coordinates'][-1]
    if tdeg == 1 and tcPo == 2  : crv['geometry']['type']='line'
    if tdeg >= 2                : crv['geometry']['type']='spline'
    if tdeg == 2 and tcPo == 5  :
        arc = rs.AddArc3Pt(pts[0],pts[4],pts[2])
        pt0 = convertToRPT(pts[0])
        pt2 = convertToRPT(pts[2])
        pt4 = convertToRPT(pts[4])
        arc = r.Geometry.Arc(startPoint = pt0, pointOnInterior = pt2, endPoint = pt4)
        crv['geometry']['type']='arc'
        print(crv['geometry']['coordinates'])
        del crv['geometry']['coordinates'][3]
        del crv['geometry']['coordinates'][1]
    if prop:
        crv['properties'] = json.loads(prop)
    print(crvcollection)
    return crvcollection
def Plane(geom,prop=None):
    pln = {"type":"Feature","geometry":{'coordinates':[geom.XAxis.X,geom.YAxis.X,geom.ZAxis.X,geom.OriginX,geom.XAxis.Y,geom.YAxis.Y,geom.ZAxis.Y,geom.OriginY,geom.XAxis.Z,geom.YAxis.Z,geom.ZAxis.Z,geom.OriginZ,0,0,0,1], 'type': 'xform'}}
    if prop:
        pln['properties'] = json.loads(prop)
    return pln
def Text(geom,prop=None):
    print("TEXT")
    text = Plane(geom.location,prop)
    text['geometry']['type']="text"
    text['geometry']['content']=geom.content
    return text
def Image(geom,prop=None):
    print("Image")
    print(dir(geom))
    image = Plane(geom.location,prop)
    image['geometry']['type']="image"
    image['geometry']['image']=geom.img
    image['geometry']['width']=geom.width
    image['geometry']['height']=geom.height
    return image
def Curve(geom,prop=None):
    t = rs.CurvePoints(geom)
    tc = rs.ClosedCurveOrientation(geom)
    if tc == 0: tc = False
    else: tc = True
    tdeg = rs.CurveDegree(geom)
    tcPo = len(t)
    print("tdeg: "+str(tdeg))
    print("tcPo: "+str(tcPo))
    pts = map(lambda g: Point(g), t)
    crv = {"type":"Feature","geometry":{'coordinates':pts, 'type': 'polyline','closed':tc}}
    if tdeg == 1 and tc  : del crv['geometry']['coordinates'][-1]
    if tdeg == 1 and tcPo == 2  : crv['geometry']['type']='line'
    if tdeg >= 2                : crv['geometry']['type']='spline'
    if tdeg == 2 and tcPo == 5  :
        arc = rs.AddArc3Pt(pts[0],pts[4],pts[2])
        pt0 = convertToRPT(pts[0])
        pt2 = convertToRPT(pts[2])
        pt4 = convertToRPT(pts[4])
        arc = r.Geometry.Arc(startPoint = pt0, pointOnInterior = pt2, endPoint = pt4)
        crv['geometry']['type']='arc'
        print(crv['geometry']['coordinates'])
        del crv['geometry']['coordinates'][3]
        del crv['geometry']['coordinates'][1]
    if prop:
        crv['properties'] = json.loads(prop)
    print(crv)
    return crv
otype = {"0": "Unknown object", "1": Point, "2": "PointCloud", "3":PointCollection, "4": Curve, "5":Plane, "6":Text, "7":CurveCollection, "8":"Surface", "9":Image, "16": "Polysurface", "32": "Mesh", "256": "Light", "512": "Annotation", "4096": "Instance reference", "8192": "Text dot", "16384": "Grip", "32768": "Detail", "65536": "Hatch", "131072": "Morph control", "134217728": "Cage", "268435456": "Phantom", "536870912": "Clipping plane", "1073741824": "Extrusion"}
def Convert(geom,prop):
    print("START CONVERT")
    print(geom)
    ot = otype["1"]
    try:
        ot = otype[str(rs.ObjectType(geom))]
    except:
        #ot = otype[type(geom)]
        othertype = str(type(geom))
        print(othertype)
        if othertype == "<type 'List[object]'>":
            innertype = type(geom[0])
            if innertype=="<type 'PolylineCurve'>":
                ot = otype["7"]
            if innertype=="<type 'Point3d'>":
                ot = otype["3"]
        if othertype == "<type 'Plane'>":
            ot = otype["5"]
        if othertype == "<type 'instance'>":
            if geom.type == "text":
                ot = otype["6"]
            if geom.type == "image":
                ot = otype["9"]
    return(ot(geom,prop))
P = map(lambda g,p: Convert(g,p), G,P)
if T == 0:
    print(P)
    O = [{"type":"FeatureCollection", "features":P}]
if T == 1:
    O = json.dumps({"type":"FeatureCollection", "features":P})
L = log
# ---------- end python ----------
output = ClusterOutput(python)  # ArchiJSON Output

# ==== cluster DrawSVG: Creates SVG output from ArchiJSON objects. Version 18.09.10
objects = ClusterInput()  # ArchiJSON obects
css = ClusterInput()  # CSS Text
layout = ClusterInput()  # Layout Object
python = PythonScript(OBJECTS=objects, LAYOUT=layout, CSS=css)  # -> SVG; inputs OBJECTS: list, CSS: list
# ---------- python: Python ----------
import rhinoscriptsyntax as rs
import sys
import json
import inspect
import Rhino as r
from string import Template

log = []
#The inputs to this node will be stored as a list in the IN variables.
in1 = OBJECTS
def checkRB(ob):
    if str(type(ob)) == "<type 'str'>":
        return json.loads(ob)
    else:
        return ob
in1 = list(map(lambda u: checkRB(u),in1))
array = []
def featurecollection(o):
    for i in o["features"]:
        fCall = function_mappings[i['geometry']['type']]
        props = {}
        try:
            props = i['properties']
        except:
            pass
        obarray.append(fCall(i['geometry'],props))
def feature(o):
    pass
def point(o,w=True):
    pt = r.Geometry.Point3d(o[0],o[1],o[2])
    remap = r.Geometry.Plane.RemapToPlaneSpace(lPlane, pt)
    rpt = remap[1]
    rpt = [rpt[0]/layout['scale'],-1*rpt[1]/layout['scale'],rpt[2]/layout['scale']]
    pt = str(remap[1][0]/layout['scale'])+","+str(remap[1][1]/layout['scale']*-1)
    if w:
        return pt
    else:
        return rpt


def line(o, props):
    #<polyline points="118.85,155.3 118.85,180.7" class="FOPActual" zindex="10"/>
    pts = map(lambda i: point(i,False), o['coordinates'])
    propString = []
    for k in props:
        print(k)
        print(props[k])
        propString.append(str(k)+'=\"'+str(props[k])+'\"')
    pString = " ".join(propString)
    pline = '<line x1="'+str(pts[0][0])+'" y1="'+str(pts[0][1])+'" x2="'+str(pts[1][0])+'" y2="'+str(pts[1][1])+'" '+pString+'/>'
    #pline = NurbsCurve.ByControlPoints(polarray,1,o['properties']['closed'])
    return pline


def polyline(o, props):
    #<polyline points="118.85,155.3 118.85,180.7" class="FOPActual" zindex="10"/>
    polarray = []
    for p in o['coordinates']:
        pt = point(p)
        polarray.append(pt)
    pts = " ".join(polarray)
    propString = []
    for k in props:

        propString.append(str(k)+'=\"'+str(props[k])+'\"')
    pString = " ".join(propString)
    if o['closed']:
        pline = '<polygon points=\"'+pts+'\" '+pString+'/>'
    else: 
        pline = '<polyline points=\"'+pts+'\" '+pString+'/>'
    #pline = NurbsCurve.ByControlPoints(polarray,1,o['properties']['closed'])
    return pline

def text(o, props):
    #<text class="CLASS" zindex="500" transform="matrix(1 0 0 1 210 148.5)">TEXT</text> 
    propString = []
    for k in props:
        propString.append(str(k)+'=\"'+str(props[k])+'\"')
    pString = " ".join(propString)
    gm = o['coordinates']
    planeorigin = [gm[3],gm[7],gm[11]]
    planeremap = point(planeorigin,False)
    matrix = [str(gm[0]), str(gm[1]),str(gm[4]),str(gm[5]), str(planeremap[0]), str(planeremap[1])]
    matrixtext = " ".join(matrix)
    text = '<text '+pString+' transform="matrix(%s)">%s</text>'%(matrixtext,o['content'])
    print text
    return text
def image(o, props):
    #<image width="132.543857" height="132.543857" transform="matrix(-0.173648 -0.984808 0.984808 -0.173648 28.869475 131.454367)" xlink:href="K:\Computational Design Group\20.png"'"/>
    propString = []
    for k in props:
        propString.append(str(k)+'=\"'+str(props[k])+'\"')
    pString = " ".join(propString)
    gm = o['coordinates']
    yvec = [gm[1]*o['height'],gm[5]*o['height'],gm[9]*o['height']]
    planeorigin = [gm[3]+yvec[0],gm[7]+yvec[1],gm[11]+yvec[2]]
    planeremap = point(planeorigin,False)
    imgPlane = r.Geometry.Plane(r.Geometry.Point3d(gm[3],gm[7],gm[11]),r.Geometry.Vector3d(gm[0],gm[4],gm[8]),r.Geometry.Vector3d(gm[1],gm[5],gm[9]))
    worldPlane = r.Geometry.Plane(r.Geometry.Point3d(0,0,0),r.Geometry.Vector3d(1,0,0),r.Geometry.Vector3d(0,1,0))
    transform = r.Geometry.Transform.PlaneToPlane(lPlane,worldPlane)
    imgPlane.Transform(transform)
    npln = [imgPlane.XAxis.X,imgPlane.YAxis.X,imgPlane.ZAxis.X,imgPlane.OriginX,imgPlane.XAxis.Y,imgPlane.YAxis.Y,imgPlane.ZAxis.Y,imgPlane.OriginY,imgPlane.XAxis.Z,imgPlane.YAxis.Z,imgPlane.ZAxis.Z,imgPlane.OriginZ,0,0,0,1]
    matrix = [str(npln[0]), str(npln[1]),str(npln[4]),str(npln[5]), str(planeremap[0]), str(planeremap[1])]
    matrixtext = " ".join(matrix)
    text = '<image transform="matrix(%s)" width="%s" height="%s" xlink:href="%s"/>'%(matrixtext,o['width']/layout['scale'],o['height']/layout['scale'],o['image'])
    print text
    return text
function_mappings = {
        'FeatureCollection':featurecollection,
        'Feature': feature,
        'polyline': polyline,
        'line': line,
        'text': text,
        'image':image,
}
obarray = []
layout = json.loads(LAYOUT)
lPlane = layout['plane']
lOrigin = r.Geometry.Point3d(lPlane[0][0],lPlane[0][1],lPlane[0][2])
lXAx = r.Geometry.Vector3d(lPlane[1][0],lPlane[1][1],lPlane[1][2])
lYAx = r.Geometry.Vector3d(lPlane[2][0],lPlane[2][1],lPlane[2][2])
lPlane = r.Geometry.Plane(lOrigin,lXAx,lYAx)
for i in in1:
    if i["type"]:
        fCall = function_mappings[i['type']]
        fCall(i)
    else:
        fCall = function_mappings[i['geometry']['type']]
        obarray.append(fCall(i['geometry']))

#OUT = log
template =Template("""<?xml version="1.0" encoding="utf-8"?>
<!-- Generator: Grasshopper 1.0.0, Redback Plugin. SVG Version: 6.00 Build 0)  -->
<!DOCTYPE svg PUBLIC "-//W3C//DTD SVG 1.1//EN" "http://www.w3.org/Graphics/SVG/1.1/DTD/svg11.dtd">
<svg version="1.1" xmlns="http://www.w3.org/2000/svg" xmlns:xlink="http://www.w3.org/1999/xlink" x="0px" y="0px"
width="${width}mm" height="${height}mm" viewBox="0 0 ${width} ${height}" xml:space="preserve">
<style type="text/css">
$css
</style>
$svg
</svg>""")
print(layout)
svgdict = {'svg':"\n".join(obarray),'width':layout['page'][0],'height':layout['page'][1],'css':"\n".join(CSS)}
svgfull = template.substitute(svgdict)
SVG = svgfull.split("\n")
# ---------- end python ----------
svg = ClusterOutput(python)  # SVG output

# ==== cluster PeopleClumpiness
crv = ClusterInput()
crv_2 = Curve(crv)
C = ClusterInput()
data = ClusterInput()
join = JoinCurves(Curves=[crv_2, C], Preserve=False)
data_2 = Data(data)
lng = ListLength(List=data_2)
boundary = BoundarySurfaces(Edges=join)
popgeo = PopulateGeometry(Geometry=boundary, Count=lng, Seed=1)
A = ClusterInput()
B = ClusterInput()
pull = PullPoint(Point=popgeo, Geometry=crv_2, ClosestOnly=True)  # -> ClosestPoint, Distance
dom = ConstructDomain(DomainStart=A, DomainEnd=B)
crv_cp = CurveClosestPoint(Point=pull.ClosestPoint, Curve=crv_2)  # -> Point, Parameter, Distance
bnd = Bounds(Numbers=crv_cp.Parameter)
remap = RemapNumbers(Value=crv_cp.Parameter, Source=bnd, Target=dom)  # -> simplify(Mapped), Clipped
R = ClusterOutput(remap.Mapped)

# ==== cluster Spread
A = ClusterInput()
objatts = ObjectAttributes(ObjectOrAttributes=A)  # -> Name, LayerName, LayerFullPath, Color, MaterialName, LinetypeName, GroupIndices, PlotWeight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
split = TextSplit(Text=objatts.Name, Separators="_")
item = ListItem(List=split, Index="1", Wrap=True)  # -> simplify(Item)
data = Data(item)
series = Series(Start=0, Step="0", Count=data)
replace = ReplaceItems(List=series, Item="1", Indices="0", Wrap=False)
bool = Boolean(replace)
bool_2 = ClusterOutput(bool)

# ==== cluster Spread_2
A = ClusterInput()
objatts = ObjectAttributes(ObjectOrAttributes=A)  # -> Name, LayerName, LayerFullPath, Color, MaterialName, LinetypeName, GroupIndices, PlotWeight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
split = TextSplit(Text=objatts.Name, Separators="_")
item = ListItem(List=split, Index="1", Wrap=True)  # -> simplify(Item)
num = Number(item)
num_2 = ClusterOutput(num)

# ==== cluster DistrubutionCrv
num = Number("0")
pt = ConstructPoint(XCoordinate=num, YCoordinate=num, ZCoordinate=num)
X = UnitX(Factor="100")
move = Move(Geometry=pt, Motion=X)  # -> Geometry, Transform
ln = Line(StartPoint=pt, EndPoint=move.Geometry)
t = ClusterInput()
L = ClusterOutput(ln)
eval = EvaluateCurve(Curve=reparameterize(ln), Parameter=t)  # -> Point, Tangent, Angle
F = ClusterInput()
Y = UnitY(Factor=F)
move_2 = Move(Geometry=eval.Point, Motion=Y)  # -> Geometry, Transform
nurbs = NurbsCurve(Vertices=move_2.Geometry, Degree="4", Periodic=False)  # -> Curve, Length, Domain
crv = Curve(nurbs.Curve)
crv_2 = ClusterOutput(crv)

# ==== cluster RDB_SVGPlaneByPage: Makes a layout json for svg
plane = ClusterInput()  # Orientation and Location of Page
page_size = ClusterInput()  # Size of Page. Input a page size from A5-A0 followed by the orientation (P) or (L), Example: 'A1 (P)'. Alternatively, input dimensions, eg. '500,500'
scale = ClusterInput()  # Scale of Page
position = ClusterInput()  # Position of Plane relative to the page. True = Plane at Centre, False = Plane at Top Left
preset_standard_page_sizes = Panel("""A5 (L),210,148
A5 (P),148,210
A4 (L),297,210
A4 (P),210,297
A3 (L),420,297
A3 (P),297,420
A2 (L),594,420
A2 (P),420,594
A1 (L),841,594
A1 (P),594,841
A0 (L),1189,841
A0 (P),841,1189""")
split = TextSplit(Text=preset_standard_page_sizes, Separators=",")
item = ListItem(List=split, Index=0, Wrap=True)  # -> flatten(Item)

# ---- group: Find which Page Size is being called and pick it from list
mindex = MemberIndex(Set=item, Member=simplify(page_size))  # -> simplify(flatten(Index)), Count
item_2 = ListItem(List=preset_standard_page_sizes, Index=mindex.Index, Wrap=True)  # -> simplify(Item)
merge = Merge(Data1=simplify(item_2), Data2=simplify(page_size))
item_3 = ListItem(List=merge, Index=0, Wrap=True)

# ----
split_2 = TextSplit(Text=scale, Separators=":")
item_4 = ListItem(List=split_2, Index=0, Wrap=True)  # -> Item, Item1
unit_checker = PythonScript()  # -> out, a
# ---------- unit_checker: Python ----------
import rhinoscriptsyntax as rs
import scriptcontext as sc

a=sc.doc.ModelUnitSystem
a = str(a)
if a == "Millimeters":
    print 1
elif a == "Meters":
    print 1000
else:
    print "Use the metric system"
# ---------- end unit_checker ----------
pos = Boolean(position)
division = Division(A=item_4.Item1, B=unit_checker.out)

# ---- group: Choose location of centre
panel = Panel("""1,1
0.5,0.5""")
item_5 = ListItem(List=panel, Index=pos, Wrap=True)

# ----
num = Number(division)

# ---- group: Extract Dimensions
split_3 = TextSplit(Text=item_3, Separators=",")
item_6 = ListItem(List=reverse(split_3), Index=[0, 1], Wrap=True)  # -> reverse(Item)
num_2 = Number(item_6)

# ----
split_4 = TextSplit(Text=item_5, Separators=",")
plane_2 = Data(plane)
dispatch = Dispatch(List=split_4, DispatchPattern=[True, False])  # -> ListA, ListB

# ---- group: Convert to Scale
expression = Expression(x=num_2, y=num, Expression="x*y")

# ----
dispatch_2 = Dispatch(List=expression, DispatchPattern=[True, False])  # -> ListA, ListB

# ---- group: Create domains
dom = ConstructDomain(DomainStart=expr("-x", dispatch_2.ListB), DomainEnd=0)
dom_2 = ConstructDomain(DomainStart=expr("-x", dispatch_2.ListA), DomainEnd=0)

# ---- group: Remap to match centre pt location
remap = RemapNumbers(Value=dispatch.ListB, Source=Domain(0, 1), Target=dom)  # -> Mapped, Clipped
remap_2 = RemapNumbers(Value=dispatch.ListA, Source=Domain(0, 1), Target=dom_2)  # -> Mapped, Clipped

# ---- group: Adjust Centre Plane
pt = PointOriented(BasePlane=plane_2, UComponent=remap_2.Mapped, VComponent=expr("-x", remap.Mapped), WComponent=0)
pl_origin = PlaneOrigin(Base=plane_2, Origin=pt)

# ----
expression_2 = Expression(x=remap_2.Mapped, y=dispatch_2.ListA, Expression="x+y")
expression_3 = Expression(x=remap.Mapped, y=dispatch_2.ListB, Expression="x+y")

# ---- group: Create Adjusted Domain
dom_3 = ConstructDomain(DomainStart=remap_2.Mapped, DomainEnd=expression_2)
dom_4 = ConstructDomain(DomainStart=remap.Mapped, DomainEnd=expression_3)

# ----
x_dim = Domain(dom_4)
y_dim = Domain(dom_3)
plane_3 = Plane(flatten(pl_origin))
scale_2 = Number(flatten(num))
dims = Number(flatten(num_2))
neg = Negative(Value=x_dim)
python = PythonScript(PLANE=plane_3, PAGE=dims, SCALE=scale_2)  # -> JSON; inputs PAGE: list
# ---------- python: Python ----------
import Rhino as r
import rhinoscriptsyntax as rs
import json
p = PLANE
o = {"plane":[[p.Origin[0],p.Origin[1],p.Origin[2]],[p.XAxis[0],p.XAxis[1],p.XAxis[2]],[p.YAxis[0],p.YAxis[1],p.YAxis[2]]], "page":PAGE, "scale":SCALE}
JSON = json.dumps(o)
# ---------- end python ----------

# ---- group: Construct Crv
rectangle = Rectangle(Plane=plane_2, XSize=y_dim, YSize=neg, Radius=0)  # -> Rectangle, Length

# ----
json = Data(python)
preview = ClusterOutput(rectangle.Rectangle)  # Previews the page curve
json_layout = ClusterOutput(json)  # Layout JSON containing Plane, Page, Scale

# ==== cluster LookAtMe
people = ClusterInput()
pt = ClusterInput()
people_2 = Data(people)
pt_2 = Point(pt)
cp = ClosestPoint(Point=people_2, Cloud=pt_2)  # -> simplify(ClosestPoint), simplify(CPIndex), simplify(Distance)
rhatt = GetRhinoAttributes(Geometry=pt_2)  # -> Name, Layer, Color
cset = CreateSet(List=cp.CPIndex)  # -> Set, Map
mindex = MemberIndex(Set=cp.CPIndex, Member=cset.Set)  # -> simplify(Index), Count
item = ListItem(List=rhatt.Name, Index=cset.Set, Wrap=True)
item_2 = ListItem(List=pt_2, Index=cset.Set, Wrap=True)
graft = GraftTree(Tree=item, IncludeEmptyLists=True, IncludeNullItems=True)  # -> simplify(Tree)
graft_2 = GraftTree(Tree=item_2, IncludeEmptyLists=True, IncludeNullItems=True)  # -> simplify(Tree)
item_3 = ListItem(List=people_2, Index=mindex.Index, Wrap=True)  # -> simplify(Item)
subtraction = Subtraction(A="100", B=graft)
area = Area(Geometry=item_3)  # -> Area, Centroid
division = Division(A=subtraction, B="100")
Y = UnitY(Factor="20")
number_slider = Slider(78, range=0..100)
move = Move(Geometry=area.Centroid, Motion=Y)  # -> Geometry, Transform
vec2pt = Vector2Pt(PointA=area.Centroid, PointB=move.Geometry, Unitize=False)  # -> Vector, Length
vec2pt_2 = Vector2Pt(PointA=area.Centroid, PointB=graft_2, Unitize=False)  # -> Vector, Length
item_4 = ListItem(List=vec2pt_2.Vector, Index=number_slider, Wrap=True)
item_5 = ListItem(List=vec2pt.Vector, Index=number_slider, Wrap=True)
item_6 = ListItem(List=area.Centroid, Index=number_slider, Wrap=True)
item_7 = ListItem(List=item_3, Index=number_slider, Wrap=True)
angle = Angle(VectorA=vec2pt_2.Vector, VectorB=vec2pt.Vector, Plane=area.Centroid)  # -> Angle, Reflex
vdis = VectorDisplay(Anchor=item_6, Vector=item_5)
vdis_2 = VectorDisplay(Anchor=item_6, Vector=item_4)
multiplication = Multiplication(A=angle.Angle, B="57.296")
item_8 = ListItem(List=multiplication, Index=number_slider, Wrap=True)
panel = Panel(item_8)
lng = ListLength(List=multiplication)
multiplication_2 = Multiplication(A=lng, B=division)
series = Series(Start=0, Step=1, Count=lng)
series_2 = Series(Start=0, Step=1, Count=multiplication_2)
jitter = Jitter(List=series, Jitter=1, Seed="11")  # -> simplify(Values), Indices
random = Random(Range="360", Number=multiplication_2, Seed="11")  # -> simplify(Random)
item_9 = ListItem(List=jitter.Values, Index=series_2, Wrap=True)  # -> simplify(Item)
null = NullItem(Item=pt_2)  # -> NullFlags, InvalidFlags, Description
ma = MassAddition(Input=null.NullFlags)  # -> Result, PartialResults
replace = ReplaceItems(List=multiplication, Item=random, Indices=item_9, Wrap=False)  # -> simplify(List)
larger = LargerThan(FirstNumber=ma.Result, SecondNumber="0")  # -> LargerThan, OrEqualTo
lng_2 = ListLength(List=people_2)
num = Number(replace)
random_2 = Random(Range="360", Number=lng_2, Seed=2)
filter = StreamFilter(Gate=larger.LargerThan, Stream0=num, Stream1=random_2)
crv = Curve(flatten(item_3))
num_2 = Number(filter)
crv_2 = Curve(crv)
num_3 = ClusterOutput(num_2)
crv_3 = ClusterOutput(crv_2)
