# Grasshopper definition scalebars.gh (Grasshopper 1.0.8)
# plug-ins: Squid, FalseStartToggle, Python

panel = Panel("""0
50
100
200""")
expression = Expression(x="2500", Expression="(x/500)")
expression_2 = Expression(x=panel, Expression="x*1000")
panel_2 = Panel("A")
expression_3 = Expression(x=panel, Expression="Format(\"{0}m\", x)")
pt = ConstructPoint(XCoordinate=expression_2, YCoordinate=0, ZCoordinate=0)
expression_4 = Expression(x=expression, y=Slider(1200, range=0..100000), Expression="x*y")
Y = UnitY(Factor=expression_4)
pline = PolyLine(Vertices=pt, Closed=False)
font = Font(Family="Mark Offc Pro", Size=expression_4, Bold=Toggle(True), Italic=False, Underline=False)
paragraph = Paragraph(HAlign=Slider(1, range=0..3), VAlign=2, RightLeft=False)
move = Move(Geometry=pt, Motion=Y)  # -> Geometry, Transform
xy = XYPlane(Origin=move.Geometry)
explode = Explode(Curve=pline, Recursive=True)  # -> Segments, Vertices
textc = TextCurves(Plane=xy, Text=expression_3, Font=font, Paragraph=paragraph)
xy_2 = XYPlane(Origin=Point(0, 0, 0))
dispatch = Dispatch(List=explode.Segments, DispatchPattern=[True, False])  # -> ListA, ListB
topoly = CurveToPolyline(Curve=textc, ToleranceDistance=1, ToleranceAngle=0)  # -> Polyline, Segments
boundary = BoundarySurfaces(Edges=topoly.Polyline)
edges = BrepEdges(Brep=boundary)  # -> Naked, Interior, NonManifold
offset_l = OffsetCurveLoose(Curve=dispatch.ListA, Distance=expression_4, Plane=xy_2)
xy_3 = XYPlane(Origin=Point(0, 0, 0))
join = JoinCurves(Curves=edges.Naked, Preserve=False)  # -> simplify(Curves)
weave = Weave(Pattern=[0, 1], Stream0=offset_l, Stream1=dispatch.ListB, NullGaps=False)
textc_2 = TextCurves(Plane=xy_3, Text="Hello world!")
cluster = Cluster(crv=join)
area = Area(Geometry=cluster)  # -> Area, Centroid
connect = ConnectCurves(Curves=weave, Continuity=0, Close=False, Bulge=1)
pt_2 = ConstructPoint(XCoordinate=0, YCoordinate=0, ZCoordinate=0)
sort = SortList(Keys=area.Area, ValuesA=cluster)  # -> Keys, reverse(ValuesA)
lng = ListLength(List=sort.ValuesA)
repeat = RepeatData(Data="0", Length=lng)
X = UnitX(Factor=1)
rep = ReplaceText(Text="1:#", Find="#", Replace="2500", RecursiveReplace=False)
topoly_2 = CurveToPolyline(Curve=connect, ToleranceDistance=0, ToleranceAngle=0)  # -> Polyline, Segments
replace = ReplaceItems(List=repeat, Item="1", Indices=0, Wrap=False)
panel_3 = Panel("A5 (L)")
dispatch_2 = Dispatch(List=sort.ValuesA, DispatchPattern=replace)  # -> ListA, ListB
line = LineSDL(Start=pt_2, Direction=X, Length=100000)
flip = FlipCurve(Curve=dispatch_2.ListB)  # -> Curve, Flag
weave_2 = Weave(Pattern=replace, Stream0=flip.Curve, Stream1=dispatch_2.ListA, NullGaps=False)
group = Group(Objects=weave_2)  # -> flatten(Group)
bbox = BoundingBox(Content=flatten([topoly_2.Polyline, group]), Plane=PlaneXY(0, 0, 0), UnionBox=True)  # -> Box, Box_2
box = EvaluateBox(Box=bbox.Box, UParameter=0.5, VParameter=0.5, WParameter=0.5)  # -> Plane, Point, Include
debox = DeconstructBox(Box=bbox.Box)  # -> Plane, X, Y, Z
dedomain = DeconstructDomain(Domain=debox.Y)  # -> Start, End
dedomain_2 = DeconstructDomain(Domain=debox.X)  # -> Start, End
expression_5 = Expression(x=dedomain_2.Start, y=dedomain_2.End, z="2500", Expression="((y-x)/z)+4")
expression_6 = Expression(x=dedomain.Start, y=dedomain.End, z="2500", Expression="((y-x)/z)+4")
int = Integer(expression_5)
int_2 = Integer(expression_6)
expression_7 = Expression(x=expression_5, y=expression_6, Expression="Format(\"{0},{1}\", x, y)")
xy_4 = XYPlane(Origin=box.Point)
svg_plane_by_page = RDB_SVGPlaneByPage(plane=xy_4, page_size=expression_7, scale=rep, position=Toggle(True))  # -> json_layout, preview
merge = Merge(Data1=flatten(svg_plane_by_page.preview), Data2=flatten(topoly_2.Polyline), Data3=flatten(group))
geo2archijson = Geo2ArchiJSON(G=merge, output_type=1)  # -> flatten(output)
toggle = FalseStartToggle(True)
rep_2 = ReplaceText(Text="scale-bar-#-small.svg", Find="#", Replace="2500", RecursiveReplace=False)
panel_4 = Panel("""polyline{
fill:none;
stroke:black;
stroke-width:0.2mm;
}
polygon{
fill:white;
}""")
draw = DrawSVG(objects=geo2archijson, layout=svg_plane_by_page.json_layout, css=panel_4)
panel_5 = Panel("""*{
fill:none;
stroke:black;
stroke-width:0.3mm;
}
polygon{
fill:white;
}""")
rel_path = RelativePath()  # -> FullPath, DirectoryPath, FileName
pt_3 = ConstructPoint(XCoordinate=0, YCoordinate=0, ZCoordinate=0)
circle = CircleCNR(Center=pt_3, Normal=Vector(0, 0, 1), Radius=Slider(3600, range=0..100000))
eval = EvaluateLength(Curve=circle, Length=Slider(0.25, range=0..1), Normalized=True)  # -> Point, Tangent, Parameter
xy_5 = XYPlane(Origin=Point(0, 0, 0))
write = WriteFile(R=toggle, C=draw, P=rel_path.DirectoryPath, N=rep_2)
ln = Line(StartPoint=pt_3, EndPoint=eval.Point)
rotate = Rotate(Geometry=ln, Angle=degrees("-71"), Plane=xy_5)  # -> Geometry, Transform
topoly_3 = CurveToPolyline(Curve=circle, ToleranceDistance=0.1, ToleranceAngle=0)  # -> Polyline, Segments
xy_6 = XYPlane(Origin=Point(0, 0, 0))
panel_6 = Panel(write)
svg_plane_by_page_2 = RDB_SVGPlaneByPage(plane=xy_6, page_size="45,45", scale="1:750", position=Toggle(True))  # -> json_layout, preview
panel_7 = Panel("#")
scale = Scale(Geometry=svg_plane_by_page_2.preview, Center=Point(0, 0, 0), Factor=2)  # -> Geometry, Transform
merge_2 = Merge(Data1=flatten(scale.Geometry), Data2=flatten(topoly_3.Polyline), Data3=flatten(rotate.Geometry))
rep_3 = ReplaceText(Text="NorthPoint_#.svg", Find="#", Replace="-71", RecursiveReplace=False)
geo2archijson_2 = Geo2ArchiJSON(G=merge_2, output_type=1)  # -> flatten(output)
draw_2 = DrawSVG(objects=geo2archijson_2, layout=svg_plane_by_page_2.json_layout, css=panel_5)
write_file = WRITEFILE(content=draw_2, filepath=rel_path.DirectoryPath, filename=graft(rep_3), activate=toggle)

# ==== cluster RDB_SVGPlaneByPage: Makes a layout json for svg
plane = ClusterInput()  # Orientation and Location of Page
page_size = ClusterInput()  # Size of Page. Input a page size from A5-A0 followed by the orientation (P) or (L), Example: 'A1 (P)'. Alternatively, input dimensions, eg. '500,500'
scale = ClusterInput()  # Scale of Page
position = ClusterInput()  # Position of Plane relative to the page. True = Plane at Centre, False = Plane at Top Left
preset_standard_page_sizes = Panel("""A5 (L),210,148
A5 (P),148,210
A4 (L),297,210
A4 (P),210,297
A3 (L),420,297
A3 (P),297,420
A2 (L),594,420
A2 (P),420,594
A1 (L),841,594
A1 (P),594,841
A0 (L),1189,841
A0 (P),841,1189""")
split = TextSplit(Text=preset_standard_page_sizes, Separators=",")
item = ListItem(List=split, Index=0, Wrap=True)  # -> flatten(Item)

# ---- group: Find which Page Size is being called and pick it from list
mindex = MemberIndex(Set=item, Member=simplify(page_size))  # -> simplify(flatten(Index)), Count
item_2 = ListItem(List=preset_standard_page_sizes, Index=mindex.Index, Wrap=True)  # -> simplify(Item)
merge = Merge(Data1=simplify(item_2), Data2=simplify(page_size))
item_3 = ListItem(List=merge, Index=0, Wrap=True)

# ----
split_2 = TextSplit(Text=scale, Separators=":")
item_4 = ListItem(List=split_2, Index=0, Wrap=True)  # -> Item, Item1
unit_checker = PythonScript()  # -> out, a
# ---------- unit_checker: Python ----------
import rhinoscriptsyntax as rs
import scriptcontext as sc

a=sc.doc.ModelUnitSystem
a = str(a)
if a == "Millimeters":
    print 1
elif a == "Meters":
    print 1000
else:
    print "Use the metric system"
# ---------- end unit_checker ----------
pos = Boolean(position)
division = Division(A=item_4.Item1, B=unit_checker.out)

# ---- group: Choose location of centre
panel = Panel("""1,1
0.5,0.5""")
item_5 = ListItem(List=panel, Index=pos, Wrap=True)

# ----
num = Number(division)

# ---- group: Extract Dimensions
split_3 = TextSplit(Text=item_3, Separators=",")
item_6 = ListItem(List=reverse(split_3), Index=[0, 1], Wrap=True)  # -> reverse(Item)
num_2 = Number(item_6)

# ----
split_4 = TextSplit(Text=item_5, Separators=",")
plane_2 = Data(plane)
dispatch = Dispatch(List=split_4, DispatchPattern=[True, False])  # -> ListA, ListB

# ---- group: Convert to Scale
expression = Expression(x=num_2, y=num, Expression="x*y")

# ----
dispatch_2 = Dispatch(List=expression, DispatchPattern=[True, False])  # -> ListA, ListB

# ---- group: Create domains
dom = ConstructDomain(DomainStart=expr("-x", dispatch_2.ListB), DomainEnd=0)
dom_2 = ConstructDomain(DomainStart=expr("-x", dispatch_2.ListA), DomainEnd=0)

# ---- group: Remap to match centre pt location
remap = RemapNumbers(Value=dispatch.ListB, Source=Domain(0, 1), Target=dom)  # -> Mapped, Clipped
remap_2 = RemapNumbers(Value=dispatch.ListA, Source=Domain(0, 1), Target=dom_2)  # -> Mapped, Clipped

# ---- group: Adjust Centre Plane
pt = PointOriented(BasePlane=plane_2, UComponent=remap_2.Mapped, VComponent=expr("-x", remap.Mapped), WComponent=0)
pl_origin = PlaneOrigin(Base=plane_2, Origin=pt)

# ----
expression_2 = Expression(x=remap_2.Mapped, y=dispatch_2.ListA, Expression="x+y")
expression_3 = Expression(x=remap.Mapped, y=dispatch_2.ListB, Expression="x+y")

# ---- group: Create Adjusted Domain
dom_3 = ConstructDomain(DomainStart=remap_2.Mapped, DomainEnd=expression_2)
dom_4 = ConstructDomain(DomainStart=remap.Mapped, DomainEnd=expression_3)

# ----
x_dim = Domain(dom_4)
y_dim = Domain(dom_3)
plane_3 = Plane(flatten(pl_origin))
scale_2 = Number(flatten(num))
dims = Number(flatten(num_2))
neg = Negative(Value=x_dim)
python = PythonScript(PLANE=plane_3, PAGE=dims, SCALE=scale_2)  # -> JSON; inputs PAGE: list
# ---------- python: Python ----------
import Rhino as r
import rhinoscriptsyntax as rs
import json
p = PLANE
o = {"plane":[[p.Origin[0],p.Origin[1],p.Origin[2]],[p.XAxis[0],p.XAxis[1],p.XAxis[2]],[p.YAxis[0],p.YAxis[1],p.YAxis[2]]], "page":PAGE, "scale":SCALE}
JSON = json.dumps(o)
# ---------- end python ----------

# ---- group: Construct Crv
rectangle = Rectangle(Plane=plane_2, XSize=y_dim, YSize=neg, Radius=0)  # -> Rectangle, Length

# ----
json = Data(python)
preview = ClusterOutput(rectangle.Rectangle)  # Previews the page curve
json_layout = ClusterOutput(json)  # Layout JSON containing Plane, Page, Scale

# ==== cluster DrawSVG: Creates SVG output from ArchiJSON objects. Version 18.09.10
objects = ClusterInput()  # ArchiJSON obects
layout = ClusterInput()  # Layout Object
css = ClusterInput()  # CSS Text
python = PythonScript(OBJECTS=objects, LAYOUT=layout, CSS=css)  # -> a, SVG; inputs OBJECTS: list, CSS: list
# ---------- python: Python ----------
import rhinoscriptsyntax as rs
import sys
import json
import inspect
import Rhino as r
from string import Template

log = []
#The inputs to this node will be stored as a list in the IN variables.
in1 = OBJECTS
def checkRB(ob):
    if str(type(ob)) == "<type 'str'>":
        return json.loads(ob)
    else:
        return ob
in1 = list(map(lambda u: checkRB(u),in1))
array = []
def featurecollection(o):
    #print ('o', o)
    for i in o["features"]:
        #print ('i', i)
        print("FEATURES---- ", i)
        fCall = function_mappings[i['geometry']['type']]
        props = {}
        try:
            props = i['properties']
        except:
            pass
        li = []
        li.append(i)
        obarray.append(fCall(li,props))
def feature(o):
    pass
    
def point(o,type="standard"):
    #print(o)
    pt = r.Geometry.Point3d(o[0],o[1],o[2])
    remap = r.Geometry.Plane.RemapToPlaneSpace(lPlane, pt)
    rpt = remap[1]
    rpt = [rpt[0]/layout['scale'],-1*rpt[1]/layout['scale'],rpt[2]/layout['scale']]
    ptx = str(remap[1][0]/layout['scale'])
    pty = str(remap[1][1]/layout['scale']*-1)
    pt = "%s, %s" %(ptx, pty)
    ppt = "%s %s" %(ptx, pty)
    ptypes = {
        "standard": "%s, %s" %(ptx, pty),
        "plane": [rpt[0]/layout['scale'],-1*rpt[1]/layout['scale'],rpt[2]/layout['scale']],
        "line": [float(ptx),float(pty),0],
        "path": "%s %s" %(ptx, pty)
    }
    return ptypes[type]
    

def isCClockwise(pts):
    total = 0
    print(pts)
    for index in range(len(pts)):
        p1 = pts[index]
        p2 = pts[(index+1) % len(pts)]
        
        f = (p2[0]-p1[0])*((p2[1]*-1)+(p1[1]*-1))
        total += f
        print("t",total, p1,p2)
    
    cclockwise = total < 0
    print("cclockwise:",cclockwise)
    return cclockwise

def arc(o, props, collection = False):
    print(o)
    #<path d="M 80 80 A 45 45, 0, 0, 0, 125 125">
    arcList = []
    for items in o:
        items = items['geometry']
        pts = map(lambda i: point(i,'line'), items['coordinates'])

        radius = items["radius"]
        angle = items["angle"]
        cclockwise = isCClockwise(pts)
        isBig = items["isBig"]
        largeCircleFlag = str(int(cclockwise))
        
        testflag = False
        largeCircleFlag = True
        if not isBig and cclockwise:
            testflag = False
            largeCircleFlag = False
        if not isBig and not cclockwise:
            testflag = True
            largeCircleFlag = False
        if isBig and not cclockwise:
            testflag = True
            largeCircleFlag = True
        if isBig and cclockwise:
            testflag = False
            largeCircleFlag = True
        largeCircleFlag = str(int(largeCircleFlag))
        testflag = str(int(testflag))
        
        print(largeCircleFlag,testflag)
        propString = []
        for k in props:
            propString.append(str(k)+'=\"'+str(props[k])+'\"')
        pString = " ".join(propString)
        #pString = pString.split('="')
        #pString = pString[0] + '= "fill:none;' + pString[1]
        arc = '<path d="M %.2f %.2f A %.2f %.2f, 0, %s, %s, %.2f %.2f" %s/>'%(pts[0][0],pts[0][1],radius,radius,largeCircleFlag,testflag,pts[-1][0],pts[-1][1],pString)
        #pline = NurbsCurve.ByControlPoints(polarray,1,o['properties']['closed'])
        arcList.append(arc)
    arcList = " ".join(arcList)
    return arcList

def line(o, props, collection = False):
    #<polyline points="118.85,155.3 118.85,180.7" class="FOPActual" zindex="10"/>
    ptList = []
    for items in o:
        items = items['geometry']
        print(o)
        pts = map(lambda i: point(i, "line"), items['coordinates'])
        propString = []
        for k in props:
            print(k)
            print(props[k])
            propString.append(str(k)+'=\"'+str(props[k])+'\"')
        pString = " ".join(propString)
        pline = '<line x1="'+str(pts[0][0])+'" y1="'+str(pts[0][1])+'" x2="'+str(pts[1][0])+'" y2="'+str(pts[1][1])+'" '+pString+'/>'
        #pline = NurbsCurve.ByControlPoints(polarray,1,o['properties']['closed'])
        
        ptList.append(pline)
    ptList = " ".join(ptList)
    return ptList

def polyline(o, props, closed = False ,collection = False):
    #<polyline points="118.85,155.3 118.85,180.7" class="FOPActual" zindex="10"/>
    ptList = []
    pStringList = []
    print(o)
    for cords in o:
        closed = cords['geometry']['closed']
        print("CORDS ---", cords)
        polarray = []
        for p in cords['geometry']['coordinates']:
            pt = point(p)
            polarray.append(pt)
        
        pts = " ".join(polarray)
        propString = []
    
        for k in props:
            propString.append(str(k)+'=\"'+str(props[k])+'\"')
        pString = " ".join(propString)
        if collection == True:
            if closed:
                pts = "M %s Z" % (pts)
            else: pts = "M %s" % (pts)
        ptList.append(pts)
        pStringList.append(pString)
    pStringList = " ".join(pStringList)
    #if not closed:
        #if pString:
            #pString = pString.split('="')
            #pString = pString[0] + '= "fill:none;' + pString[1]
    ptList = " ".join(ptList)
    if collection == True: 
        pline = '<path d=\"'+ptList+'\"  '+ pString +'/>'
    else:
        if closed:
            pline = '<polygon points=\"'+ptList+'\" '+pStringList+'/>'
        else:
            pline = '<polyline points=\"'+ptList+'\" '+pString+'/>'
            #pline = NurbsCurve.ByControlPoints(polarray,1,o['properties']['closed'])

    return pline
    
def curvecollection(o, props):
    #<path d="M10 10 H 90 V 90 H 10 L 10 10"/>
    print("CURVE COLLECTION")
    
    o = o[0]["geometry"]["coordinates"]
    print(o)
    # in types in o["coordinates"]
    typeDic = {}
    for items in  o:
        print ("ITEM ", items)
        groupType = items['geometry']['type']
        if typeDic.has_key(str(groupType)):
            typeDic[str(groupType)].append(items)
        else:
            typeDic[str(groupType)] = [items]
    print("GROUP BY TYPES --", typeDic)
    
    ptListCombined = []
    for typeKey in typeDic:
        fCall = function_mappings[str(typeKey)] #get group type
        #typeDicList.append(typeDic[str(typeKey)])
        ptList = fCall(typeDic[str(typeKey)], props, collection = True)
        ptListCombined.append(ptList)
    
    ptListCombined = ' '.join(ptListCombined)
    return ptListCombined
   
def avgpts(p1, p2, w1=0.5, w2=0.5):
    p3 = []
    for p1p, p2p in zip(p1, p2):
        p3.append((p1p*w1)+(p2p*w2))
    return p3

def spline_2deg(initCoords, props, outType=None, closed = True):
    polarray = []
    
    print("SPLINE COORDS -- ", initCoords['coords'])
    initCoords = initCoords['coords']
    knotPtsList = []
    beizerPtsList = []
    
    for index, p in enumerate(initCoords):
        for indvPts in p:
            
            pnt = point(indvPts, 'line')
            pt = [pnt[0],pnt[1]]
            polarray.append(pt)
            polarray_len = len(polarray)
        bezierPts = []
        knotPts = []
        if closed:
            for index in range(polarray_len-1):
                pt1 = polarray[index % len(polarray)]
                pt2 = polarray[(index+1) % len(polarray)]
                pt3 = avgpts(pt1,pt2,(5/6),(1/6))
                pt4 = avgpts(pt1,pt2,(1/6),(5/6))
                #print("par",pt1,pt2,pt3,pt4)
                bezierPts.append(pt3)
                bezierPts.append(pt4)
                a = bezierPts
            #fpoint = bezierPts.pop(0)
            #bezierPts.append(fpoint)
            for index in range(int(len(bezierPts)/2)):
                index = index*2
                pt1 = bezierPts[index % len(bezierPts)]
                pt2 = bezierPts[(index+1) % len(bezierPts)]
                #print("avg",index,index+1,pt1,pt2)
                knotPts.append(avgpts(pt1,pt2))
            fpoint = bezierPts.pop(0)
            #bezierPts.append(fpoint)
        
        else:
            mode = "normal"
            if len(polarray) == 3:
                mode = "3pt"
            #print("p",len(polarray),polarray)
            if mode == "normal":
                apPt = avgpts(polarray[0],polarray[1],0.25,0.75)
                bezierPts.append(apPt)
            for index in range(polarray_len-3):
                bezierPts.append(avgpts(polarray[index+1],polarray[index+2],(5/6),(1/6)))
                bezierPts.append(avgpts(polarray[index+1],polarray[index+2],(1/6),(5/6)))
            if mode == "normal":
                bezierPts.append(avgpts(polarray[-1],polarray[-2],0.25,0.75))
            #print(len(bezierPts),bezierPts)
            knotPts = [polarray[0]]+knotPts
            if mode == "normal":
                for index in range(int((len(bezierPts)-2)/2)):
                    index = (index*2)+1
                    p1 = bezierPts[index]
                    p2 = bezierPts[index+1]
                    p3 = avgpts(p1,p2)
                    #print("kp",index,p1,p2)
                    knotPts.append(p3)
            knotPts.append(polarray[-1])
        knotPtsList.append(knotPts)
        beizerPtsList.append(bezierPts)
        
    coordStringList = []
    print(len(knotPts),knotPts)
    print(len(bezierPts),bezierPts)
    for sPts in range(len(knotPtsList)):
        splineCoords = []
        print('SPTS == ', sPts)
        knotPts = knotPtsList[sPts]
        bezierPts = beizerPtsList[sPts]
        print("KNOTS --- ", knotPts)
        
        for index, knotPt in enumerate(knotPts):
            rspoints = [knotPt]
            try:
                if index == 0:  rspoints = [knotPt, bezierPts[index*2], bezierPts[(index*2)+1]]
                else:           rspoints = [knotPt, bezierPts[(index*2)+1]]
            except: pass
            for rspoint in rspoints:
                for coord in rspoint:
                    splineCoords.append("%.2f"%(coord))
        coordString = ["M"]+list(" , ".join(splineCoords))
        delimIndex = 0
        for index, char in enumerate(coordString):
            if char == ",":
                if delimIndex == 1:
                    coordString[index] = "C"
                if (delimIndex-7) % 4 == 0 and delimIndex >= 7:
                    coordString[index] = "S"
                delimIndex += 1
        coordString = "".join(coordString)
        if closed:
            coordString = coordString+"Z"
        coordStringList.append(coordString)
    propString = []
    for k in props:
        propString.append(str(k)+'=\"'+str(props[k])+'\"')
    pString = " ".join(propString)
    coordStringList = " ".join(coordStringList)
    pline = '<path d="'+coordStringList+'" '+pString+'/>'
    print(pline)
    #pline = NurbsCurve.ByControlPoints(polarray,1,o['properties']['closed'])
    return pline
    
def spline_3deg(initCoords, props, outType=None, closed = False):
    #<polyline points="118.85,155.3 118.85,180.7" class="FOPActual" zindex="10"/>
    polarray = []
    print("CLOSED ---", closed)
    print("SPLINE COORDS -- ", initCoords['coords'])
    initCoords = initCoords['coords']
    
    knotPtsList = []
    beizerPtsList = []
    for indvCoords in initCoords:
        polarray = []
        print("SPLINE COORD -- ", indvCoords)
        for index, p in enumerate(indvCoords):
            pnt = point(p, type = 'line')
            pt = [pnt[0],pnt[1]]
            #print('pnt', pnt)
            #print('pt', pt)
            polarray.append(pt)
        polarray_len = len(polarray)
        bezierPts = []
        knotPts = []
        if closed:
            for index in range(polarray_len-1):
                pt1 = polarray[index]
                pt2 = polarray[(index+1) % len(polarray)]
                pt3 = avgpts(pt1,pt2,(2/3),(1/3))
                pt4 = avgpts(pt1,pt2,(1/3),(2/3))
                #print("par",pt1,pt2,pt3,pt4)
                bezierPts.append(pt3)
                bezierPts.append(pt4)
            
            fpoint = bezierPts.pop(0)
            bezierPts.append(fpoint)
            #print(bezierPts)
            for index in range(int(len(bezierPts)/2)-1):
                index = index*2
                pt1 = bezierPts[index]
                pt2 = bezierPts[(index+1) % len(bezierPts)]
                #print("avg",index,index+1,pt1,pt2)
                knotPts.append(avgpts(pt1,pt2))
            fpoint = bezierPts.pop(0)
            bezierPts.append(fpoint)
            #print("bpts", bezierPts)
        else:
            mode = "normal"
            if len(polarray) == 4:
                mode = "4pt"
            
            if mode == "normal":
                bezierPts.append(avgpts(polarray[1],polarray[2]))
            for index in range(polarray_len-5):
                bezierPts.append(avgpts(polarray[index+2],polarray[index+3],(2/3),(1/3)))
                bezierPts.append(avgpts(polarray[index+2],polarray[index+3],(1/3),(2/3)))
            if mode == "normal":
                bezierPts.append(avgpts(polarray[-2],polarray[-3]))
            knotPts = [polarray[0]]+knotPts
            if mode == "normal":
                for index in range(int(len(bezierPts)/2)):
                    index = index*2
                    p1 = bezierPts[index]
                    p2 = bezierPts[index+1]
                    p3 = []
                    for p1p, p2p in zip(p1, p2):
                        p3.append((p1p*(1/2))+(p2p*(1/2)))
                    knotPts.append(p3)
            knotPts.append(polarray[-1])
            bezierPts = [polarray[1]]+bezierPts
            bezierPts.append(polarray[-2])
    
            #print('SPLINE OBJECT --', splineObject)
        beizerPtsList.append(bezierPts)
        knotPtsList.append(knotPts)
    
    coordStringList = []
    for sPts in range(len(knotPtsList)):
        splineCoords = []
        #print(sPts)
        knotPts = knotPtsList[sPts]
        bezierPts = beizerPtsList[sPts]
        #print("KNOTS --- ", knotPts)
        for index, knotPt in enumerate(knotPts):
            #print(index)
            #print(len(knotPts))
            rspoints = [knotPt]
            try:
                if index == len(knotPts)-1: pass
                elif index == 0:  rspoints = [knotPt, bezierPts[index*2], bezierPts[(index*2)+1]]
                else:           rspoints = [knotPt, bezierPts[(index*2)+1]]
            except: pass
            #print("RS POINTS --- ", rspoints)
            for rspoint in rspoints:
                for coord in rspoint:
                    splineCoords.append("%.2f"%(coord))
        #print (splineCoords)
        coordString = ["M"]+list(" , ".join(splineCoords))
        
        delimIndex = 0
        for index, char in enumerate(coordString):
            if char == ",":
                if delimIndex == 1:
                    coordString[index] = "C"
                if (delimIndex-7) % 4 == 0 and delimIndex >= 7:
                    coordString[index] = "S"
                delimIndex += 1
        coordString = "".join(coordString)
        print (coordString)
        if closed:
            coordString = coordString+"Z"
        coordStringList.append(coordString)
    print(" coordStringList --- ",coordStringList)
    propString = []
    for k in props:
        propString.append(str(k)+'=\"'+str(props[k])+'\"')
    pString = " ".join(propString)
    coordStringList = " ".join(coordStringList)
    pline = '<path d="'+coordStringList+'" '+pString+'/>'
    #pline = NurbsCurve.ByControlPoints(polarray,1,o['properties']['closed'])
    print("pline",pline)
    #print("bp",bezierPts)    

    return pline
    
def spline(o, props, outType=None, collection = False):
    print("SPLINE")
    splineObject = None
    
    initCoords2d = {'coords': [], 'closed': ''}
    initCoords3d = {'coords': [], 'closed': ''}

    for coords in o:
        try:
            coords = coords['geometry']
        except:
            pass
        if coords['deg'] == 2:
            initCoords2d['coords'].append(coords['coordinates'])
            initCoords2d['closed'] = coords['closed']        
        if coords['deg'] == 3:
            initCoords3d['coords'].append(coords['coordinates'])
            initCoords3d['closed'] = coords['closed']

        #print(initCoords3d)
    
    if len(initCoords2d['coords']) >= 1:
        print ("2 degree")
        splineObject = spline_2deg(initCoords2d, props, outType, closed = initCoords2d['closed'])
        
    elif len(initCoords3d['coords']) >= 1:
        print ("3 degree")
        splineObject = spline_3deg(initCoords3d, props, outType, closed = initCoords3d['closed'])
    #knotPts = splineObject['knotPts']
    #bezierPts = splineObject['bezierPts']
        
    return splineObject

def polycurve(o, props, collection = False):
    print(o)
    parts = []
    for part in o:
        part = part["geometry"]["coordinates"]
        polycurvePath = []
        for curve_i, curve in enumerate(part):
            #for curveInfo in curve['geometry']["coordinates"]:
            print(curve)
            svgCurve = spline(curve["geometry"]["coordinates"],{},outType="coordinates")
            polycurvePath.append(svgCurve)
    polycurvePath = ' '.join(polycurvePath)
    return polycurvePath

    
def circPath(cx,cy,r, cclockwise):
    #NOTE : Assumes direction pattern is T/F
    #"M" + cx + "," + cy + "m" + (r) + ",0" + "a" + r + "," + r + " 0 1,1 " + (-r * 2) + ",0" + "a" + r + "," + r + " 0 1,1 " + (r * 2) + ",0"
    circPath = "M %.2f, %.2f m %.2f, 0 a %.2f, %.2f 0 1,%s %.2f, 0 a %.2f, %.2f 0 1, %s %.2f, 0"%(cx, cy, r, r, r, cclockwise, -r*2, r, r, cclockwise, r*2)
    return circPath


def circle(o, props, collection = False):
    #<circle cx="50" cy="50" r="50"/>
    circList = []
    for index, coords in enumerate(o):
        coords = coords['geometry']
        print (coords['coordinates'])
        pt = point(coords['coordinates'], 'line')
        propString = []
        for k in props:
            print(k)
            print(props[k])
            propString.append(str(k)+'=\"'+str(props[k])+'\"')
        pString = " ".join(propString)
        
        #pline = NurbsCurve.ByControlPoints(polarray,1,o['properties']['closed'])
        if collection:
            cclockwise = index%2
            print (cclockwise)
            circ = circPath(pt[0],pt[1],coords['radius']/layout['scale'], cclockwise)
            print (circ)
            #circ = ''.join([str(item) for item in circ])
        else:
            circ = '<circle cx="%.2f" cy="%.2f" r="%.2f" %s/>'%(pt[0],pt[1],coords['radius']/layout['scale'],pString)
        circList.append(circ)
    print (circList)
    
    circList = " ".join(circList)
    if collection:
        circList = '<path d= "%s" %s/>'%(circList, pString)
    return circList

def text(o, props):
    #<text class="CLASS" zindex="500" transform="matrix(1 0 0 1 210 148.5)">TEXT</text> 
    propString = []
    for k in props:
        propString.append(str(k)+'=\"'+str(props[k])+'\"')
    pString = " ".join(propString)
    gm = o['coordinates']
    planeorigin = [gm[3],gm[7],gm[11]]
    planeremap = point(planeorigin,False)
    matrix = [str(gm[0]), str(gm[1]),str(gm[4]),str(gm[5]), str(planeremap[0]), str(planeremap[1])]
    matrixtext = " ".join(matrix)
    text = '<text '+pString+' transform="matrix(%s)">%s</text>'%(matrixtext,o['content'])
    print text
    return text
def image(o, props):
    #<image width="132.543857" height="132.543857" transform="matrix(-0.173648 -0.984808 0.984808 -0.173648 28.869475 131.454367)" xlink:href="K:\Computational Design Group\20.png"'"/>
    propString = []
    for k in props:
        propString.append(str(k)+'=\"'+str(props[k])+'\"')
    pString = " ".join(propString)
    gm = o['coordinates']
    yvec = [gm[1]*o['height'],gm[5]*o['height'],gm[9]*o['height']]
    planeorigin = [gm[3]+yvec[0],gm[7]+yvec[1],gm[11]+yvec[2]]
    planeremap = point(planeorigin,False)
    imgPlane = r.Geometry.Plane(r.Geometry.Point3d(gm[3],gm[7],gm[11]),r.Geometry.Vector3d(gm[0],gm[4],gm[8]),r.Geometry.Vector3d(gm[1],gm[5],gm[9]))
    worldPlane = r.Geometry.Plane(r.Geometry.Point3d(0,0,0),r.Geometry.Vector3d(1,0,0),r.Geometry.Vector3d(0,1,0))
    transform = r.Geometry.Transform.PlaneToPlane(lPlane,worldPlane)
    imgPlane.Transform(transform)
    npln = [imgPlane.XAxis.X,imgPlane.YAxis.X,imgPlane.ZAxis.X,imgPlane.OriginX,imgPlane.XAxis.Y,imgPlane.YAxis.Y,imgPlane.ZAxis.Y,imgPlane.OriginY,imgPlane.XAxis.Z,imgPlane.YAxis.Z,imgPlane.ZAxis.Z,imgPlane.OriginZ,0,0,0,1]
    matrix = [str(npln[0]), str(npln[1]),str(npln[4]),str(npln[5]), str(planeremap[0]), str(planeremap[1])]
    matrixtext = " ".join(matrix)
    text = '<image transform="matrix(%s)" width="%s" height="%s" xlink:href="%s"/>'%(matrixtext,o['width']/layout['scale'],o['height']/layout['scale'],o['image'])
    print text
    return text
function_mappings = {
        'FeatureCollection':featurecollection,
        'Feature': feature,
        'Circle':circle,
        'Arc':arc,
        'Polyline': polyline,
        'polyline': polyline,
        'Spline': spline,
        'PolyCurve': polycurve,
        'CurveCollection': curvecollection,
        'Line': line,
        'Text': text,
        'Image':image,
}
obarray = []
layout = json.loads(LAYOUT)
lPlane = layout['plane']
lOrigin = r.Geometry.Point3d(lPlane[0][0],lPlane[0][1],lPlane[0][2])
lXAx = r.Geometry.Vector3d(lPlane[1][0],lPlane[1][1],lPlane[1][2])
lYAx = r.Geometry.Vector3d(lPlane[2][0],lPlane[2][1],lPlane[2][2])
lPlane = r.Geometry.Plane(lOrigin,lXAx,lYAx)

for i in in1:
    if i["type"]:
        print(i)
        fCall = function_mappings[i['type']]
        fCall(i)
    else:
        fCall = function_mappings[i['geometry']['type']]
        obarray.append(fCall(i['geometry']))

#OUT = log
template =Template("""<?xml version="1.0" encoding="utf-8"?>
<!-- Generator: Grasshopper 1.0.0, Redback Plugin. SVG Version: 6.00 Build 0) Made by Andrew Butler at Cox Architecture -->
<!DOCTYPE svg PUBLIC "-//W3C//DTD SVG 1.1//EN" "http://www.w3.org/Graphics/SVG/1.1/DTD/svg11.dtd">
<svg version="1.1" xmlns="http://www.w3.org/2000/svg" xmlns:xlink="http://www.w3.org/1999/xlink" x="0px" y="0px"
width="${width}mm" height="${height}mm" viewBox="0 0 ${width} ${height}" xml:space="preserve">
<style type="text/css">
$css
</style>
$svg
</svg>""")
#print(layout)
svgdict = {'svg':"\n".join(obarray),'width':layout['page'][0],'height':layout['page'][1],'css':"\n".join(CSS)}
svgfull = template.substitute(svgdict)
SVG = svgfull.split("\n")
# ---------- end python ----------
panel = Panel(objects)
svg = ClusterOutput(python.SVG)  # SVG output
panel_2 = Panel(python.SVG)

# ==== cluster Geo2ArchiJSON: Converts Geometry to ArchiJSON. Version 18.09.10
properties = ClusterInput()  # Properties as a JSON to sync with Geometry. Use JSON Component to build properties. Need to include 'zindex'
G = ClusterInput()
output_type = ClusterInput()  # Output Type: 0 = PythonDictionary; 1=JSON String
G_2 = Data(G)
long = LongestList(ListA=G_2, ListB=properties, PaddingMode=2)  # -> ListA, ListB
int = Integer(output_type)
python = PythonScript(G=long.ListA, P=long.ListB, T=int)  # -> O; inputs G: list, P: list
# ---------- python: Python ----------
import rhinoscriptsyntax as rs
import Rhino as rh
import scriptcontext as sc
import Grasshopper as g
import ghpythonlib as ghp
import json
log = []

document = sc.doc
sc.doc = rh.RhinoDoc.ActiveDoc
sc.doc = ghdoc


def Point(geom,prop=None):
    pt = rs.coerce3dpoint(geom)
    pt = [pt[0],pt[1],pt[2]]
    if prop:
        pt = {"type":"Feature","geometry":{'coordinates':pt, 'type': 'Point'}}
        pt['properties'] = json.loads(prop)
        return pt
    else:
        return pt
def convertToRPT (geom):
    pt = rh.Geometry.Point3d(geom[0],geom[1],geom[2])
    return pt
def PointCollection(geom,prop=None):
    t = geom
    pts = map(lambda g: Point(g), t)
    crv = {"type":"Feature","geometry":{'coordinates':pts, 'type': 'PointCollection'}}
    if prop:
        crv['properties'] = json.loads(prop)
    print(crv)
    return crv
    
def CurveCollection(geom,prop=None):
    t = geom
    print('geom', geom)
    crvs = map(lambda g: Curve(g), t)
    print("CURVE COLLECTION--- ", crvs)
    crvCol = {"type":"Feature","geometry":{'coordinates':crvs, 'type': 'CurveCollection'}}
    if prop:
        crvCol['properties'] = json.loads(prop)
    return crvCol
    
#    t = rs.CurvePoints(crvs)
#    tc = rs.ClosedCurveOrientation(crvs)
#    if tc == 0: tc = False
#    else: tc = True
#    tdeg = rs.CurveDegree(crvs)
#    tcPo = len(t)
#    print("tdeg: ",tdeg)
#    print("tcPo: ",tcPo)
#    pts = map(lambda g: Point(g), t)
#    crv = {"type":"Feature","geometry":{'coordinates':pts, 'type': 'CurveCollection','closed':tc}}
#    if tdeg == 1 and tc: del crv['geometry']['coordinates'][-1]
#    if tdeg == 1 and tcPo == 2  : crv['geometry']['type']='Line'
#    if tdeg >= 2                : crv['geometry']['type']='Spline'
#    if tdeg == 2 and tcPo == 3  :
#        print("3ARC")
#        crv['geometry']['type']='Arc'
#    if tdeg == 2 and tcPo == 5  :
#        print("5ARC")
#        arc = rs.AddArc3Pt(pts[0],pts[4],pts[2])
#        pt0 = convertToRPT(pts[0])
#        pt2 = convertToRPT(pts[2])
#        pt4 = convertToRPT(pts[4])
#        arc = rh.Geometry.Arc(startPoint = pt0, pointOnInterior = pt2, endPoint = pt4)
#        crv['geometry']['type']='Arc'
#        print(crv['geometry']['coordinates'])
#        del crv['geometry']['coordinates'][3]
#        del crv['geometry']['coordinates'][1]
#    if prop:
#        crv['properties'] = json.loads(prop)
#    print(crvcollection)
#    return crvcollection

def Plane(geom,prop=None):
    pln = {"type":"Feature","geometry":{'coordinates':[geom.XAxis.X,geom.YAxis.X,geom.ZAxis.X,geom.OriginX,geom.XAxis.Y,geom.YAxis.Y,geom.ZAxis.Y,geom.OriginY,geom.XAxis.Z,geom.YAxis.Z,geom.ZAxis.Z,geom.OriginZ,0,0,0,1], 'type': 'Xform'}}
    if prop:
        pln['properties'] = json.loads(prop)
    return pln
def Text(geom,prop=None):
    print("TEXT")
    text = Plane(geom.location,prop)
    text['geometry']['type']="Text"
    text['geometry']['content']=geom.content
    return text
def Image(geom,prop=None):
    print("Image")
    #print(dir(geom))
    image = Plane(geom.location,prop)
    image['geometry']['type']="Image"
    image['geometry']['image']=geom.img
    image['geometry']['width']=geom.width
    image['geometry']['height']=geom.height
    return image
def Curve(geom,prop=None):
    print("Curve def")
    
    t = rs.CurvePoints(geom)
    
    #check if curve closed
    tc = rs.ClosedCurveOrientation(geom)
    if tc == 0: tc = False
    else: tc = True
    #print(dir(geom))
    #split = rs.ExplodeCurves(geom, True)
    #print(rs.CurveDegree(geom))
    #split = ghp.components.Explode(,True)
    #print("Split",split)
    tdeg = rs.CurveDegree(geom)
    tcPo = len(t)
    isArc = rs.IsArc(geom)
    isCirc = rs.IsCircle(geom)
    
    #print("isCirc: ",isCirc)
    pts = map(lambda g: Point(g), t) #object to points
    print(pts)
    crv = {"type":"Feature","geometry":{'coordinates':pts, 'type': 'Polyline','closed':tc, "deg":tdeg}}
    print("tdeg: "+str(tdeg))
    print("tcPo: "+str(tcPo))
    print(crv)
    print(isArc)
    print("----------------------------------")
    if tdeg == 1 and tc  : del crv['geometry']['coordinates'][-1]
    if tdeg == 1 and tcPo == 2  : crv['geometry']['type']='Line'
    if tdeg >= 2                : crv['geometry']['type']='Spline'
    if tdeg == 2 and tcPo == 3  :
        print("3ARC")
        crv['geometry']['type']='Arc'
    if tdeg == 2 and tcPo == 5  :
        arc = rs.AddArc3Pt(pts[0],pts[4],pts[2])
        pt0 = convertToRPT(pts[0])
        pt2 = convertToRPT(pts[2])
        pt4 = convertToRPT(pts[4])
        arc = rh.Geometry.Arc(startPoint = pt0, pointOnInterior = pt2, endPoint = pt4)
        crv['geometry']['type']='Arc'
        #print(crv['geometry']['coordinates'])
        del crv['geometry']['coordinates'][3]
        del crv['geometry']['coordinates'][1]
    if isArc:
        cpt = rs.ArcCenterPoint(geom)
        testCrvPts = rs.CurvePoints(geom)
        testCrvPts.append(testCrvPts[0])
        testCrv = rs.AddPolyline(testCrvPts)
        try:    isBig = bool(rs.PointInPlanarClosedCurve(cpt, testCrv))
        except: isBig = False
        cpt = Point(cpt)
        crd = rs.ArcRadius(geom)
        cang = rs.ArcAngle(geom)
        #print("cang",cang)
        crv['geometry']['type']='Arc'
        crv['geometry']['radius'] = crd
        crv['geometry']['isBig'] = isBig
        crv['geometry']['center'] = cpt
        crv['geometry']['angle'] = cang
    if isCirc:
        cpt = Point(rs.CircleCenterPoint(geom))
        crd = rs.CircleRadius(geom)
        crv['geometry']['type']='Circle'
        crv['geometry']['coordinates'] = cpt
        crv['geometry']['radius'] = crd
    if prop:
        crv['properties'] = json.loads(prop)
#    if tdeg >= 2:
    print (crv)
    return crv
def PolyCurve(geom, prop=None):
    
    print("PolyCurve def")
    print(geom, type(geom))
    if str(type(geom)) != "<type 'List[object]'>":
        geom = [geom]
    polyCurveParts = []
    #for d in dir(geom):
    #    print(d)

    for part in geom:
        print(part)
        tc = rs.ClosedCurveOrientation(part)
        part = part.Explode()
        curves = list(map(lambda x: Curve(x, {})["geometry"], part))
        polycrvPart = {"type":"Feature","geometry":{'coordinates':curves, 'type': 'PolyCurvePart','closed':tc}}
        polyCurveParts.append(polycrvPart)
    polycrv = {"type":"Feature","geometry":{'coordinates':polyCurveParts, 'type': 'PolyCurve'}}
    if prop:
        polycrv['properties'] = json.loads(prop)
    return polycrv

    return crvCol
otype = {
        "0": "Unknown object",
        "1": Point,
        "2": "PointCloud",
        "3": PointCollection,
        "4": Curve,
        "5": Plane,
        "6": Text,
        "7": CurveCollection,
        "8": "Surface",
        "9": Image,
        "16": "Polysurface",
        "32": "Mesh",
        "256": "Light",
        "512": "Annotation",
        "4096": "Instance reference",
        "8192": "Text dot",
        "16384": "Grip",
        "32768": "Detail",
        "65536": "Hatch",
        "131072": "Morph control",
        "134217728": "Cage",
        "268435456": "Phantom",
        "536870912": "Clipping plane",
        "1073741824": "Extrusion"}
def Convert(geom,prop):
    print("START CONVERT")
    print(geom, type(geom))
    ot = otype["1"]
    try:
        ot = otype[str(rs.ObjectType(geom))]
        try:
            if ot == Curve:
                geom = rs.coercegeometry(geom)
                othertype = str(type(geom))
                print("othertype", othertype)
                if othertype == "<type 'PolyCurve'>":
                    ot = PolyCurve
                    print("POLYCURVE")
        except Exception as e:  print("e",e)
        
        
    except Exception as e:
        print(e)
        #ot = otype[type(geom)]
        othertype = str(type(geom))
        print("othertype" ,othertype)
        if othertype == "<type 'List[object]'>":
            "object is in a List"
            innertype = str(type(geom[0]))
            print("innertype",innertype,)
            #if innertype=="<type 'PolylineCurve'>":
                #print("PCrv")
                #ot = otype["7"]
            #if innertype=="<type 'PolyCurve'>":
                #print("PolyCrv")
                #ot = PolyCurve
            if "Curve" in innertype:
                print("PCrv")
                ot = otype["7"]
            if innertype=="<type 'Point3d'>":
                print("PT3D")
                ot = otype["3"]
        if othertype == "<type 'Plane'>":
            ot = otype["5"]
        if othertype == "<type 'instance'>":
            if geom.type == "text":
                ot = otype["6"]
            if geom.type == "image":
                ot = otype["9"]
    print("OBJECT TYPE ---- ", ot)
    print("GEOM ---- ", type(geom))
    return(ot(geom,prop))
P = map(lambda g,p: Convert(g,p), G,P)

    
if T == 0:
    print(P)
    O = [{"type":"FeatureCollection", "features":P}]
if T == 1:
    O = json.dumps({"type":"FeatureCollection", "features":P})
L = log
# ---------- end python ----------
output = ClusterOutput(python)  # ArchiJSON Output
panel = Panel(python)

# ==== cluster Cluster
crv = ClusterInput()
crv_2 = Curve(crv)
cp = ControlPoints(Curve=crv_2)  # -> Points, Weights, Knots
shift = ShiftList(List=cp.Points, Shift=1, Wrap=True)
pdecon = Deconstruct(Point=cp.Points)  # -> XComponent, YComponent, ZComponent
pdecon_2 = Deconstruct(Point=shift)  # -> XComponent, YComponent, ZComponent
expression = Expression(x=pdecon.XComponent, y=pdecon.YComponent, z=pdecon_2.XComponent, u=pdecon_2.YComponent, Expression="(z-x)*(y+y)")
ma = MassAddition(Input=expression)  # -> Result, PartialResults
expression_2 = Expression(x=ma.Result, Expression="x>0")
unflatten = UnflattenTree(Tree=expression_2, Guide=crv_2)
dispatch = Dispatch(List=crv_2, DispatchPattern=unflatten)  # -> ListA, ListB
flip = FlipCurve(Curve=dispatch.ListA)  # -> Curve, Flag
weave = Weave(Pattern=unflatten, Stream0=dispatch.ListB, Stream1=flip.Curve, NullGaps=False)
crv_3 = Curve(weave)
crv_4 = ClusterOutput(crv_3)

# ==== cluster WRITEFILE: Writes files, also checks for python objects and converts them to text before writing.
activate = ClusterInput()
content = ClusterInput()
filename = ClusterInput()
filepath = ClusterInput()
python = GhPythonScript(CONTENT=content, FILEPATH=filepath, FILENAME=filename, ACTIVATE=activate)  # inputs CONTENT: list
# ---------- python: Python ----------
__author__ = "s-abutler"
__version__ = "2018.09.10"

import rhinoscriptsyntax as rs
from json import dumps
def check(o):
#    print(str(type(o)))
#    return o
    if str(type(o)) == "<type 'dict'>":
        return dumps(o)
    else:
        return o
if ACTIVATE:
    con = list(map(lambda u: check(u), CONTENT))
    conwrite = "\n".join(con)
    dir = FILEPATH+"\\"+FILENAME
    print(dir)
    with open(dir,'w') as f:
        f.write(conwrite)
# ---------- end python ----------
