# Grasshopper definition TitleBlocks.gh (Grasshopper 1.0.8)
# plug-ins: RhinoCodePluginGH, Python

srf = Surface(<surface referenced from the Rhino model>)
crv = Curve([<curve referenced from the Rhino model> x49])
panel = Panel("K:\2023\223002.00\04.0 DOCUMENTS\4.4 Drawings\4.4.5 Rhino\Master Plan\GH\SVG Assets\Cumulus.png")
crv_2 = Curve([<curve referenced from the Rhino model> x14])
text_entity = TextEntity([<text entity referenced from the Rhino model> x10])
text_entity_2 = TextEntity([<text entity referenced from the Rhino model> x3])
text_entity_3 = TextEntity([<text entity referenced from the Rhino model> x14])
text_entity_4 = TextEntity([<text entity referenced from the Rhino model> x3])
bbox = BoundingBox(Content=srf, Plane=PlaneXY(0, 0, 0))  # -> Box, Box_2
topoly = CurveToPolyline(Curve=crv, ToleranceDistance=0.01, ToleranceAngle=0)  # -> flatten(Polyline), Segments
topoly_2 = CurveToPolyline(Curve=crv_2, ToleranceDistance=0.01, ToleranceAngle=0)  # -> flatten(Polyline), Segments
flatten = FlattenTree(Tree=[text_entity, text_entity_3, text_entity_2], Path="{0}")
debox = DeconstructBox(Box=bbox.Box)  # -> Plane, X, Y, Z
long = LongestList(ListA=topoly.Polyline, ListB="{\"class\":\"lines\"}", PaddingMode=2)  # -> ListA, ListB
u_text = UserText(Content=text_entity_4, UserTextMode=1)  # -> Content, Keys, Values
u_text_2 = UserText(Content=flatten, UserTextMode=1)  # -> Content, Keys, Values
text_entity_5 = TextEntity(TextEntity=text_entity_4)  # -> TextEntity, Plane, Text
rectangle = Rectangle(Plane=PlaneXY(0, 0, 0), XSize=debox.X, YSize=debox.Y, Radius=0)  # -> Rectangle, Length
text_entity_6 = TextEntity(TextEntity=flatten)  # -> TextEntity, Plane, Text
wrapper = Geo2Ar(Geometry=topoly_2.Polyline)
wrapper_2 = Geo2Ar(Geometry=long.ListA, Properties=long.ListB)
image_object = ImageObject(R=rectangle.Rectangle, I=panel)
json = CreateJSON(K=u_text.Keys, V=u_text.Values)
text_object = TextObject(P=text_entity_5.Plane, T=text_entity_5.Text)
json_2 = CreateJSON(K=u_text_2.Keys, V=u_text_2.Values)
text_object_2 = TextObject(P=text_entity_6.Plane, T=text_entity_6.Text)
unflatten = UnflattenTree(Tree=json, Guide=text_object)
unflatten_2 = UnflattenTree(Tree=json_2, Guide=text_object_2)
panel_2 = Panel("""*{font-family:"Mark Offc Pro";}
.lines{fill:none;stroke:Black; stroke-width:0.05mm;}
text{font-size:1;}
.text500{font-size:0.5;}
.bold{font-weight:Bold;}""")
wrapper_3 = Geo2Ar(Geometry=image_object)
wrapper_4 = Geo2Ar(Geometry=text_object, Properties=unflatten)
wrapper_5 = Geo2Ar(Geometry=text_object_2, Properties=unflatten_2)
pt = Point(<point referenced from the Rhino model>)
xy = XYPlane(Origin=pt)
flatten_2 = FlattenTree(Tree=[wrapper_5, wrapper_4], Path="{0}")
py3 = Python3Script(O=flatten([wrapper_2, wrapper, flatten_2]))  # -> a; inputs O: list
# ---------- py3: Python ----------
__author__ = "Andrew.Butler"
__version__ = "2021.08.03"

import rhinoscriptsyntax as rs
import json

O = list(map(lambda x: json.loads(x), O))

first = O.pop()

for i in O:
    first["features"] = first["features"]+i["features"]

a = json.dumps(first)
# ---------- end py3 ----------
svg_layout = SVGLayout(P=xy, D="A3 (L)", S="1:1")  # -> Layout, Rectangle
expression = Expression(x="A3 (L)", Expression="Format(\"{0}.svg\", x)")
svg = SVGGenerator(J=py3, L=svg_layout.Layout, C=panel_2)  # -> SVG, LOG
draw = DrawSVG(objects=py3, layout=svg_layout.Layout, css=panel_2)
panel_3 = Panel("K:\2023\223002.00\04.0 DOCUMENTS\4.4 Drawings\4.4.5 Rhino\Master Plan\GH\Stadium Sections")
rel_path = RelativePath(P=panel_3)  # -> FullPath, DirectoryPath, FileName
panel_4 = Panel(draw)
write = WriteFile(R=Toggle(True), C=draw, P=rel_path.DirectoryPath, N=expression)

# ==== cluster DrawSVG: Creates SVG output from ArchiJSON objects. Version 18.09.10
objects = ClusterInput()  # ArchiJSON obects
css = ClusterInput()  # CSS Text
layout = ClusterInput()  # Layout Object
python = PythonScript(OBJECTS=objects, LAYOUT=layout, CSS=css)  # -> SVG; inputs OBJECTS: list, CSS: list
# ---------- python: Python ----------
import rhinoscriptsyntax as rs
import sys
import json
import inspect
import Rhino as r
from string import Template

log = []
#The inputs to this node will be stored as a list in the IN variables.
in1 = OBJECTS
def checkRB(ob):
    if str(type(ob)) == "<type 'str'>":
        return json.loads(ob)
    else:
        return ob
in1 = list(map(lambda u: checkRB(u),in1))
array = []
def featurecollection(o):
    for i in o["features"]:
        fCall = function_mappings[i['geometry']['type']]
        props = {}
        try:
            props = i['properties']
        except:
            pass
        obarray.append(fCall(i['geometry'],props))
def feature(o):
    pass
def point(o,w=True):
    pt = r.Geometry.Point3d(o[0],o[1],o[2])
    remap = r.Geometry.Plane.RemapToPlaneSpace(lPlane, pt)
    rpt = remap[1]
    rpt = [rpt[0]/layout['scale'],-1*rpt[1]/layout['scale'],rpt[2]/layout['scale']]
    pt = str(remap[1][0]/layout['scale'])+","+str(remap[1][1]/layout['scale']*-1)
    if w:
        return pt
    else:
        return rpt


def line(o, props):
    #<polyline points="118.85,155.3 118.85,180.7" class="FOPActual" zindex="10"/>
    pts = map(lambda i: point(i,False), o['coordinates'])
    propString = []
    for k in props:
        print(k)
        print(props[k])
        propString.append(str(k)+'=\"'+str(props[k])+'\"')
    pString = " ".join(propString)
    pline = '<line x1="'+str(pts[0][0])+'" y1="'+str(pts[0][1])+'" x2="'+str(pts[1][0])+'" y2="'+str(pts[1][1])+'" '+pString+'/>'
    #pline = NurbsCurve.ByControlPoints(polarray,1,o['properties']['closed'])
    return pline


def polyline(o, props):
    #<polyline points="118.85,155.3 118.85,180.7" class="FOPActual" zindex="10"/>
    polarray = []
    for p in o['coordinates']:
        pt = point(p)
        polarray.append(pt)
    pts = " ".join(polarray)
    propString = []
    for k in props:

        propString.append(str(k)+'=\"'+str(props[k])+'\"')
    pString = " ".join(propString)
    if o['closed']:
        pline = '<polygon points=\"'+pts+'\" '+pString+'/>'
    else: 
        pline = '<polyline points=\"'+pts+'\" '+pString+'/>'
    #pline = NurbsCurve.ByControlPoints(polarray,1,o['properties']['closed'])
    return pline

def text(o, props):
    #<text class="CLASS" zindex="500" transform="matrix(1 0 0 1 210 148.5)">TEXT</text> 
    propString = []
    for k in props:
        propString.append(str(k)+'=\"'+str(props[k])+'\"')
    pString = " ".join(propString)
    gm = o['coordinates']
    planeorigin = [gm[3],gm[7],gm[11]]
    planeremap = point(planeorigin,False)
    matrix = [str(gm[0]), str(gm[1]),str(gm[4]),str(gm[5]), str(planeremap[0]), str(planeremap[1])]
    matrixtext = " ".join(matrix)
    text = '<text '+pString+' transform="matrix(%s)">%s</text>'%(matrixtext,o['content'])
    print text
    return text
def image(o, props):
    #<image width="132.543857" height="132.543857" transform="matrix(-0.173648 -0.984808 0.984808 -0.173648 28.869475 131.454367)" xlink:href="K:\Computational Design Group\20.png"'"/>
    propString = []
    for k in props:
        propString.append(str(k)+'=\"'+str(props[k])+'\"')
    pString = " ".join(propString)
    gm = o['coordinates']
    yvec = [gm[1]*o['height'],gm[5]*o['height'],gm[9]*o['height']]
    planeorigin = [gm[3]+yvec[0],gm[7]+yvec[1],gm[11]+yvec[2]]
    planeremap = point(planeorigin,False)
    imgPlane = r.Geometry.Plane(r.Geometry.Point3d(gm[3],gm[7],gm[11]),r.Geometry.Vector3d(gm[0],gm[4],gm[8]),r.Geometry.Vector3d(gm[1],gm[5],gm[9]))
    worldPlane = r.Geometry.Plane(r.Geometry.Point3d(0,0,0),r.Geometry.Vector3d(1,0,0),r.Geometry.Vector3d(0,1,0))
    transform = r.Geometry.Transform.PlaneToPlane(lPlane,worldPlane)
    imgPlane.Transform(transform)
    npln = [imgPlane.XAxis.X,imgPlane.YAxis.X,imgPlane.ZAxis.X,imgPlane.OriginX,imgPlane.XAxis.Y,imgPlane.YAxis.Y,imgPlane.ZAxis.Y,imgPlane.OriginY,imgPlane.XAxis.Z,imgPlane.YAxis.Z,imgPlane.ZAxis.Z,imgPlane.OriginZ,0,0,0,1]
    matrix = [str(npln[0]), str(npln[1]),str(npln[4]),str(npln[5]), str(planeremap[0]), str(planeremap[1])]
    matrixtext = " ".join(matrix)
    text = '<image transform="matrix(%s)" width="%s" height="%s" xlink:href="%s"/>'%(matrixtext,o['width']/layout['scale'],o['height']/layout['scale'],o['image'])
    print text
    return text
function_mappings = {
        'FeatureCollection':featurecollection,
        'Feature': feature,
        'polyline': polyline,
        'Spline': polyline,
        'Line': line,
        'Text': text,
        'image':image,
}
obarray = []
layout = json.loads(LAYOUT)
lPlane = layout['plane']
lOrigin = r.Geometry.Point3d(lPlane[0][0],lPlane[0][1],lPlane[0][2])
lXAx = r.Geometry.Vector3d(lPlane[1][0],lPlane[1][1],lPlane[1][2])
lYAx = r.Geometry.Vector3d(lPlane[2][0],lPlane[2][1],lPlane[2][2])
lPlane = r.Geometry.Plane(lOrigin,lXAx,lYAx)
for i in in1:
    if i["type"]:
        fCall = function_mappings[i['type']]
        fCall(i)
    else:
        fCall = function_mappings[i['geometry']['type']]
        obarray.append(fCall(i['geometry']))

#OUT = log
template =Template("""<?xml version="1.0" encoding="utf-8"?>
<!-- Generator: Grasshopper 1.0.0, Redback Plugin. SVG Version: 6.00 Build 0) Made by Andrew Butler at Cox Architecture -->
<!DOCTYPE svg PUBLIC "-//W3C//DTD SVG 1.1//EN" "http://www.w3.org/Graphics/SVG/1.1/DTD/svg11.dtd">
<svg version="1.1" xmlns="http://www.w3.org/2000/svg" xmlns:xlink="http://www.w3.org/1999/xlink" x="0px" y="0px"
width="${width}mm" height="${height}mm" viewBox="0 0 ${width} ${height}" xml:space="preserve">
<style type="text/css">
$css
</style>
$svg
</svg>""")
print(layout)
svgdict = {'svg':"\n".join(obarray),'width':layout['page'][0],'height':layout['page'][1],'css':"\n".join(CSS)}
svgfull = template.substitute(svgdict)
SVG = svgfull.split("\n")
# ---------- end python ----------
svg = ClusterOutput(python)  # SVG output
