# Grasshopper definition HarrisDemo.gh (Grasshopper 1.0.8)

box = Box({Plane=PlaneXY(-108.647541, -128.0327869, 0), X=Domain(0, 289.4262295), Y=Domain(0, 183.0327869), Z=Domain(0, 157.6863849)})
get_geometry = GetGeometry(box, AnnotationTypeFilter=3966, AtLeast=1, AtMost=1, DeleteInput=False, Filter=1074081855, TreeAccess=False)
get_string = GetString(AtLeast=1, AtMost=1, TreeAccess=False)
debrep = DeconstructBrep(Brep=get_geometry)  # -> Faces, Edges, Vertices
context_bake = ContextBake(Content=debrep.Faces)
