# Grasshopper definition Redback SVG - Data - Tables.ghx (Grasshopper 1.0.8)
# plug-ins: treesloth01, Human, Redback.Components

pop2d = Populate2D(
    Region={Plane=PlaneXY(6.059322034, -1.86440678, 0), Size=Domain2(u=-164.0677966..164.0677966, v=-108.1355932..108.1355932)},
    Count=100,
    Seed=1)
lng = ListLength(List=pop2d)
random = Random(Range=Domain(-180, 180), Number=lng, Seed=45362)
xy = XYPlane(Origin=pop2d)
prot = RotatePlane(Plane=xy, Angle=random)
panel = Panel("X:\93_Development\PackageManager\redback\components\ghContent\Icon-Geo2ArchiJSON.png")
X = XSize(Domain(-5, 5))
rectangle = Rectangle(Plane=prot, XSize=X, YSize=X, Radius=0)  # -> Rectangle, Length
item = ListItem(List=rectangle.Rectangle, Index=0, Wrap=True)
text_object = IronPython2Script(PL=prot, TE="A")  # -> TO
# ---------- text_object: IronPython ----------
#### Constants ####
global __var__
__var__ = {
	"guid":"983d9511-87a8-479f-a688-dcef879bd7dc",
	
	"name":"Text Object",
	"nickname":"Text Object",
	"description":"Creates a text object that can be parsed by archJSON",
	"icon": "ghContent\\Icon-TextObject.png",

	"tabname":"Redback",
	"section":"ArchJSON",

	"inputs":[
		{"name":"Plane",		"nickname":"P",	"objectAccess":"item",	"description":"", },
		{"name":"Text",			"nickname":"T",	"objectAccess":"item",	"description":"", },
	],
	"outputs":[
		{"name":"Text Object",		"nickname":"O",	"description":"archJSON Text Object"},
	]
}
__author__ = "Andrew.Butler"
__version__ = "2024.02.02"
#### Constants ####
import Rhino as r
import rhinoscriptsyntax as rs
import json
P = PL
T = TE
class archJSONText:
    def __init__(self, location, content):
        self.location = location
        self.content = str(content)
    def __str__(self):
        return ("<ArchJSON String>: "+self.content)

TO = archJSONText(P,T)
# ---------- end text_object ----------
charseq = CharSequence(Count=20, CharPool="ABCDEFGHIJKLMNOPQRSTUVWXYZ", Format="{0}")
image_object = IronPython2Script(RE=item, IP=panel)  # -> IO; inputs RE: Curve, IP: String
# ---------- image_object: IronPython ----------
#### Constants ####
global __var__
__var__ = {
	"guid":"53cc467c-f4e5-4782-ac66-a8ce3084f988",
	
	"name":"Image Object",
	"nickname":"Image Object",
	"description":"Creates an image object that can be parsed by archJSON",
	"icon": "ghContent\\Icon-ImageObject.png",

	"tabname":"Redback",
	"section":"ArchJSON",

	"inputs":[
		{"name":"Rectangle",		"nickname":"R",	"objectAccess":"item",	"description":"", },
		{"name":"Image",			"nickname":"I",	"objectAccess":"item",	"description":"", },
	],
	"outputs":[
		{"name":"Image Object",		"nickname":"O",	"description":"archJSON Text Object"},
	]
}
__author__ = "Andrew.Butler"
__version__ = "2024.02.02"

R = RE
I = IP

import rhinoscriptsyntax as rs
import Rhino as r
import os



class archJSONImage:
    def __init__(self, rec, img):
        #print(rec)
        p = rs.CurvePoints(rec)
        self.location = rs.PlaneFromPoints(p[0],p[1],p[2])
        self.bounds = rs.BoundingBox(rec,self.location,False)
        self.width = self.bounds[2][0]
        self.height = self.bounds[2][1]
        self.img = str(img)
        self.fileDirectory, self.fileName = os.path.split(self.img)
    def __str__(self):
        return "<ArchJSON Image>: %s"%(self.fileName)

IO = archJSONImage(R,I)
# ---------- end image_object ----------
xy_2 = XYPlane(Origin=Point(0, 0, 0))
partition = PartitionList(List=charseq, Size=4)
partition_2 = PartitionList(List=partition, Size=4)  # -> simplify(Chunks)
path = FilePath("C:\Users\Andrew.Butler\OneDrive - Cox Architecture Pty Ltd\Transfer\250827 CTR RDS Data\CTR RDS Data.xlsx")
panel_2 = Panel("""class
id
test""")
panel_3 = Panel("""class1
123
test""")
xy_3 = XYPlane(Origin=Point(0, 0, 0))
panel_4 = Panel("{}")
circle = Circle([{Plane=Plane(origin=(-2.330508475, -0.9322033898, 0), x=(0.4472135955, 0.894427191, 0), y=(-0.894427191, 0.4472135955, 0)), Radius=12.50682089}, {Plane=Plane(origin=(14.44915254, 16.77966102, 0), x=(0.5144957554, 0.8574929257, 0), y=(-0.8574929257, 0.5144957554, 0)), Radius=10.87126624}, {Plane=Plane(origin=(30.29661017, 33.55932203, 0), x=(0.8192319205, 0.5734623444, 0), y=(-0.5734623444, 0.8192319205, 0)), Radius=11.37899252}, {Plane=Plane(origin=(46.1440678, 45.6779661, 0), x=(0.6459422415, 0.7633862854, 0), y=(-0.7633862854, 0.6459422415, 0)), Radius=15.8748517}, {Plane=Plane(origin=(68.51694915, 68.98305085, 0), x=(0.7525766947, 0.6585046079, 0), y=(-0.6585046079, 0.7525766947, 0)), Radius=9.909457961}, {Plane=Plane(origin=(85.29661017, 88.55932203, 0), x=(0.7071067812, 0.7071067812, 0), y=(-0.7071067812, 0.7071067812, 0)), Radius=7.910008061}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])
import_excel = Python3Script(FP=path)  # -> out, S, D
# ---------- import_excel: Python ----------
#r: openpyxl, pywin32

from openpyxl import Workbook, load_workbook

import shutil
from win32com import client
import json
import copy

D = []
S = []
try:
    workbook = load_workbook(filename=FP, read_only=True, data_only=True)
    #print(dir(workbook))
    #print(workbook.sheetnames)
    S = list(workbook.sheetnames)
    for sheetName in workbook.sheetnames:
        sheet = workbook[sheetName]
        data = list(sheet.values)
        data = list(map(lambda i: list(i), data))
        #print(data)
        data = json.dumps(data)
        D.append(data)
        #for row in sheet.values:
            #print(row)
        #     for cell in row:
        #         print(sheetName, cell)
    try:    workbook.close()
    except: pass

    
except Exception as e:
    if str(type(e)) == "<class 'PermissionError'>":
        xlApp = client.GetObject(None, "Excel.Application")
        workbook = xlApp.Workbooks.Open(FP)

        sheets = [sheet.Name for sheet in workbook.Sheets]

        S = sheets
        for sheetName in sheets:
            sheet =  workbook.Sheets(sheetName)
            data = list(sheet.UsedRange.Value)
            data = data = list(map(lambda i: list(i), data))
            data = json.dumps(data)
            D.append(data)
# ---------- end import_excel ----------
# \\persrv01\projects\~2023\623093.00 King Salman Exhibition Center\12. GRAPHICS\0 In Process Reports and Presentations\2024-06-04_Draft Report\02 Links\MICE\Diagrams
xy_4 = XYPlane(Origin=Point(0, 0, 0))
tstat = TreeStatistics(Tree=partition)  # -> Paths, Length, Count
create_json = IronPython2Script(K=panel_2, V=panel_3)  # -> JO; inputs K: list, V: list
# ---------- create_json: IronPython ----------
#! python 2
#### Constants ####
global __var__
__var__ = {
	"guid":"0e4b6507-e8be-483f-8d55-21c261e5bbcb",
	
	"name":"Create JSON",
	"nickname":"JSON",
	"description":"Creates a JSON string from a list of matching keys and values",
	"icon": "ghContent\\Icon-MakeJSON.png",

	"tabname":"Redback",
	"section":"JSON",

	"inputs":[
		{"name":"Keys",		"nickname":"K",	"objectAccess":"list",	"description":"List of Keys", },
		{"name":"Values",	"nickname":"V",	"objectAccess":"list",	"description":"List of Values", },
	],
	"outputs":[
		{"name":"JSON",		"nickname":"J",	"description":"JSON Output"},
	]
}
__author__ = "Andrew.Butler"
__version__ = "2024.02.02"
		
import json

if not K:
	K = []

if not V:
	V = []

values = [None]*len(K)
for i in range(len(V)):
	values[i] = V[i]

def convertObs(ob):
	try:
		ob = json.loads(ob)
		return ob
	except:
		return ob

values = list(map(lambda x: convertObs(x),values))



outdict = dict(zip(K,values))
JO = json.dumps(outdict)
# ---------- end create_json ----------
series = Series(Start=0, Step=1, Count=32)
geo2arch = IronPython2Script(GE=image_object, PR="{}")  # -> JO; inputs GE: list, PR: list of String
# ---------- geo2arch: IronPython ----------
#### Constants ####
global __var__
__var__ = {
	"guid":"d276cba6-c7bd-4860-8d09-1c6b23a620d4",
	
	"name":"Geo2Ar",
	"nickname":"Wrapper",
	"description":"Wraps and joins text with selected data characters",
	"icon": "ghContent\\Icon-Geo2ArchiJSON.png",

	"tabname":"Redback",
	"section":"ArchJSON",

	"inputs":[
		{"name":"Geometry",			"nickname":"G",	"objectAccess":"list", "objectType":"GenericObject"	,"description":"List of Geometry to convert", },
		{"name":"Properties",		"nickname":"P",	"objectAccess":"list", "objectType":"String"		,"description":"List of Properties per geometry", },
	],
	"outputs":[
		{"name":"JSON",	"nickname":"J",	"description":"ArchiJSON representing the geometry"},
		#{"name":"CHECKGEOM", "nickname":"CHECKGEOM", "description":"ArchiJSON representing the geometry"},
		#{"name":"LOG", "nickname":"LOG", "description":"ArchiJSON representing the geometry"}
	]
}
__author__ = "Andrew.Butler"
__version__ = "2024.02.02"
import rhinoscriptsyntax as rs
import Rhino as rh
import scriptcontext as sc
import Grasshopper as g
import ghpythonlib as ghp
import json
#LOG = []
CHECKGEOM = []
#document = sc.doc
#sc.doc = rh.RhinoDoc.ActiveDoc
#sc.doc = ghdoc


def Point(geom,prop=None):
	pt = rs.coerce3dpoint(geom)
	pt = [pt[0],pt[1],pt[2]]
	if prop:
		pt = {"type":"Feature","geometry":{'coordinates':pt, 'type': 'Point'}}
		pt['properties'] = json.loads(prop)
		return pt
	else:
		return pt
def convertToRPT (geom):
	pt = rh.Geometry.Point3d(geom[0],geom[1],geom[2])
	return pt
def PointCollection(geom,prop=None):
	t = geom
	pts = map(lambda g: Point(g), t)
	crv = {"type":"Feature","geometry":{'coordinates':pts, 'type': 'PointCollection'}}
	if prop:
		crv['properties'] = json.loads(prop)
	#print(crv)
	return crv
	
def CurveCollection(geom,prop=None):
	t = geom
	#print('geom', geom)
	crvs = map(lambda g: Curve(g), t)
	#print("CURVE COLLECTION--- ", crvs)
	crvCol = {"type":"Feature","geometry":{'coordinates':crvs, 'type': 'CurveCollection'}}
	if prop:
		crvCol['properties'] = json.loads(prop)
	return crvCol
	
#    t = rs.CurvePoints(crvs)
#    tc = rs.ClosedCurveOrientation(crvs)
#    if tc == 0: tc = False
#    else: tc = True
#    tdeg = rs.CurveDegree(crvs)
#    tcPo = len(t)
#    #print("tdeg: ",tdeg)
#    #print("tcPo: ",tcPo)
#    pts = map(lambda g: Point(g), t)
#    crv = {"type":"Feature","geometry":{'coordinates':pts, 'type': 'CurveCollection','closed':tc}}
#    if tdeg == 1 and tc: del crv['geometry']['coordinates'][-1]
#    if tdeg == 1 and tcPo == 2  : crv['geometry']['type']='Line'
#    if tdeg >= 2                : crv['geometry']['type']='Spline'
#    if tdeg == 2 and tcPo == 3  :
#        #print("3ARC")
#        crv['geometry']['type']='Arc'
#    if tdeg == 2 and tcPo == 5  :
#        #print("5ARC")
#        arc = rs.AddArc3Pt(pts[0],pts[4],pts[2])
#        pt0 = convertToRPT(pts[0])
#        pt2 = convertToRPT(pts[2])
#        pt4 = convertToRPT(pts[4])
#        arc = rh.Geometry.Arc(startPoint = pt0, pointOnInterior = pt2, endPoint = pt4)
#        crv['geometry']['type']='Arc'
#        #print(crv['geometry']['coordinates'])
#        del crv['geometry']['coordinates'][3]
#        del crv['geometry']['coordinates'][1]
#    if prop:
#        crv['properties'] = json.loads(prop)
#    #print(crvcollection)
#    return crvcollection

def Plane(geom,prop=None):
	pln = {"type":"Feature","geometry":{'coordinates':[geom.XAxis.X,geom.YAxis.X,geom.ZAxis.X,geom.OriginX,geom.XAxis.Y,geom.YAxis.Y,geom.ZAxis.Y,geom.OriginY,geom.XAxis.Z,geom.YAxis.Z,geom.ZAxis.Z,geom.OriginZ,0,0,0,1], 'type': 'Xform'}}
	if prop:
		pln['properties'] = json.loads(prop)
	return pln
def Text(geom,prop=None):
	#print("TEXT")
	text = Plane(geom.location,prop)
	text['geometry']['type']="Text"
	text['geometry']['content']=geom.content
	return text
def Image(geom,prop=None):
	#print("Image")
	##print(dir(geom))
	image = Plane(geom.location,prop)
	image['geometry']['type']="Image"
	image['geometry']['image']=geom.img
	image['geometry']['width']=geom.width
	image['geometry']['height']=geom.height
	return image
def Curve(geom,prop=None):
	#print("Curve def")
	#print(geom, type(geom))
	if type(geom).__name__ == "Line":
		geom = ghp.components.RebuildCurve(geom,1,3,False)
	if type(geom).__name__ == "Circle":
		geom = geom.ToNurbsCurve()
	try:
		t = rs.CurvePoints(geom)
	except:
		t = []
	
	#print(t)
	#check if curve closed
	tc = rs.ClosedCurveOrientation(geom)
	if tc == 0: tc = False
	else: tc = True
	##print(dir(geom))
	#split = rs.ExplodeCurves(geom, True)
	##print(rs.CurveDegree(geom))
	#split = ghp.components.Explode(,True)
	##print("Split",split)
	tdeg = rs.CurveDegree(geom)
	tcPo = len(t)
	isArc = rs.IsArc(geom)
	isCirc = rs.IsCircle(geom)
	
	##print("isCirc: ",isCirc)
	pts = map(lambda g: Point(g), t) #object to points
	#print(pts)
	crv = {"type":"Feature","geometry":{'coordinates':pts, 'type': 'Spline','closed':tc, "deg":tdeg}}
	#print("tdeg: "+str(tdeg))
	#print("tcPo: "+str(tcPo))
	#print(crv)
	#print("isArc",isArc)
	#print("----------------------------------")
	if tdeg == 1 and tc  : del crv['geometry']['coordinates'][-1]
	if tdeg == 1 and tcPo == 2  : crv['geometry']['type']='Line'
	if tdeg >= 2                : crv['geometry']['type']='Spline'
	if tdeg == 2 and tcPo == 3  :
		#print("3ARC")
		crv['geometry']['deg']=tdeg
		# crv['geometry']['type']='Arc'
	#if tdeg == 2 and tcPo == 5  :
		#arc = rs.AddArc3Pt(pts[0],pts[4],pts[2])
		#pt0 = convertToRPT(pts[0])
		#pt2 = convertToRPT(pts[2])
		#pt4 = convertToRPT(pts[4])
		#arc = rh.Geometry.Arc(startPoint = pt0, pointOnInterior = pt2, endPoint = pt4)
		
		##print(crv['geometry']['coordinates'])
		#del crv['geometry']['coordinates'][3]
		#del crv['geometry']['coordinates'][1]
	if isArc:
		cpt = rs.ArcCenterPoint(geom)
		testCrvPts = rs.CurvePoints(geom)
		testCrvPts.append(testCrvPts[0])
		testCrv = rs.AddPolyline(testCrvPts)
		try:    isBig = bool(rs.PointInPlanarClosedCurve(cpt, testCrv))
		except: isBig = False
		cpt = Point(cpt)
		crd = rs.ArcRadius(geom)
		cang = rs.ArcAngle(geom)
		##print("cang",cang)
		crv['geometry']['type']='Arc'
		crv['geometry']['radius'] = crd
		crv['geometry']['isBig'] = isBig
		crv['geometry']['center'] = cpt
		crv['geometry']['angle'] = cang
	if isCirc:
		cpt = Point(rs.CircleCenterPoint(geom))
		crd = rs.CircleRadius(geom)
		crv['geometry']['type']='Circle'
		crv['geometry']['coordinates'] = cpt
		crv['geometry']['radius'] = crd
	if prop:
		crv['properties'] = json.loads(prop)
	#if not isArc and crv["geometry"]['type'] == "Arc":
		#crv['geometry']['type']='Spline'
#    if tdeg >= 2:
	#print (crv)
	return crv
def PolyCurve(geom, prop=None):
	##print(geom)
	
	#print("PolyCurve def")
	#print(geom, type(geom))
	if str(type(geom)) != "<type 'List[object]'>":
		geom = [geom]
	polyCurveParts = []
	#for d in dir(geom):
	#    #print(d)

	for part in geom:
		#print(part)
		tc = rs.ClosedCurveOrientation(part)
		part = part.Explode()
		curves = list(map(lambda x: Curve(x, {})["geometry"], part))
		polycrvPart = {"type":"Feature","geometry":{'coordinates':curves, 'type': 'PolyCurvePart','closed':tc}}
		polyCurveParts.append(polycrvPart)
	polycrv = {"type":"Feature","geometry":{'coordinates':polyCurveParts, 'type': 'PolyCurve'}}
	if prop:
		polycrv['properties'] = json.loads(prop)
	return polycrv

	return crvCol
otype = {
		"PolyCurve": Curve,
		"Line": Curve,
		"LineCurve": Curve,
		"NurbsCurve": Curve,
		"ArcCurve": Curve,
		"Circle": Curve,
		"PolylineCurve": Curve,
		"0": "Unknown object",
		"1": Point,
		"2": "PointCloud",
		"3": PointCollection,
		"4": Curve,
		"5": Plane,
		"6": Text,
		"7": CurveCollection,
		"8": "Surface",
		"9": Image,
		"16": "Polysurface",
		"32": "Mesh",
		"256": "Light",
		"512": "Annotation",
		"4096": "Instance reference",
		"8192": "Text dot",
		"16384": "Grip",
		"32768": "Detail",
		"65536": "Hatch",
		"131072": "Morph control",
		"134217728": "Cage",
		"268435456": "Phantom",
		"536870912": "Clipping plane",
		"1073741824": "Extrusion"}
def Convert(geom,prop):
	#print("START CONVERT")
	#print("SC",geom, type(geom))
	ot = otype["1"]
	try:
		#print(type(geom))
		#print("-"*100)
		ot = otype[str(type(geom).__name__)]
		try:
			if ot.__name__ == "Curve":
				try:
					ngeom = rs.coercegeometry(geom)
					ngeom = ghp.components.Explode(geom, True)
					ngeom = ghp.components.JoinCurves(geom["segments"],True)
					geom = ngeom
				except Exception as e:
					pass
				#print("after explode",geom)
				othertype = str(type(geom))
				##print("othertype", othertype)
				if othertype == "<type 'PolyCurve'>":
					ot = PolyCurve
					##print("POLYCURVE")
				if othertype == "<type 'Line'>":
					ot = Curve
		except Exception as e:
			#print("e",e)
			pass
		
		
	except Exception as e:
		#print("1:", e)
		#ot = otype[type(geom)]
		othertype = str(type(geom))
		print("othertype" ,othertype)
		if othertype == "<type 'List[object]'>":
			"object is in a List"
			innertype = str(type(geom[0]))
			#print("innertype",innertype,)
			#if innertype=="<type 'PolylineCurve'>":
				##print("PCrv")
				#ot = otype["7"]
			#if innertype=="<type 'PolyCurve'>":
				##print("PolyCrv")
				#ot = PolyCurve
			if "Curve" in innertype:
				#print("PCrv")
				ot = otype["7"]
			if innertype=="<type 'Point3d'>":
				#print("PT3D")
				ot = otype["3"]
		if othertype == "<type 'Plane'>":
			ot = otype["5"]
		othertype = str(geom.__class__.__name__)
		#print("othertype" ,othertype)
		if othertype == "archJSONText":
			ot = otype["6"]
		if othertype == "archJSONImage":
			ot = otype["9"]
		if othertype == "<type 'instance'>":
			if geom.type == "text":
				ot = otype["6"]
			if geom.type == "image":
				ot = otype["9"]
	#print("OBJECT TYPE ---- ", ot)
	#print("GEOM ---- ", geom,type(geom))
	return(ot(geom,prop)
		)

if not PR:
    PR = ["{}"]
fillP = ["{}"]*len(GE)
for i, prop in enumerate(PR):
	fillP[i] = prop


PR = list(PR)

for index, i in enumerate(PR):
    try:
        json.loads(i)
    except:
        PR[index] = json.dumps({"class":i})

fullProps = [PR[-1]]*len(GE)

for i in range(len(PR)):
    fullProps[i] = PR[i]



features = list(map(lambda g,p: Convert(g,p), GE,fullProps))

	
JO = json.dumps({"type":"FeatureCollection", "features":features})

#class dictionaryObject(dict):
	#pass
	#def __str__(self):
		#return "<d>"

#dictTest = dictionaryObject({"hello":"world"})

#print(dir(dictTest))
#print(dictTest.__str__)

#DO = dictTest
# ---------- end geo2arch ----------
svg_layout = Python3Script(P=xy_3, D="A4", S="1:1", L=True)  # -> out, L, R; inputs P: Plane
# ---------- svg_layout: Python ----------
#### Constants ####
import System
import Rhino
import Grasshopper

import rhinoscriptsyntax as rs

class MyComponent(Grasshopper.Kernel.GH_ScriptInstance):
    def RunScript(self, P: Rhino.Geometry.Plane, D, S, L):
        global __var__
        __var__ = {
        	"guid":"bb0530c2-d04f-4c52-8fb1-7f81d876a193",
        	
        	"name":"SVG Layout",
        	"nickname":"SVG Layout",
        	"description":"Creates a SVG layout dictionary",
        	"icon": "ghContent\\Icon-SVGLayout.png",
        
        	"tabname":"Redback",
        	"section":"SVG",
        
        	"inputs":[
        		{"name":"Plane",		"nickname":"P",	"objectAccess":"item",	"description":"", },
        		{"name":"Dimensions",	"nickname":"D",	"objectAccess":"item",	"description":"", },
        		{"name":"Scale",		"nickname":"S",	"objectAccess":"item",	"description":"", },
        		{"name":"Location",		"nickname":"L",	"objectAccess":"item",	"description":"", },
        	],
        	"outputs":[
        		{"name":"Layout",		"nickname":"L",	"description":"JSON Layout"},
        		{"name":"Rectangle",	"nickname":"R",	"description":"Page Border"},
        	]
        }
        __author__ = "Andrew.Butler"
        __version__ = "2024.02.02"
        #### Constants ####
        
        import json
        import scriptcontext as sc
        import rhinoscriptsyntax as rs
        import Rhino
        
        
        
        millimeters = sc.doc.ModelUnitSystem.Millimeters
        currentUnits = sc.doc.ModelUnitSystem
        
        
        #### This assumes base units as millimeters
        
        unitRatio = Rhino.RhinoMath.UnitScale(millimeters, currentUnits)
        
        pageLUT = {
        "A5":		(210,148),
        "A5 (L)":	(210,148),
        "A5 (P)":	(148,210),
        "A4":		(297,210),
        "A4 (L)":	(297,210),
        "A4 (P)":	(210,297),
        "A3":		(420,297),
        "A3 (L)":	(420,297),
        "A3 (P)":	(297,420),
        "A2":		(594,420),
        "A2 (L)":	(594,420),
        "A2 (P)":	(420,594),
        "A1":		(841,594),
        "A1 (L)":	(841,594),
        "A1 (P)":	(594,841),
        "A0":		(1189,841),
        "A0 (L)":	(1189,841),
        "A0 (P)":	(841,1189),
        }
        
        plane = P
        location = L
        scale = S
        
        DIM = D
        if not DIM:
        	DIM = "A3 (L)"
        if location == None:
        	location = True
        if scale == None:
        	scale = "1:1"
        
        pageScale = float(scale.split(":")[1])/float(scale.split(":")[0])
        
        if DIM in pageLUT:
        	width, height = pageLUT[DIM]
        elif DIM.replace(",","").replace(".","").isdigit():
        	width, height = tuple(DIM.split(","))
        
        
        combScale = unitRatio*pageScale
        swidth = float(width)*combScale
        sheight = float(height)*combScale
        
        print(width, height)
        
        
        #print(dir(plane))
        #print(plane.PointAt.__doc__)
        print("location", location)
        if P:
            if location:
        	    positionedPlaneOrig = plane.PointAt(swidth/-2.0,sheight/-2.0,0)
        	    svgPlaneOrig = plane.PointAt(swidth/-2.0,sheight/2.0,0)
            else:
        	    positionedPlaneOrig = plane.PointAt(0,-sheight,0)
        	    svgPlaneOrig = plane.PointAt(0,0,0)
            print(positionedPlaneOrig)
            plane.Origin = positionedPlaneOrig
            #print(rs.AddRectangle.__doc__)
            #R = rs.AddRectangle(plane,swidth,sheight )
            
            R = Rhino.Geometry.Rectangle3d(plane,swidth,sheight)
            #print(R,dir(R))
            plane.Origin = svgPlaneOrig
            p = plane
            L = json.dumps({"plane":[[p.Origin[0],p.Origin[1],p.Origin[2]],[p.XAxis[0],p.XAxis[1],p.XAxis[2]],[p.YAxis[0],p.YAxis[1],p.YAxis[2]]], "page":[width,height], "scale":combScale})
            

        return L, R

    # Preview overrides 
    @property
    def ClippingBox(self):
        return Rhino.Geometry.BoundingBox.Empty

    def DrawViewportWires(self, args):
        pass

    def DrawViewportMeshes(self, args):
        pass
# ---------- end svg_layout ----------
item_2 = ListItem(List=import_excel.D, Index=0, Wrap=True)
svg_layout_2 = IronPython2Script(P=xy_3, D="A4", S="1:1", L=Toggle(True))  # -> out, L, R; inputs P: Plane, D: String, S: String
# ---------- svg_layout_2: IronPython ----------
#### Constants ####
import System
import Rhino
import Grasshopper

import rhinoscriptsyntax as rs

class MyComponent(Grasshopper.Kernel.GH_ScriptInstance):
    def RunScript(self, P, D, S, L):
        global __var__
        __var__ = {
        	"guid":"bb0530c2-d04f-4c52-8fb1-7f81d876a193",
        	
        	"name":"SVG Layout",
        	"nickname":"SVG Layout",
        	"description":"Creates a SVG layout dictionary",
        	"icon": "ghContent\\Icon-SVGLayout.png",
        
        	"tabname":"Redback",
        	"section":"SVG",
        
        	"inputs":[
        		{"name":"Plane",		"nickname":"P",	"objectAccess":"item",	"description":"", },
        		{"name":"Dimensions",	"nickname":"D",	"objectAccess":"item",	"description":"", },
        		{"name":"Scale",		"nickname":"S",	"objectAccess":"item",	"description":"", },
        		{"name":"Location",		"nickname":"L",	"objectAccess":"item",	"description":"", },
        	],
        	"outputs":[
        		{"name":"Layout",		"nickname":"L",	"description":"JSON Layout"},
        		{"name":"Rectangle",	"nickname":"R",	"description":"Page Border"},
        	]
        }
        __author__ = "Andrew.Butler"
        __version__ = "2024.02.02"
        #### Constants ####
        
        import json
        import scriptcontext as sc
        import rhinoscriptsyntax as rs
        import Rhino
        
        
        
        millimeters = sc.doc.ModelUnitSystem.Millimeters
        currentUnits = sc.doc.ModelUnitSystem
        
        
        #### This assumes base units as millimeters
        
        unitRatio = Rhino.RhinoMath.UnitScale(millimeters, currentUnits)
        
        pageLUT = {
        "A5":		(210,148),
        "A5 (L)":	(210,148),
        "A5 (P)":	(148,210),
        "A4":		(297,210),
        "A4 (L)":	(297,210),
        "A4 (P)":	(210,297),
        "A3":		(420,297),
        "A3 (L)":	(420,297),
        "A3 (P)":	(297,420),
        "A2":		(594,420),
        "A2 (L)":	(594,420),
        "A2 (P)":	(420,594),
        "A1":		(841,594),
        "A1 (L)":	(841,594),
        "A1 (P)":	(594,841),
        "A0":		(1189,841),
        "A0 (L)":	(1189,841),
        "A0 (P)":	(841,1189),
        }
        
        plane = P
        location = L
        scale = S
        
        DIM = D
        if not DIM:
        	DIM = "A3 (L)"
        if location == None:
        	location = True
        if scale == None:
        	scale = "1:1"
        
        pageScale = float(scale.split(":")[1])/float(scale.split(":")[0])
        
        if DIM in pageLUT:
        	width, height = pageLUT[DIM]
        elif DIM.replace(",","").replace(".","").isdigit():
        	width, height = tuple(DIM.split(","))
        
        
        combScale = unitRatio*pageScale
        swidth = float(width)*combScale
        sheight = float(height)*combScale
        
        print(width, height)
        
        
        #print(dir(plane))
        #print(plane.PointAt.__doc__)
        print("location", location)
        if P:
            if location:
        	    positionedPlaneOrig = plane.PointAt(swidth/-2.0,sheight/-2.0,0)
        	    svgPlaneOrig = plane.PointAt(swidth/-2.0,sheight/2.0,0)
            else:
        	    positionedPlaneOrig = plane.PointAt(0,-sheight,0)
        	    svgPlaneOrig = plane.PointAt(0,0,0)
            print(positionedPlaneOrig)
            plane.Origin = positionedPlaneOrig
            #print(rs.AddRectangle.__doc__)
            #R = rs.AddRectangle(plane,swidth,sheight )
            
            R = Rhino.Geometry.Rectangle3d(plane,swidth,sheight).ToPolyline()
            #print(R,dir(R))
            plane.Origin = svgPlaneOrig
            p = plane
            L = json.dumps({"plane":[[p.Origin[0],p.Origin[1],p.Origin[2]],[p.XAxis[0],p.XAxis[1],p.XAxis[2]],[p.YAxis[0],p.YAxis[1],p.YAxis[2]]], "page":[width,height], "scale":combScale})
            

        return L, R

    # Preview overrides 
    @property
    def ClippingBox(self):
        return Rhino.Geometry.BoundingBox.Empty

    def DrawViewportWires(self, args= Grasshopper.Kernel.IGH_PreviewArgs):
        args.Viewport
        pass

    def DrawViewportMeshes(self, args):
        pass

    # Solve overrides 
    def BeforeRunScript(self):
        pass

    def AfterRunScript(self):
        pass
# ---------- end svg_layout_2 ----------
lng_2 = ListLength(List=tstat.Paths)
encode_integer = IronPython2Script(N=series, A="ABCDEFGHIJKLMNOPQRSTUVWXYZ0123456789-:+/", L=Slider(3, range=0..10))  # -> out, E; inputs N: Int32, A: list of String, L: Int32
#   port N: Number to encode
#   port A: Alphabet to use for encription
# ---------- encode_integer: IronPython ----------
def base36encode(number, alphabet='ABCDEFGHIJKLMNOPQRSTUVWXYZ0123456789-:+/', string_length=5):
    """Converts an integer to a base36 string."""
    if not isinstance(number, int):
        raise TypeError('number must be an integer')
 
    base36 = ''
    sign = ''
 
    if number < 0:
        sign = '-'
        number = -number
 
    if 0 <= number < len(alphabet):
        val = ['0']*string_length+list(alphabet[number])
        return sign + "".join(val[-string_length:])
 
    while number != 0:
        number, i = divmod(number, len(alphabet))
        base36 = alphabet[i] + base36
 
    val = ['0']*string_length+list(base36)
    
    return sign + "".join(val[-string_length:])
 
def base36decode(number):
    return int(number, 36)


context = {"number":N}
A = "".join(A)
if A: context["alphabet"] = A
if L: context["string_length"] = L
E = base36encode(**context)
# ---------- end encode_integer ----------
json_keys = IronPython2Script(JO=create_json)  # -> K; inputs JO: String
# ---------- json_keys: IronPython ----------
#### Constants ####
global __var__
__var__ = {
	"guid":"c2790a28-9f47-43da-a0c7-538cae087e63",
	
	"name":"JSON Keys",
	"nickname":"JSON Keys",
	"description":"Returns all surface keys from a JSON string",
	"icon": "ghContent\\Icon-JSONKeys.png",

	"tabname":"Redback",
	"section":"JSON",

	"inputs":[
		{"name":"JSON",			"nickname":"J",	"objectAccess":"item",	"description":"JSON object to read", },
	],
	"outputs":[
		{"name":"Keys",	"nickname":"K",	"description":"Surface level keys."}
	]
}
__author__ = "Andrew.Butler"
__version__ = "2024.02.02"
			   
import json

if not JO:
	JO = "{}"
K = list(json.loads(JO))
# ---------- end json_keys ----------
merge = Merge(Data1=create_json, Data2=create_json)
charseq_2 = CharSequence(Count=lng_2, CharPool="ABCDEFGHIJKLMNOPQRSTUVWXYZ", Format="{0}")
list2tree = IronPython2Script(L=item_2)  # -> T; inputs L: tree
# ---------- list2tree: IronPython ----------
import Grasshopper as gh
import sys
import json
import ghpythonlib.treehelpers as th

def TreeToPythonList(input, retrieve_base = lambda x: x[0]):
    """Returns a list representation of a Grasshopper DataTree"""
    def extend_at(path, index, simple_input, rest_list):
        #print("INPUT -- ", simple_input)
        #print("REST LIST ---", rest_list)
        target = path[index]
        #print("TARGET --", target)
        #print("INDEX  --", index)
        #try:
            #simple_input = [int("%.2f") %num for num in list(simple_input)] #round ints to 2dec
        #except:
            #simple_input = list(simple_input)
        sortList = []
        for value in list(simple_input):
            #print("VALUE:  ", value, "TPYE:  ", type(value))
            if type(value) == type(""):
                try: 
                    value = json.loads(str(value))
                except:
                    pass
                sortList.append(value)
                #print(value)
            #### TO BE FIXED? - FLOATS ####
            elif type(value) == type(0.0):
                try:
                    value = "{:.2f}".format(value)
                    #print ("FLOAT", value)
                except:
                    pass
                sortList.append(value)
            else:
                sortList.append(value)
                                
        #print(sortList)
        if len(rest_list) <= target: #make empty space for new value
            #print("-MAKING NEW SPOT-", rest_list)
            rest_list.extend([None]*(target-len(rest_list)+1))
        elif not (isinstance(i, list) for i in rest_list):
            #print("EXTENDED LIST -- ", rest_list)
            pass
        if index == path.Length - 1:
            try:
                if rest_list[target] != None: #if trying to replace value
                    #print(">><<<")
                    rest_list.insert(target, sortList)
                else:
                    #print("replace", rest_list[target], sortList)
                    rest_list[target] = sortList
                    #print("new -- ", rest_list)
            except:
                rest_list[target] = sortList
        else:
            if rest_list[target] is None: 
                rest_list[target] = []
            #print ("---- LOOOPPP ----", type(rest_list))
            extend_at(path, index+1, sortList, rest_list[target])

    all = []
    #print(input)
    for i in range(input.BranchCount):

        path = input.Path(i)
        
        #print(list(path.Indices))
        #print(dir(path))

        extend_at(path, 0, input.Branch(path), all)
    
    #sublists = [my_list[i:i+j] for i,j in zip(range(0,len(my_list)), [2,3,4,1])] 
    #print(all)
    return all
def flatten_deep(nested_list):
    """
    Recursively flattens an arbitrarily nested list.

    Args:
        nested_list: The list to be flattened.

    Returns:
        A new list containing all elements from the nested list, flattened.
    """
    flat_list = []
    for item in nested_list:
        if isinstance(item, list):
            # If the item is a list, recursively flatten it and extend the result
            flat_list.extend(flatten_deep(item))
        else:
            # If the item is not a list, append it to the flat list
            flat_list.append(item)
    return flat_list

def deepConvertDictToJSON(ob):
    if type(ob) == type([]):
        returnOb = list(map(lambda i: deepConvertDictToJSON(i), ob))
        return returnOb
    if type(ob) == type({}):
        return json.dumps(ob)
    return ob
        
def deep_simplify(lst):
    if isinstance(lst, list):
        # Recursively simplify each element
        simplified = [deep_simplify(item) for item in lst]
        # If the simplified list has only one element and that element is a list, flatten it
        while isinstance(simplified, list) and len(simplified) == 1 and isinstance(simplified[0], list):
            simplified = simplified[0]
        return simplified
    else:
        return lst


#print(T, type(T))
Tree = TreeToPythonList(L)
#Tree = flatten_deep(Tree)

Tree = deepConvertDictToJSON(Tree)

Tree = deep_simplify(Tree)


#L = json.loads(L)
#Tree = list(map(lambda i: json.dumps(i), Tree))
#L = list(map(lambda i: json.dumps(i), L))

print(Tree)
T = th.list_to_tree(Tree)



#T = th.list_to_tree([[[0,1],[2,3]],[[0,1],[2,3]]])
#L = th.list_to_tree(outData, source=[0,0])
# ---------- end list2tree ----------
long = LongestList(ListA=partition, ListB=graft(charseq_2), PaddingMode=2)  # -> ListA, simplify(graft(ListB))
convertsvgunits = IronPython2Script()  # -> CSS
# ---------- convertsvgunits: IronPython ----------
import re

def modify_number(match):
    number = match.group(0)
    number = number.rstrip("m")
    number = float(number)
    modified_number = number * 0.352778
    return str(modified_number)+"mm"

CSS = re.sub(r'\d+(\.\d*)?mm', modify_number, CSS)
# ---------- end convertsvgunits ----------
svg = IronPython2Script(JO=geo2arch, LA=svg_layout.L)  # -> SVG; inputs JO: list of String, LA: String, CSS: list of String
# ---------- svg: IronPython ----------
#### Constants ####
global __var__
__var__ = {
    "guid":"6d71b3c9-aa54-477b-8810-e70e61a39418",
    
    "name":"SVG Generator",
    "nickname":"SVG",
    "description":"Converts ArchiJSON to SVG",
    "icon": "ghContent\\Icon-SVGGenerator.png",

    "tabname":"Redback",
    "section":"SVG",

    "inputs":[
        {"name":"Geometry",			"nickname":"J",	"objectAccess":"list",	"description":"", },
        {"name":"Properties",		"nickname":"L",	"objectAccess":"item",	"description":"", },
        {"name":"Properties",		"nickname":"C",	"objectAccess":"list",	"description":"", },
    ],
    "outputs":[
        {"name":"SVG",	"nickname":"S",	"description":"SVG"},
        {"name":"LOG",	"nickname":"LOG",	"description":"LOG"},
    ]
}
__author__ = "Andrew.Butler"
__version__ = "2024.02.02"

import rhinoscriptsyntax as rs
import sys
import json
import inspect
import Rhino as r
from string import Template

LOG = []
#The inputs to this node will be stored as a list in the IN variables.
ARCHIJSON = JO
LAYOUT = LA

def errorLog(e, log=[]):
    import os, sys
    exc_type, exc_obj, exc_tb = sys.exc_info()
    other = sys.exc_info()[0].__name__
    fname = os.path.split(exc_tb.tb_frame.f_code.co_filename)[1]
    errorType = str(exc_type)
    errob = {"isError": True, "error":str(e), "errorType":errorType, "function":fname, "line":exc_tb.tb_lineno, "log":log}
    return errob

def checkRB(ob):
    if type(ob) == type(""):
        return json.loads(ob)
    else:
        return ob

ARCHIJSON = list(map(lambda u: checkRB(u),ARCHIJSON))

array = []
def featurecollection(o):
    print ('o', o)
    for i in o["features"]:
        print ('i', i['geometry']['type'], i, )
        #print("FEATURES---- ", i)
        
        fCall = function_mappings[i['geometry']['type']]
        props = {}
        try:
            props = i['properties']
        except:
            pass
        print("props",props)
        li = []
        li.append(i)
        obarray.append(fCall(li,props))
def feature(o):
    pass
    
def point(o,pointType="standard"):
    try:
        print(o)
        pt = r.Geometry.Point3d(o[0],o[1],o[2])
        remap = r.Geometry.Plane.RemapToPlaneSpace(lPlane, pt)
        rpt = remap[1]
        rpt = [rpt[0]/layout['scale'],-1*rpt[1]/layout['scale'],rpt[2]/layout['scale']]
        ptx = str(remap[1][0]/layout['scale'])
        pty = str(remap[1][1]/layout['scale']*-1)
        pt = "%s, %s" %(ptx, pty)
        ppt = "%s %s" %(ptx, pty)
        ptypes = {
            "standard": "%s, %s" %(ptx, pty),
            "plane": [rpt[0]/layout['scale'],-1*rpt[1]/layout['scale'],rpt[2]/layout['scale']],
            "rplane": [rpt[0], rpt[1], rpt[2]],
            "line": [float(ptx),float(pty),0],
            "path": "%s %s" %(ptx, pty)
        }
        return ptypes[pointType]
    except: return []
    

def isCClockwise(pts):
    total = 0
    #print(pts)
    for index in range(len(pts)):
        p1 = pts[index]
        p2 = pts[(index+1) % len(pts)]
        
        f = (p2[0]-p1[0])*((p2[1]*-1)+(p1[1]*-1))
        total += f
        #print("t",total, p1,p2)
    
    cclockwise = total < 0
    #print("cclockwise:",cclockwise)
    return cclockwise

def arc(o, props, collection = False):
    #print(o)
    #<path d="M 80 80 A 45 45, 0, 0, 0, 125 125">
    arcList = []
    for items in o:
        items = items['geometry']
        pts = map(lambda i: point(i,'line'), items['coordinates'])

        radius = items["radius"]
        angle = items["angle"]
        cclockwise = isCClockwise(pts)
        isBig = items["isBig"]
        largeCircleFlag = str(int(cclockwise))
        
        testflag = False
        largeCircleFlag = True
        if not isBig and cclockwise:
            testflag = False
            largeCircleFlag = False
        if not isBig and not cclockwise:
            testflag = True
            largeCircleFlag = False
        if isBig and not cclockwise:
            testflag = True
            largeCircleFlag = True
        if isBig and cclockwise:
            testflag = False
            largeCircleFlag = True
        largeCircleFlag = str(int(largeCircleFlag))
        testflag = str(int(testflag))
        
        #print(largeCircleFlag,testflag)
        propString = []
        for k in props:
            propString.append(str(k)+'=\"'+str(props[k])+'\"')
        pString = " ".join(propString)
        pString = pString.split('="')
        pString = pString[0] + '= "fill:none;' + pString[1]
        arc = '<path arc="" d="M %.2f %.2f A %.2f %.2f, 0, %s, %s, %.2f %.2f" %s/>'%(pts[0][0],pts[0][1],radius,radius,largeCircleFlag,testflag,pts[-1][0],pts[-1][1],pString)
        #pline = NurbsCurve.ByControlPoints(polarray,1,o['properties']['closed'])
        arcList.append(arc)
    arcList = " ".join(arcList)
    return arcList

def line(o, props, collection = False):
    #<polyline points="118.85,155.3 118.85,180.7" class="FOPActual" zindex="10"/>
    ptList = []
    for items in o:
        items = items['geometry']
        #print(o)
        pts = map(lambda i: point(i, "line"), items['coordinates'])
        propString = []
        for k in props:
            #print(k)
            #print(props[k])
            propString.append(str(k)+'=\"'+str(props[k])+'\"')
        pString = " ".join(propString)
        pline = '<line x1="'+str(pts[0][0])+'" y1="'+str(pts[0][1])+'" x2="'+str(pts[1][0])+'" y2="'+str(pts[1][1])+'" '+pString+'/>'
        #pline = NurbsCurve.ByControlPoints(polarray,1,o['properties']['closed'])
        
        ptList.append(pline)
    ptList = " ".join(ptList)
    return ptList

def polyline(o, props, closed = False ,collection = False):
    #<polyline points="118.85,155.3 118.85,180.7" class="FOPActual" zindex="10"/>
    ptList = []
    pStringList = []
    #print(o)
    for cords in o:
        closed = cords['geometry']['closed']
        #print("CORDS ---", cords)
        polarray = []
        for p in cords['geometry']['coordinates']:
            pt = point(p)
            polarray.append(pt)
        
        pts = " ".join(polarray)
        propString = []
    
        for k in props:
            propString.append(str(k)+'=\"'+str(props[k])+'\"')
        pString = " ".join(propString)
        if collection == True:
            if closed:
                pts = "M %s Z" % (pts)
            else: pts = "M %s" % (pts)
        ptList.append(pts)
        pStringList.append(pString)
    pStringList = " ".join(pStringList)
    if not closed:
        if pString:
            pString = pString.split('="')
            pString = pString[0] + '= "fill:none;' + pString[1]
    ptList = " ".join(ptList)
    if collection == True: 
        pline = '<path polyline="" d=\"'+ptList+'\"  '+ pString +'/>'
    else:
        if closed:
            pline = '<polygon polyline points=\"'+ptList+'\" '+pStringList+'/>'
        else:
            pline = '<polyline polyline points=\"'+ptList+'\" '+pString+'/>'
            #pline = NurbsCurve.ByControlPoints(polarray,1,o['properties']['closed'])

    return pline
    
def curvecollection(o, props):
    #<path d="M10 10 H 90 V 90 H 10 L 10 10"/>
    #print("CURVE COLLECTION")
    
    o = o[0]["geometry"]["coordinates"]
    #print(o)
    # in types in o["coordinates"]
    typeDic = {}
    for items in  o:
        print ("ITEM ", items)
        groupType = items['geometry']['type']
        if typeDic.has_key(str(groupType)):
            typeDic[str(groupType)].append(items)
        else:
            typeDic[str(groupType)] = [items]
    #print("GROUP BY TYPES --", typeDic)
    
    ptListCombined = []
    for typeKey in typeDic:
        fCall = function_mappings[str(typeKey)] #get group type
        #typeDicList.append(typeDic[str(typeKey)])
        ptList = fCall(typeDic[str(typeKey)], props, collection = True)
        ptListCombined.append(ptList)
    
    ptListCombined = ' '.join(ptListCombined)
    return ptListCombined
    
def avgpts(p1, p2, w1=0.5, w2=0.5):
    p3 = []
    #LOG.append(" "*20+"avgpts"+str([p1,p2,w1,w2]))
    for p1p, p2p in zip(p1, p2):
        p3.append((p1p*w1)+(p2p*w2))
    #LOG.append(" "*20+"avgpts"+str([p3]))
    return p3
def spline_1deg(initCoords, props, outType=None, closed = True, skipFirst = False):
    try:
        polarray = []
        #print("spline_1deg",initCoords)
        initCoords = [initCoords]
        knotPtsList = initCoords
        beizerPtsList = []
        coordStringList = []
        #LOG.append(" knotPtsList --- "+str(knotPtsList))#########################################################
        
        for sPts in initCoords:
            coordString = []
            start = sPts.pop(0)
            start = point(start, 'line')
            start = start[:-1]
            start = list(map(lambda x: "{:.2f}".format(float(x)), start))
            if not skipFirst:
                coordString.append(" M"+",".join(start))
            for pts in sPts:
                pts = point(pts, 'line')
                pts = list(map(lambda x: "{:.2f}".format(float(x)), pts))
                pts = pts[:-1]
                coordString.append(" L"+",".join(pts))

            coordString = "".join(coordString)
            #LOG.append(" coordString --- "+str(coordString))#########################################################
            if closed:
                coordString = coordString+"Z"
            coordStringList.append(coordString)
        #LOG.append(" coordStringList --- "+str(coordStringList))#########################################################
        propString = []
        for k in props:
            propString.append(str(k)+'=\"'+str(props[k])+'\"')
        pString = " ".join(propString)
        coordStringList = " ".join(coordStringList)
        pline = '<path spline_1deg="" d="'+coordStringList+'" '+pString+'/>'
        #pline = NurbsCurve.ByControlPoints(polarray,1,o['properties']['closed'])
        #LOG.append("pline"+str(pline))#########################################################
        #print("bp",bezierPts)    
        if outType == "coordinates":
            return coordStringList
        else:
            return pline
    except Exception as e:
        print(e)
        LOG.append(e)
        return "<>"
        pass

def spline_2deg(initCoords, props, outType=None, closed = True, skipFirst = False):
    polarray = []
    
    print("SPLINE COORDS -- ", initCoords)
    initCoords = [initCoords]
    knotPtsList = []
    beizerPtsList = []
    
    for index, p in enumerate(initCoords):
        for indvPts in p:
            
            pnt = point(indvPts, 'line')
            pt = [pnt[0],pnt[1]]
            polarray.append(pt)
            polarray_len = len(polarray)
        bezierPts = []
        knotPts = []
        print("polLen",polarray_len)
        if closed:
            print("closed")
            for index in range(polarray_len-1):
                pt1 = polarray[index % len(polarray)]
                pt2 = polarray[(index+1) % len(polarray)]
                pt3 = polarray[(index+2) % len(polarray)]
                
                pt4 = avgpts(pt1,pt2,(1.0/6.0),(5.0/6.0))
                pt5 = avgpts(pt2,pt3,(5.0/6.0),(1.0/6.0))
                #print("par",pt1,pt2,pt3,pt4)
                bezierPts.append(pt4)
                bezierPts.append(pt5)
                a = bezierPts
            #fpoint = bezierPts.pop(0)
            #bezierPts.append(fpoint)
            # fpoint = bezierPts.pop(0)
            bezierPts = bezierPts[:-2]
            for index in range(int(len(bezierPts)/2.0)):
                index = index*2
                pt1 = bezierPts[(index+1) % len(bezierPts)]
                pt2 = bezierPts[(index+2) % len(bezierPts)]
                #print("avg",index,index+1,pt1,pt2)
                knotPts.append(avgpts(pt1,pt2))
            #bezierPts.append(fpoint)
            #bezierPts = bezierPts[-1:]+bezierPts[:-1]
            knotPts = knotPts[-1:]+knotPts[:-1]
            knotPts = knotPts+[knotPts[0]]
        else:
            mode = "normal"
            if len(polarray) == 3:
                mode = "3pt"
            print("_"*10+mode)
            #print("p",len(polarray),polarray)
            #if mode == "normal":
                #apPt = avgpts(polarray[0],polarray[1],1.0/3.0,2.0/3.0)
                #bezierPts.append(apPt)
            if mode == "3pt":
                apPt1 = avgpts(polarray[0],polarray[1],(1.0/3.0),(2.0/3.0))
                apPt2 = avgpts(polarray[1],polarray[2],(2.0/3.0),(1.0/3.0))
                bezierPts.append(apPt1)
                bezierPts.append(apPt2)
            if mode == "normal":
                for index in range(int((polarray_len-1)/2)):
                    index = index*2
                    print("index",index)
                    p1 = avgpts(polarray[index+0],polarray[index+1],(1.0/3.0),(2.0/3.0))
                    p2 = avgpts(polarray[index+1],polarray[index+2],(2.0/3.0),(1.0/3.0))
                    print("bez",p1)
                    bezierPts.append(p1)
                    bezierPts.append(p2)
            if mode == "normal":
                bezierPts.append(avgpts(polarray[-1],polarray[-2],1.0/3.0,2.0/3.0))
            #print(len(bezierPts),bezierPts)
            knotPts = [polarray[0]]+knotPts
            if mode == "normal":
                for index in range(int((len(bezierPts)-2)/2.0)):
                    index = (index*2)+1
                    p1 = bezierPts[index]
                    p2 = bezierPts[index+1]
                    p3 = avgpts(p1,p2)
                    #print("kp",index,p1,p2)
                    knotPts.append(p3)
            knotPts.append(polarray[-1])
        knotPtsList.append(knotPts)
        beizerPtsList.append(bezierPts)
    #print("knotPtsList",knotPtsList)
    #print("beizerPtsList",beizerPtsList)
    coordStringList = []
    #print(len(knotPts),knotPts)
    #print(len(bezierPts),bezierPts)
    for sPts in range(len(knotPtsList)):
        splineCoords = []
        #print('SPTS == ', sPts)
        knotPts = knotPtsList[sPts]
        bezierPts = beizerPtsList[sPts]
        #print("KNOTS --- ", knotPts)
        
        for index, knotPt in enumerate(knotPts):
            rspoints = [knotPt]
            try:
                if index == 0:  rspoints = [knotPt, bezierPts[index*2], bezierPts[(index*2)+1]]
                else:           rspoints = [knotPt, bezierPts[(index*2)+1]]
            except: pass
            for rspoint in rspoints:
                for coord in rspoint:
                    splineCoords.append("%.2f"%(coord))
        coordString= []
        if not skipFirst:
            coordString= ["M"]

        coordString = coordString+list(" , ".join(splineCoords))
        delimIndex = 0
        for index, char in enumerate(coordString):
            #print(index, char)
            if char == ",":
                if delimIndex == 1:
                    if not skipFirst:
                        coordString[index] = "C"
                    else:
                        coordString[index] = "~C"

                if (delimIndex-7) % 4 == 0 and delimIndex >= 7:
                    coordString[index] = "S"
                delimIndex += 1
        coordString = "".join(coordString)
        print("-"*20, coordString)
        if closed:
            coordString = coordString+"Z"
        coordStringList.append(coordString)
    propString = []
    for k in props:
        propString.append(str(k)+'=\"'+str(props[k])+'\"')
    pString = " ".join(propString)
    coordStringList = "".join(coordStringList)
    if skipFirst:
        coordStringList = coordStringList.split("~")[1]
    pline = '<path spline_2deg="" d="'+coordStringList+'" '+pString+'/>'
    #print(pline)
    #pline = NurbsCurve.ByControlPoints(polarray,1,o['properties']['closed'])
    if outType == "coordinates":
        print("coordStringList"+"__"+str(coordStringList))
        return coordStringList
    else:
        return pline
    
def spline_3deg(initCoords, props, outType=None, closed = True, skipFirst = False):
    #<polyline points="118.85,155.3 118.85,180.7" class="FOPActual" zindex="10"/>
    polarray = []
    #LOG.append("CLOSED ---"+str(closed))#########################################################
    #LOG.append("SPLINE COORDS -- "+str(initCoords['coords']))####################################
    initCoords = [initCoords]
    
    knotPtsList = []
    beizerPtsList = []
    for indvCoords in initCoords:
        polarray = []
        #LOG.append("SPLINE COORD -- "+str(indvCoords))###########################################
        for index, p in enumerate(indvCoords):
            pnt = point(p, type = 'line')
            #LOG.append("   pnt ----- "+str(pnt))
            
            pt = [pnt[0],pnt[1]]
            #print('pnt', pnt)
            #print('pt', pt)
            polarray.append(pt)
        polarray_len = len(polarray)
        bezierPts = []
        knotPts = []
        #LOG.append("  polarray ---- "+str(polarray))
        if closed:
            for index in range(polarray_len-1):
                pt1 = polarray[index]
                pt2 = polarray[(index+1) % len(polarray)]
                pt3 = avgpts(pt1,pt2,float(2.0/3.0),float(1.0/3.0))
                pt4 = avgpts(pt1,pt2,float(1.0/3.0),float(2.0/3.0))
                #print("par",pt1,pt2,pt3,pt4)
                #LOG.append(" "*10+"pt3,pt4 ----- "+str([pt3,pt4]))
                bezierPts.append(pt3)
                bezierPts.append(pt4)
            
            fpoint = bezierPts.pop(0)
            bezierPts.append(fpoint)
            #print(bezierPts)
            #LOG.append("   bezierPts ----- "+str(bezierPts))
            #LOG.append("   runningKnots")
            for index in range(int(len(bezierPts)/2.0)-1):
                index = index*2
                pt1 = bezierPts[index]
                pt2 = bezierPts[(index+1) % len(bezierPts)]
                #print("avg",index,index+1,pt1,pt2)
                avgresult = avgpts(pt1,pt2)
                #LOG.append("   avgresult ----- "+str(avgresult))
                knotPts.append(avgresult)
            fpoint = bezierPts.pop(0)
            bezierPts.append(fpoint)
            #print("bpts", bezierPts)
        else:
            mode = "normal"
            if len(polarray) == 4:
                mode = "4pt"
            #LOG.append("  mode ---- "+str(mode))
            if mode == "normal":
                bezierPts.append(avgpts(polarray[1],polarray[2]))
            for index in range(polarray_len-5):
                bezierPts.append(avgpts(polarray[index+2],polarray[index+3],float(2.0/3.0),float(1.0/3.0)))
                bezierPts.append(avgpts(polarray[index+2],polarray[index+3],float(1.0/3.0),float(2.0/3.0)))
            if mode == "normal":
                bezierPts.append(avgpts(polarray[-2],polarray[-3]))
            #LOG.append("   adding to knotPts ----- "+str(polarray[0])+str(knotPts))
            knotPts = [polarray[0]]+knotPts
            if mode == "normal":
                for index in range(int(len(bezierPts)/2.0)):
                    index = index*2
                    p1 = bezierPts[index]
                    p2 = bezierPts[index+1]
                    p3 = []
                    for p1p, p2p in zip(p1, p2):
                        p3.append((p1p*(1.0/2.0))+(p2p*(1.0/2.0)))
                    knotPts.append(p3)
            knotPts.append(polarray[-1])
            bezierPts = [polarray[1]]+bezierPts
            bezierPts.append(polarray[-2])
    
            #print('SPLINE OBJECT --', splineObject)
        beizerPtsList.append(bezierPts)
        knotPtsList.append(knotPts)
    
    coordStringList = []
    #LOG.append(" knotPtsList --- "+str(knotPtsList))#########################################################
    for sPts in range(len(knotPtsList)):
        splineCoords = []
        #print(sPts)
        knotPts = knotPtsList[sPts]
        bezierPts = beizerPtsList[sPts]
        #print("KNOTS --- ", knotPts)
        for index, knotPt in enumerate(knotPts):
            #print(index)
            #print(len(knotPts))
            rspoints = [knotPt]
            try:
                if index == len(knotPts)-1: pass
                elif index == 0:  rspoints = [knotPt, bezierPts[index*2], bezierPts[(index*2)+1]]
                else:           rspoints = [knotPt, bezierPts[(index*2)+1]]
            except: pass
            #print("RS POINTS --- ", rspoints)
            for rspoint in rspoints:
                for coord in rspoint:
                    splineCoords.append("%.2f"%(coord))
        #print (splineCoords)
        # #LOG.append(" splineCoords --- "+str(splineCoords))#########################################################
        if not skipFirst:
            coordString = ["M"]+list(" , ".join(splineCoords))
        
        delimIndex = 0
        for index, char in enumerate(coordString):
            if char == ",":
                if delimIndex == 1:
                    coordString[index] = "C"
                if (delimIndex-7) % 4 == 0 and delimIndex >= 7:
                    coordString[index] = "S"
                delimIndex += 1
        coordString = "".join(coordString)
        #LOG.append(" coordString --- "+str(coordString))#########################################################
        if closed:
            coordString = coordString+"Z"
        coordStringList.append(coordString)
    #LOG.append(" coordStringList --- "+str(coordStringList))#########################################################
    propString = []
    for k in props:
        propString.append(str(k)+'=\"'+str(props[k])+'\"')
    pString = " ".join(propString)
    coordStringList = " ".join(coordStringList)
    pline = '<path spline_3deg="" d="'+coordStringList+'" '+pString+'/>'
    #pline = NurbsCurve.ByControlPoints(polarray,1,o['properties']['closed'])
    #LOG.append("pline"+str(pline))#########################################################
    #print("bp",bezierPts)    

    if outType == "coordinates":
        return coordStringList
    else:
        return pline
    
def spline(o, props, outType=None, collection = False):
    LOG.append("spline")
    print("spline props: ",props)
    try:
        
        splineFuncs = {
        "spline_1deg" : spline_1deg,
        "spline_2deg" : spline_2deg,
        "spline_3deg" : spline_3deg,
        }
        splineObject = ""
        
        for segmentIndex, coords in enumerate(o):
            if "geometry" in coords:
                coords = coords["geometry"]
            deg = coords["deg"]
            print("coords",deg)
            func = splineFuncs["spline_"+str(deg)+"deg"]
            skipFirst = True
            if segmentIndex == 0:
                skipFirst = False
            appendSpline = func(coords["coordinates"], props, outType, closed = coords['closed'], skipFirst=skipFirst)
            print(appendSpline)
            splineObject = splineObject+appendSpline
            #print("splineObject",splineObject)

            #try:
                #coords = coords['geometry']
            #except:
                #pass
            #if coords['deg'] == 1:
                #initCoords1d['coords'].append(coords['coordinates'])
                #initCoords1d['closed'] = coords['closed']        
            #if coords['deg'] == 2:
                #initCoords2d['coords'].append(coords['coordinates'])
                #initCoords2d['closed'] = coords['closed']        
            #if coords['deg'] == 3:
                #initCoords3d['coords'].append(coords['coordinates'])
                #initCoords3d['closed'] = coords['closed']

            #print(initCoords3d)
        
        #if len(initCoords1d['coords']) >= 1:
            #print ("1 degree")
            #splineObject = spline_1deg(initCoords1d, props, outType, closed = initCoords1d['closed'])

        #if len(initCoords2d['coords']) >= 1:
            #print ("2 degree")
            #splineObject = spline_2deg(initCoords2d, props, outType, closed = initCoords2d['closed'])
            
        #elif len(initCoords3d['coords']) >= 1:
            #print ("3 degree")
            #splineObject = spline_3deg(initCoords3d, props, outType, closed = initCoords3d['closed'])
        #knotPts = splineObject['knotPts']
        #bezierPts = splineObject['bezierPts']
        if outType == "coordinates":
            propString = []
            for k in props:
                propString.append(str(k)+'=\"'+str(props[k])+'\"')
            pString = " ".join(propString)
            splineObject = "".join(splineObject)
            print("spline pString",pString)
            pline = '<path spline="" d="'+splineObject+'" '+pString+'/>'
            return pline
        return splineObject
    except Exception as e:
        LOG.append("spline: "+str(errorLog(e)))
        return ""
def polycurve(o, props, collection = False):
    #print(o)
    try:
        parts = []
        for part in o:
            part = part["geometry"]["coordinates"]
            polycurvePath = []
            for curve_i, curve in enumerate(part):
                #for curveInfo in curve['geometry']["coordinates"]:
                #print(curve)
                svgCurve = spline(curve["geometry"]["coordinates"],props,outType="coordinates")
                polycurvePath.append(svgCurve)
        polycurvePath = ' '.join(polycurvePath)
        return polycurvePath
    except Exception as e:
        LOG.append("polycurve"+str(errorLog(e)))
        return ""

    
def circPath(cx,cy,r, cclockwise):
    #NOTE : Assumes direction pattern is T/F
    #"M" + cx + "," + cy + "m" + (r) + ",0" + "a" + r + "," + r + " 0 1,1 " + (-r * 2) + ",0" + "a" + r + "," + r + " 0 1,1 " + (r * 2) + ",0"
    circPath = "M %.2f, %.2f m %.2f, 0 a %.2f, %.2f 0 1,%s %.2f, 0 a %.2f, %.2f 0 1, %s %.2f, 0"%(cx, cy, r, r, r, cclockwise, -r*2, r, r, cclockwise, r*2)
    return circPath


def circle(o, props, collection = False):
    #<circle cx="50" cy="50" r="50"/>
    circList = []
    for index, coords in enumerate(o):
        coords = coords['geometry']
        print (coords['coordinates'])
        pt = point(coords['coordinates'], 'line')
        propString = []
        for k in props:
            #print(k)
            #print(props[k])
            propString.append(str(k)+'=\"'+str(props[k])+'\"')
        pString = " ".join(propString)
        
        #pline = NurbsCurve.ByControlPoints(polarray,1,o['properties']['closed'])
        if collection:
            cclockwise = index%2
            #print (cclockwise)
            circ = circPath(pt[0],pt[1],coords['radius']/layout['scale'], cclockwise)
            #print (circ)
            #circ = ''.join([str(item) for item in circ])
        else:
            circ = '<circle cx="%.2f" cy="%.2f" r="%.2f" %s/>'%(pt[0],pt[1],coords['radius']/layout['scale'],pString)
        circList.append(circ)
    print (circList)
    
    circList = " ".join(circList)
    if collection:
        circList = '<path circle="" d= "%s" %s/>'%(circList, pString)
    return circList

def text(o, props):
    try:
        print("text")
        #<text class="CLASS" zindex="500" transform="matrix(1 0 0 1 210 148.5)">TEXT</text> 
        propString = []
        for k in props:
            propString.append(str(k)+'=\"'+str(props[k])+'\"')
        pString = " ".join(propString)
        
        if type(o) == type([]):
            o = o[0]["geometry"]
        print(o)
        gm = o['coordinates']
        planeorigin = [gm[3],gm[7],gm[11]]
        print(planeorigin)
        planeremap = point(planeorigin,"rplane")
        matrix = [str(gm[0]), str(gm[1]),str(gm[4]),str(gm[5]), str(planeremap[0]), str(planeremap[1])]
        matrixtext = " ".join(matrix)
        text = '<text '+pString+' transform="matrix(%s)">%s</text>'%(matrixtext,o['content'])
        print(text)
        return text
    except Exception as e:
        print(errorLog(e))
        return None
def image(o, props):
    try:
        #<image width="132.543857" height="132.543857" transform="matrix(-0.173648 -0.984808 0.984808 -0.173648 28.869475 131.454367)" xlink:href="K:\Computational Design Group\20.png"'"/>
        propString = []
        for k in props:
            propString.append(str(k)+'=\"'+str(props[k])+'\"')
        pString = " ".join(propString)
        if type(o) == type([]):
            o = o[0]["geometry"]
        gm = o['coordinates']
        yvec = [gm[1]*o['height'],gm[5]*o['height'],gm[9]*o['height']]
        planeorigin = [gm[3]+yvec[0],gm[7]+yvec[1],gm[11]+yvec[2]]
        planeremap = point(planeorigin,"rplane")
        imgPlane = r.Geometry.Plane(r.Geometry.Point3d(gm[3],gm[7],gm[11]),r.Geometry.Vector3d(gm[0],gm[4],gm[8]),r.Geometry.Vector3d(gm[1],gm[5],gm[9]))
        worldPlane = r.Geometry.Plane(r.Geometry.Point3d(0,0,0),r.Geometry.Vector3d(1,0,0),r.Geometry.Vector3d(0,1,0))
        transform = r.Geometry.Transform.PlaneToPlane(lPlane,worldPlane)
        imgPlane.Transform(transform)
        npln = [imgPlane.XAxis.X,imgPlane.YAxis.X,imgPlane.ZAxis.X,imgPlane.OriginX,imgPlane.XAxis.Y,imgPlane.YAxis.Y,imgPlane.ZAxis.Y,imgPlane.OriginY,imgPlane.XAxis.Z,imgPlane.YAxis.Z,imgPlane.ZAxis.Z,imgPlane.OriginZ,0,0,0,1]
        matrix = [str(npln[0]), str(npln[1]),str(npln[4]),str(npln[5]), str(planeremap[0]), str(planeremap[1])]
        matrixtext = " ".join(matrix)
        text = '<image transform="matrix(%s)" width="%s" height="%s" xlink:href="%s"/>'%(matrixtext,o['width']/layout['scale'],o['height']/layout['scale'],o['image'])
        print(text)
        return text
    except Exception as e:
        print(errorLog(e))
        return None
function_mappings = {
        'FeatureCollection':featurecollection,
        'Feature': feature,
        'Circle':circle,
        'Arc':arc,
        'Polyline': polyline,
        'Spline': spline,
        'PolyCurve': polycurve,
        'CurveCollection': curvecollection,
        'Line': line,
        'Text': text,
        'Image':image,
}
obarray = []
if not LAYOUT:
    layout = {"plane": [[0.0, 0.0, 0.0], [1.0, 0.0, 0.0], [0.0, 1.0, 0.0]], "page": [420, 297], "scale": 1.0}
else:
    layout = json.loads(LAYOUT)
lPlane = layout['plane']
lOrigin = r.Geometry.Point3d(lPlane[0][0],lPlane[0][1],lPlane[0][2])
lXAx = r.Geometry.Vector3d(lPlane[1][0],lPlane[1][1],lPlane[1][2])
lYAx = r.Geometry.Vector3d(lPlane[2][0],lPlane[2][1],lPlane[2][2])
lPlane = r.Geometry.Plane(lOrigin,lXAx,lYAx)
try:
    for i in ARCHIJSON:
        if i["type"]:
            #print(i)
            print(i['type'])
            fCall = function_mappings[i['type']]
            fCall(i)
        else:
            fCall = function_mappings[i['geometry']['type']]
            obarray.append(fCall(i['geometry']))

    #OUT = log
    template =Template("""<?xml version="1.0" encoding="utf-8"?>
    <!-- Generator: Grasshopper 1.0.0, Redback Plugin. SVG Version: 6.00 Build 0) Made by Andrew Butler at Cox Architecture -->
    <!DOCTYPE svg PUBLIC "-//W3C//DTD SVG 1.1//EN" "http://www.w3.org/Graphics/SVG/1.1/DTD/svg11.dtd">
    <svg version="1.1" xmlns="http://www.w3.org/2000/svg" xmlns:xlink="http://www.w3.org/1999/xlink" x="0px" y="0px"
    width="${width}mm" height="${height}mm" viewBox="0 0 ${width} ${height}" xml:space="preserve">
    <style type="text/css">
    $css
    </style>
    $svg
    </svg>""")
    #print(layout)
    if not CSS:
        CSS = [None]
    if len(CSS) == 1:
        if CSS[0] == None:
            CSS = [""]
    svgdict = {'svg':"\n".join(obarray),'width':layout['page'][0],'height':layout['page'][1],'css':"\n".join(CSS)}
    svgfull = template.substitute(svgdict)
    SVG = svgfull.split("\n")
    #L = log


except Exception as e:
    print("?",errorLog(e))
    LOG.append("based error: "+str(errorLog(e)))
    SVG = None
    pass
# ---------- end svg ----------
panel_5 = Panel(import_excel.S)
panel_6 = Panel("""1
2
3""")
graft = GraftTree(Tree=flatten(partition), IncludeEmptyLists=True, IncludeNullItems=True)  # -> simplify(Tree)
panel_7 = Panel(json_keys)
shift = ShiftPaths(Offset=-1)
mergejson = IronPython2Script()  # -> J; inputs J: list
# ---------- mergejson: IronPython ----------
import json

J = list(map(lambda x: json.loads(x), J))

first = J.pop(0)
for i in J:
    first.update(i)
J = json.dumps(first)
# ---------- end mergejson ----------
graft_2 = GraftTree(Tree=flatten(long.ListB), IncludeEmptyLists=True, IncludeNullItems=True)  # -> simplify(Tree)
panel_8 = Panel(encode_integer.E)
panel_9 = Panel("""value
class""")
wrapper = IronPython2Script(CO=panel_6, WR="\"", DE=",")  # -> RE; inputs CO: list
# ---------- wrapper: IronPython ----------
#### Constants ####
global __var__
__var__ = {
	"guid":"8e12d3d2-9c02-4af4-8931-ae8a51372bd0",
	
	"name":"Text Wrapper",
	"nickname":"Wrapper",
	"description":"Wraps and joins text with selected data characters",
	"icon": "ghContent\\Icon-Wrapper.png",

	"tabname":"Redback",
	"section":"JSON",

	"inputs":[
		{"name":"Content",			"nickname":"C",	"objectAccess":"list",	"description":"Text content to wrap", },
		{"name":"Wrap Character",	"nickname":"W",	"objectAccess":"item",	"description":"Character that will wrap the text", },
		{"name":"Join Character",	"nickname":"J",	"objectAccess":"item",	"description":"Character that will join the text, leave empty to wrap each individually", },
	],
	"outputs":[
		{"name":"Wrapped Text",	"nickname":"W",	"description":"Wrapped Text"}
	]
}
__author__ = "Andrew.Butler"
__version__ = "2024.02.02"
	
lut = {
	'': {'t':'[{value}]'},
	'"': {'t':'"{value}"'},
	"'": {'t':"'{value}'"},
	'{': {'t':'{{{value}}}'},
	'}': {'t':'{{{value}}}'},
	'{}': {'t':'{{{value}}}'},
	'[': {'t':'[{value}]'},
	']': {'t':'[{value}]'},
	'[]': {'t':'[{value}]'},
	'(': {'t':'({value})'},
	')': {'t':'({value})'},
	'()': {'t':'({value})'},
}

C = CO
W = WR
J = DE


def wrapText(text, wrap):
	if wrap in lut:
		template = lut[wrap]["t"]
		print(template)
		return template.format(value=text)
	else:
		return wrap+text+wrap

if not C:
	C = []
if not W:
	W = ""


if J != None:
	C = [J.join(C)]

outText = list(map(lambda x: wrapText(x, W), C))


RE = outText
# ---------- end wrapper ----------
mergearchjson = IronPython2Script()  # -> AJ; inputs AJ: list
# ---------- mergearchjson: IronPython ----------
import json

AJ = list(map(lambda x: json.loads(x), AJ))

first = AJ.pop(0)
print(first)
for i in AJ:
    first["features"] = first["features"]+i["features"]

AJ = json.dumps(first)
# ---------- end mergearchjson ----------
merge_2 = Merge(Data1=simplify(graft), Data2=simplify(graft_2))
stylesvg = IronPython2Script(SVG=svg)  # -> SVG; inputs SVG: list, CSS: list
# ---------- stylesvg: IronPython ----------
modIndex = []
for i, line in enumerate(SVG):
    if "<preStyle/>" in line.strip():
        modIndex.append(i)
for i in modIndex:
    SVG[i] = "".join(CSS)
# ---------- end stylesvg ----------
series_2 = Series(Start=0.5, Step=1, Count=10)
panel_10 = Panel(wrapper)
relative_path = IronPython2Script(PA=Toggle(False), RP="testing\test.svg")  # -> FP, DI, FN
#   port PA: Accepts path string or Boolean for current Rhino or Grasshopper document path
# ---------- relative_path: IronPython ----------
       
import os
import Rhino
import scriptcontext as sc
P = PA
R = RP


try:
    isServerAdress = False
    
    #print(isServerAdress)
    context = {}
    try:    context["rh"] = os.path.splitext(os.path.basename(Rhino.RhinoDoc.ActiveDoc.Path))[0]
    except: pass
    try:    context["gh"] = os.path.splitext(os.path.basename(sc.doc.Path))[0]
    except: pass

    R = R.format(**context)
    print(R)
    if P == None:
        P = False
    #if not R:
        #R = ""
    if type(P) == type(False): 
        
        if P:
            DOC = Rhino.RhinoDoc.ActiveDoc.Path
        else:
            DOC = sc.doc.Path
    else:
        DOC = P

    if DOC.startswith("\\\\"):
        isServerAdress = True
    if os.path.isdir(DOC):
        docDir = DOC
        docName = None
    else:
        docDir, docName = os.path.split(DOC)
    
    docDirs = docDir.split(os.sep)
    #print("1 docDirs",docDirs)
    
    if R == None:
        R = docName
    try:
        relDirs = R.split(os.sep)
    except:
        relDirs = []



    for pathStep in relDirs:
        #print("pathstep", pathStep)
        if pathStep == ".":
            del docDirs[-1]

    relDirs = list(filter(lambda x: x != ".", relDirs))
    #print("relDirs",relDirs)
    #print("docDirs",docDirs)
    newDirs = docDirs+relDirs
    #print("newDirs",newDirs)
    newDirs = list(map(lambda x: x.replace(":", ":"+os.sep), newDirs))
    newDir = os.path.join(*newDirs)

    #print(newDir)
    if isServerAdress:
        newDir = "\\\\"+newDir
    FP = newDir
    if os.path.isdir(newDir):
        DI = newDir
        FN = None
    else:
        DI, FN = os.path.split(newDir)
except Exception as e:
    print(e)
    FP = R
    DI, FN = os.path.split(R)
# ---------- end relative_path ----------
partition_3 = PartitionList(List=series_2, Size=2)
srf = Surface(<surface referenced from the Rhino model>)
unflatten = UnflattenTree(Guide=partition)  # -> simplify(Tree)
simplify = SimplifyTree(Tree=partition, Front=False)
num = Number(partition_3)
graft_3 = GraftTree(Tree=relative_path.DI, IncludeEmptyLists=True, IncludeNullItems=True)
graft_4 = GraftTree(Tree=relative_path.FN, IncludeEmptyLists=True, IncludeNullItems=True)
object = ModelObject(Object=srf)  # -> Object, Render
int = Integer(num)
panel_11 = Panel("""A
B
C
D""")
int_2 = Integer(0)
render = RenderAttributes(Render=object.Render)  # -> Render, ObjectMaterial, CastsShadows, ReceivesShadows
tree2list = IronPython2Script(T=simplify, B=int_2)  # -> L; inputs T: tree, B: Int32
# ---------- tree2list: IronPython ----------
List = None
__author__ = "danielle.bisazza"
__version__ = "2022.06.30"
import Grasshopper as gh
import sys
import json
import ghpythonlib.treehelpers as th
                
                
def TreeToPythonList(input, retrieve_base = lambda x: x[0]):
    """Returns a list representation of a Grasshopper DataTree"""
    def extend_at(path, index, simple_input, rest_list):
        #print("INPUT -- ", simple_input)
        #print("REST LIST ---", rest_list)
        target = path[index]
        #print("TARGET --", target)
        #print("INDEX  --", index)
        #try:
            #simple_input = [int("%.2f") %num for num in list(simple_input)] #round ints to 2dec
        #except:
            #simple_input = list(simple_input)
        sortList = []
        for value in list(simple_input):
            #print("VALUE:  ", value, "TPYE:  ", type(value))
            if type(value) == type(""):
                try: 
                    value = json.loads(str(value))
                except:
                    pass
                sortList.append(value)
                #print(value)
            #### TO BE FIXED? - FLOATS ####
            elif type(value) == type(0.0):
                #try:
                    #value = "{:.2f}".format(value)
                    #value = value
                    #print ("FLOAT", value)
                #except:
                    #pass
                sortList.append(value)
            else:
                sortList.append(value)
                                
        #print(sortList)
        if len(rest_list) <= target: #make empty space for new value
            #print("-MAKING NEW SPOT-", rest_list)
            rest_list.extend([None]*(target-len(rest_list)+1))
        elif not (isinstance(i, list) for i in rest_list):
            #print("EXTENDED LIST -- ", rest_list)
            pass
        if index == path.Length - 1:
            try:
                if rest_list[target] != None: #if trying to replace value
                    #print(">><<<")
                    rest_list.insert(target, sortList)
                else:
                    #print("replace", rest_list[target], sortList)
                    rest_list[target] = sortList
                    #print("new -- ", rest_list)
            except:
                rest_list[target] = sortList
        else:
            if rest_list[target] is None: 
                rest_list[target] = []
            #print ("---- LOOOPPP ----", type(rest_list))
            extend_at(path, index+1, sortList, rest_list[target])

    all = []
    #print(input)
    for i in range(input.BranchCount):

        path = input.Path(i)
        
        #print(list(path.Indices))
        #print(dir(path))

        extend_at(path, 0, input.Branch(path), all)
    
    #sublists = [my_list[i:i+j] for i,j in zip(range(0,len(my_list)), [2,3,4,1])] 
    #print(all)
    return all
                    
#print(T, type(T))
Tree = TreeToPythonList(T)
#print(Tree)
B = max(0,B)
outData = []


def splitListRecursive(datalist,targetLevel=0, _currentLevel=0):
    if _currentLevel == targetLevel:
        outData.append(json.dumps(datalist, ensure_ascii=False))
    else:
        for i in datalist:
            splitListRecursive(i, targetLevel, _currentLevel+1)

splitListRecursive(Tree,B)


L = th.list_to_tree(outData, source=[0,0])
# ---------- end tree2list ----------
panel_12 = Panel(tree2list)
material = ModelMaterial(Material=render.ObjectMaterial)  # -> Material, Name, Shader
write_file = IronPython2Script(R=Toggle(True), CO=stylesvg, FD=graft_3, FN=graft_4)  # -> FP; inputs R: Boolean, CO: list of String, FD: String, FN: String
# ---------- write_file: IronPython ----------
C = CO
P = FD
N = FN

import os
from json import dumps
def check(o):
    if str(type(o)) == "<type 'dict'>":
        return dumps(o)
    else:
        return o
FP = None
if R:
    con = list(map(lambda u: check(u), C))
    conwrite = "\n".join(con)
    P = P.replace(r"%user%", "~")
    P = os.path.expanduser(P)

    directory = os.path.join(P,N)
    fileDir, _t = os.path.split(directory)
    if not os.path.isdir(fileDir):
        os.makedirs(fileDir)
    FP = directory
    with open(directory,'wb') as f:
        f.write(conwrite.encode("UTF-8"))
# ---------- end write_file ----------
material_2 = ModelMaterial()  # -> Material, Name, Shader
matdiff_path = Python3Script(M=material.Material)  # -> P
#   port M: Material with diffuse texture
#   port P: Folder path to diffuse image
# ---------- matdiff_path: Python ----------
import Rhino
import scriptcontext as sc

scriptcontext.doc = Rhino.RhinoDoc.ActiveDoc
materials = sc.doc.Materials
scriptcontext.doc = ghdoc



material = None
for index, m in enumerate(materials):
    print(index, m, M.Name)
    if m.Name == M.Name:
        material = m


texture = material.GetBitmapTexture()
P = material.GetBitmapTexture().FileName
# ---------- end matdiff_path ----------
dpipeline = DynamicGeometryPipeline(
    LayerFilter="SVG::Arrows2",
    TypeFilter="Curve",
    NameFilter="*",
    GroupByLayer=False,
    GroupByType=False,
    IncludeHidden=True,
    IncludeLocked=True,
    enableFullPath=True,
    listenToAttributes=True)
panel_13 = Panel("{\"columnWidths\": [10,20],\"columnWidthsRev\": [10], \"variables\": {\"line-thick\": 2, \"line-medium\": 1, \"line-thin\": 0.5 }}")
u_text = UserText(Content=dpipeline, UserTextMode=1)  # -> Content, Keys, Values
panel_14 = Panel(write_file)
panel_15 = Panel("""*{paragraphStyle:Table - Small;}
.A{characterStyle:Bold;}
bord{weight:1;}
[xPos=1]{weight:2;}""")
graft_5 = GraftTree(Tree=tree2list, IncludeEmptyLists=True, IncludeNullItems=True)
panel_16 = Panel(graft_5)
expression = Expression(x="Replace Text", Expression="Format(\"*::{0}::*\", x)")
panel_17 = Panel("""*{paragraphStyle:Table - Small; cellStyle:Inner;}
border[xPos=0]{weight:0;}
border[yPos=0]{weight:0;}
border[xPosRev=-1]{weight:0;}
border[yPosRev=-1]{weight:0;}""")
topoly = CurveToPolyline(Curve=dpipeline, ToleranceDistance=0.01, ToleranceAngle=0)  # -> Polyline, Segments
lon_dº = Panel("151.198885")  # disabled
lat_dº = Panel("-33.826260")  # disabled
panel_18 = Panel("""columnWidths:
- 20
variables:
  line-thick: 2
  line-medium: 1
  line-thin: 0.5""")
number_slider = Slider(0.515, range=0..1)
number_of_hours_to_analyse = Slider(7, range=0..10)  # disabled
list = ValueList({"One": 1, "Two": 2, "Three": 2² - 1, "Four": Sqrt(16)}, selected="One")
starting_hour = Slider(9, range=0..10)  # disabled
panel_19 = Panel("10")  # disabled
join = TextJoin(Text=panel_17)
dpipeline_2 = DynamicGeometryPipeline(
    LayerFilter=expression,
    TypeFilter="Curve",
    NameFilter="*",
    GroupByLayer=False,
    GroupByType=False,
    IncludeHidden=True,
    IncludeLocked=True,
    enableFullPath=True,
    listenToAttributes=True)
m_objects = QueryModelObjects(Locked=True, Hidden=True, AutoUpdateState=True)  # disabled
ladybug = Ladybug_Ladybug()  # -> Vviiiiiiiiiizzz; disabled; plug-in component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
icml_generator_v2 = Python3Script(DA=graft_5, OP=panel_18, CS=join)  # -> out, TA; inputs OP: list, CS: list
# ---------- icml_generator_v2: Python ----------
import xml.etree.ElementTree as ET
import json

def dict_to_element(d):
    element = ET.Element(d["_tag"])
    
    if "_subElements" in d:
        
        #print(json.dumps(d))
        #print("Type", type(d["_subElements"]))
        for subElement in d["_subElements"]:
            #print(subElement)
            element.append(dict_to_element(subElement))
        del d["_subElements"]
    if "_text" in d:
        element.text = d["_text"]
        del d["_text"]
    del d["_tag"]
    
    element.attrib = d
    return element

class parent():
    def __init__():
        self.data = {}
    @property
    def element(self):
        element = ET.Element(self.classText, self.attrib)
        if "value" in self.data:
            element.text = self.data["value"]
        self.elementAfter(element)
        return element
    def elementAfter(self, element):
        pass
    @property
    def XML(self):
        return ET.tostring(self.element, encoding='utf-8', xml_declaration=True).decode('utf-8')
    
    def afterDict(self, dictOb):
        pass
    @property
    def __dict__(self):
        dictOb = {"_tag":"Tag","_subElements":[]}
        dictOb.update(self.attrib)
        if "value" in dictOb:
            dictOb["_text"] = dictOb["value"]
        self.afterDict(dictOb)
        return(dictOb)

class cell(parent):
    def __init__(self, data = {}, parent=None):
        defaultData = {"value":""}
        defaultData.update(data)
        self.data = defaultData

        #print(self.data)
        self.parent = parent
        self.attrib = {
            "_tag": "Cell",
            "Self":"u00000i00000i0",
            "Name":"0:1",
            "RowSpan":"1",
            "ColumnSpan":"1",
            "CellType":"TextTypeCell",
            "TextTopInset":"4",
            "TextLeftInset":"4",
            "TextBottomInset":"4",
            "TextRightInset":"4",
            "ClipContentToTextCell":"false",
            "AppliedCellStyle":"CellStyle/Generated%3aOption0",
            "AppliedCellStylePriority":"2",
            "TopEdgeStrokeWeight":"0.5",
            "TopEdgeStrokeColor":"Color/Black",
            "ClipContentToCell":"false",
            "LeftEdgeStrokePriority":"1",
            "RightEdgeStrokePriority":"1",
            "TopEdgeStrokePriority":"23",
            "BottomEdgeStrokePriority":"1",
        }
        self.attrib.update(data)
        self.classText = "Cell"
    def elementAfter(self, element):
        #print(self.data)
        subElement = {
            "_tag": "ParagraphStyleRange", 
            "AppliedParagraphStyle":"ParagraphStyle/Generated%3aTable - Header", "ParagraphShadingTint":"20", "ParagraphBorderTopLeftCornerRadius":"12", "ParagraphBorderTopRightCornerRadius":"12", "ParagraphBorderBottomLeftCornerRadius":"12", "ParagraphBorderBottomRightCornerRadius":"12", "ParagraphShadingTopLeftCornerRadius":"12", "ParagraphShadingTopRightCornerRadius":"12", "ParagraphShadingBottomLeftCornerRadius":"12", "ParagraphShadingBottomRightCornerRadius":"12",
            "_subElements": [
                {"_tag":"Properties", "_subElements":[{"_tag":"ParagraphBorderGapColor", "type":"object", "_text":"Swatch/None"}]},
                {"_tag":"CharacterStyleRange", "AppliedCharacterStyle":"CharacterStyle/$ID/[No character style]", "AppliedLanguage":"$ID/English: USA", "_subElements":[
                    {"_tag":"Content", "_text":self.data["value"]}
                ]}
            ]
        }
        subElement = dict_to_element(subElement)
        element.append(subElement)

    def afterDict(self, dictOb):
        subElement = {
            "_tag": "ParagraphStyleRange", 
            "AppliedParagraphStyle":"ParagraphStyle/Generated%3aTable - Header", "ParagraphShadingTint":"20", "ParagraphBorderTopLeftCornerRadius":"12", "ParagraphBorderTopRightCornerRadius":"12", "ParagraphBorderBottomLeftCornerRadius":"12", "ParagraphBorderBottomRightCornerRadius":"12", "ParagraphShadingTopLeftCornerRadius":"12", "ParagraphShadingTopRightCornerRadius":"12", "ParagraphShadingBottomLeftCornerRadius":"12", "ParagraphShadingBottomRightCornerRadius":"12",
            "_subElements": [
                {"_tag":"Properties", "_subElements":[{"_tag":"ParagraphBorderGapColor", "type":"object", "_text":"Swatch/None"}]},
                {"_tag":"CharacterStyleRange", "AppliedCharacterStyle":"CharacterStyle/$ID/[No character style]", "AppliedLanguage":"$ID/English: USA", "_subElements":[
                    {"_tag":"Content", "_text":self.data["value"]}
                ]}
            ]
        }
        dictOb["_subElements"] = [subElement]
        pass


class table(parent):
    def __init__(self, data):
        self.data = data
        self.rowsCount = len(data)
        self.attrib = {
            "_tag":"Table",
            "Self":"u00000i00000",
            "HeaderRowCount":"0",
            "FooterRowCount":"0",
            "TextTopInset":"4",
            "TextLeftInset":"4",
            "TextBottomInset":"4",
            "TextRightInset":"4",
            "ClipContentToTextCell":"false",
            "BodyRowCount":str(self.rowsCount),
            "ColumnCount":str(self.columnsCount),
            "AppliedTableStyle":"TableStyle/Generated%3aBasic Table",
            "TableDirection":"LeftToRightDirection",
        }
        self.classText = "Table"
        
        self.rowsIndex = []
        self.columnsIndex = []
        self.borders = {}
        self.cells = []

        for i in range(self.rowsCount):
            rowData = {
                "_tag":"Row",
                "Self":"u00000i00000Row0",
                "Name":str(i),
                "TextTopInset":"4",
                "TextLeftInset":"4",
                "TextBottomInset":"8.503937007874017",
                "TextRightInset":"4",
                "ClipContentToTextCell":"false",
                "SingleRowHeight":"23.56384301373339",
                "MinimumHeight":"14.1732283465",
                "KeepWithNextRow":"true",
            }
            self.rowsIndex.append(rowData)
        for i in range(self.columnsCount):
            columnData = {
                "_tag":"Column",
                "Self":"u00000i00000Column0",
                "Name":str(i),
                "TextTopInset":"4",
                "TextLeftInset":"4",
                "TextBottomInset":"8.503937007874017",
                "TextRightInset":"4",
                "ClipContentToTextCell":"false",
                "SingleColumnWidth":"96.37795275590551",
            }
            self.columnsIndex.append(columnData)
        
        rowIndex = 0
        for row in self.data:
            columnIndex = 0
            for cellObject in row:
                #print(rowIndex, columnIndex, cellObject)
                cellObject["Name"] = "%s:%s"%(columnIndex, rowIndex)
                self.cells.append(cell(cellObject,self))
                columnDelta = 1
                columnIndex += columnDelta
            rowIndex += 1


    @property
    def columnsCount(self):
        count = 0
        for r in self.data:
            count = max(count, len(r))
        return count
    def elementAfter(self, element):
        for i in self.rowsIndex:
            element.append(i)
        for i in self.columnsIndex:
            element.append(i)
        for i in self.cells:
            element.append(i.element)
    def afterDict(self, dictOb):
        for i in self.rowsIndex:
            dictOb["_subElements"].append(dict(i))
        for i in self.columnsIndex:
            dictOb["_subElements"].append(dict(i))
        for i in self.cells:
            dictOb["_subElements"].append(i.__dict__)



class document(parent):
    def __init__(self, data):
        self.data = data
        self.table = table(data).__dict__
        self.subElement_storyContent = [
            {"_tag": "StoryPreference", "OpticalMarginAlignment": "false", "OpticalMarginSize": "12", "FrameType": "TextFrameType", "StoryOrientation": "Horizontal", "StoryDirection": "LeftToRightDirection"}, {"_tag": "MetadataPacketPreference", "_subElements":[
			{"_tag": "Properties", "_subElements":[
				{"_tag": "Contents"} ] } ] }, {"_tag": "InCopyExportOption", "IncludeGraphicProxies": "true", "IncludeAllResources": "false"}, {"_tag": "ParagraphStyleRange", "AppliedParagraphStyle": "ParagraphStyle/$ID/NormalParagraphStyle", "ParagraphShadingTint": "20", "ParagraphBorderTopLeftCornerRadius": "12", "ParagraphBorderTopRightCornerRadius": "12", "ParagraphBorderBottomLeftCornerRadius": "12", "ParagraphBorderBottomRightCornerRadius": "12", "ParagraphShadingTopLeftCornerRadius": "12", "ParagraphShadingTopRightCornerRadius": "12", "ParagraphShadingBottomLeftCornerRadius": "12", "ParagraphShadingBottomRightCornerRadius": "12", "_subElements":[
			{"_tag": "Properties", "_subElements":[
				{"_tag": "ParagraphBorderGapColor", "_text": "Swatch/None", "type": "object"} ] }, {"_tag": "CharacterStyleRange", "AppliedCharacterStyle": "CharacterStyle/$ID/[No character style]", "AppliedLanguage": "$ID/English: USA", "_subElements":[
				self.table
				]}
			]}
		]
        self.subElement_first = [
            {"_tag": "Color", "Self": "Color/Black", "Model": "Process", "Space": "CMYK", "ColorValue": "0 0 0 100", "ColorOverride": "Specialblack", "ConvertToHsb": "false", "AlternateSpace": "NoAlternateColor", "AlternateColorValue": "", "Name": "Black", "ColorEditable": "false", "ColorRemovable": "false", "Visible": "true", "SwatchCreatorID": "7937", "SwatchColorGroupReference": "ud0d3ColorGroupSwatch3"},
            {"_tag": "Color", "Self": "Color/C=30 M=90 Y=19 K=0", "Model": "Process", "Space": "CMYK", "ColorValue": "30.19607843137255 89.80392156862746 18.823529411764707 0.39215686274509803", "ColorOverride": "Normal", "ConvertToHsb": "false", "AlternateSpace": "NoAlternateColor", "AlternateColorValue": "", "Name": "C=30 M=90 Y=19 K=0", "ColorEditable": "true", "ColorRemovable": "true", "Visible": "true", "SwatchCreatorID": "7937", "SwatchColorGroupReference": "u16018ColorGroupSwatch1"},
            {"_tag": "Color", "Self": "Color/C=100 M=0 Y=0 K=0", "Model": "Process", "Space": "CMYK", "ColorValue": "100 0 0 0", "ColorOverride": "Normal", "ConvertToHsb": "false", "AlternateSpace": "NoAlternateColor", "AlternateColorValue": "", "Name": "C=100 M=0 Y=0 K=0", "ColorEditable": "true", "ColorRemovable": "true", "Visible": "true", "SwatchCreatorID": "7937", "SwatchColorGroupReference": "ud0d3ColorGroupSwatch9"},
            {"_tag": "Ink", "Self": "Ink/$ID/Process Cyan", "Name": "$ID/Process Cyan", "Angle": "15", "ConvertToProcess": "false", "Frequency": "85", "NeutralDensity": "0.61", "PrintInk": "true", "TrapOrder": "1", "InkType": "Normal"},
            {"_tag": "Ink", "Self": "Ink/$ID/Process Magenta", "Name": "$ID/Process Magenta", "Angle": "75", "ConvertToProcess": "false", "Frequency": "85", "NeutralDensity": "0.76", "PrintInk": "true", "TrapOrder": "2", "InkType": "Normal"},
            {"_tag": "Ink", "Self": "Ink/$ID/Process Yellow", "Name": "$ID/Process Yellow", "Angle": "0", "ConvertToProcess": "false", "Frequency": "85", "NeutralDensity": "0.16", "PrintInk": "true", "TrapOrder": "3", "InkType": "Normal"},
            {"_tag": "Ink", "Self": "Ink/$ID/Process Black", "Name": "$ID/Process Black", "Angle": "45", "ConvertToProcess": "false", "Frequency": "85", "NeutralDensity": "1.7", "PrintInk": "true", "TrapOrder": "4", "InkType": "Normal"},
            {"_tag": "Swatch", "Self": "Swatch/None", "Name": "None", "ColorEditable": "false", "ColorRemovable": "false", "Visible": "true", "SwatchCreatorID": "7937", "SwatchColorGroupReference": "ud0d3ColorGroupSwatch0"},
            {"_tag": "StrokeStyle", "Self": "StrokeStyle/$ID/Solid", "Name": "$ID/Solid"},
            {"_tag": "FontFamily", "Self": "di3e", "Name": "Times New Roman", "_subElements":[{"_tag": "Font", "Self": "di3eFontnTimes New Roman Regular", "FontFamily": "Times New Roman", "Name": "Times New Roman Regular", "PostScriptName": "TimesNewRomanPSMT", "Status": "Installed", "FontStyleName": "Regular", "FontType": "OpenTypeTT", "WritingScript": "0", "FullName": "Times New Roman", "FullNameNative": "Times New Roman", "FontStyleNameNative": "Regular", "PlatformName": "$ID/", "Version": "Version 5.07", "TypekitID": "$ID/"}, {"_tag": "Font", "Self": "di3eFontnTimes New Roman Italic", "FontFamily": "Times New Roman", "Name": "Times New Roman Italic", "PostScriptName": "TimesNewRomanPS-ItalicMT", "Status": "Installed", "FontStyleName": "Italic", "FontType": "OpenTypeTT", "WritingScript": "0", "FullName": "Times New Roman Italic", "FullNameNative": "Times New Roman Italic", "FontStyleNameNative": "Italic", "PlatformName": "$ID/", "Version": "Version 5.07", "TypekitID": "$ID/"}, {"_tag": "Font", "Self": "di3eFontnTimes New Roman Bold", "FontFamily": "Times New Roman", "Name": "Times New Roman Bold", "PostScriptName": "TimesNewRomanPS-BoldMT", "Status": "Installed", "FontStyleName": "Bold", "FontType": "OpenTypeTT", "WritingScript": "0", "FullName": "Times New Roman Bold", "FullNameNative": "Times New Roman Bold", "FontStyleNameNative": "Bold", "PlatformName": "$ID/", "Version": "Version 5.07", "TypekitID": "$ID/"}, {"_tag": "Font", "Self": "di3eFontnTimes New Roman Bold Italic", "FontFamily": "Times New Roman", "Name": "Times New Roman Bold Italic", "PostScriptName": "TimesNewRomanPS-BoldItalicMT", "Status": "Installed", "FontStyleName": "Bold Italic", "FontType": "OpenTypeTT", "WritingScript": "0", "FullName": "Times New Roman Bold Italic", "FullNameNative": "Times New Roman Bold Italic", "FontStyleNameNative": "Bold Italic", "PlatformName": "$ID/", "Version": "Version 5.07", "TypekitID": "$ID/"} ] },
            {"_tag": "FontFamily", "Self": "di95", "Name": "Myriad Pro", "_subElements":[{"_tag": "Font", "Self": "di95FontnMyriad Pro Regular", "FontFamily": "Myriad Pro", "Name": "Myriad Pro Regular", "PostScriptName": "MyriadPro-Regular", "Status": "Installed", "FontStyleName": "Regular", "FontType": "OpenTypeCFF", "WritingScript": "0", "FullName": "Myriad Pro", "FullNameNative": "Myriad Pro", "FontStyleNameNative": "Regular", "PlatformName": "$ID/", "Version": "Version 2.102;PS 2.000;hotconv 1.0.67;makeotf.lib2.5.33168", "TypekitID": "$ID/"}, {"_tag": "Font", "Self": "di95FontnMyriad Pro Condensed", "FontFamily": "Myriad Pro", "Name": "Myriad Pro Condensed", "PostScriptName": "MyriadPro-Cond", "Status": "Substituted", "FontStyleName": "Condensed", "FontType": "OpenTypeCFF", "WritingScript": "0", "FullName": "Myriad Pro Condensed", "FullNameNative": "Myriad Pro Condensed", "FontStyleNameNative": "Condensed", "PlatformName": "$ID/", "Version": "Version 2.102;PS 2.000;hotconv 1.0.67;makeotf.lib2.5.33168", "TypekitID": "$ID/"}, {"_tag": "Font", "Self": "di95FontnMyriad Pro Condensed Italic", "FontFamily": "Myriad Pro", "Name": "Myriad Pro Condensed Italic", "PostScriptName": "MyriadPro-CondIt", "Status": "Substituted", "FontStyleName": "Condensed Italic", "FontType": "OpenTypeCFF", "WritingScript": "0", "FullName": "Myriad Pro Condensed Italic", "FullNameNative": "Myriad Pro Condensed Italic", "FontStyleNameNative": "Condensed Italic", "PlatformName": "$ID/", "Version": "Version 2.102;PS 2.000;hotconv 1.0.67;makeotf.lib2.5.33168", "TypekitID": "$ID/"}, {"_tag": "Font", "Self": "di95FontnMyriad Pro Bold Condensed", "FontFamily": "Myriad Pro", "Name": "Myriad Pro Bold Condensed", "PostScriptName": "MyriadPro-BoldCond", "Status": "Substituted", "FontStyleName": "Bold Condensed", "FontType": "OpenTypeCFF", "WritingScript": "0", "FullName": "Myriad Pro Bold Condensed", "FullNameNative": "Myriad Pro Bold Condensed", "FontStyleNameNative": "Bold Condensed", "PlatformName": "$ID/", "Version": "Version 2.102;PS 2.000;hotconv 1.0.67;makeotf.lib2.5.33168", "TypekitID": "$ID/"}, {"_tag": "Font", "Self": "di95FontnMyriad Pro Bold Condensed Italic", "FontFamily": "Myriad Pro", "Name": "Myriad Pro Bold Condensed Italic", "PostScriptName": "MyriadPro-BoldCondIt", "Status": "Substituted", "FontStyleName": "Bold Condensed Italic", "FontType": "OpenTypeCFF", "WritingScript": "0", "FullName": "Myriad Pro Bold Condensed Italic", "FullNameNative": "Myriad Pro Bold Condensed Italic", "FontStyleNameNative": "Bold Condensed Italic", "PlatformName": "$ID/", "Version": "Version 2.102;PS 2.000;hotconv 1.0.67;makeotf.lib2.5.33168", "TypekitID": "$ID/"}, {"_tag": "Font", "Self": "di95FontnMyriad Pro Italic", "FontFamily": "Myriad Pro", "Name": "Myriad Pro Italic", "PostScriptName": "MyriadPro-It", "Status": "Installed", "FontStyleName": "Italic", "FontType": "OpenTypeCFF", "WritingScript": "0", "FullName": "Myriad Pro Italic", "FullNameNative": "Myriad Pro Italic", "FontStyleNameNative": "Italic", "PlatformName": "$ID/", "Version": "Version 2.102;PS 2.000;hotconv 1.0.67;makeotf.lib2.5.33168", "TypekitID": "$ID/"}, {"_tag": "Font", "Self": "di95FontnMyriad Pro Semibold", "FontFamily": "Myriad Pro", "Name": "Myriad Pro Semibold", "PostScriptName": "MyriadPro-Semibold", "Status": "Substituted", "FontStyleName": "Semibold", "FontType": "OpenTypeCFF", "WritingScript": "0", "FullName": "Myriad Pro Semibold", "FullNameNative": "Myriad Pro Semibold", "FontStyleNameNative": "Semibold", "PlatformName": "$ID/", "Version": "Version 2.102;PS 2.000;hotconv 1.0.67;makeotf.lib2.5.33168", "TypekitID": "$ID/"}, {"_tag": "Font", "Self": "di95FontnMyriad Pro Semibold Italic", "FontFamily": "Myriad Pro", "Name": "Myriad Pro Semibold Italic", "PostScriptName": "MyriadPro-SemiboldIt", "Status": "Substituted", "FontStyleName": "Semibold Italic", "FontType": "OpenTypeCFF", "WritingScript": "0", "FullName": "Myriad Pro Semibold Italic", "FullNameNative": "Myriad Pro Semibold Italic", "FontStyleNameNative": "Semibold Italic", "PlatformName": "$ID/", "Version": "Version 2.102;PS 2.000;hotconv 1.0.67;makeotf.lib2.5.33168", "TypekitID": "$ID/"}, {"_tag": "Font", "Self": "di95FontnMyriad Pro Bold", "FontFamily": "Myriad Pro", "Name": "Myriad Pro Bold", "PostScriptName": "MyriadPro-Bold", "Status": "Installed", "FontStyleName": "Bold", "FontType": "OpenTypeCFF", "WritingScript": "0", "FullName": "Myriad Pro Bold", "FullNameNative": "Myriad Pro Bold", "FontStyleNameNative": "Bold", "PlatformName": "$ID/", "Version": "Version 2.102;PS 2.000;hotconv 1.0.67;makeotf.lib2.5.33168", "TypekitID": "$ID/"}, {"_tag": "Font", "Self": "di95FontnMyriad Pro Bold Italic", "FontFamily": "Myriad Pro", "Name": "Myriad Pro Bold Italic", "PostScriptName": "MyriadPro-BoldIt", "Status": "Installed", "FontStyleName": "Bold Italic", "FontType": "OpenTypeCFF", "WritingScript": "0", "FullName": "Myriad Pro Bold Italic", "FullNameNative": "Myriad Pro Bold Italic", "FontStyleNameNative": "Bold Italic", "PlatformName": "$ID/", "Version": "Version 2.102;PS 2.000;hotconv 1.0.67;makeotf.lib2.5.33168", "TypekitID": "$ID/"}, {"_tag": "Font", "Self": "di95FontnMyriad Pro Light Condensed", "FontFamily": "Myriad Pro", "Name": "Myriad Pro Light Condensed", "PostScriptName": "MyriadPro-LightCond", "Status": "Substituted", "FontStyleName": "Light Condensed", "FontType": "OpenTypeCFF", "WritingScript": "0", "FullName": "Myriad Pro Light Condensed", "FullNameNative": "Myriad Pro Light Condensed", "FontStyleNameNative": "Light Condensed", "PlatformName": "$ID/", "Version": "Version 2.037;PS 2.000;hotconv 1.0.51;makeotf.lib2.0.18671", "TypekitID": "$ID/"}, {"_tag": "Font", "Self": "di95FontnMyriad Pro Light Condensed Italic", "FontFamily": "Myriad Pro", "Name": "Myriad Pro Light Condensed Italic", "PostScriptName": "MyriadPro-LightCondIt", "Status": "Substituted", "FontStyleName": "Light Condensed Italic", "FontType": "OpenTypeCFF", "WritingScript": "0", "FullName": "Myriad Pro Light Condensed Italic", "FullNameNative": "Myriad Pro Light Condensed Italic", "FontStyleNameNative": "Light Condensed Italic", "PlatformName": "$ID/", "Version": "Version 2.037;PS 2.000;hotconv 1.0.51;makeotf.lib2.0.18671", "TypekitID": "$ID/"}, {"_tag": "Font", "Self": "di95FontnMyriad Pro Semibold Condensed", "FontFamily": "Myriad Pro", "Name": "Myriad Pro Semibold Condensed", "PostScriptName": "MyriadPro-SemiboldCond", "Status": "Substituted", "FontStyleName": "Semibold Condensed", "FontType": "OpenTypeCFF", "WritingScript": "0", "FullName": "Myriad Pro Semibold Condensed", "FullNameNative": "Myriad Pro Semibold Condensed", "FontStyleNameNative": "Semibold Condensed", "PlatformName": "$ID/", "Version": "Version 2.037;PS 2.000;hotconv 1.0.51;makeotf.lib2.0.18671", "TypekitID": "$ID/"}, {"_tag": "Font", "Self": "di95FontnMyriad Pro Semibold Condensed Italic", "FontFamily": "Myriad Pro", "Name": "Myriad Pro Semibold Condensed Italic", "PostScriptName": "MyriadPro-SemiboldCondIt", "Status": "Substituted", "FontStyleName": "Semibold Condensed Italic", "FontType": "OpenTypeCFF", "WritingScript": "0", "FullName": "Myriad Pro Semibold Condensed Italic", "FullNameNative": "Myriad Pro Semibold Condensed Italic", "FontStyleNameNative": "Semibold Condensed Italic", "PlatformName": "$ID/", "Version": "Version 2.037;PS 2.000;hotconv 1.0.51;makeotf.lib2.0.18671", "TypekitID": "$ID/"}, {"_tag": "Font", "Self": "di95FontnMyriad Pro Black Condensed", "FontFamily": "Myriad Pro", "Name": "Myriad Pro Black Condensed", "PostScriptName": "MyriadPro-BlackCond", "Status": "Substituted", "FontStyleName": "Black Condensed", "FontType": "OpenTypeCFF", "WritingScript": "0", "FullName": "Myriad Pro Black Condensed", "FullNameNative": "Myriad Pro Black Condensed", "FontStyleNameNative": "Black Condensed", "PlatformName": "$ID/", "Version": "Version 2.037;PS 2.000;hotconv 1.0.51;makeotf.lib2.0.18671", "TypekitID": "$ID/"}, {"_tag": "Font", "Self": "di95FontnMyriad Pro Black Condensed Italic", "FontFamily": "Myriad Pro", "Name": "Myriad Pro Black Condensed Italic", "PostScriptName": "MyriadPro-BlackCondIt", "Status": "Substituted", "FontStyleName": "Black Condensed Italic", "FontType": "OpenTypeCFF", "WritingScript": "0", "FullName": "Myriad Pro Black Condensed Italic", "FullNameNative": "Myriad Pro Black Condensed Italic", "FontStyleNameNative": "Black Condensed Italic", "PlatformName": "$ID/", "Version": "Version 2.037;PS 2.000;hotconv 1.0.51;makeotf.lib2.0.18671", "TypekitID": "$ID/"}, {"_tag": "Font", "Self": "di95FontnMyriad Pro Light SemiCondensed", "FontFamily": "Myriad Pro", "Name": "Myriad Pro Light SemiCondensed", "PostScriptName": "MyriadPro-LightSemiCn", "Status": "Substituted", "FontStyleName": "Light SemiCondensed", "FontType": "OpenTypeCFF", "WritingScript": "0", "FullName": "Myriad Pro Light SemiCondensed", "FullNameNative": "Myriad Pro Light SemiCondensed", "FontStyleNameNative": "Light SemiCondensed", "PlatformName": "$ID/", "Version": "Version 2.037;PS 2.000;hotconv 1.0.51;makeotf.lib2.0.18671", "TypekitID": "$ID/"}, {"_tag": "Font", "Self": "di95FontnMyriad Pro Light SemiCondensed Italic", "FontFamily": "Myriad Pro", "Name": "Myriad Pro Light SemiCondensed Italic", "PostScriptName": "MyriadPro-LightSemiCnIt", "Status": "Substituted", "FontStyleName": "Light SemiCondensed Italic", "FontType": "OpenTypeCFF", "WritingScript": "0", "FullName": "Myriad Pro Light SemiCondensed Italic", "FullNameNative": "Myriad Pro Light SemiCondensed Italic", "FontStyleNameNative": "Light SemiCondensed Italic", "PlatformName": "$ID/", "Version": "Version 2.037;PS 2.000;hotconv 1.0.51;makeotf.lib2.0.18671", "TypekitID": "$ID/"}, {"_tag": "Font", "Self": "di95FontnMyriad Pro SemiCondensed", "FontFamily": "Myriad Pro", "Name": "Myriad Pro SemiCondensed", "PostScriptName": "MyriadPro-SemiCn", "Status": "Substituted", "FontStyleName": "SemiCondensed", "FontType": "OpenTypeCFF", "WritingScript": "0", "FullName": "Myriad Pro SemiCondensed", "FullNameNative": "Myriad Pro SemiCondensed", "FontStyleNameNative": "SemiCondensed", "PlatformName": "$ID/", "Version": "Version 2.037;PS 2.000;hotconv 1.0.51;makeotf.lib2.0.18671", "TypekitID": "$ID/"}, {"_tag": "Font", "Self": "di95FontnMyriad Pro SemiCondensed Italic", "FontFamily": "Myriad Pro", "Name": "Myriad Pro SemiCondensed Italic", "PostScriptName": "MyriadPro-SemiCnIt", "Status": "Substituted", "FontStyleName": "SemiCondensed Italic", "FontType": "OpenTypeCFF", "WritingScript": "0", "FullName": "Myriad Pro SemiCondensed Italic", "FullNameNative": "Myriad Pro SemiCondensed Italic", "FontStyleNameNative": "SemiCondensed Italic", "PlatformName": "$ID/", "Version": "Version 2.037;PS 2.000;hotconv 1.0.51;makeotf.lib2.0.18671", "TypekitID": "$ID/"}, {"_tag": "Font", "Self": "di95FontnMyriad Pro Semibold SemiCondensed", "FontFamily": "Myriad Pro", "Name": "Myriad Pro Semibold SemiCondensed", "PostScriptName": "MyriadPro-SemiboldSemiCn", "Status": "Substituted", "FontStyleName": "Semibold SemiCondensed", "FontType": "OpenTypeCFF", "WritingScript": "0", "FullName": "Myriad Pro Semibold SemiCondensed", "FullNameNative": "Myriad Pro Semibold SemiCondensed", "FontStyleNameNative": "Semibold SemiCondensed", "PlatformName": "$ID/", "Version": "Version 2.037;PS 2.000;hotconv 1.0.51;makeotf.lib2.0.18671", "TypekitID": "$ID/"}, {"_tag": "Font", "Self": "di95FontnMyriad Pro Semibold SemiCondensed Italic", "FontFamily": "Myriad Pro", "Name": "Myriad Pro Semibold SemiCondensed Italic", "PostScriptName": "MyriadPro-SemiboldSemiCnIt", "Status": "Substituted", "FontStyleName": "Semibold SemiCondensed Italic", "FontType": "OpenTypeCFF", "WritingScript": "0", "FullName": "Myriad Pro Semibold SemiCondensed Italic", "FullNameNative": "Myriad Pro Semibold SemiCondensed Italic", "FontStyleNameNative": "Semibold SemiCondensed Italic", "PlatformName": "$ID/", "Version": "Version 2.037;PS 2.000;hotconv 1.0.51;makeotf.lib2.0.18671", "TypekitID": "$ID/"}, {"_tag": "Font", "Self": "di95FontnMyriad Pro Bold SemiCondensed", "FontFamily": "Myriad Pro", "Name": "Myriad Pro Bold SemiCondensed", "PostScriptName": "MyriadPro-BoldSemiCn", "Status": "Substituted", "FontStyleName": "Bold SemiCondensed", "FontType": "OpenTypeCFF", "WritingScript": "0", "FullName": "Myriad Pro Bold SemiCondensed", "FullNameNative": "Myriad Pro Bold SemiCondensed", "FontStyleNameNative": "Bold SemiCondensed", "PlatformName": "$ID/", "Version": "Version 2.037;PS 2.000;hotconv 1.0.51;makeotf.lib2.0.18671", "TypekitID": "$ID/"}, {"_tag": "Font", "Self": "di95FontnMyriad Pro Bold SemiCondensed Italic", "FontFamily": "Myriad Pro", "Name": "Myriad Pro Bold SemiCondensed Italic", "PostScriptName": "MyriadPro-BoldSemiCnIt", "Status": "Substituted", "FontStyleName": "Bold SemiCondensed Italic", "FontType": "OpenTypeCFF", "WritingScript": "0", "FullName": "Myriad Pro Bold SemiCondensed Italic", "FullNameNative": "Myriad Pro Bold SemiCondensed Italic", "FontStyleNameNative": "Bold SemiCondensed Italic", "PlatformName": "$ID/", "Version": "Version 2.037;PS 2.000;hotconv 1.0.51;makeotf.lib2.0.18671", "TypekitID": "$ID/"}, {"_tag": "Font", "Self": "di95FontnMyriad Pro Black SemiCondensed", "FontFamily": "Myriad Pro", "Name": "Myriad Pro Black SemiCondensed", "PostScriptName": "MyriadPro-BlackSemiCn", "Status": "Substituted", "FontStyleName": "Black SemiCondensed", "FontType": "OpenTypeCFF", "WritingScript": "0", "FullName": "Myriad Pro Black SemiCondensed", "FullNameNative": "Myriad Pro Black SemiCondensed", "FontStyleNameNative": "Black SemiCondensed", "PlatformName": "$ID/", "Version": "Version 2.037;PS 2.000;hotconv 1.0.51;makeotf.lib2.0.18671", "TypekitID": "$ID/"}, {"_tag": "Font", "Self": "di95FontnMyriad Pro Black SemiCondensed Italic", "FontFamily": "Myriad Pro", "Name": "Myriad Pro Black SemiCondensed Italic", "PostScriptName": "MyriadPro-BlackSemiCnIt", "Status": "Substituted", "FontStyleName": "Black SemiCondensed Italic", "FontType": "OpenTypeCFF", "WritingScript": "0", "FullName": "Myriad Pro Black SemiCondensed Italic", "FullNameNative": "Myriad Pro Black SemiCondensed Italic", "FontStyleNameNative": "Black SemiCondensed Italic", "PlatformName": "$ID/", "Version": "Version 2.037;PS 2.000;hotconv 1.0.51;makeotf.lib2.0.18671", "TypekitID": "$ID/"}, {"_tag": "Font", "Self": "di95FontnMyriad Pro Light", "FontFamily": "Myriad Pro", "Name": "Myriad Pro Light", "PostScriptName": "MyriadPro-Light", "Status": "Substituted", "FontStyleName": "Light", "FontType": "OpenTypeCFF", "WritingScript": "0", "FullName": "Myriad Pro Light", "FullNameNative": "Myriad Pro Light", "FontStyleNameNative": "Light", "PlatformName": "$ID/", "Version": "Version 2.037;PS 2.000;hotconv 1.0.51;makeotf.lib2.0.18671", "TypekitID": "$ID/"}, {"_tag": "Font", "Self": "di95FontnMyriad Pro Light Italic", "FontFamily": "Myriad Pro", "Name": "Myriad Pro Light Italic", "PostScriptName": "MyriadPro-LightIt", "Status": "Substituted", "FontStyleName": "Light Italic", "FontType": "OpenTypeCFF", "WritingScript": "0", "FullName": "Myriad Pro Light Italic", "FullNameNative": "Myriad Pro Light Italic", "FontStyleNameNative": "Light Italic", "PlatformName": "$ID/", "Version": "Version 2.037;PS 2.000;hotconv 1.0.51;makeotf.lib2.0.18671", "TypekitID": "$ID/"}, {"_tag": "Font", "Self": "di95FontnMyriad Pro Black", "FontFamily": "Myriad Pro", "Name": "Myriad Pro Black", "PostScriptName": "MyriadPro-Black", "Status": "Substituted", "FontStyleName": "Black", "FontType": "OpenTypeCFF", "WritingScript": "0", "FullName": "Myriad Pro Black", "FullNameNative": "Myriad Pro Black", "FontStyleNameNative": "Black", "PlatformName": "$ID/", "Version": "Version 2.037;PS 2.000;hotconv 1.0.51;makeotf.lib2.0.18671", "TypekitID": "$ID/"}, {"_tag": "Font", "Self": "di95FontnMyriad Pro Black Italic", "FontFamily": "Myriad Pro", "Name": "Myriad Pro Black Italic", "PostScriptName": "MyriadPro-BlackIt", "Status": "Substituted", "FontStyleName": "Black Italic", "FontType": "OpenTypeCFF", "WritingScript": "0", "FullName": "Myriad Pro Black Italic", "FullNameNative": "Myriad Pro Black Italic", "FontStyleNameNative": "Black Italic", "PlatformName": "$ID/", "Version": "Version 2.037;PS 2.000;hotconv 1.0.51;makeotf.lib2.0.18671", "TypekitID": "$ID/"}, {"_tag": "Font", "Self": "di95FontnMyriad Pro Light SemiExtended", "FontFamily": "Myriad Pro", "Name": "Myriad Pro Light SemiExtended", "PostScriptName": "MyriadPro-LightSemiExt", "Status": "Substituted", "FontStyleName": "Light SemiExtended", "FontType": "OpenTypeCFF", "WritingScript": "0", "FullName": "Myriad Pro Light SemiExtended", "FullNameNative": "Myriad Pro Light SemiExtended", "FontStyleNameNative": "Light SemiExtended", "PlatformName": "$ID/", "Version": "Version 2.037;PS 2.000;hotconv 1.0.51;makeotf.lib2.0.18671", "TypekitID": "$ID/"}, {"_tag": "Font", "Self": "di95FontnMyriad Pro Light SemiExtended Italic", "FontFamily": "Myriad Pro", "Name": "Myriad Pro Light SemiExtended Italic", "PostScriptName": "MyriadPro-LightSemiExtIt", "Status": "Substituted", "FontStyleName": "Light SemiExtended Italic", "FontType": "OpenTypeCFF", "WritingScript": "0", "FullName": "Myriad Pro Light SemiExtended Italic", "FullNameNative": "Myriad Pro Light SemiExtended Italic", "FontStyleNameNative": "Light SemiExtended Italic", "PlatformName": "$ID/", "Version": "Version 2.037;PS 2.000;hotconv 1.0.51;makeotf.lib2.0.18671", "TypekitID": "$ID/"}, {"_tag": "Font", "Self": "di95FontnMyriad Pro SemiExtended", "FontFamily": "Myriad Pro", "Name": "Myriad Pro SemiExtended", "PostScriptName": "MyriadPro-SemiExt", "Status": "Substituted", "FontStyleName": "SemiExtended", "FontType": "OpenTypeCFF", "WritingScript": "0", "FullName": "Myriad Pro SemiExtended", "FullNameNative": "Myriad Pro SemiExtended", "FontStyleNameNative": "SemiExtended", "PlatformName": "$ID/", "Version": "Version 2.037;PS 2.000;hotconv 1.0.51;makeotf.lib2.0.18671", "TypekitID": "$ID/"}, {"_tag": "Font", "Self": "di95FontnMyriad Pro SemiExtended Italic", "FontFamily": "Myriad Pro", "Name": "Myriad Pro SemiExtended Italic", "PostScriptName": "MyriadPro-SemiExtIt", "Status": "Substituted", "FontStyleName": "SemiExtended Italic", "FontType": "OpenTypeCFF", "WritingScript": "0", "FullName": "Myriad Pro SemiExtended Italic", "FullNameNative": "Myriad Pro SemiExtended Italic", "FontStyleNameNative": "SemiExtended Italic", "PlatformName": "$ID/", "Version": "Version 2.037;PS 2.000;hotconv 1.0.51;makeotf.lib2.0.18671", "TypekitID": "$ID/"}, {"_tag": "Font", "Self": "di95FontnMyriad Pro Semibold SemiExtended", "FontFamily": "Myriad Pro", "Name": "Myriad Pro Semibold SemiExtended", "PostScriptName": "MyriadPro-SemiboldSemiExt", "Status": "Substituted", "FontStyleName": "Semibold SemiExtended", "FontType": "OpenTypeCFF", "WritingScript": "0", "FullName": "Myriad Pro Semibold SemiExtended", "FullNameNative": "Myriad Pro Semibold SemiExtended", "FontStyleNameNative": "Semibold SemiExtended", "PlatformName": "$ID/", "Version": "Version 2.037;PS 2.000;hotconv 1.0.51;makeotf.lib2.0.18671", "TypekitID": "$ID/"}, {"_tag": "Font", "Self": "di95FontnMyriad Pro Semibold SemiExtended Italic", "FontFamily": "Myriad Pro", "Name": "Myriad Pro Semibold SemiExtended Italic", "PostScriptName": "MyriadPro-SemiboldSemiExtIt", "Status": "Substituted", "FontStyleName": "Semibold SemiExtended Italic", "FontType": "OpenTypeCFF", "WritingScript": "0", "FullName": "Myriad Pro Semibold SemiExtended Italic", "FullNameNative": "Myriad Pro Semibold SemiExtended Italic", "FontStyleNameNative": "Semibold SemiExtended Italic", "PlatformName": "$ID/", "Version": "Version 2.037;PS 2.000;hotconv 1.0.51;makeotf.lib2.0.18671", "TypekitID": "$ID/"}, {"_tag": "Font", "Self": "di95FontnMyriad Pro Bold SemiExtended", "FontFamily": "Myriad Pro", "Name": "Myriad Pro Bold SemiExtended", "PostScriptName": "MyriadPro-BoldSemiExt", "Status": "Substituted", "FontStyleName": "Bold SemiExtended", "FontType": "OpenTypeCFF", "WritingScript": "0", "FullName": "Myriad Pro Bold SemiExtended", "FullNameNative": "Myriad Pro Bold SemiExtended", "FontStyleNameNative": "Bold SemiExtended", "PlatformName": "$ID/", "Version": "Version 2.037;PS 2.000;hotconv 1.0.51;makeotf.lib2.0.18671", "TypekitID": "$ID/"}, {"_tag": "Font", "Self": "di95FontnMyriad Pro Bold SemiExtended Italic", "FontFamily": "Myriad Pro", "Name": "Myriad Pro Bold SemiExtended Italic", "PostScriptName": "MyriadPro-BoldSemiExtIt", "Status": "Substituted", "FontStyleName": "Bold SemiExtended Italic", "FontType": "OpenTypeCFF", "WritingScript": "0", "FullName": "Myriad Pro Bold SemiExtended Italic", "FullNameNative": "Myriad Pro Bold SemiExtended Italic", "FontStyleNameNative": "Bold SemiExtended Italic", "PlatformName": "$ID/", "Version": "Version 2.037;PS 2.000;hotconv 1.0.51;makeotf.lib2.0.18671", "TypekitID": "$ID/"}, {"_tag": "Font", "Self": "di95FontnMyriad Pro Black SemiExtended", "FontFamily": "Myriad Pro", "Name": "Myriad Pro Black SemiExtended", "PostScriptName": "MyriadPro-BlackSemiExt", "Status": "Substituted", "FontStyleName": "Black SemiExtended", "FontType": "OpenTypeCFF", "WritingScript": "0", "FullName": "Myriad Pro Black SemiExtended", "FullNameNative": "Myriad Pro Black SemiExtended", "FontStyleNameNative": "Black SemiExtended", "PlatformName": "$ID/", "Version": "Version 2.037;PS 2.000;hotconv 1.0.51;makeotf.lib2.0.18671", "TypekitID": "$ID/"}, {"_tag": "Font", "Self": "di95FontnMyriad Pro Black SemiExtended Italic", "FontFamily": "Myriad Pro", "Name": "Myriad Pro Black SemiExtended Italic", "PostScriptName": "MyriadPro-BlackSemiExtIt", "Status": "Substituted", "FontStyleName": "Black SemiExtended Italic", "FontType": "OpenTypeCFF", "WritingScript": "0", "FullName": "Myriad Pro Black SemiExtended Italic", "FullNameNative": "Myriad Pro Black SemiExtended Italic", "FontStyleNameNative": "Black SemiExtended Italic", "PlatformName": "$ID/", "Version": "Version 2.037;PS 2.000;hotconv 1.0.51;makeotf.lib2.0.18671", "TypekitID": "$ID/"} ] },
            {"_tag": "FontFamily", "Self": "di96", "Name": "Minion Pro", "_subElements":[{"_tag": "Font", "Self": "di96FontnMinion Pro Regular", "FontFamily": "Minion Pro", "Name": "Minion Pro Regular", "PostScriptName": "MinionPro-Regular", "Status": "Installed", "FontStyleName": "Regular", "FontType": "OpenTypeCFF", "WritingScript": "0", "FullName": "Minion Pro", "FullNameNative": "Minion Pro", "FontStyleNameNative": "Regular", "PlatformName": "$ID/", "Version": "Version 2.108;PS 2.000;hotconv 1.0.67;makeotf.lib2.5.33168", "TypekitID": "$ID/"}, {"_tag": "Font", "Self": "di96FontnMinion Pro Italic", "FontFamily": "Minion Pro", "Name": "Minion Pro Italic", "PostScriptName": "MinionPro-It", "Status": "Substituted", "FontStyleName": "Italic", "FontType": "OpenTypeCFF", "WritingScript": "0", "FullName": "Minion Pro Italic", "FullNameNative": "Minion Pro Italic", "FontStyleNameNative": "Italic", "PlatformName": "$ID/", "Version": "Version 2.108;PS 2.000;hotconv 1.0.67;makeotf.lib2.5.33168", "TypekitID": "$ID/"}, {"_tag": "Font", "Self": "di96FontnMinion Pro Bold", "FontFamily": "Minion Pro", "Name": "Minion Pro Bold", "PostScriptName": "MinionPro-Bold", "Status": "Substituted", "FontStyleName": "Bold", "FontType": "OpenTypeCFF", "WritingScript": "0", "FullName": "Minion Pro Bold", "FullNameNative": "Minion Pro Bold", "FontStyleNameNative": "Bold", "PlatformName": "$ID/", "Version": "Version 2.108;PS 2.000;hotconv 1.0.67;makeotf.lib2.5.33168", "TypekitID": "$ID/"}, {"_tag": "Font", "Self": "di96FontnMinion Pro Semibold Italic", "FontFamily": "Minion Pro", "Name": "Minion Pro Semibold Italic", "PostScriptName": "MinionPro-SemiboldIt", "Status": "Substituted", "FontStyleName": "Semibold Italic", "FontType": "OpenTypeCFF", "WritingScript": "0", "FullName": "Minion Pro Semibold Italic", "FullNameNative": "Minion Pro Semibold Italic", "FontStyleNameNative": "Semibold Italic", "PlatformName": "$ID/", "Version": "Version 2.108;PS 2.000;hotconv 1.0.67;makeotf.lib2.5.33168", "TypekitID": "$ID/"}, {"_tag": "Font", "Self": "di96FontnMinion Pro Medium Italic", "FontFamily": "Minion Pro", "Name": "Minion Pro Medium Italic", "PostScriptName": "MinionPro-MediumIt", "Status": "Substituted", "FontStyleName": "Medium Italic", "FontType": "OpenTypeCFF", "WritingScript": "0", "FullName": "Minion Pro Medium Italic", "FullNameNative": "Minion Pro Medium Italic", "FontStyleNameNative": "Medium Italic", "PlatformName": "$ID/", "Version": "Version 2.108;PS 2.000;hotconv 1.0.67;makeotf.lib2.5.33168", "TypekitID": "$ID/"}, {"_tag": "Font", "Self": "di96FontnMinion Pro Bold Cond", "FontFamily": "Minion Pro", "Name": "Minion Pro Bold Cond", "PostScriptName": "MinionPro-BoldCn", "Status": "Substituted", "FontStyleName": "Bold Cond", "FontType": "OpenTypeCFF", "WritingScript": "0", "FullName": "Minion Pro Bold Cond", "FullNameNative": "Minion Pro Bold Cond", "FontStyleNameNative": "Bold Cond", "PlatformName": "$ID/", "Version": "Version 2.108;PS 2.000;hotconv 1.0.67;makeotf.lib2.5.33168", "TypekitID": "$ID/"}, {"_tag": "Font", "Self": "di96FontnMinion Pro Bold Cond Italic", "FontFamily": "Minion Pro", "Name": "Minion Pro Bold Cond Italic", "PostScriptName": "MinionPro-BoldCnIt", "Status": "Substituted", "FontStyleName": "Bold Cond Italic", "FontType": "OpenTypeCFF", "WritingScript": "0", "FullName": "Minion Pro Bold Cond Italic", "FullNameNative": "Minion Pro Bold Cond Italic", "FontStyleNameNative": "Bold Cond Italic", "PlatformName": "$ID/", "Version": "Version 2.108;PS 2.000;hotconv 1.0.67;makeotf.lib2.5.33168", "TypekitID": "$ID/"}, {"_tag": "Font", "Self": "di96FontnMinion Pro Medium", "FontFamily": "Minion Pro", "Name": "Minion Pro Medium", "PostScriptName": "MinionPro-Medium", "Status": "Substituted", "FontStyleName": "Medium", "FontType": "OpenTypeCFF", "WritingScript": "0", "FullName": "Minion Pro Medium", "FullNameNative": "Minion Pro Medium", "FontStyleNameNative": "Medium", "PlatformName": "$ID/", "Version": "Version 2.108;PS 2.000;hotconv 1.0.67;makeotf.lib2.5.33168", "TypekitID": "$ID/"}, {"_tag": "Font", "Self": "di96FontnMinion Pro Semibold", "FontFamily": "Minion Pro", "Name": "Minion Pro Semibold", "PostScriptName": "MinionPro-Semibold", "Status": "Substituted", "FontStyleName": "Semibold", "FontType": "OpenTypeCFF", "WritingScript": "0", "FullName": "Minion Pro Semibold", "FullNameNative": "Minion Pro Semibold", "FontStyleNameNative": "Semibold", "PlatformName": "$ID/", "Version": "Version 2.108;PS 2.000;hotconv 1.0.67;makeotf.lib2.5.33168", "TypekitID": "$ID/"}, {"_tag": "Font", "Self": "di96FontnMinion Pro Bold Italic", "FontFamily": "Minion Pro", "Name": "Minion Pro Bold Italic", "PostScriptName": "MinionPro-BoldIt", "Status": "Substituted", "FontStyleName": "Bold Italic", "FontType": "OpenTypeCFF", "WritingScript": "0", "FullName": "Minion Pro Bold Italic", "FullNameNative": "Minion Pro Bold Italic", "FontStyleNameNative": "Bold Italic", "PlatformName": "$ID/", "Version": "Version 2.108;PS 2.000;hotconv 1.0.67;makeotf.lib2.5.33168", "TypekitID": "$ID/"}, {"_tag": "Font", "Self": "di96FontnMinion Pro Cond Caption", "FontFamily": "Minion Pro", "Name": "Minion Pro Cond Caption", "PostScriptName": "MinionPro-CnCapt", "Status": "Substituted", "FontStyleName": "Cond Caption", "FontType": "OpenTypeCFF", "WritingScript": "0", "FullName": "Minion Pro Cond Caption", "FullNameNative": "Minion Pro Cond Caption", "FontStyleNameNative": "Cond Caption", "PlatformName": "$ID/", "Version": "Version 2.030;PS 2.000;hotconv 1.0.51;makeotf.lib2.0.18671", "TypekitID": "$ID/"}, {"_tag": "Font", "Self": "di96FontnMinion Pro Cond", "FontFamily": "Minion Pro", "Name": "Minion Pro Cond", "PostScriptName": "MinionPro-Cn", "Status": "Substituted", "FontStyleName": "Cond", "FontType": "OpenTypeCFF", "WritingScript": "0", "FullName": "Minion Pro Cond", "FullNameNative": "Minion Pro Cond", "FontStyleNameNative": "Cond", "PlatformName": "$ID/", "Version": "Version 2.030;PS 2.000;hotconv 1.0.51;makeotf.lib2.0.18671", "TypekitID": "$ID/"}, {"_tag": "Font", "Self": "di96FontnMinion Pro Cond Subhead", "FontFamily": "Minion Pro", "Name": "Minion Pro Cond Subhead", "PostScriptName": "MinionPro-CnSubh", "Status": "Substituted", "FontStyleName": "Cond Subhead", "FontType": "OpenTypeCFF", "WritingScript": "0", "FullName": "Minion Pro Cond Subhead", "FullNameNative": "Minion Pro Cond Subhead", "FontStyleNameNative": "Cond Subhead", "PlatformName": "$ID/", "Version": "Version 2.030;PS 2.000;hotconv 1.0.51;makeotf.lib2.0.18671", "TypekitID": "$ID/"}, {"_tag": "Font", "Self": "di96FontnMinion Pro Cond Display", "FontFamily": "Minion Pro", "Name": "Minion Pro Cond Display", "PostScriptName": "MinionPro-CnDisp", "Status": "Substituted", "FontStyleName": "Cond Display", "FontType": "OpenTypeCFF", "WritingScript": "0", "FullName": "Minion Pro Cond Display", "FullNameNative": "Minion Pro Cond Display", "FontStyleNameNative": "Cond Display", "PlatformName": "$ID/", "Version": "Version 2.030;PS 2.000;hotconv 1.0.51;makeotf.lib2.0.18671", "TypekitID": "$ID/"}, {"_tag": "Font", "Self": "di96FontnMinion Pro Cond Italic Caption", "FontFamily": "Minion Pro", "Name": "Minion Pro Cond Italic Caption", "PostScriptName": "MinionPro-CnItCapt", "Status": "Substituted", "FontStyleName": "Cond Italic Caption", "FontType": "OpenTypeCFF", "WritingScript": "0", "FullName": "Minion Pro Cond Italic Caption", "FullNameNative": "Minion Pro Cond Italic Caption", "FontStyleNameNative": "Cond Italic Caption", "PlatformName": "$ID/", "Version": "Version 2.030;PS 2.000;hotconv 1.0.51;makeotf.lib2.0.18671", "TypekitID": "$ID/"}, {"_tag": "Font", "Self": "di96FontnMinion Pro Cond Italic", "FontFamily": "Minion Pro", "Name": "Minion Pro Cond Italic", "PostScriptName": "MinionPro-CnIt", "Status": "Substituted", "FontStyleName": "Cond Italic", "FontType": "OpenTypeCFF", "WritingScript": "0", "FullName": "Minion Pro Cond Italic", "FullNameNative": "Minion Pro Cond Italic", "FontStyleNameNative": "Cond Italic", "PlatformName": "$ID/", "Version": "Version 2.030;PS 2.000;hotconv 1.0.51;makeotf.lib2.0.18671", "TypekitID": "$ID/"}, {"_tag": "Font", "Self": "di96FontnMinion Pro Cond Italic Subhead", "FontFamily": "Minion Pro", "Name": "Minion Pro Cond Italic Subhead", "PostScriptName": "MinionPro-CnItSubh", "Status": "Substituted", "FontStyleName": "Cond Italic Subhead", "FontType": "OpenTypeCFF", "WritingScript": "0", "FullName": "Minion Pro Cond Italic Subhead", "FullNameNative": "Minion Pro Cond Italic Subhead", "FontStyleNameNative": "Cond Italic Subhead", "PlatformName": "$ID/", "Version": "Version 2.030;PS 2.000;hotconv 1.0.51;makeotf.lib2.0.18671", "TypekitID": "$ID/"}, {"_tag": "Font", "Self": "di96FontnMinion Pro Cond Italic Display", "FontFamily": "Minion Pro", "Name": "Minion Pro Cond Italic Display", "PostScriptName": "MinionPro-CnItDisp", "Status": "Substituted", "FontStyleName": "Cond Italic Display", "FontType": "OpenTypeCFF", "WritingScript": "0", "FullName": "Minion Pro Cond Italic Display", "FullNameNative": "Minion Pro Cond Italic Display", "FontStyleNameNative": "Cond Italic Display", "PlatformName": "$ID/", "Version": "Version 2.030;PS 2.000;hotconv 1.0.51;makeotf.lib2.0.18671", "TypekitID": "$ID/"}, {"_tag": "Font", "Self": "di96FontnMinion Pro Medium Cond Caption", "FontFamily": "Minion Pro", "Name": "Minion Pro Medium Cond Caption", "PostScriptName": "MinionPro-MediumCnCapt", "Status": "Substituted", "FontStyleName": "Medium Cond Caption", "FontType": "OpenTypeCFF", "WritingScript": "0", "FullName": "Minion Pro Medium Cond Caption", "FullNameNative": "Minion Pro Medium Cond Caption", "FontStyleNameNative": "Medium Cond Caption", "PlatformName": "$ID/", "Version": "Version 2.030;PS 2.000;hotconv 1.0.51;makeotf.lib2.0.18671", "TypekitID": "$ID/"}, {"_tag": "Font", "Self": "di96FontnMinion Pro Medium Cond", "FontFamily": "Minion Pro", "Name": "Minion Pro Medium Cond", "PostScriptName": "MinionPro-MediumCn", "Status": "Substituted", "FontStyleName": "Medium Cond", "FontType": "OpenTypeCFF", "WritingScript": "0", "FullName": "Minion Pro Medium Cond", "FullNameNative": "Minion Pro Medium Cond", "FontStyleNameNative": "Medium Cond", "PlatformName": "$ID/", "Version": "Version 2.030;PS 2.000;hotconv 1.0.51;makeotf.lib2.0.18671", "TypekitID": "$ID/"}, {"_tag": "Font", "Self": "di96FontnMinion Pro Medium Cond Subhead", "FontFamily": "Minion Pro", "Name": "Minion Pro Medium Cond Subhead", "PostScriptName": "MinionPro-MediumCnSubh", "Status": "Substituted", "FontStyleName": "Medium Cond Subhead", "FontType": "OpenTypeCFF", "WritingScript": "0", "FullName": "Minion Pro Medium Cond Subhead", "FullNameNative": "Minion Pro Medium Cond Subhead", "FontStyleNameNative": "Medium Cond Subhead", "PlatformName": "$ID/", "Version": "Version 2.030;PS 2.000;hotconv 1.0.51;makeotf.lib2.0.18671", "TypekitID": "$ID/"}, {"_tag": "Font", "Self": "di96FontnMinion Pro Medium Cond Display", "FontFamily": "Minion Pro", "Name": "Minion Pro Medium Cond Display", "PostScriptName": "MinionPro-MediumCnDisp", "Status": "Substituted", "FontStyleName": "Medium Cond Display", "FontType": "OpenTypeCFF", "WritingScript": "0", "FullName": "Minion Pro Medium Cond Display", "FullNameNative": "Minion Pro Medium Cond Display", "FontStyleNameNative": "Medium Cond Display", "PlatformName": "$ID/", "Version": "Version 2.030;PS 2.000;hotconv 1.0.51;makeotf.lib2.0.18671", "TypekitID": "$ID/"}, {"_tag": "Font", "Self": "di96FontnMinion Pro Medium Cond Italic Caption", "FontFamily": "Minion Pro", "Name": "Minion Pro Medium Cond Italic Caption", "PostScriptName": "MinionPro-MediumCnItCapt", "Status": "Substituted", "FontStyleName": "Medium Cond Italic Caption", "FontType": "OpenTypeCFF", "WritingScript": "0", "FullName": "Minion Pro Medium Cond Italic Caption", "FullNameNative": "Minion Pro Medium Cond Italic Caption", "FontStyleNameNative": "Medium Cond Italic Caption", "PlatformName": "$ID/", "Version": "Version 2.030;PS 2.000;hotconv 1.0.51;makeotf.lib2.0.18671", "TypekitID": "$ID/"}, {"_tag": "Font", "Self": "di96FontnMinion Pro Medium Cond Italic", "FontFamily": "Minion Pro", "Name": "Minion Pro Medium Cond Italic", "PostScriptName": "MinionPro-MediumCnIt", "Status": "Substituted", "FontStyleName": "Medium Cond Italic", "FontType": "OpenTypeCFF", "WritingScript": "0", "FullName": "Minion Pro Medium Cond Italic", "FullNameNative": "Minion Pro Medium Cond Italic", "FontStyleNameNative": "Medium Cond Italic", "PlatformName": "$ID/", "Version": "Version 2.030;PS 2.000;hotconv 1.0.51;makeotf.lib2.0.18671", "TypekitID": "$ID/"}, {"_tag": "Font", "Self": "di96FontnMinion Pro Medium Cond Italic Subhead", "FontFamily": "Minion Pro", "Name": "Minion Pro Medium Cond Italic Subhead", "PostScriptName": "MinionPro-MediumCnItSubh", "Status": "Substituted", "FontStyleName": "Medium Cond Italic Subhead", "FontType": "OpenTypeCFF", "WritingScript": "0", "FullName": "Minion Pro Medium Cond Italic Subhead", "FullNameNative": "Minion Pro Medium Cond Italic Subhead", "FontStyleNameNative": "Medium Cond Italic Subhead", "PlatformName": "$ID/", "Version": "Version 2.030;PS 2.000;hotconv 1.0.51;makeotf.lib2.0.18671", "TypekitID": "$ID/"}, {"_tag": "Font", "Self": "di96FontnMinion Pro Medium Cond Italic Display", "FontFamily": "Minion Pro", "Name": "Minion Pro Medium Cond Italic Display", "PostScriptName": "MinionPro-MediumCnItDisp", "Status": "Substituted", "FontStyleName": "Medium Cond Italic Display", "FontType": "OpenTypeCFF", "WritingScript": "0", "FullName": "Minion Pro Medium Cond Italic Display", "FullNameNative": "Minion Pro Medium Cond Italic Display", "FontStyleNameNative": "Medium Cond Italic Display", "PlatformName": "$ID/", "Version": "Version 2.030;PS 2.000;hotconv 1.0.51;makeotf.lib2.0.18671", "TypekitID": "$ID/"}, {"_tag": "Font", "Self": "di96FontnMinion Pro Semibold Cond Caption", "FontFamily": "Minion Pro", "Name": "Minion Pro Semibold Cond Caption", "PostScriptName": "MinionPro-SemiboldCnCapt", "Status": "Substituted", "FontStyleName": "Semibold Cond Caption", "FontType": "OpenTypeCFF", "WritingScript": "0", "FullName": "Minion Pro Semibold Cond Caption", "FullNameNative": "Minion Pro Semibold Cond Caption", "FontStyleNameNative": "Semibold Cond Caption", "PlatformName": "$ID/", "Version": "Version 2.030;PS 2.000;hotconv 1.0.51;makeotf.lib2.0.18671", "TypekitID": "$ID/"}, {"_tag": "Font", "Self": "di96FontnMinion Pro Semibold Cond", "FontFamily": "Minion Pro", "Name": "Minion Pro Semibold Cond", "PostScriptName": "MinionPro-SemiboldCn", "Status": "Substituted", "FontStyleName": "Semibold Cond", "FontType": "OpenTypeCFF", "WritingScript": "0", "FullName": "Minion Pro Semibold Cond", "FullNameNative": "Minion Pro Semibold Cond", "FontStyleNameNative": "Semibold Cond", "PlatformName": "$ID/", "Version": "Version 2.030;PS 2.000;hotconv 1.0.51;makeotf.lib2.0.18671", "TypekitID": "$ID/"}, {"_tag": "Font", "Self": "di96FontnMinion Pro Semibold Cond Subhead", "FontFamily": "Minion Pro", "Name": "Minion Pro Semibold Cond Subhead", "PostScriptName": "MinionPro-SemiboldCnSubh", "Status": "Substituted", "FontStyleName": "Semibold Cond Subhead", "FontType": "OpenTypeCFF", "WritingScript": "0", "FullName": "Minion Pro Semibold Cond Subhead", "FullNameNative": "Minion Pro Semibold Cond Subhead", "FontStyleNameNative": "Semibold Cond Subhead", "PlatformName": "$ID/", "Version": "Version 2.030;PS 2.000;hotconv 1.0.51;makeotf.lib2.0.18671", "TypekitID": "$ID/"}, {"_tag": "Font", "Self": "di96FontnMinion Pro Semibold Cond Display", "FontFamily": "Minion Pro", "Name": "Minion Pro Semibold Cond Display", "PostScriptName": "MinionPro-SemiboldCnDisp", "Status": "Substituted", "FontStyleName": "Semibold Cond Display", "FontType": "OpenTypeCFF", "WritingScript": "0", "FullName": "Minion Pro Semibold Cond Display", "FullNameNative": "Minion Pro Semibold Cond Display", "FontStyleNameNative": "Semibold Cond Display", "PlatformName": "$ID/", "Version": "Version 2.030;PS 2.000;hotconv 1.0.51;makeotf.lib2.0.18671", "TypekitID": "$ID/"}, {"_tag": "Font", "Self": "di96FontnMinion Pro Semibold Cond Italic Caption", "FontFamily": "Minion Pro", "Name": "Minion Pro Semibold Cond Italic Caption", "PostScriptName": "MinionPro-SemiboldCnItCapt", "Status": "Substituted", "FontStyleName": "Semibold Cond Italic Caption", "FontType": "OpenTypeCFF", "WritingScript": "0", "FullName": "Minion Pro Semibold Cond Italic Caption", "FullNameNative": "Minion Pro Semibold Cond Italic Caption", "FontStyleNameNative": "Semibold Cond Italic Caption", "PlatformName": "$ID/", "Version": "Version 2.030;PS 2.000;hotconv 1.0.51;makeotf.lib2.0.18671", "TypekitID": "$ID/"}, {"_tag": "Font", "Self": "di96FontnMinion Pro Semibold Cond Italic", "FontFamily": "Minion Pro", "Name": "Minion Pro Semibold Cond Italic", "PostScriptName": "MinionPro-SemiboldCnIt", "Status": "Substituted", "FontStyleName": "Semibold Cond Italic", "FontType": "OpenTypeCFF", "WritingScript": "0", "FullName": "Minion Pro Semibold Cond Italic", "FullNameNative": "Minion Pro Semibold Cond Italic", "FontStyleNameNative": "Semibold Cond Italic", "PlatformName": "$ID/", "Version": "Version 2.030;PS 2.000;hotconv 1.0.51;makeotf.lib2.0.18671", "TypekitID": "$ID/"}, {"_tag": "Font", "Self": "di96FontnMinion Pro Semibold Cond Italic Subhead", "FontFamily": "Minion Pro", "Name": "Minion Pro Semibold Cond Italic Subhead", "PostScriptName": "MinionPro-SemiboldCnItSubh", "Status": "Substituted", "FontStyleName": "Semibold Cond Italic Subhead", "FontType": "OpenTypeCFF", "WritingScript": "0", "FullName": "Minion Pro Semibold Cond Italic Subhead", "FullNameNative": "Minion Pro Semibold Cond Italic Subhead", "FontStyleNameNative": "Semibold Cond Italic Subhead", "PlatformName": "$ID/", "Version": "Version 2.030;PS 2.000;hotconv 1.0.51;makeotf.lib2.0.18671", "TypekitID": "$ID/"}, {"_tag": "Font", "Self": "di96FontnMinion Pro Semibold Cond Italic Display", "FontFamily": "Minion Pro", "Name": "Minion Pro Semibold Cond Italic Display", "PostScriptName": "MinionPro-SemiboldCnItDisp", "Status": "Substituted", "FontStyleName": "Semibold Cond Italic Display", "FontType": "OpenTypeCFF", "WritingScript": "0", "FullName": "Minion Pro Semibold Cond Italic Display", "FullNameNative": "Minion Pro Semibold Cond Italic Display", "FontStyleNameNative": "Semibold Cond Italic Display", "PlatformName": "$ID/", "Version": "Version 2.030;PS 2.000;hotconv 1.0.51;makeotf.lib2.0.18671", "TypekitID": "$ID/"}, {"_tag": "Font", "Self": "di96FontnMinion Pro Bold Cond Caption", "FontFamily": "Minion Pro", "Name": "Minion Pro Bold Cond Caption", "PostScriptName": "MinionPro-BoldCnCapt", "Status": "Substituted", "FontStyleName": "Bold Cond Caption", "FontType": "OpenTypeCFF", "WritingScript": "0", "FullName": "Minion Pro Bold Cond Caption", "FullNameNative": "Minion Pro Bold Cond Caption", "FontStyleNameNative": "Bold Cond Caption", "PlatformName": "$ID/", "Version": "Version 2.030;PS 2.000;hotconv 1.0.51;makeotf.lib2.0.18671", "TypekitID": "$ID/"}, {"_tag": "Font", "Self": "di96FontnMinion Pro Bold Cond Subhead", "FontFamily": "Minion Pro", "Name": "Minion Pro Bold Cond Subhead", "PostScriptName": "MinionPro-BoldCnSubh", "Status": "Substituted", "FontStyleName": "Bold Cond Subhead", "FontType": "OpenTypeCFF", "WritingScript": "0", "FullName": "Minion Pro Bold Cond Subhead", "FullNameNative": "Minion Pro Bold Cond Subhead", "FontStyleNameNative": "Bold Cond Subhead", "PlatformName": "$ID/", "Version": "Version 2.030;PS 2.000;hotconv 1.0.51;makeotf.lib2.0.18671", "TypekitID": "$ID/"}, {"_tag": "Font", "Self": "di96FontnMinion Pro Bold Cond Display", "FontFamily": "Minion Pro", "Name": "Minion Pro Bold Cond Display", "PostScriptName": "MinionPro-BoldCnDisp", "Status": "Substituted", "FontStyleName": "Bold Cond Display", "FontType": "OpenTypeCFF", "WritingScript": "0", "FullName": "Minion Pro Bold Cond Display", "FullNameNative": "Minion Pro Bold Cond Display", "FontStyleNameNative": "Bold Cond Display", "PlatformName": "$ID/", "Version": "Version 2.030;PS 2.000;hotconv 1.0.51;makeotf.lib2.0.18671", "TypekitID": "$ID/"}, {"_tag": "Font", "Self": "di96FontnMinion Pro Bold Cond Italic Caption", "FontFamily": "Minion Pro", "Name": "Minion Pro Bold Cond Italic Caption", "PostScriptName": "MinionPro-BoldCnItCapt", "Status": "Substituted", "FontStyleName": "Bold Cond Italic Caption", "FontType": "OpenTypeCFF", "WritingScript": "0", "FullName": "Minion Pro Bold Cond Italic Caption", "FullNameNative": "Minion Pro Bold Cond Italic Caption", "FontStyleNameNative": "Bold Cond Italic Caption", "PlatformName": "$ID/", "Version": "Version 2.030;PS 2.000;hotconv 1.0.51;makeotf.lib2.0.18671", "TypekitID": "$ID/"}, {"_tag": "Font", "Self": "di96FontnMinion Pro Bold Cond Italic Subhead", "FontFamily": "Minion Pro", "Name": "Minion Pro Bold Cond Italic Subhead", "PostScriptName": "MinionPro-BoldCnItSubh", "Status": "Substituted", "FontStyleName": "Bold Cond Italic Subhead", "FontType": "OpenTypeCFF", "WritingScript": "0", "FullName": "Minion Pro Bold Cond Italic Subhead", "FullNameNative": "Minion Pro Bold Cond Italic Subhead", "FontStyleNameNative": "Bold Cond Italic Subhead", "PlatformName": "$ID/", "Version": "Version 2.030;PS 2.000;hotconv 1.0.51;makeotf.lib2.0.18671", "TypekitID": "$ID/"}, {"_tag": "Font", "Self": "di96FontnMinion Pro Bold Cond Italic Display", "FontFamily": "Minion Pro", "Name": "Minion Pro Bold Cond Italic Display", "PostScriptName": "MinionPro-BoldCnItDisp", "Status": "Substituted", "FontStyleName": "Bold Cond Italic Display", "FontType": "OpenTypeCFF", "WritingScript": "0", "FullName": "Minion Pro Bold Cond Italic Display", "FullNameNative": "Minion Pro Bold Cond Italic Display", "FontStyleNameNative": "Bold Cond Italic Display", "PlatformName": "$ID/", "Version": "Version 2.030;PS 2.000;hotconv 1.0.51;makeotf.lib2.0.18671", "TypekitID": "$ID/"}, {"_tag": "Font", "Self": "di96FontnMinion Pro Caption", "FontFamily": "Minion Pro", "Name": "Minion Pro Caption", "PostScriptName": "MinionPro-Capt", "Status": "Substituted", "FontStyleName": "Caption", "FontType": "OpenTypeCFF", "WritingScript": "0", "FullName": "Minion Pro Caption", "FullNameNative": "Minion Pro Caption", "FontStyleNameNative": "Caption", "PlatformName": "$ID/", "Version": "Version 2.030;PS 2.000;hotconv 1.0.51;makeotf.lib2.0.18671", "TypekitID": "$ID/"}, {"_tag": "Font", "Self": "di96FontnMinion Pro Subhead", "FontFamily": "Minion Pro", "Name": "Minion Pro Subhead", "PostScriptName": "MinionPro-Subh", "Status": "Substituted", "FontStyleName": "Subhead", "FontType": "OpenTypeCFF", "WritingScript": "0", "FullName": "Minion Pro Subhead", "FullNameNative": "Minion Pro Subhead", "FontStyleNameNative": "Subhead", "PlatformName": "$ID/", "Version": "Version 2.030;PS 2.000;hotconv 1.0.51;makeotf.lib2.0.18671", "TypekitID": "$ID/"}, {"_tag": "Font", "Self": "di96FontnMinion Pro Display", "FontFamily": "Minion Pro", "Name": "Minion Pro Display", "PostScriptName": "MinionPro-Disp", "Status": "Substituted", "FontStyleName": "Display", "FontType": "OpenTypeCFF", "WritingScript": "0", "FullName": "Minion Pro Display", "FullNameNative": "Minion Pro Display", "FontStyleNameNative": "Display", "PlatformName": "$ID/", "Version": "Version 2.030;PS 2.000;hotconv 1.0.51;makeotf.lib2.0.18671", "TypekitID": "$ID/"}, {"_tag": "Font", "Self": "di96FontnMinion Pro Italic Caption", "FontFamily": "Minion Pro", "Name": "Minion Pro Italic Caption", "PostScriptName": "MinionPro-ItCapt", "Status": "Substituted", "FontStyleName": "Italic Caption", "FontType": "OpenTypeCFF", "WritingScript": "0", "FullName": "Minion Pro Italic Caption", "FullNameNative": "Minion Pro Italic Caption", "FontStyleNameNative": "Italic Caption", "PlatformName": "$ID/", "Version": "Version 2.030;PS 2.000;hotconv 1.0.51;makeotf.lib2.0.18671", "TypekitID": "$ID/"}, {"_tag": "Font", "Self": "di96FontnMinion Pro Italic Subhead", "FontFamily": "Minion Pro", "Name": "Minion Pro Italic Subhead", "PostScriptName": "MinionPro-ItSubh", "Status": "Substituted", "FontStyleName": "Italic Subhead", "FontType": "OpenTypeCFF", "WritingScript": "0", "FullName": "Minion Pro Italic Subhead", "FullNameNative": "Minion Pro Italic Subhead", "FontStyleNameNative": "Italic Subhead", "PlatformName": "$ID/", "Version": "Version 2.030;PS 2.000;hotconv 1.0.51;makeotf.lib2.0.18671", "TypekitID": "$ID/"}, {"_tag": "Font", "Self": "di96FontnMinion Pro Italic Display", "FontFamily": "Minion Pro", "Name": "Minion Pro Italic Display", "PostScriptName": "MinionPro-ItDisp", "Status": "Substituted", "FontStyleName": "Italic Display", "FontType": "OpenTypeCFF", "WritingScript": "0", "FullName": "Minion Pro Italic Display", "FullNameNative": "Minion Pro Italic Display", "FontStyleNameNative": "Italic Display", "PlatformName": "$ID/", "Version": "Version 2.030;PS 2.000;hotconv 1.0.51;makeotf.lib2.0.18671", "TypekitID": "$ID/"}, {"_tag": "Font", "Self": "di96FontnMinion Pro Medium Caption", "FontFamily": "Minion Pro", "Name": "Minion Pro Medium Caption", "PostScriptName": "MinionPro-MediumCapt", "Status": "Substituted", "FontStyleName": "Medium Caption", "FontType": "OpenTypeCFF", "WritingScript": "0", "FullName": "Minion Pro Medium Caption", "FullNameNative": "Minion Pro Medium Caption", "FontStyleNameNative": "Medium Caption", "PlatformName": "$ID/", "Version": "Version 2.030;PS 2.000;hotconv 1.0.51;makeotf.lib2.0.18671", "TypekitID": "$ID/"}, {"_tag": "Font", "Self": "di96FontnMinion Pro Medium Subhead", "FontFamily": "Minion Pro", "Name": "Minion Pro Medium Subhead", "PostScriptName": "MinionPro-MediumSubh", "Status": "Substituted", "FontStyleName": "Medium Subhead", "FontType": "OpenTypeCFF", "WritingScript": "0", "FullName": "Minion Pro Medium Subhead", "FullNameNative": "Minion Pro Medium Subhead", "FontStyleNameNative": "Medium Subhead", "PlatformName": "$ID/", "Version": "Version 2.030;PS 2.000;hotconv 1.0.51;makeotf.lib2.0.18671", "TypekitID": "$ID/"}, {"_tag": "Font", "Self": "di96FontnMinion Pro Medium Display", "FontFamily": "Minion Pro", "Name": "Minion Pro Medium Display", "PostScriptName": "MinionPro-MediumDisp", "Status": "Substituted", "FontStyleName": "Medium Display", "FontType": "OpenTypeCFF", "WritingScript": "0", "FullName": "Minion Pro Medium Display", "FullNameNative": "Minion Pro Medium Display", "FontStyleNameNative": "Medium Display", "PlatformName": "$ID/", "Version": "Version 2.030;PS 2.000;hotconv 1.0.51;makeotf.lib2.0.18671", "TypekitID": "$ID/"}, {"_tag": "Font", "Self": "di96FontnMinion Pro Medium Italic Caption", "FontFamily": "Minion Pro", "Name": "Minion Pro Medium Italic Caption", "PostScriptName": "MinionPro-MediumItCapt", "Status": "Substituted", "FontStyleName": "Medium Italic Caption", "FontType": "OpenTypeCFF", "WritingScript": "0", "FullName": "Minion Pro Medium Italic Caption", "FullNameNative": "Minion Pro Medium Italic Caption", "FontStyleNameNative": "Medium Italic Caption", "PlatformName": "$ID/", "Version": "Version 2.030;PS 2.000;hotconv 1.0.51;makeotf.lib2.0.18671", "TypekitID": "$ID/"}, {"_tag": "Font", "Self": "di96FontnMinion Pro Medium Italic Subhead", "FontFamily": "Minion Pro", "Name": "Minion Pro Medium Italic Subhead", "PostScriptName": "MinionPro-MediumItSubh", "Status": "Substituted", "FontStyleName": "Medium Italic Subhead", "FontType": "OpenTypeCFF", "WritingScript": "0", "FullName": "Minion Pro Medium Italic Subhead", "FullNameNative": "Minion Pro Medium Italic Subhead", "FontStyleNameNative": "Medium Italic Subhead", "PlatformName": "$ID/", "Version": "Version 2.030;PS 2.000;hotconv 1.0.51;makeotf.lib2.0.18671", "TypekitID": "$ID/"}, {"_tag": "Font", "Self": "di96FontnMinion Pro Medium Italic Display", "FontFamily": "Minion Pro", "Name": "Minion Pro Medium Italic Display", "PostScriptName": "MinionPro-MediumItDisp", "Status": "Substituted", "FontStyleName": "Medium Italic Display", "FontType": "OpenTypeCFF", "WritingScript": "0", "FullName": "Minion Pro Medium Italic Display", "FullNameNative": "Minion Pro Medium Italic Display", "FontStyleNameNative": "Medium Italic Display", "PlatformName": "$ID/", "Version": "Version 2.030;PS 2.000;hotconv 1.0.51;makeotf.lib2.0.18671", "TypekitID": "$ID/"}, {"_tag": "Font", "Self": "di96FontnMinion Pro Semibold Caption", "FontFamily": "Minion Pro", "Name": "Minion Pro Semibold Caption", "PostScriptName": "MinionPro-SemiboldCapt", "Status": "Substituted", "FontStyleName": "Semibold Caption", "FontType": "OpenTypeCFF", "WritingScript": "0", "FullName": "Minion Pro Semibold Caption", "FullNameNative": "Minion Pro Semibold Caption", "FontStyleNameNative": "Semibold Caption", "PlatformName": "$ID/", "Version": "Version 2.030;PS 2.000;hotconv 1.0.51;makeotf.lib2.0.18671", "TypekitID": "$ID/"}, {"_tag": "Font", "Self": "di96FontnMinion Pro Semibold Subhead", "FontFamily": "Minion Pro", "Name": "Minion Pro Semibold Subhead", "PostScriptName": "MinionPro-SemiboldSubh", "Status": "Substituted", "FontStyleName": "Semibold Subhead", "FontType": "OpenTypeCFF", "WritingScript": "0", "FullName": "Minion Pro Semibold Subhead", "FullNameNative": "Minion Pro Semibold Subhead", "FontStyleNameNative": "Semibold Subhead", "PlatformName": "$ID/", "Version": "Version 2.030;PS 2.000;hotconv 1.0.51;makeotf.lib2.0.18671", "TypekitID": "$ID/"}, {"_tag": "Font", "Self": "di96FontnMinion Pro Semibold Display", "FontFamily": "Minion Pro", "Name": "Minion Pro Semibold Display", "PostScriptName": "MinionPro-SemiboldDisp", "Status": "Substituted", "FontStyleName": "Semibold Display", "FontType": "OpenTypeCFF", "WritingScript": "0", "FullName": "Minion Pro Semibold Display", "FullNameNative": "Minion Pro Semibold Display", "FontStyleNameNative": "Semibold Display", "PlatformName": "$ID/", "Version": "Version 2.030;PS 2.000;hotconv 1.0.51;makeotf.lib2.0.18671", "TypekitID": "$ID/"}, {"_tag": "Font", "Self": "di96FontnMinion Pro Semibold Italic Caption", "FontFamily": "Minion Pro", "Name": "Minion Pro Semibold Italic Caption", "PostScriptName": "MinionPro-SemiboldItCapt", "Status": "Substituted", "FontStyleName": "Semibold Italic Caption", "FontType": "OpenTypeCFF", "WritingScript": "0", "FullName": "Minion Pro Semibold Italic Caption", "FullNameNative": "Minion Pro Semibold Italic Caption", "FontStyleNameNative": "Semibold Italic Caption", "PlatformName": "$ID/", "Version": "Version 2.030;PS 2.000;hotconv 1.0.51;makeotf.lib2.0.18671", "TypekitID": "$ID/"}, {"_tag": "Font", "Self": "di96FontnMinion Pro Semibold Italic Subhead", "FontFamily": "Minion Pro", "Name": "Minion Pro Semibold Italic Subhead", "PostScriptName": "MinionPro-SemiboldItSubh", "Status": "Substituted", "FontStyleName": "Semibold Italic Subhead", "FontType": "OpenTypeCFF", "WritingScript": "0", "FullName": "Minion Pro Semibold Italic Subhead", "FullNameNative": "Minion Pro Semibold Italic Subhead", "FontStyleNameNative": "Semibold Italic Subhead", "PlatformName": "$ID/", "Version": "Version 2.030;PS 2.000;hotconv 1.0.51;makeotf.lib2.0.18671", "TypekitID": "$ID/"}, {"_tag": "Font", "Self": "di96FontnMinion Pro Semibold Italic Display", "FontFamily": "Minion Pro", "Name": "Minion Pro Semibold Italic Display", "PostScriptName": "MinionPro-SemiboldItDisp", "Status": "Substituted", "FontStyleName": "Semibold Italic Display", "FontType": "OpenTypeCFF", "WritingScript": "0", "FullName": "Minion Pro Semibold Italic Display", "FullNameNative": "Minion Pro Semibold Italic Display", "FontStyleNameNative": "Semibold Italic Display", "PlatformName": "$ID/", "Version": "Version 2.030;PS 2.000;hotconv 1.0.51;makeotf.lib2.0.18671", "TypekitID": "$ID/"}, {"_tag": "Font", "Self": "di96FontnMinion Pro Bold Caption", "FontFamily": "Minion Pro", "Name": "Minion Pro Bold Caption", "PostScriptName": "MinionPro-BoldCapt", "Status": "Substituted", "FontStyleName": "Bold Caption", "FontType": "OpenTypeCFF", "WritingScript": "0", "FullName": "Minion Pro Bold Caption", "FullNameNative": "Minion Pro Bold Caption", "FontStyleNameNative": "Bold Caption", "PlatformName": "$ID/", "Version": "Version 2.030;PS 2.000;hotconv 1.0.51;makeotf.lib2.0.18671", "TypekitID": "$ID/"}, {"_tag": "Font", "Self": "di96FontnMinion Pro Bold Subhead", "FontFamily": "Minion Pro", "Name": "Minion Pro Bold Subhead", "PostScriptName": "MinionPro-BoldSubh", "Status": "Substituted", "FontStyleName": "Bold Subhead", "FontType": "OpenTypeCFF", "WritingScript": "0", "FullName": "Minion Pro Bold Subhead", "FullNameNative": "Minion Pro Bold Subhead", "FontStyleNameNative": "Bold Subhead", "PlatformName": "$ID/", "Version": "Version 2.030;PS 2.000;hotconv 1.0.51;makeotf.lib2.0.18671", "TypekitID": "$ID/"}, {"_tag": "Font", "Self": "di96FontnMinion Pro Bold Display", "FontFamily": "Minion Pro", "Name": "Minion Pro Bold Display", "PostScriptName": "MinionPro-BoldDisp", "Status": "Substituted", "FontStyleName": "Bold Display", "FontType": "OpenTypeCFF", "WritingScript": "0", "FullName": "Minion Pro Bold Display", "FullNameNative": "Minion Pro Bold Display", "FontStyleNameNative": "Bold Display", "PlatformName": "$ID/", "Version": "Version 2.030;PS 2.000;hotconv 1.0.51;makeotf.lib2.0.18671", "TypekitID": "$ID/"}, {"_tag": "Font", "Self": "di96FontnMinion Pro Bold Italic Caption", "FontFamily": "Minion Pro", "Name": "Minion Pro Bold Italic Caption", "PostScriptName": "MinionPro-BoldItCapt", "Status": "Substituted", "FontStyleName": "Bold Italic Caption", "FontType": "OpenTypeCFF", "WritingScript": "0", "FullName": "Minion Pro Bold Italic Caption", "FullNameNative": "Minion Pro Bold Italic Caption", "FontStyleNameNative": "Bold Italic Caption", "PlatformName": "$ID/", "Version": "Version 2.030;PS 2.000;hotconv 1.0.51;makeotf.lib2.0.18671", "TypekitID": "$ID/"}, {"_tag": "Font", "Self": "di96FontnMinion Pro Bold Italic Subhead", "FontFamily": "Minion Pro", "Name": "Minion Pro Bold Italic Subhead", "PostScriptName": "MinionPro-BoldItSubh", "Status": "Substituted", "FontStyleName": "Bold Italic Subhead", "FontType": "OpenTypeCFF", "WritingScript": "0", "FullName": "Minion Pro Bold Italic Subhead", "FullNameNative": "Minion Pro Bold Italic Subhead", "FontStyleNameNative": "Bold Italic Subhead", "PlatformName": "$ID/", "Version": "Version 2.030;PS 2.000;hotconv 1.0.51;makeotf.lib2.0.18671", "TypekitID": "$ID/"}, {"_tag": "Font", "Self": "di96FontnMinion Pro Bold Italic Display", "FontFamily": "Minion Pro", "Name": "Minion Pro Bold Italic Display", "PostScriptName": "MinionPro-BoldItDisp", "Status": "Substituted", "FontStyleName": "Bold Italic Display", "FontType": "OpenTypeCFF", "WritingScript": "0", "FullName": "Minion Pro Bold Italic Display", "FullNameNative": "Minion Pro Bold Italic Display", "FontStyleNameNative": "Bold Italic Display", "PlatformName": "$ID/", "Version": "Version 2.030;PS 2.000;hotconv 1.0.51;makeotf.lib2.0.18671", "TypekitID": "$ID/"} ] },
            {"_tag": "FontFamily", "Self": "dia3", "Name": "Kozuka Mincho Pro", "_subElements":[{"_tag": "Font", "Self": "dia3FontnKozuka Mincho Pro EL", "FontFamily": "Kozuka Mincho Pro", "Name": "Kozuka Mincho Pro EL", "PostScriptName": "KozMinPro-ExtraLight", "Status": "Substituted", "FontStyleName": "EL", "FontType": "OpenTypeCID", "WritingScript": "1", "FullName": "Kozuka Mincho Pro EL", "FullNameNative": "小塚明朝 Pro EL", "FontStyleNameNative": "EL", "PlatformName": "$ID/", "Version": "Version 4.013;PS 4.003;hotconv 1.0.67;makeotf.lib2.5.33168", "TypekitID": "$ID/"}, {"_tag": "Font", "Self": "dia3FontnKozuka Mincho Pro L", "FontFamily": "Kozuka Mincho Pro", "Name": "Kozuka Mincho Pro L", "PostScriptName": "KozMinPro-Light", "Status": "Substituted", "FontStyleName": "L", "FontType": "OpenTypeCID", "WritingScript": "1", "FullName": "Kozuka Mincho Pro L", "FullNameNative": "小塚明朝 Pro L", "FontStyleNameNative": "L", "PlatformName": "$ID/", "Version": "Version 4.013;PS 4.003;hotconv 1.0.67;makeotf.lib2.5.33168", "TypekitID": "$ID/"}, {"_tag": "Font", "Self": "dia3FontnKozuka Mincho Pro R", "FontFamily": "Kozuka Mincho Pro", "Name": "Kozuka Mincho Pro R", "PostScriptName": "KozMinPro-Regular", "Status": "Substituted", "FontStyleName": "R", "FontType": "OpenTypeCID", "WritingScript": "1", "FullName": "Kozuka Mincho Pro R", "FullNameNative": "小塚明朝 Pro R", "FontStyleNameNative": "R", "PlatformName": "$ID/", "Version": "Version 4.013;PS 4.003;hotconv 1.0.67;makeotf.lib2.5.33168", "TypekitID": "$ID/"}, {"_tag": "Font", "Self": "dia3FontnKozuka Mincho Pro M", "FontFamily": "Kozuka Mincho Pro", "Name": "Kozuka Mincho Pro M", "PostScriptName": "KozMinPro-Medium", "Status": "Substituted", "FontStyleName": "M", "FontType": "OpenTypeCID", "WritingScript": "1", "FullName": "Kozuka Mincho Pro M", "FullNameNative": "小塚明朝 Pro M", "FontStyleNameNative": "M", "PlatformName": "$ID/", "Version": "Version 4.013;PS 4.003;hotconv 1.0.67;makeotf.lib2.5.33168", "TypekitID": "$ID/"}, {"_tag": "Font", "Self": "dia3FontnKozuka Mincho Pro B", "FontFamily": "Kozuka Mincho Pro", "Name": "Kozuka Mincho Pro B", "PostScriptName": "KozMinPro-Bold", "Status": "Substituted", "FontStyleName": "B", "FontType": "OpenTypeCID", "WritingScript": "1", "FullName": "Kozuka Mincho Pro B", "FullNameNative": "小塚明朝 Pro B", "FontStyleNameNative": "B", "PlatformName": "$ID/", "Version": "Version 4.013;PS 4.003;hotconv 1.0.67;makeotf.lib2.5.33168", "TypekitID": "$ID/"}, {"_tag": "Font", "Self": "dia3FontnKozuka Mincho Pro H", "FontFamily": "Kozuka Mincho Pro", "Name": "Kozuka Mincho Pro H", "PostScriptName": "KozMinPro-Heavy", "Status": "Substituted", "FontStyleName": "H", "FontType": "OpenTypeCID", "WritingScript": "1", "FullName": "Kozuka Mincho Pro H", "FullNameNative": "小塚明朝 Pro H", "FontStyleNameNative": "H", "PlatformName": "$ID/", "Version": "Version 4.013;PS 4.003;hotconv 1.0.67;makeotf.lib2.5.33168", "TypekitID": "$ID/"} ] },
            {"_tag": "FontFamily", "Self": "di189", "Name": "Helvetica Neue LT Std", "_subElements":[{"_tag": "Font", "Self": "di189FontnHelvetica Neue LT Std 37 Thin Condensed", "FontFamily": "Helvetica Neue LT Std", "Name": "Helvetica Neue LT Std 37 Thin Condensed", "PostScriptName": "HelveticaNeueLTStd-ThCn", "Status": "Substituted", "FontStyleName": "37 Thin Condensed", "FontType": "OpenTypeCFF", "WritingScript": "0", "FullName": "Helvetica Neue LT Std 37 Thin Condensed", "FullNameNative": "Helvetica Neue LT Std 37 Thin Condensed", "FontStyleNameNative": "37 Thin Condensed", "PlatformName": "$ID/", "Version": "Version 2.035;PS 002.000;hotconv 1.0.51;makeotf.lib2.0.18671", "TypekitID": "$ID/"}, {"_tag": "Font", "Self": "di189FontnHelvetica Neue LT Std 37 Thin Condensed Oblique", "FontFamily": "Helvetica Neue LT Std", "Name": "Helvetica Neue LT Std 37 Thin Condensed Oblique", "PostScriptName": "HelveticaNeueLTStd-ThCnO", "Status": "Substituted", "FontStyleName": "37 Thin Condensed Oblique", "FontType": "OpenTypeCFF", "WritingScript": "0", "FullName": "Helvetica Neue LT Std 37 Thin Condensed Oblique", "FullNameNative": "Helvetica Neue LT Std 37 Thin Condensed Oblique", "FontStyleNameNative": "37 Thin Condensed Oblique", "PlatformName": "$ID/", "Version": "Version 2.035;PS 002.000;hotconv 1.0.51;makeotf.lib2.0.18671", "TypekitID": "$ID/"}, {"_tag": "Font", "Self": "di189FontnHelvetica Neue LT Std 27 Ultra Light Condensed", "FontFamily": "Helvetica Neue LT Std", "Name": "Helvetica Neue LT Std 27 Ultra Light Condensed", "PostScriptName": "HelveticaNeueLTStd-UltLtCn", "Status": "Substituted", "FontStyleName": "27 Ultra Light Condensed", "FontType": "OpenTypeCFF", "WritingScript": "0", "FullName": "Helvetica Neue LT Std 27 Ultra Light Condensed", "FullNameNative": "Helvetica Neue LT Std 27 Ultra Light Condensed", "FontStyleNameNative": "27 Ultra Light Condensed", "PlatformName": "$ID/", "Version": "Version 2.035;PS 002.000;hotconv 1.0.51;makeotf.lib2.0.18671", "TypekitID": "$ID/"}, {"_tag": "Font", "Self": "di189FontnHelvetica Neue LT Std 27 Ultra Light Condensed Oblique", "FontFamily": "Helvetica Neue LT Std", "Name": "Helvetica Neue LT Std 27 Ultra Light Condensed Oblique", "PostScriptName": "HelveticaNeueLTStd-UltLtCnO", "Status": "Substituted", "FontStyleName": "27 Ultra Light Condensed Oblique", "FontType": "OpenTypeCFF", "WritingScript": "0", "FullName": "Helvetica Neue LT Std 27 Ultra Light Condensed Oblique", "FullNameNative": "Helvetica Neue LT Std 27 Ultra Light Condensed Oblique", "FontStyleNameNative": "27 Ultra Light Condensed Oblique", "PlatformName": "$ID/", "Version": "Version 2.035;PS 002.000;hotconv 1.0.51;makeotf.lib2.0.18671", "TypekitID": "$ID/"}, {"_tag": "Font", "Self": "di189FontnHelvetica Neue LT Std 47 Light Condensed", "FontFamily": "Helvetica Neue LT Std", "Name": "Helvetica Neue LT Std 47 Light Condensed", "PostScriptName": "HelveticaNeueLTStd-LtCn", "Status": "Substituted", "FontStyleName": "47 Light Condensed", "FontType": "OpenTypeCFF", "WritingScript": "0", "FullName": "Helvetica Neue LT Std 47 Light Condensed", "FullNameNative": "Helvetica Neue LT Std 47 Light Condensed", "FontStyleNameNative": "47 Light Condensed", "PlatformName": "$ID/", "Version": "Version 2.035;PS 002.000;hotconv 1.0.51;makeotf.lib2.0.18671", "TypekitID": "$ID/"}, {"_tag": "Font", "Self": "di189FontnHelvetica Neue LT Std 47 Light Condensed Oblique", "FontFamily": "Helvetica Neue LT Std", "Name": "Helvetica Neue LT Std 47 Light Condensed Oblique", "PostScriptName": "HelveticaNeueLTStd-LtCnO", "Status": "Substituted", "FontStyleName": "47 Light Condensed Oblique", "FontType": "OpenTypeCFF", "WritingScript": "0", "FullName": "Helvetica Neue LT Std 47 Light Condensed Oblique", "FullNameNative": "Helvetica Neue LT Std 47 Light Condensed Oblique", "FontStyleNameNative": "47 Light Condensed Oblique", "PlatformName": "$ID/", "Version": "Version 2.035;PS 002.000;hotconv 1.0.51;makeotf.lib2.0.18671", "TypekitID": "$ID/"}, {"_tag": "Font", "Self": "di189FontnHelvetica Neue LT Std 57 Condensed", "FontFamily": "Helvetica Neue LT Std", "Name": "Helvetica Neue LT Std 57 Condensed", "PostScriptName": "HelveticaNeueLTStd-Cn", "Status": "Substituted", "FontStyleName": "57 Condensed", "FontType": "OpenTypeCFF", "WritingScript": "0", "FullName": "Helvetica Neue LT Std 57 Condensed", "FullNameNative": "Helvetica Neue LT Std 57 Condensed", "FontStyleNameNative": "57 Condensed", "PlatformName": "$ID/", "Version": "Version 2.035;PS 002.000;hotconv 1.0.51;makeotf.lib2.0.18671", "TypekitID": "$ID/"}, {"_tag": "Font", "Self": "di189FontnHelvetica Neue LT Std 57 Condensed Oblique", "FontFamily": "Helvetica Neue LT Std", "Name": "Helvetica Neue LT Std 57 Condensed Oblique", "PostScriptName": "HelveticaNeueLTStd-CnO", "Status": "Substituted", "FontStyleName": "57 Condensed Oblique", "FontType": "OpenTypeCFF", "WritingScript": "0", "FullName": "Helvetica Neue LT Std 57 Condensed Oblique", "FullNameNative": "Helvetica Neue LT Std 57 Condensed Oblique", "FontStyleNameNative": "57 Condensed Oblique", "PlatformName": "$ID/", "Version": "Version 2.035;PS 002.000;hotconv 1.0.51;makeotf.lib2.0.18671", "TypekitID": "$ID/"}, {"_tag": "Font", "Self": "di189FontnHelvetica Neue LT Std 67 Medium Condensed", "FontFamily": "Helvetica Neue LT Std", "Name": "Helvetica Neue LT Std 67 Medium Condensed", "PostScriptName": "HelveticaNeueLTStd-MdCn", "Status": "Substituted", "FontStyleName": "67 Medium Condensed", "FontType": "OpenTypeCFF", "WritingScript": "0", "FullName": "Helvetica Neue LT Std 67 Medium Condensed", "FullNameNative": "Helvetica Neue LT Std 67 Medium Condensed", "FontStyleNameNative": "67 Medium Condensed", "PlatformName": "$ID/", "Version": "Version 2.035;PS 002.000;hotconv 1.0.51;makeotf.lib2.0.18671", "TypekitID": "$ID/"}, {"_tag": "Font", "Self": "di189FontnHelvetica Neue LT Std 67 Medium Condensed Oblique", "FontFamily": "Helvetica Neue LT Std", "Name": "Helvetica Neue LT Std 67 Medium Condensed Oblique", "PostScriptName": "HelveticaNeueLTStd-MdCnO", "Status": "Substituted", "FontStyleName": "67 Medium Condensed Oblique", "FontType": "OpenTypeCFF", "WritingScript": "0", "FullName": "Helvetica Neue LT Std 67 Medium Condensed Oblique", "FullNameNative": "Helvetica Neue LT Std 67 Medium Condensed Oblique", "FontStyleNameNative": "67 Medium Condensed Oblique", "PlatformName": "$ID/", "Version": "Version 2.035;PS 002.000;hotconv 1.0.51;makeotf.lib2.0.18671", "TypekitID": "$ID/"}, {"_tag": "Font", "Self": "di189FontnHelvetica Neue LT Std 77 Bold Condensed", "FontFamily": "Helvetica Neue LT Std", "Name": "Helvetica Neue LT Std 77 Bold Condensed", "PostScriptName": "HelveticaNeueLTStd-BdCn", "Status": "Substituted", "FontStyleName": "77 Bold Condensed", "FontType": "OpenTypeCFF", "WritingScript": "0", "FullName": "Helvetica Neue LT Std 77 Bold Condensed", "FullNameNative": "Helvetica Neue LT Std 77 Bold Condensed", "FontStyleNameNative": "77 Bold Condensed", "PlatformName": "$ID/", "Version": "Version 2.035;PS 002.000;hotconv 1.0.51;makeotf.lib2.0.18671", "TypekitID": "$ID/"}, {"_tag": "Font", "Self": "di189FontnHelvetica Neue LT Std 77 Bold Condensed Oblique", "FontFamily": "Helvetica Neue LT Std", "Name": "Helvetica Neue LT Std 77 Bold Condensed Oblique", "PostScriptName": "HelveticaNeueLTStd-BdCnO", "Status": "Substituted", "FontStyleName": "77 Bold Condensed Oblique", "FontType": "OpenTypeCFF", "WritingScript": "0", "FullName": "Helvetica Neue LT Std 77 Bold Condensed Oblique", "FullNameNative": "Helvetica Neue LT Std 77 Bold Condensed Oblique", "FontStyleNameNative": "77 Bold Condensed Oblique", "PlatformName": "$ID/", "Version": "Version 2.035;PS 002.000;hotconv 1.0.51;makeotf.lib2.0.18671", "TypekitID": "$ID/"}, {"_tag": "Font", "Self": "di189FontnHelvetica Neue LT Std 87 Heavy Condensed", "FontFamily": "Helvetica Neue LT Std", "Name": "Helvetica Neue LT Std 87 Heavy Condensed", "PostScriptName": "HelveticaNeueLTStd-HvCn", "Status": "Substituted", "FontStyleName": "87 Heavy Condensed", "FontType": "OpenTypeCFF", "WritingScript": "0", "FullName": "Helvetica Neue LT Std 87 Heavy Condensed", "FullNameNative": "Helvetica Neue LT Std 87 Heavy Condensed", "FontStyleNameNative": "87 Heavy Condensed", "PlatformName": "$ID/", "Version": "Version 2.035;PS 002.000;hotconv 1.0.51;makeotf.lib2.0.18671", "TypekitID": "$ID/"}, {"_tag": "Font", "Self": "di189FontnHelvetica Neue LT Std 87 Heavy Condensed Oblique", "FontFamily": "Helvetica Neue LT Std", "Name": "Helvetica Neue LT Std 87 Heavy Condensed Oblique", "PostScriptName": "HelveticaNeueLTStd-HvCnO", "Status": "Substituted", "FontStyleName": "87 Heavy Condensed Oblique", "FontType": "OpenTypeCFF", "WritingScript": "0", "FullName": "Helvetica Neue LT Std 87 Heavy Condensed Oblique", "FullNameNative": "Helvetica Neue LT Std 87 Heavy Condensed Oblique", "FontStyleNameNative": "87 Heavy Condensed Oblique", "PlatformName": "$ID/", "Version": "Version 2.035;PS 002.000;hotconv 1.0.51;makeotf.lib2.0.18671", "TypekitID": "$ID/"}, {"_tag": "Font", "Self": "di189FontnHelvetica Neue LT Std 97 Black Condensed", "FontFamily": "Helvetica Neue LT Std", "Name": "Helvetica Neue LT Std 97 Black Condensed", "PostScriptName": "HelveticaNeueLTStd-BlkCn", "Status": "Substituted", "FontStyleName": "97 Black Condensed", "FontType": "OpenTypeCFF", "WritingScript": "0", "FullName": "Helvetica Neue LT Std 97 Black Condensed", "FullNameNative": "Helvetica Neue LT Std 97 Black Condensed", "FontStyleNameNative": "97 Black Condensed", "PlatformName": "$ID/", "Version": "Version 2.035;PS 002.000;hotconv 1.0.51;makeotf.lib2.0.18671", "TypekitID": "$ID/"}, {"_tag": "Font", "Self": "di189FontnHelvetica Neue LT Std 97 Black Condensed Oblique", "FontFamily": "Helvetica Neue LT Std", "Name": "Helvetica Neue LT Std 97 Black Condensed Oblique", "PostScriptName": "HelveticaNeueLTStd-BlkCnO", "Status": "Substituted", "FontStyleName": "97 Black Condensed Oblique", "FontType": "OpenTypeCFF", "WritingScript": "0", "FullName": "Helvetica Neue LT Std 97 Black Condensed Oblique", "FullNameNative": "Helvetica Neue LT Std 97 Black Condensed Oblique", "FontStyleNameNative": "97 Black Condensed Oblique", "PlatformName": "$ID/", "Version": "Version 2.035;PS 002.000;hotconv 1.0.51;makeotf.lib2.0.18671", "TypekitID": "$ID/"}, {"_tag": "Font", "Self": "di189FontnHelvetica Neue LT Std 107 Extra Black Condensed", "FontFamily": "Helvetica Neue LT Std", "Name": "Helvetica Neue LT Std 107 Extra Black Condensed", "PostScriptName": "HelveticaNeueLTStd-XBlkCn", "Status": "Substituted", "FontStyleName": "107 Extra Black Condensed", "FontType": "OpenTypeCFF", "WritingScript": "0", "FullName": "Helvetica Neue LT Std 107 Extra Black Condensed", "FullNameNative": "Helvetica Neue LT Std 107 Extra Black Condensed", "FontStyleNameNative": "107 Extra Black Condensed", "PlatformName": "$ID/", "Version": "Version 2.020;PS 002.000;hotconv 1.0.50;makeotf.lib2.0.16970", "TypekitID": "$ID/"}, {"_tag": "Font", "Self": "di189FontnHelvetica Neue LT Std 107 Extra Black Condensed Oblique", "FontFamily": "Helvetica Neue LT Std", "Name": "Helvetica Neue LT Std 107 Extra Black Condensed Oblique", "PostScriptName": "HelveticaNeueLTStd-XBlkCnO", "Status": "Substituted", "FontStyleName": "107 Extra Black Condensed Oblique", "FontType": "OpenTypeCFF", "WritingScript": "0", "FullName": "Helvetica Neue LT Std 107 Extra Black Condensed Oblique", "FullNameNative": "Helvetica Neue LT Std 107 Extra Black Condensed Oblique", "FontStyleNameNative": "107 Extra Black Condensed Oblique", "PlatformName": "$ID/", "Version": "Version 2.020;PS 002.000;hotconv 1.0.50;makeotf.lib2.0.16970", "TypekitID": "$ID/"}, {"_tag": "Font", "Self": "di189FontnHelvetica Neue LT Std 35 Thin", "FontFamily": "Helvetica Neue LT Std", "Name": "Helvetica Neue LT Std 35 Thin", "PostScriptName": "HelveticaNeueLTStd-Th", "Status": "Substituted", "FontStyleName": "35 Thin", "FontType": "OpenTypeCFF", "WritingScript": "0", "FullName": "Helvetica Neue LT Std 35 Thin", "FullNameNative": "Helvetica Neue LT Std 35 Thin", "FontStyleNameNative": "35 Thin", "PlatformName": "$ID/", "Version": "Version 2.035;PS 002.000;hotconv 1.0.51;makeotf.lib2.0.18671", "TypekitID": "$ID/"}, {"_tag": "Font", "Self": "di189FontnHelvetica Neue LT Std 36 Thin Italic", "FontFamily": "Helvetica Neue LT Std", "Name": "Helvetica Neue LT Std 36 Thin Italic", "PostScriptName": "HelveticaNeueLTStd-ThIt", "Status": "Substituted", "FontStyleName": "36 Thin Italic", "FontType": "OpenTypeCFF", "WritingScript": "0", "FullName": "Helvetica Neue LT Std 36 Thin Italic", "FullNameNative": "Helvetica Neue LT Std 36 Thin Italic", "FontStyleNameNative": "36 Thin Italic", "PlatformName": "$ID/", "Version": "Version 2.035;PS 002.000;hotconv 1.0.51;makeotf.lib2.0.18671", "TypekitID": "$ID/"}, {"_tag": "Font", "Self": "di189FontnHelvetica Neue LT Std 25 Ultra Light", "FontFamily": "Helvetica Neue LT Std", "Name": "Helvetica Neue LT Std 25 Ultra Light", "PostScriptName": "HelveticaNeueLTStd-UltLt", "Status": "Substituted", "FontStyleName": "25 Ultra Light", "FontType": "OpenTypeCFF", "WritingScript": "0", "FullName": "Helvetica Neue LT Std 25 Ultra Light", "FullNameNative": "Helvetica Neue LT Std 25 Ultra Light", "FontStyleNameNative": "25 Ultra Light", "PlatformName": "$ID/", "Version": "Version 2.035;PS 002.000;hotconv 1.0.51;makeotf.lib2.0.18671", "TypekitID": "$ID/"}, {"_tag": "Font", "Self": "di189FontnHelvetica Neue LT Std 26 Ultra Light Italic", "FontFamily": "Helvetica Neue LT Std", "Name": "Helvetica Neue LT Std 26 Ultra Light Italic", "PostScriptName": "HelveticaNeueLTStd-UltLtIt", "Status": "Substituted", "FontStyleName": "26 Ultra Light Italic", "FontType": "OpenTypeCFF", "WritingScript": "0", "FullName": "Helvetica Neue LT Std 26 Ultra Light Italic", "FullNameNative": "Helvetica Neue LT Std 26 Ultra Light Italic", "FontStyleNameNative": "26 Ultra Light Italic", "PlatformName": "$ID/", "Version": "Version 2.035;PS 002.000;hotconv 1.0.51;makeotf.lib2.0.18671", "TypekitID": "$ID/"}, {"_tag": "Font", "Self": "di189FontnHelvetica Neue LT Std 45 Light", "FontFamily": "Helvetica Neue LT Std", "Name": "Helvetica Neue LT Std 45 Light", "PostScriptName": "HelveticaNeueLTStd-Lt", "Status": "Substituted", "FontStyleName": "45 Light", "FontType": "OpenTypeCFF", "WritingScript": "0", "FullName": "Helvetica Neue LT Std 45 Light", "FullNameNative": "Helvetica Neue LT Std 45 Light", "FontStyleNameNative": "45 Light", "PlatformName": "$ID/", "Version": "Version 2.035;PS 002.000;hotconv 1.0.51;makeotf.lib2.0.18671", "TypekitID": "$ID/"}, {"_tag": "Font", "Self": "di189FontnHelvetica Neue LT Std 46 Light Italic", "FontFamily": "Helvetica Neue LT Std", "Name": "Helvetica Neue LT Std 46 Light Italic", "PostScriptName": "HelveticaNeueLTStd-LtIt", "Status": "Substituted", "FontStyleName": "46 Light Italic", "FontType": "OpenTypeCFF", "WritingScript": "0", "FullName": "Helvetica Neue LT Std 46 Light Italic", "FullNameNative": "Helvetica Neue LT Std 46 Light Italic", "FontStyleNameNative": "46 Light Italic", "PlatformName": "$ID/", "Version": "Version 2.035;PS 002.000;hotconv 1.0.51;makeotf.lib2.0.18671", "TypekitID": "$ID/"}, {"_tag": "Font", "Self": "di189FontnHelvetica Neue LT Std 55 Roman", "FontFamily": "Helvetica Neue LT Std", "Name": "Helvetica Neue LT Std 55 Roman", "PostScriptName": "HelveticaNeueLTStd-Roman", "Status": "Substituted", "FontStyleName": "55 Roman", "FontType": "OpenTypeCFF", "WritingScript": "0", "FullName": "Helvetica Neue LT Std 55 Roman", "FullNameNative": "Helvetica Neue LT Std 55 Roman", "FontStyleNameNative": "55 Roman", "PlatformName": "$ID/", "Version": "Version 2.020;PS 002.000;hotconv 1.0.50;makeotf.lib2.0.16970", "TypekitID": "$ID/"}, {"_tag": "Font", "Self": "di189FontnHelvetica Neue LT Std 56 Italic", "FontFamily": "Helvetica Neue LT Std", "Name": "Helvetica Neue LT Std 56 Italic", "PostScriptName": "HelveticaNeueLTStd-It", "Status": "Substituted", "FontStyleName": "56 Italic", "FontType": "OpenTypeCFF", "WritingScript": "0", "FullName": "Helvetica Neue LT Std 56 Italic", "FullNameNative": "Helvetica Neue LT Std 56 Italic", "FontStyleNameNative": "56 Italic", "PlatformName": "$ID/", "Version": "Version 2.035;PS 002.000;hotconv 1.0.51;makeotf.lib2.0.18671", "TypekitID": "$ID/"}, {"_tag": "Font", "Self": "di189FontnHelvetica Neue LT Std 65 Medium", "FontFamily": "Helvetica Neue LT Std", "Name": "Helvetica Neue LT Std 65 Medium", "PostScriptName": "HelveticaNeueLTStd-Md", "Status": "Substituted", "FontStyleName": "65 Medium", "FontType": "OpenTypeCFF", "WritingScript": "0", "FullName": "Helvetica Neue LT Std 65 Medium", "FullNameNative": "Helvetica Neue LT Std 65 Medium", "FontStyleNameNative": "65 Medium", "PlatformName": "$ID/", "Version": "Version 2.035;PS 002.000;hotconv 1.0.51;makeotf.lib2.0.18671", "TypekitID": "$ID/"}, {"_tag": "Font", "Self": "di189FontnHelvetica Neue LT Std 66 Medium Italic", "FontFamily": "Helvetica Neue LT Std", "Name": "Helvetica Neue LT Std 66 Medium Italic", "PostScriptName": "HelveticaNeueLTStd-MdIt", "Status": "Substituted", "FontStyleName": "66 Medium Italic", "FontType": "OpenTypeCFF", "WritingScript": "0", "FullName": "Helvetica Neue LT Std 66 Medium Italic", "FullNameNative": "Helvetica Neue LT Std 66 Medium Italic", "FontStyleNameNative": "66 Medium Italic", "PlatformName": "$ID/", "Version": "Version 2.035;PS 002.000;hotconv 1.0.51;makeotf.lib2.0.18671", "TypekitID": "$ID/"}, {"_tag": "Font", "Self": "di189FontnHelvetica Neue LT Std 75 Bold", "FontFamily": "Helvetica Neue LT Std", "Name": "Helvetica Neue LT Std 75 Bold", "PostScriptName": "HelveticaNeueLTStd-Bd", "Status": "Substituted", "FontStyleName": "75 Bold", "FontType": "OpenTypeCFF", "WritingScript": "0", "FullName": "Helvetica Neue LT Std 75 Bold", "FullNameNative": "Helvetica Neue LT Std 75 Bold", "FontStyleNameNative": "75 Bold", "PlatformName": "$ID/", "Version": "Version 2.035;PS 002.000;hotconv 1.0.51;makeotf.lib2.0.18671", "TypekitID": "$ID/"}, {"_tag": "Font", "Self": "di189FontnHelvetica Neue LT Std 75 Bold Outline", "FontFamily": "Helvetica Neue LT Std", "Name": "Helvetica Neue LT Std 75 Bold Outline", "PostScriptName": "HelveticaNeueLTStd-BdOu", "Status": "Substituted", "FontStyleName": "75 Bold Outline", "FontType": "OpenTypeCFF", "WritingScript": "0", "FullName": "Helvetica Neue LT Std 75 Bold Outline", "FullNameNative": "Helvetica Neue LT Std 75 Bold Outline", "FontStyleNameNative": "75 Bold Outline", "PlatformName": "$ID/", "Version": "Version 2.035;PS 002.000;hotconv 1.0.51;makeotf.lib2.0.18671", "TypekitID": "$ID/"}, {"_tag": "Font", "Self": "di189FontnHelvetica Neue LT Std 76 Bold Italic", "FontFamily": "Helvetica Neue LT Std", "Name": "Helvetica Neue LT Std 76 Bold Italic", "PostScriptName": "HelveticaNeueLTStd-BdIt", "Status": "Substituted", "FontStyleName": "76 Bold Italic", "FontType": "OpenTypeCFF", "WritingScript": "0", "FullName": "Helvetica Neue LT Std 76 Bold Italic", "FullNameNative": "Helvetica Neue LT Std 76 Bold Italic", "FontStyleNameNative": "76 Bold Italic", "PlatformName": "$ID/", "Version": "Version 2.035;PS 002.000;hotconv 1.0.51;makeotf.lib2.0.18671", "TypekitID": "$ID/"}, {"_tag": "Font", "Self": "di189FontnHelvetica Neue LT Std 85 Heavy", "FontFamily": "Helvetica Neue LT Std", "Name": "Helvetica Neue LT Std 85 Heavy", "PostScriptName": "HelveticaNeueLTStd-Hv", "Status": "Substituted", "FontStyleName": "85 Heavy", "FontType": "OpenTypeCFF", "WritingScript": "0", "FullName": "Helvetica Neue LT Std 85 Heavy", "FullNameNative": "Helvetica Neue LT Std 85 Heavy", "FontStyleNameNative": "85 Heavy", "PlatformName": "$ID/", "Version": "Version 2.035;PS 002.000;hotconv 1.0.51;makeotf.lib2.0.18671", "TypekitID": "$ID/"}, {"_tag": "Font", "Self": "di189FontnHelvetica Neue LT Std 86 Heavy Italic", "FontFamily": "Helvetica Neue LT Std", "Name": "Helvetica Neue LT Std 86 Heavy Italic", "PostScriptName": "HelveticaNeueLTStd-HvIt", "Status": "Substituted", "FontStyleName": "86 Heavy Italic", "FontType": "OpenTypeCFF", "WritingScript": "0", "FullName": "Helvetica Neue LT Std 86 Heavy Italic", "FullNameNative": "Helvetica Neue LT Std 86 Heavy Italic", "FontStyleNameNative": "86 Heavy Italic", "PlatformName": "$ID/", "Version": "Version 2.035;PS 002.000;hotconv 1.0.51;makeotf.lib2.0.18671", "TypekitID": "$ID/"}, {"_tag": "Font", "Self": "di189FontnHelvetica Neue LT Std 95 Black", "FontFamily": "Helvetica Neue LT Std", "Name": "Helvetica Neue LT Std 95 Black", "PostScriptName": "HelveticaNeueLTStd-Blk", "Status": "Substituted", "FontStyleName": "95 Black", "FontType": "OpenTypeCFF", "WritingScript": "0", "FullName": "Helvetica Neue LT Std 95 Black", "FullNameNative": "Helvetica Neue LT Std 95 Black", "FontStyleNameNative": "95 Black", "PlatformName": "$ID/", "Version": "Version 2.035;PS 002.000;hotconv 1.0.51;makeotf.lib2.0.18671", "TypekitID": "$ID/"}, {"_tag": "Font", "Self": "di189FontnHelvetica Neue LT Std 96 Black Italic", "FontFamily": "Helvetica Neue LT Std", "Name": "Helvetica Neue LT Std 96 Black Italic", "PostScriptName": "HelveticaNeueLTStd-BlkIt", "Status": "Substituted", "FontStyleName": "96 Black Italic", "FontType": "OpenTypeCFF", "WritingScript": "0", "FullName": "Helvetica Neue LT Std 96 Black Italic", "FullNameNative": "Helvetica Neue LT Std 96 Black Italic", "FontStyleNameNative": "96 Black Italic", "PlatformName": "$ID/", "Version": "Version 2.035;PS 002.000;hotconv 1.0.51;makeotf.lib2.0.18671", "TypekitID": "$ID/"}, {"_tag": "Font", "Self": "di189FontnHelvetica Neue LT Std 33 Thin Extended", "FontFamily": "Helvetica Neue LT Std", "Name": "Helvetica Neue LT Std 33 Thin Extended", "PostScriptName": "HelveticaNeueLTStd-ThEx", "Status": "Substituted", "FontStyleName": "33 Thin Extended", "FontType": "OpenTypeCFF", "WritingScript": "0", "FullName": "Helvetica Neue LT Std 33 Thin Extended", "FullNameNative": "Helvetica Neue LT Std 33 Thin Extended", "FontStyleNameNative": "33 Thin Extended", "PlatformName": "$ID/", "Version": "Version 2.020;PS 002.000;hotconv 1.0.50;makeotf.lib2.0.16970", "TypekitID": "$ID/"}, {"_tag": "Font", "Self": "di189FontnHelvetica Neue LT Std 33 Thin Extended Oblique", "FontFamily": "Helvetica Neue LT Std", "Name": "Helvetica Neue LT Std 33 Thin Extended Oblique", "PostScriptName": "HelveticaNeueLTStd-ThExO", "Status": "Substituted", "FontStyleName": "33 Thin Extended Oblique", "FontType": "OpenTypeCFF", "WritingScript": "0", "FullName": "Helvetica Neue LT Std 33 Thin Extended Oblique", "FullNameNative": "Helvetica Neue LT Std 33 Thin Extended Oblique", "FontStyleNameNative": "33 Thin Extended Oblique", "PlatformName": "$ID/", "Version": "Version 2.020;PS 002.000;hotconv 1.0.50;makeotf.lib2.0.16970", "TypekitID": "$ID/"}, {"_tag": "Font", "Self": "di189FontnHelvetica Neue LT Std 23 Ultra Light Extended", "FontFamily": "Helvetica Neue LT Std", "Name": "Helvetica Neue LT Std 23 Ultra Light Extended", "PostScriptName": "HelveticaNeueLTStd-UltLtEx", "Status": "Substituted", "FontStyleName": "23 Ultra Light Extended", "FontType": "OpenTypeCFF", "WritingScript": "0", "FullName": "Helvetica Neue LT Std 23 Ultra Light Extended", "FullNameNative": "Helvetica Neue LT Std 23 Ultra Light Extended", "FontStyleNameNative": "23 Ultra Light Extended", "PlatformName": "$ID/", "Version": "Version 2.035;PS 002.000;hotconv 1.0.51;makeotf.lib2.0.18671", "TypekitID": "$ID/"}, {"_tag": "Font", "Self": "di189FontnHelvetica Neue LT Std 23 Ultra Light Extended Oblique", "FontFamily": "Helvetica Neue LT Std", "Name": "Helvetica Neue LT Std 23 Ultra Light Extended Oblique", "PostScriptName": "HelveticaNeueLTStd-UltLtExO", "Status": "Substituted", "FontStyleName": "23 Ultra Light Extended Oblique", "FontType": "OpenTypeCFF", "WritingScript": "0", "FullName": "Helvetica Neue LT Std 23 Ultra Light Extended Oblique", "FullNameNative": "Helvetica Neue LT Std 23 Ultra Light Extended Oblique", "FontStyleNameNative": "23 Ultra Light Extended Oblique", "PlatformName": "$ID/", "Version": "Version 2.035;PS 002.000;hotconv 1.0.51;makeotf.lib2.0.18671", "TypekitID": "$ID/"}, {"_tag": "Font", "Self": "di189FontnHelvetica Neue LT Std 43 Light Extended", "FontFamily": "Helvetica Neue LT Std", "Name": "Helvetica Neue LT Std 43 Light Extended", "PostScriptName": "HelveticaNeueLTStd-LtEx", "Status": "Substituted", "FontStyleName": "43 Light Extended", "FontType": "OpenTypeCFF", "WritingScript": "0", "FullName": "Helvetica Neue LT Std 43 Light Extended", "FullNameNative": "Helvetica Neue LT Std 43 Light Extended", "FontStyleNameNative": "43 Light Extended", "PlatformName": "$ID/", "Version": "Version 2.035;PS 002.000;hotconv 1.0.51;makeotf.lib2.0.18671", "TypekitID": "$ID/"}, {"_tag": "Font", "Self": "di189FontnHelvetica Neue LT Std 43 Light Extended Oblique", "FontFamily": "Helvetica Neue LT Std", "Name": "Helvetica Neue LT Std 43 Light Extended Oblique", "PostScriptName": "HelveticaNeueLTStd-LtExO", "Status": "Substituted", "FontStyleName": "43 Light Extended Oblique", "FontType": "OpenTypeCFF", "WritingScript": "0", "FullName": "Helvetica Neue LT Std 43 Light Extended Oblique", "FullNameNative": "Helvetica Neue LT Std 43 Light Extended Oblique", "FontStyleNameNative": "43 Light Extended Oblique", "PlatformName": "$ID/", "Version": "Version 2.035;PS 002.000;hotconv 1.0.51;makeotf.lib2.0.18671", "TypekitID": "$ID/"}, {"_tag": "Font", "Self": "di189FontnHelvetica Neue LT Std 53 Extended", "FontFamily": "Helvetica Neue LT Std", "Name": "Helvetica Neue LT Std 53 Extended", "PostScriptName": "HelveticaNeueLTStd-Ex", "Status": "Substituted", "FontStyleName": "53 Extended", "FontType": "OpenTypeCFF", "WritingScript": "0", "FullName": "Helvetica Neue LT Std 53 Extended", "FullNameNative": "Helvetica Neue LT Std 53 Extended", "FontStyleNameNative": "53 Extended", "PlatformName": "$ID/", "Version": "Version 2.035;PS 002.000;hotconv 1.0.51;makeotf.lib2.0.18671", "TypekitID": "$ID/"}, {"_tag": "Font", "Self": "di189FontnHelvetica Neue LT Std 53 Extended Oblique", "FontFamily": "Helvetica Neue LT Std", "Name": "Helvetica Neue LT Std 53 Extended Oblique", "PostScriptName": "HelveticaNeueLTStd-ExO", "Status": "Substituted", "FontStyleName": "53 Extended Oblique", "FontType": "OpenTypeCFF", "WritingScript": "0", "FullName": "Helvetica Neue LT Std 53 Extended Oblique", "FullNameNative": "Helvetica Neue LT Std 53 Extended Oblique", "FontStyleNameNative": "53 Extended Oblique", "PlatformName": "$ID/", "Version": "Version 2.035;PS 002.000;hotconv 1.0.51;makeotf.lib2.0.18671", "TypekitID": "$ID/"}, {"_tag": "Font", "Self": "di189FontnHelvetica Neue LT Std 63 Medium Extended", "FontFamily": "Helvetica Neue LT Std", "Name": "Helvetica Neue LT Std 63 Medium Extended", "PostScriptName": "HelveticaNeueLTStd-MdEx", "Status": "Substituted", "FontStyleName": "63 Medium Extended", "FontType": "OpenTypeCFF", "WritingScript": "0", "FullName": "Helvetica Neue LT Std 63 Medium Extended", "FullNameNative": "Helvetica Neue LT Std 63 Medium Extended", "FontStyleNameNative": "63 Medium Extended", "PlatformName": "$ID/", "Version": "Version 2.035;PS 002.000;hotconv 1.0.51;makeotf.lib2.0.18671", "TypekitID": "$ID/"}, {"_tag": "Font", "Self": "di189FontnHelvetica Neue LT Std 63 Medium Extended Oblique", "FontFamily": "Helvetica Neue LT Std", "Name": "Helvetica Neue LT Std 63 Medium Extended Oblique", "PostScriptName": "HelveticaNeueLTStd-MdExO", "Status": "Substituted", "FontStyleName": "63 Medium Extended Oblique", "FontType": "OpenTypeCFF", "WritingScript": "0", "FullName": "Helvetica Neue LT Std 63 Medium Extended Oblique", "FullNameNative": "Helvetica Neue LT Std 63 Medium Extended Oblique", "FontStyleNameNative": "63 Medium Extended Oblique", "PlatformName": "$ID/", "Version": "Version 2.035;PS 002.000;hotconv 1.0.51;makeotf.lib2.0.18671", "TypekitID": "$ID/"}, {"_tag": "Font", "Self": "di189FontnHelvetica Neue LT Std 73 Bold Extended", "FontFamily": "Helvetica Neue LT Std", "Name": "Helvetica Neue LT Std 73 Bold Extended", "PostScriptName": "HelveticaNeueLTStd-BdEx", "Status": "Substituted", "FontStyleName": "73 Bold Extended", "FontType": "OpenTypeCFF", "WritingScript": "0", "FullName": "Helvetica Neue LT Std 73 Bold Extended", "FullNameNative": "Helvetica Neue LT Std 73 Bold Extended", "FontStyleNameNative": "73 Bold Extended", "PlatformName": "$ID/", "Version": "Version 2.035;PS 002.000;hotconv 1.0.51;makeotf.lib2.0.18671", "TypekitID": "$ID/"}, {"_tag": "Font", "Self": "di189FontnHelvetica Neue LT Std 73 Bold Extended Oblique", "FontFamily": "Helvetica Neue LT Std", "Name": "Helvetica Neue LT Std 73 Bold Extended Oblique", "PostScriptName": "HelveticaNeueLTStd-BdExO", "Status": "Substituted", "FontStyleName": "73 Bold Extended Oblique", "FontType": "OpenTypeCFF", "WritingScript": "0", "FullName": "Helvetica Neue LT Std 73 Bold Extended Oblique", "FullNameNative": "Helvetica Neue LT Std 73 Bold Extended Oblique", "FontStyleNameNative": "73 Bold Extended Oblique", "PlatformName": "$ID/", "Version": "Version 2.035;PS 002.000;hotconv 1.0.51;makeotf.lib2.0.18671", "TypekitID": "$ID/"}, {"_tag": "Font", "Self": "di189FontnHelvetica Neue LT Std 83 Heavy Extended", "FontFamily": "Helvetica Neue LT Std", "Name": "Helvetica Neue LT Std 83 Heavy Extended", "PostScriptName": "HelveticaNeueLTStd-HvEx", "Status": "Substituted", "FontStyleName": "83 Heavy Extended", "FontType": "OpenTypeCFF", "WritingScript": "0", "FullName": "Helvetica Neue LT Std 83 Heavy Extended", "FullNameNative": "Helvetica Neue LT Std 83 Heavy Extended", "FontStyleNameNative": "83 Heavy Extended", "PlatformName": "$ID/", "Version": "Version 2.035;PS 002.000;hotconv 1.0.51;makeotf.lib2.0.18671", "TypekitID": "$ID/"}, {"_tag": "Font", "Self": "di189FontnHelvetica Neue LT Std 83 Heavy Extended Oblique", "FontFamily": "Helvetica Neue LT Std", "Name": "Helvetica Neue LT Std 83 Heavy Extended Oblique", "PostScriptName": "HelveticaNeueLTStd-HvExO", "Status": "Substituted", "FontStyleName": "83 Heavy Extended Oblique", "FontType": "OpenTypeCFF", "WritingScript": "0", "FullName": "Helvetica Neue LT Std 83 Heavy Extended Oblique", "FullNameNative": "Helvetica Neue LT Std 83 Heavy Extended Oblique", "FontStyleNameNative": "83 Heavy Extended Oblique", "PlatformName": "$ID/", "Version": "Version 2.035;PS 002.000;hotconv 1.0.51;makeotf.lib2.0.18671", "TypekitID": "$ID/"}, {"_tag": "Font", "Self": "di189FontnHelvetica Neue LT Std 93 Black Extended", "FontFamily": "Helvetica Neue LT Std", "Name": "Helvetica Neue LT Std 93 Black Extended", "PostScriptName": "HelveticaNeueLTStd-BlkEx", "Status": "Substituted", "FontStyleName": "93 Black Extended", "FontType": "OpenTypeCFF", "WritingScript": "0", "FullName": "Helvetica Neue LT Std 93 Black Extended", "FullNameNative": "Helvetica Neue LT Std 93 Black Extended", "FontStyleNameNative": "93 Black Extended", "PlatformName": "$ID/", "Version": "Version 2.035;PS 002.000;hotconv 1.0.51;makeotf.lib2.0.18671", "TypekitID": "$ID/"}, {"_tag": "Font", "Self": "di189FontnHelvetica Neue LT Std 93 Black Extended Oblique", "FontFamily": "Helvetica Neue LT Std", "Name": "Helvetica Neue LT Std 93 Black Extended Oblique", "PostScriptName": "HelveticaNeueLTStd-BlkExO", "Status": "Substituted", "FontStyleName": "93 Black Extended Oblique", "FontType": "OpenTypeCFF", "WritingScript": "0", "FullName": "Helvetica Neue LT Std 93 Black Extended Oblique", "FullNameNative": "Helvetica Neue LT Std 93 Black Extended Oblique", "FontStyleNameNative": "93 Black Extended Oblique", "PlatformName": "$ID/", "Version": "Version 2.035;PS 002.000;hotconv 1.0.51;makeotf.lib2.0.18671", "TypekitID": "$ID/"} ] },
            {"_tag": "FontFamily", "Self": "dif3b9", "Name": "Wingdings", "_subElements":[{"_tag": "Font", "Self": "dif3b9FontnWingdings Regular", "FontFamily": "Wingdings", "Name": "Wingdings Regular", "PostScriptName": "Wingdings-Regular", "Status": "Installed", "FontStyleName": "Regular", "FontType": "OpenTypeTT", "WritingScript": "0", "FullName": "Wingdings", "FullNameNative": "Wingdings", "FontStyleNameNative": "Regular", "PlatformName": "$ID/", "Version": "Version 5.00", "TypekitID": "$ID/"} ] },
            {"_tag": "FontFamily", "Self": "di1cdf9", "Name": "Mark Offc Pro", "_subElements":[{"_tag": "Font", "Self": "di1cdf9FontnMark Offc Pro Light", "FontFamily": "Mark Offc Pro", "Name": "Mark Offc Pro Light", "PostScriptName": "MarkOffcPro-Light", "Status": "Installed", "FontStyleName": "Light", "FontType": "OpenTypeTT", "WritingScript": "0", "FullName": "Mark Offc Pro Light", "FullNameNative": "Mark Offc Pro Light", "FontStyleNameNative": "Light", "PlatformName": "$ID/", "Version": "Version 7.504; 2013; Build 1022", "TypekitID": "$ID/"}, {"_tag": "Font", "Self": "di1cdf9FontnMark Offc Pro Regular", "FontFamily": "Mark Offc Pro", "Name": "Mark Offc Pro Regular", "PostScriptName": "MarkOffcPro", "Status": "Installed", "FontStyleName": "Regular", "FontType": "OpenTypeTT", "WritingScript": "0", "FullName": "Mark Offc Pro", "FullNameNative": "Mark Offc Pro", "FontStyleNameNative": "Regular", "PlatformName": "$ID/", "Version": "Version 7.504; 2013; Build 1022", "TypekitID": "$ID/"}, {"_tag": "Font", "Self": "di1cdf9FontnMark Offc Pro Italic", "FontFamily": "Mark Offc Pro", "Name": "Mark Offc Pro Italic", "PostScriptName": "MarkOffcPro-Italic", "Status": "Installed", "FontStyleName": "Italic", "FontType": "OpenTypeTT", "WritingScript": "0", "FullName": "Mark Offc Pro Italic", "FullNameNative": "Mark Offc Pro Italic", "FontStyleNameNative": "Italic", "PlatformName": "$ID/", "Version": "Version 7.504; 2013; Build 1022", "TypekitID": "$ID/"}, {"_tag": "Font", "Self": "di1cdf9FontnMark Offc Pro Medium", "FontFamily": "Mark Offc Pro", "Name": "Mark Offc Pro Medium", "PostScriptName": "MarkOffcPro-Medium", "Status": "Installed", "FontStyleName": "Medium", "FontType": "OpenTypeTT", "WritingScript": "0", "FullName": "Mark Offc Pro Medium", "FullNameNative": "Mark Offc Pro Medium", "FontStyleNameNative": "Medium", "PlatformName": "$ID/", "Version": "Version 7.504; 2013; Build 1022", "TypekitID": "$ID/"}, {"_tag": "Font", "Self": "di1cdf9FontnMark Offc Pro Medium Italic", "FontFamily": "Mark Offc Pro", "Name": "Mark Offc Pro Medium Italic", "PostScriptName": "MarkOffcPro-MediumItalic", "Status": "Installed", "FontStyleName": "Medium Italic", "FontType": "OpenTypeTT", "WritingScript": "0", "FullName": "Mark Offc Pro Medium Italic", "FullNameNative": "Mark Offc Pro Medium Italic", "FontStyleNameNative": "Medium Italic", "PlatformName": "$ID/", "Version": "Version 7.504; 2013; Build 1022", "TypekitID": "$ID/"}, {"_tag": "Font", "Self": "di1cdf9FontnMark Offc Pro Bold", "FontFamily": "Mark Offc Pro", "Name": "Mark Offc Pro Bold", "PostScriptName": "MarkOffcPro-Bold", "Status": "Installed", "FontStyleName": "Bold", "FontType": "OpenTypeTT", "WritingScript": "0", "FullName": "Mark Offc Pro Bold", "FullNameNative": "Mark Offc Pro Bold", "FontStyleNameNative": "Bold", "PlatformName": "$ID/", "Version": "Version 7.504; 2013; Build 1022", "TypekitID": "$ID/"} ] },
            {"_tag": "FontFamily", "Self": "di1ce76", "Name": "DIN Offc", "_subElements":[{"_tag": "Font", "Self": "di1ce76FontnDIN Offc Light", "FontFamily": "DIN Offc", "Name": "DIN Offc Light", "PostScriptName": "DINOffc-Light", "Status": "Substituted", "FontStyleName": "Light", "FontType": "OpenTypeTT", "WritingScript": "0", "FullName": "DIN Offc Light", "FullNameNative": "DIN Offc Light", "FontStyleNameNative": "Light", "PlatformName": "$ID/", "Version": "Version 7.504; 2009; Build 1012", "TypekitID": "$ID/"}, {"_tag": "Font", "Self": "di1ce76FontnDIN Offc Light Italic", "FontFamily": "DIN Offc", "Name": "DIN Offc Light Italic", "PostScriptName": "DINOffc-LightIta", "Status": "Substituted", "FontStyleName": "Light Italic", "FontType": "OpenTypeTT", "WritingScript": "0", "FullName": "DIN Offc Light Italic", "FullNameNative": "DIN Offc Light Italic", "FontStyleNameNative": "Light Italic", "PlatformName": "$ID/", "Version": "Version 7.504; 2009; Build 1013", "TypekitID": "$ID/"}, {"_tag": "Font", "Self": "di1ce76FontnDIN Offc Regular", "FontFamily": "DIN Offc", "Name": "DIN Offc Regular", "PostScriptName": "DINOffc", "Status": "Substituted", "FontStyleName": "Regular", "FontType": "OpenTypeTT", "WritingScript": "0", "FullName": "DIN Offc", "FullNameNative": "DIN Offc", "FontStyleNameNative": "Regular", "PlatformName": "$ID/", "Version": "Version 7.504; 2009; Build 1013", "TypekitID": "$ID/"}, {"_tag": "Font", "Self": "di1ce76FontnDIN Offc Italic", "FontFamily": "DIN Offc", "Name": "DIN Offc Italic", "PostScriptName": "DINOffc-Ita", "Status": "Substituted", "FontStyleName": "Italic", "FontType": "OpenTypeTT", "WritingScript": "0", "FullName": "DIN Offc Italic", "FullNameNative": "DIN Offc Italic", "FontStyleNameNative": "Italic", "PlatformName": "$ID/", "Version": "Version 7.504; 2009; Build 1014", "TypekitID": "$ID/"}, {"_tag": "Font", "Self": "di1ce76FontnDIN Offc Medium", "FontFamily": "DIN Offc", "Name": "DIN Offc Medium", "PostScriptName": "DINOffc-Medi", "Status": "Substituted", "FontStyleName": "Medium", "FontType": "OpenTypeTT", "WritingScript": "0", "FullName": "DIN Offc Medium", "FullNameNative": "DIN Offc Medium", "FontStyleNameNative": "Medium", "PlatformName": "$ID/", "Version": "Version 7.504; 2009; Build 1012", "TypekitID": "$ID/"}, {"_tag": "Font", "Self": "di1ce76FontnDIN Offc Medium Italic", "FontFamily": "DIN Offc", "Name": "DIN Offc Medium Italic", "PostScriptName": "DINOffc-MediIta", "Status": "Substituted", "FontStyleName": "Medium Italic", "FontType": "OpenTypeTT", "WritingScript": "0", "FullName": "DIN Offc Medium Italic", "FullNameNative": "DIN Offc Medium Italic", "FontStyleNameNative": "Medium Italic", "PlatformName": "$ID/", "Version": "Version 7.504; 2009; Build 1012", "TypekitID": "$ID/"}, {"_tag": "Font", "Self": "di1ce76FontnDIN Offc Bold", "FontFamily": "DIN Offc", "Name": "DIN Offc Bold", "PostScriptName": "DINOffc-Bold", "Status": "Substituted", "FontStyleName": "Bold", "FontType": "OpenTypeTT", "WritingScript": "0", "FullName": "DIN Offc Bold", "FullNameNative": "DIN Offc Bold", "FontStyleNameNative": "Bold", "PlatformName": "$ID/", "Version": "Version 7.504; 2009; Build 1013", "TypekitID": "$ID/"}, {"_tag": "Font", "Self": "di1ce76FontnDIN Offc Bold Italic", "FontFamily": "DIN Offc", "Name": "DIN Offc Bold Italic", "PostScriptName": "DINOffc-BoldIta", "Status": "Substituted", "FontStyleName": "Bold Italic", "FontType": "OpenTypeTT", "WritingScript": "0", "FullName": "DIN Offc Bold Italic", "FullNameNative": "DIN Offc Bold Italic", "FontStyleNameNative": "Bold Italic", "PlatformName": "$ID/", "Version": "Version 7.504; 2009; Build 1012", "TypekitID": "$ID/"}, {"_tag": "Font", "Self": "di1ce76FontnDIN Offc Black", "FontFamily": "DIN Offc", "Name": "DIN Offc Black", "PostScriptName": "DINOffc-Black", "Status": "Substituted", "FontStyleName": "Black", "FontType": "OpenTypeTT", "WritingScript": "0", "FullName": "DIN Offc Black", "FullNameNative": "DIN Offc Black", "FontStyleNameNative": "Black", "PlatformName": "$ID/", "Version": "Version 7.504; 2009; Build 1013", "TypekitID": "$ID/"}, {"_tag": "Font", "Self": "di1ce76FontnDIN Offc Black Italic", "FontFamily": "DIN Offc", "Name": "DIN Offc Black Italic", "PostScriptName": "DINOffc-BlackIta", "Status": "Substituted", "FontStyleName": "Black Italic", "FontType": "OpenTypeTT", "WritingScript": "0", "FullName": "DIN Offc Black Italic", "FullNameNative": "DIN Offc Black Italic", "FontStyleNameNative": "Black Italic", "PlatformName": "$ID/", "Version": "Version 7.504; 2009; Build 1013", "TypekitID": "$ID/"} ] },
            {"_tag": "FontFamily", "Self": "di1ce78", "Name": "Lato (TT)", "_subElements":[{"_tag": "Font", "Self": "di1ce78FontnLato (TT) Hairline", "FontFamily": "Lato (TT)", "Name": "Lato (TT) Hairline", "PostScriptName": "Lato-Hairline", "Status": "Substituted", "FontStyleName": "Hairline", "FontType": "TrueType", "WritingScript": "0", "FullName": "Lato Hairline", "FullNameNative": "Lato Hairline", "FontStyleNameNative": "Hairline", "PlatformName": "$ID/", "Version": "Version 1.104; Western+Polish opensource", "TypekitID": "$ID/"}, {"_tag": "Font", "Self": "di1ce78FontnLato (TT) Hairline Italic", "FontFamily": "Lato (TT)", "Name": "Lato (TT) Hairline Italic", "PostScriptName": "Lato-HairlineItalic", "Status": "Substituted", "FontStyleName": "Hairline Italic", "FontType": "TrueType", "WritingScript": "0", "FullName": "Lato Hairline Italic", "FullNameNative": "Lato Hairline Italic", "FontStyleNameNative": "Hairline Italic", "PlatformName": "$ID/", "Version": "Version 1.104; Western+Polish opensource", "TypekitID": "$ID/"}, {"_tag": "Font", "Self": "di1ce78FontnLato (TT) Thin", "FontFamily": "Lato (TT)", "Name": "Lato (TT) Thin", "PostScriptName": "Lato-Thin", "Status": "Substituted", "FontStyleName": "Thin", "FontType": "TrueType", "WritingScript": "0", "FullName": "Lato Thin", "FullNameNative": "Lato Thin", "FontStyleNameNative": "Thin", "PlatformName": "$ID/", "Version": "Version 2.007; 2014-02-27", "TypekitID": "$ID/"}, {"_tag": "Font", "Self": "di1ce78FontnLato (TT) Thin Italic", "FontFamily": "Lato (TT)", "Name": "Lato (TT) Thin Italic", "PostScriptName": "Lato-ThinItalic", "Status": "Substituted", "FontStyleName": "Thin Italic", "FontType": "TrueType", "WritingScript": "0", "FullName": "Lato Thin Italic", "FullNameNative": "Lato Thin Italic", "FontStyleNameNative": "Thin Italic", "PlatformName": "$ID/", "Version": "Version 2.007; 2014-02-27", "TypekitID": "$ID/"}, {"_tag": "Font", "Self": "di1ce78FontnLato (TT) Light", "FontFamily": "Lato (TT)", "Name": "Lato (TT) Light", "PostScriptName": "Lato-Light", "Status": "Substituted", "FontStyleName": "Light", "FontType": "TrueType", "WritingScript": "0", "FullName": "Lato Light", "FullNameNative": "Lato Light", "FontStyleNameNative": "Light", "PlatformName": "$ID/", "Version": "Version 1.104; Western+Polish opensource", "TypekitID": "$ID/"}, {"_tag": "Font", "Self": "di1ce78FontnLato (TT) Light Italic", "FontFamily": "Lato (TT)", "Name": "Lato (TT) Light Italic", "PostScriptName": "Lato-LightItalic", "Status": "Substituted", "FontStyleName": "Light Italic", "FontType": "TrueType", "WritingScript": "0", "FullName": "Lato Light Italic", "FullNameNative": "Lato Light Italic", "FontStyleNameNative": "Light Italic", "PlatformName": "$ID/", "Version": "Version 1.104; Western+Polish opensource", "TypekitID": "$ID/"}, {"_tag": "Font", "Self": "di1ce78FontnLato (TT) Regular", "FontFamily": "Lato (TT)", "Name": "Lato (TT) Regular", "PostScriptName": "Lato-Regular", "Status": "Substituted", "FontStyleName": "Regular", "FontType": "TrueType", "WritingScript": "0", "FullName": "Lato Regular", "FullNameNative": "Lato Regular", "FontStyleNameNative": "Regular", "PlatformName": "$ID/", "Version": "Version 1.104; Western+Polish opensource", "TypekitID": "$ID/"}, {"_tag": "Font", "Self": "di1ce78FontnLato (TT) Italic", "FontFamily": "Lato (TT)", "Name": "Lato (TT) Italic", "PostScriptName": "Lato-Italic", "Status": "Substituted", "FontStyleName": "Italic", "FontType": "TrueType", "WritingScript": "0", "FullName": "Lato Italic", "FullNameNative": "Lato Italic", "FontStyleNameNative": "Italic", "PlatformName": "$ID/", "Version": "Version 1.104; Western+Polish opensource", "TypekitID": "$ID/"}, {"_tag": "Font", "Self": "di1ce78FontnLato (TT) Medium", "FontFamily": "Lato (TT)", "Name": "Lato (TT) Medium", "PostScriptName": "Lato-Medium", "Status": "Substituted", "FontStyleName": "Medium", "FontType": "TrueType", "WritingScript": "0", "FullName": "Lato Medium", "FullNameNative": "Lato Medium", "FontStyleNameNative": "Medium", "PlatformName": "$ID/", "Version": "Version 2.006; 2014-01-15", "TypekitID": "$ID/"}, {"_tag": "Font", "Self": "di1ce78FontnLato (TT) Medium Italic", "FontFamily": "Lato (TT)", "Name": "Lato (TT) Medium Italic", "PostScriptName": "Lato-MediumItalic", "Status": "Substituted", "FontStyleName": "Medium Italic", "FontType": "TrueType", "WritingScript": "0", "FullName": "Lato Medium Italic", "FullNameNative": "Lato Medium Italic", "FontStyleNameNative": "Medium Italic", "PlatformName": "$ID/", "Version": "Version 2.006; 2014-01-15", "TypekitID": "$ID/"}, {"_tag": "Font", "Self": "di1ce78FontnLato (TT) Semibold", "FontFamily": "Lato (TT)", "Name": "Lato (TT) Semibold", "PostScriptName": "Lato-Semibold", "Status": "Substituted", "FontStyleName": "Semibold", "FontType": "TrueType", "WritingScript": "0", "FullName": "Lato Semibold", "FullNameNative": "Lato Semibold", "FontStyleNameNative": "Semibold", "PlatformName": "$ID/", "Version": "Version 2.006; 2014-01-15", "TypekitID": "$ID/"}, {"_tag": "Font", "Self": "di1ce78FontnLato (TT) Semibold Italic", "FontFamily": "Lato (TT)", "Name": "Lato (TT) Semibold Italic", "PostScriptName": "Lato-SemiboldItalic", "Status": "Substituted", "FontStyleName": "Semibold Italic", "FontType": "TrueType", "WritingScript": "0", "FullName": "Lato Semibold Italic", "FullNameNative": "Lato Semibold Italic", "FontStyleNameNative": "Semibold Italic", "PlatformName": "$ID/", "Version": "Version 2.006; 2014-01-15", "TypekitID": "$ID/"}, {"_tag": "Font", "Self": "di1ce78FontnLato (TT) Bold", "FontFamily": "Lato (TT)", "Name": "Lato (TT) Bold", "PostScriptName": "Lato-Bold", "Status": "Substituted", "FontStyleName": "Bold", "FontType": "TrueType", "WritingScript": "0", "FullName": "Lato Bold", "FullNameNative": "Lato Bold", "FontStyleNameNative": "Bold", "PlatformName": "$ID/", "Version": "Version 1.104; Western+Polish opensource", "TypekitID": "$ID/"}, {"_tag": "Font", "Self": "di1ce78FontnLato (TT) Bold Italic", "FontFamily": "Lato (TT)", "Name": "Lato (TT) Bold Italic", "PostScriptName": "Lato-BoldItalic", "Status": "Substituted", "FontStyleName": "Bold Italic", "FontType": "TrueType", "WritingScript": "0", "FullName": "Lato Bold Italic", "FullNameNative": "Lato Bold Italic", "FontStyleNameNative": "Bold Italic", "PlatformName": "$ID/", "Version": "Version 1.104; Western+Polish opensource", "TypekitID": "$ID/"}, {"_tag": "Font", "Self": "di1ce78FontnLato (TT) Heavy", "FontFamily": "Lato (TT)", "Name": "Lato (TT) Heavy", "PostScriptName": "Lato-Heavy", "Status": "Substituted", "FontStyleName": "Heavy", "FontType": "TrueType", "WritingScript": "0", "FullName": "Lato Heavy", "FullNameNative": "Lato Heavy", "FontStyleNameNative": "Heavy", "PlatformName": "$ID/", "Version": "Version 2.007; 2014-02-27", "TypekitID": "$ID/"}, {"_tag": "Font", "Self": "di1ce78FontnLato (TT) Black", "FontFamily": "Lato (TT)", "Name": "Lato (TT) Black", "PostScriptName": "Lato-Black", "Status": "Substituted", "FontStyleName": "Black", "FontType": "TrueType", "WritingScript": "0", "FullName": "Lato Black", "FullNameNative": "Lato Black", "FontStyleNameNative": "Black", "PlatformName": "$ID/", "Version": "Version 1.104; Western+Polish opensource", "TypekitID": "$ID/"} ] },
            {"_tag": "FontFamily", "Self": "di1ce7c", "Name": "Mark Pro", "_subElements":[{"_tag": "Font", "Self": "di1ce7cFontnMark Pro Light", "FontFamily": "Mark Pro", "Name": "Mark Pro Light", "PostScriptName": "MarkPro-Light", "Status": "Installed", "FontStyleName": "Light", "FontType": "OpenTypeCFF", "WritingScript": "0", "FullName": "Mark Pro Light", "FullNameNative": "Mark Pro Light", "FontStyleNameNative": "Light", "PlatformName": "$ID/", "Version": "Version 7.504; 2013; Build 1030", "TypekitID": "$ID/"}, {"_tag": "Font", "Self": "di1ce7cFontnMark Pro Regular", "FontFamily": "Mark Pro", "Name": "Mark Pro Regular", "PostScriptName": "MarkPro", "Status": "Installed", "FontStyleName": "Regular", "FontType": "OpenTypeCFF", "WritingScript": "0", "FullName": "Mark Pro", "FullNameNative": "Mark Pro", "FontStyleNameNative": "Regular", "PlatformName": "$ID/", "Version": "Version 7.504; 2013; Build 1030", "TypekitID": "$ID/"}, {"_tag": "Font", "Self": "di1ce7cFontnMark Pro Italic", "FontFamily": "Mark Pro", "Name": "Mark Pro Italic", "PostScriptName": "MarkPro-Italic", "Status": "Installed", "FontStyleName": "Italic", "FontType": "OpenTypeCFF", "WritingScript": "0", "FullName": "Mark Pro Italic", "FullNameNative": "Mark Pro Italic", "FontStyleNameNative": "Italic", "PlatformName": "$ID/", "Version": "Version 7.504; 2013; Build 1027", "TypekitID": "$ID/"}, {"_tag": "Font", "Self": "di1ce7cFontnMark Pro Medium", "FontFamily": "Mark Pro", "Name": "Mark Pro Medium", "PostScriptName": "MarkPro-Medium", "Status": "Installed", "FontStyleName": "Medium", "FontType": "OpenTypeCFF", "WritingScript": "0", "FullName": "Mark Pro Medium", "FullNameNative": "Mark Pro Medium", "FontStyleNameNative": "Medium", "PlatformName": "$ID/", "Version": "Version 7.504; 2013; Build 1028", "TypekitID": "$ID/"}, {"_tag": "Font", "Self": "di1ce7cFontnMark Pro Medium Italic", "FontFamily": "Mark Pro", "Name": "Mark Pro Medium Italic", "PostScriptName": "MarkPro-MediumItalic", "Status": "Installed", "FontStyleName": "Medium Italic", "FontType": "OpenTypeCFF", "WritingScript": "0", "FullName": "Mark Pro Medium Italic", "FullNameNative": "Mark Pro Medium Italic", "FontStyleNameNative": "Medium Italic", "PlatformName": "$ID/", "Version": "Version 7.504; 2013; Build 1027", "TypekitID": "$ID/"}, {"_tag": "Font", "Self": "di1ce7cFontnMark Pro Bold", "FontFamily": "Mark Pro", "Name": "Mark Pro Bold", "PostScriptName": "MarkPro-Bold", "Status": "Installed", "FontStyleName": "Bold", "FontType": "OpenTypeCFF", "WritingScript": "0", "FullName": "Mark Pro Bold", "FullNameNative": "Mark Pro Bold", "FontStyleNameNative": "Bold", "PlatformName": "$ID/", "Version": "Version 7.504; 2013; Build 1029", "TypekitID": "$ID/"} ] },
            {"_tag": "CompositeFont", "Self": "CompositeFont/$ID/[No composite font]", "Name": "$ID/[No composite font]", "_subElements":[{"_tag": "CompositeFontEntry", "Self": "ua2", "Name": "$ID/Kanji", "FontStyle": "$ID/R", "RelativeSize": "100", "HorizontalScale": "100", "VerticalScale": "100", "Locked": "true", "ScaleOption": "true", "BaselineShift": "0", "_subElements":[{"_tag": "Properties", "_subElements":[{"_tag": "AppliedFont", "_text": "Kozuka Mincho Pro", "type": "string"} ] } ] }, {"_tag": "CompositeFontEntry", "Self": "ua4", "Name": "$ID/Kana", "FontStyle": "$ID/R", "RelativeSize": "100", "HorizontalScale": "100", "VerticalScale": "100", "CustomCharacters": "ぁあぃいぅうぇえぉおかがきぎくぐけげこごさざしじすずせぜそぞただちぢっつづてでとどなにぬねのはばぱひびぴふぶぷへべぺほぼぽまみむめもゃやゅゆょよらりるれろゎわゐゑをんゔゕゖゝゞァアィイゥウェエォオカガキギクグケゲコゴサザシジスズセゼソゾタダチヂッツヅテデトドナニヌネノハバパヒビピフブプヘベペホボポマミムメモャヤュユョヨラリルレロヮワヰヱヲンヴヵヶヷヸヹヺーヽヾ", "Locked": "true", "ScaleOption": "true", "BaselineShift": "0", "_subElements":[{"_tag": "Properties", "_subElements":[{"_tag": "AppliedFont", "_text": "Kozuka Mincho Pro", "type": "string"} ] } ] }, {"_tag": "CompositeFontEntry", "Self": "ua5", "Name": "$ID/Punctuation", "FontStyle": "$ID/R", "RelativeSize": "100", "HorizontalScale": "100", "VerticalScale": "100", "CustomCharacters": "—―‖‘’“”‥…′″∥、。〈〉《》「」『』【】〔〕〜・！（），．／：；？［］｛｝～", "Locked": "true", "ScaleOption": "true", "BaselineShift": "0", "_subElements":[{"_tag": "Properties", "_subElements":[{"_tag": "AppliedFont", "_text": "Kozuka Mincho Pro", "type": "string"} ] } ] }, {"_tag": "CompositeFontEntry", "Self": "ua6", "Name": "$ID/Symbols", "FontStyle": "$ID/R", "RelativeSize": "100", "HorizontalScale": "100", "VerticalScale": "100", "CustomCharacters": "¢£§¨¬°±´¶×÷ΑΒΓΔΕΖΗΘΙΚΛΜΝΞΟΠΡΣΤΥΦΧΨΩαβγδεζηθικλμνξοπρστυφχψωЁАБВГДЕЖЗИЙКЛМНОПРСТУФХЦЧШЩЪЫЬЭЮЯабвгдежзийклмнопрстуфхцчшщъыьэюяё‐†‡‰※℃Å←↑→↓⇒⇔∀∂∃∇∈∋−√∝∞∠∧∨∩∪∫∬∴∵∽≒≠≡≦≧≪≫⊂⊃⊆⊇⊥⌒■□▲△▼▽◆◇○◎●◯★☆♀♂♪♭♯〃〆〇〒〓゛゜＃＄％＆＊＋－０１２３４５６７８９＜＝＞＠ＡＢＣＤＥＦＧＨＩＪＫＬＭＮＯＰＱＲＳＴＵＶＷＸＹＺ＼＾＿｀ａｂｃｄｅｆｇｈｉｊｋｌｍｎｏｐｑｒｓｔｕｖｗｘｙｚ｜￠￡￢￣￥", "Locked": "true", "ScaleOption": "true", "BaselineShift": "0", "_subElements":[{"_tag": "Properties", "_subElements":[{"_tag": "AppliedFont", "_text": "Kozuka Mincho Pro", "type": "string"} ] } ] }, {"_tag": "CompositeFontEntry", "Self": "ua7", "Name": "$ID/Alphabetic", "FontStyle": "$ID/Regular", "RelativeSize": "100", "HorizontalScale": "100", "VerticalScale": "100", "CustomCharacters": " !\"#$%&'()*+,-./:;<=>?@ABCDEFGHIJKLMNOPQRSTUVWXYZ[\\]^_`abcdefghijklmnopqrstuvwxyz{|}~ ¡¤¥¦©ª«­®¯²³µ·¸¹º»¼½¾¿ÀÁÂÃÄÅÆÇÈÉÊËÌÍÎÏÐÑÒÓÔÕÖØÙÚÛÜÝÞßàáâãäåæçèéêëìíîïðñòóôõöøùúûüýþÿıŒœŠšŸŽžƒˆˇ˘˙˚˛˜˝–‚„•‹›⁄€™∆∏∑≈≤≥◊ﬀﬁﬂﬃﬄﬅﬆ", "Locked": "true", "ScaleOption": "false", "BaselineShift": "0", "_subElements":[{"_tag": "Properties", "_subElements":[{"_tag": "AppliedFont", "_text": "Minion Pro", "type": "string"} ] } ] }, {"_tag": "CompositeFontEntry", "Self": "ua8", "Name": "$ID/Numbers", "FontStyle": "$ID/Regular", "RelativeSize": "100", "HorizontalScale": "100", "VerticalScale": "100", "CustomCharacters": "0123456789", "Locked": "true", "ScaleOption": "false", "BaselineShift": "0", "_subElements":[{"_tag": "Properties", "_subElements":[{"_tag": "AppliedFont", "_text": "Minion Pro", "type": "string"} ] } ] } ] },
            {"_tag": "KinsokuTable", "Self": "KinsokuTable/$ID/kHardKinsokuName", "Name": "$ID/kHardKinsokuName"},
            {"_tag": "MojikumiTable", "Self": "MojikumiTable/$ID/kMojikumiDefaultName1", "Name": "$ID/kMojikumiDefaultName1"},
            {"_tag": "RootCharacterStyleGroup", "Self": "u77", "_subElements":[{"_tag": "CharacterStyle", "Self": "CharacterStyle/$ID/[No character style]", "Imported": "false", "SplitDocument": "false", "EmitCss": "true", "StyleUniqueId": "$ID/", "IncludeClass": "true", "ExtendedKeyboardShortcut": "0 0 0", "Name": "$ID/[No character style]"} ] },
            {"_tag": "NumberingList", "Self": "NumberingList/$ID/[Default]", "Name": "$ID/[Default]", "ContinueNumbersAcrossStories": "false", "ContinueNumbersAcrossDocuments": "false"},
            {"_tag": "RootParagraphStyleGroup", "Self": "u76", "_subElements":[{"_tag": "ParagraphStyle", "Self": "ParagraphStyle/$ID/NormalParagraphStyle", "Name": "$ID/NormalParagraphStyle", "Imported": "false", "NextStyle": "ParagraphStyle/$ID/NormalParagraphStyle", "SplitDocument": "false", "EmitCss": "true", "StyleUniqueId": "72eb150d-d042-4954-b157-623e65fb5410", "IncludeClass": "true", "ExtendedKeyboardShortcut": "0 0 0", "EmptyNestedStyles": "true", "EmptyLineStyles": "true", "EmptyGrepStyles": "true", "KeyboardShortcut": "0 0", "_subElements":[{"_tag": "Properties", "_subElements":[{"_tag": "BasedOn", "_text": "$ID/[No paragraph style]", "type": "string"}, {"_tag": "PreviewColor", "_text": "Nothing", "type": "enumeration"}, {"_tag": "AppliedFont", "_text": "Mark Offc Pro", "type": "string"}, {"_tag": "ParagraphShadingColor", "_text": "Color/C=100 M=0 Y=0 K=0", "type": "object"} ] } ] }, {"_tag": "ParagraphStyleGroup", "Self": "ParagraphStyleGroup/$ID/Generated", "Name": "$ID/Generated", "_subElements":[{"_tag": "ParagraphStyle", "Self": "ParagraphStyle/Generated%3aTable - Header", "Name": "Generated:Table - Header", "Imported": "false", "NextStyle": "ParagraphStyle/Generated%3aTable - Header", "SplitDocument": "false", "EmitCss": "true", "StyleUniqueId": "53ea4144-43d6-4274-8ef9-17bf2dc482ec", "IncludeClass": "true", "ExtendedKeyboardShortcut": "0 0 0", "EmptyNestedStyles": "true", "EmptyLineStyles": "true", "EmptyGrepStyles": "true", "KeyboardShortcut": "0 0", "FontStyle": "Bold", "PointSize": "14", "_subElements":[{"_tag": "Properties", "_subElements":[{"_tag": "BasedOn", "_text": "ParagraphStyle/Generated%3aTable - Small", "type": "object"}, {"_tag": "PreviewColor", "_text": "Nothing", "type": "enumeration"} ] } ] }, {"_tag": "ParagraphStyle", "Self": "ParagraphStyle/Generated%3aTable - Key", "Name": "Generated:Table - Key", "Imported": "false", "NextStyle": "ParagraphStyle/Generated%3aTable - Key", "SplitDocument": "false", "EmitCss": "true", "StyleUniqueId": "75639ee3-7d65-4cab-adb3-b597f8f0095c", "IncludeClass": "true", "ExtendedKeyboardShortcut": "0 0 0", "EmptyNestedStyles": "true", "EmptyLineStyles": "true", "EmptyGrepStyles": "true", "KeyboardShortcut": "0 0", "FontStyle": "Medium", "PointSize": "9", "AppliedLanguage": "$ID/English: UK", "Hyphenation": "false", "Justification": "RightAlign", "_subElements":[{"_tag": "Properties", "_subElements":[{"_tag": "BasedOn", "_text": "ParagraphStyle/$ID/NormalParagraphStyle", "type": "object"}, {"_tag": "PreviewColor", "_text": "Nothing", "type": "enumeration"}, {"_tag": "AppliedFont", "_text": "Mark Offc Pro", "type": "string"} ] } ] }, {"_tag": "ParagraphStyle", "Self": "ParagraphStyle/Generated%3aTable - Small", "Name": "Generated:Table - Small", "Imported": "false", "NextStyle": "ParagraphStyle/Generated%3aTable - Small", "SplitDocument": "false", "EmitCss": "true", "StyleUniqueId": "6a5ee4ae-ce1f-4a89-b0c7-ea756e65b554", "IncludeClass": "true", "ExtendedKeyboardShortcut": "0 0 0", "EmptyNestedStyles": "true", "EmptyLineStyles": "true", "EmptyGrepStyles": "true", "KeyboardShortcut": "0 0", "FontStyle": "Regular", "PointSize": "9", "Hyphenation": "false", "_subElements":[{"_tag": "Properties", "_subElements":[{"_tag": "BasedOn", "_text": "ParagraphStyle/$ID/NormalParagraphStyle", "type": "object"}, {"_tag": "PreviewColor", "_text": "Nothing", "type": "enumeration"} ] } ] }, {"_tag": "ParagraphStyle", "Self": "ParagraphStyle/Generated%3aTable - Group", "Name": "Generated:Table - Group", "Imported": "false", "NextStyle": "ParagraphStyle/Generated%3aTable - Group", "SplitDocument": "false", "EmitCss": "true", "StyleUniqueId": "78a935e7-ec2b-45ad-a580-fde518baf65d", "IncludeClass": "true", "ExtendedKeyboardShortcut": "0 0 0", "EmptyNestedStyles": "true", "EmptyLineStyles": "true", "EmptyGrepStyles": "true", "KeyboardShortcut": "0 0", "FontStyle": "Bold", "PointSize": "10", "SpaceBefore": "28.34645669291339", "_subElements":[{"_tag": "Properties", "_subElements":[{"_tag": "BasedOn", "_text": "ParagraphStyle/Generated%3aTable - Small", "type": "object"}, {"_tag": "PreviewColor", "_text": "Nothing", "type": "enumeration"} ] } ] } ] }, {"_tag": "ParagraphStyle", "Self": "ParagraphStyle/$ID/[No paragraph style]", "Name": "$ID/[No paragraph style]", "Imported": "false", "SplitDocument": "false", "EmitCss": "true", "StyleUniqueId": "4c6a53c2-9f9b-4fbd-8f2d-721a3d790e7a", "IncludeClass": "true", "ExtendedKeyboardShortcut": "0 0 0", "EmptyNestedStyles": "true", "EmptyLineStyles": "true", "EmptyGrepStyles": "true", "FillColor": "Color/Black", "FontStyle": "Regular", "PointSize": "12", "HorizontalScale": "100", "KerningMethod": "$ID/Metrics", "Ligatures": "true", "PageNumberType": "AutoPageNumber", "StrokeWeight": "1", "Tracking": "0", "Composer": "HL Composer", "DropCapCharacters": "0", "DropCapLines": "0", "BaselineShift": "0", "Capitalization": "Normal", "StrokeColor": "Swatch/None", "HyphenateLadderLimit": "3", "VerticalScale": "100", "LeftIndent": "0", "RightIndent": "0", "FirstLineIndent": "0", "AutoLeading": "120", "AppliedLanguage": "$ID/English: UK", "Hyphenation": "true", "HyphenateAfterFirst": "2", "HyphenateBeforeLast": "2", "HyphenateCapitalizedWords": "true", "HyphenateWordsLongerThan": "5", "NoBreak": "false", "HyphenationZone": "36", "SpaceBefore": "0", "SpaceAfter": "0", "Underline": "false", "OTFFigureStyle": "Default", "DesiredWordSpacing": "100", "MaximumWordSpacing": "133", "MinimumWordSpacing": "80", "DesiredLetterSpacing": "0", "MaximumLetterSpacing": "0", "MinimumLetterSpacing": "0", "DesiredGlyphScaling": "100", "MaximumGlyphScaling": "100", "MinimumGlyphScaling": "100", "StartParagraph": "Anywhere", "KeepAllLinesTogether": "false", "KeepWithNext": "0", "KeepFirstLines": "2", "KeepLastLines": "2", "Position": "Normal", "StrikeThru": "false", "CharacterAlignment": "AlignEmCenter", "KeepLinesTogether": "false", "StrokeTint": "-1", "FillTint": "-1", "OverprintStroke": "false", "OverprintFill": "false", "GradientStrokeAngle": "0", "GradientFillAngle": "0", "GradientStrokeLength": "-1", "GradientFillLength": "-1", "GradientStrokeStart": "0 0", "GradientFillStart": "0 0", "Skew": "0", "RuleAboveLineWeight": "1", "RuleAboveTint": "-1", "RuleAboveOffset": "0", "RuleAboveLeftIndent": "0", "RuleAboveRightIndent": "0", "RuleAboveWidth": "ColumnWidth", "RuleBelowLineWeight": "1", "RuleBelowTint": "-1", "RuleBelowOffset": "0", "RuleBelowLeftIndent": "0", "RuleBelowRightIndent": "0", "RuleBelowWidth": "ColumnWidth", "RuleAboveOverprint": "false", "RuleBelowOverprint": "false", "RuleAbove": "false", "RuleBelow": "false", "LastLineIndent": "0", "HyphenateLastWord": "true", "ParagraphBreakType": "Anywhere", "SingleWordJustification": "FullyJustified", "OTFOrdinal": "false", "OTFFraction": "false", "OTFDiscretionaryLigature": "false", "OTFTitling": "false", "RuleAboveGapTint": "-1", "RuleAboveGapOverprint": "false", "RuleBelowGapTint": "-1", "RuleBelowGapOverprint": "false", "Justification": "LeftAlign", "DropcapDetail": "1", "PositionalForm": "None", "OTFMark": "true", "HyphenWeight": "5", "OTFLocale": "true", "HyphenateAcrossColumns": "true", "KeepRuleAboveInFrame": "false", "IgnoreEdgeAlignment": "false", "OTFSlashedZero": "false", "OTFStylisticSets": "0", "OTFHistorical": "false", "OTFContextualAlternate": "true", "UnderlineGapOverprint": "false", "UnderlineGapTint": "-1", "UnderlineOffset": "-9999", "UnderlineOverprint": "false", "UnderlineTint": "-1", "UnderlineWeight": "-9999", "StrikeThroughGapOverprint": "false", "StrikeThroughGapTint": "-1", "StrikeThroughOffset": "-9999", "StrikeThroughOverprint": "false", "StrikeThroughTint": "-1", "StrikeThroughWeight": "-9999", "MiterLimit": "4", "StrokeAlignment": "OutsideAlignment", "EndJoin": "MiterEndJoin", "SpanColumnType": "SingleColumn", "SplitColumnInsideGutter": "6", "SplitColumnOutsideGutter": "0", "KeepWithPrevious": "false", "SpanColumnMinSpaceBefore": "0", "SpanColumnMinSpaceAfter": "0", "OTFSwash": "false", "ParagraphShadingTint": "-1", "ParagraphShadingOverprint": "false", "ParagraphShadingWidth": "ColumnWidth", "ParagraphShadingOn": "false", "ParagraphShadingClipToFrame": "false", "ParagraphShadingSuppressPrinting": "false", "ParagraphShadingLeftOffset": "0", "ParagraphShadingRightOffset": "0", "ParagraphShadingTopOffset": "0", "ParagraphShadingBottomOffset": "0", "ParagraphShadingTopOrigin": "AscentTopOrigin", "ParagraphShadingBottomOrigin": "DescentBottomOrigin", "ParagraphBorderTint": "-1", "ParagraphBorderOverprint": "false", "ParagraphBorderOn": "false", "ParagraphBorderGapTint": "-1", "ParagraphBorderGapOverprint": "false", "Tsume": "0", "LeadingAki": "-1", "TrailingAki": "-1", "KinsokuType": "KinsokuPushInFirst", "KinsokuHangType": "None", "BunriKinshi": "true", "RubyOpenTypePro": "true", "RubyFontSize": "-1", "RubyAlignment": "RubyJIS", "RubyType": "PerCharacterRuby", "RubyParentSpacing": "RubyParent121Aki", "RubyXScale": "100", "RubyYScale": "100", "RubyXOffset": "0", "RubyYOffset": "0", "RubyPosition": "AboveRight", "RubyAutoAlign": "true", "RubyParentOverhangAmount": "RubyOverhangOneRuby", "RubyOverhang": "false", "RubyAutoScaling": "false", "RubyParentScalingPercent": "66", "RubyTint": "-1", "RubyOverprintFill": "Auto", "RubyStrokeTint": "-1", "RubyOverprintStroke": "Auto", "RubyWeight": "-1", "KentenKind": "None", "KentenFontSize": "-1", "KentenXScale": "100", "KentenYScale": "100", "KentenPlacement": "0", "KentenAlignment": "AlignKentenCenter", "KentenPosition": "AboveRight", "KentenCustomCharacter": "", "KentenCharacterSet": "CharacterInput", "KentenTint": "-1", "KentenOverprintFill": "Auto", "KentenStrokeTint": "-1", "KentenOverprintStroke": "Auto", "KentenWeight": "-1", "Tatechuyoko": "false", "TatechuyokoXOffset": "0", "TatechuyokoYOffset": "0", "AutoTcy": "0", "AutoTcyIncludeRoman": "false", "Jidori": "0", "GridGyoudori": "0", "GridAlignFirstLineOnly": "false", "GridAlignment": "None", "CharacterRotation": "0", "RotateSingleByteCharacters": "false", "Rensuuji": "true", "ShataiMagnification": "0", "ShataiDegreeAngle": "4500", "ShataiAdjustTsume": "true", "ShataiAdjustRotation": "false", "Warichu": "false", "WarichuLines": "2", "WarichuSize": "50", "WarichuLineSpacing": "0", "WarichuAlignment": "Auto", "WarichuCharsBeforeBreak": "2", "WarichuCharsAfterBreak": "2", "OTFHVKana": "false", "OTFProportionalMetrics": "false", "OTFRomanItalics": "false", "LeadingModel": "LeadingModelAkiBelow", "ScaleAffectsLineHeight": "false", "ParagraphGyoudori": "false", "CjkGridTracking": "false", "GlyphForm": "None", "RubyAutoTcyDigits": "0", "RubyAutoTcyIncludeRoman": "false", "RubyAutoTcyAutoScale": "true", "TreatIdeographicSpaceAsSpace": "true", "AllowArbitraryHyphenation": "false", "BulletsAndNumberingListType": "NoList", "NumberingStartAt": "1", "NumberingLevel": "1", "NumberingContinue": "true", "NumberingApplyRestartPolicy": "true", "BulletsAlignment": "LeftAlign", "NumberingAlignment": "LeftAlign", "NumberingExpression": "^#.^t", "BulletsTextAfter": "^t", "ParagraphBorderLeftOffset": "0", "ParagraphBorderRightOffset": "0", "ParagraphBorderTopOffset": "0", "ParagraphBorderBottomOffset": "0", "ParagraphBorderStrokeEndJoin": "MiterEndJoin", "ParagraphBorderTopLeftCornerOption": "None", "ParagraphBorderTopRightCornerOption": "None", "ParagraphBorderBottomLeftCornerOption": "None", "ParagraphBorderBottomRightCornerOption": "None", "ParagraphBorderTopLeftCornerRadius": "1", "ParagraphBorderTopRightCornerRadius": "1", "ParagraphBorderBottomLeftCornerRadius": "1", "ParagraphBorderBottomRightCornerRadius": "1", "ParagraphShadingTopLeftCornerOption": "None", "ParagraphShadingTopRightCornerOption": "None", "ParagraphShadingBottomLeftCornerOption": "None", "ParagraphShadingBottomRightCornerOption": "None", "ParagraphShadingTopLeftCornerRadius": "1", "ParagraphShadingTopRightCornerRadius": "1", "ParagraphShadingBottomLeftCornerRadius": "1", "ParagraphShadingBottomRightCornerRadius": "1", "ParagraphBorderStrokeEndCap": "ButtEndCap", "ParagraphBorderWidth": "ColumnWidth", "ParagraphBorderTopOrigin": "AscentTopOrigin", "ParagraphBorderBottomOrigin": "DescentBottomOrigin", "ParagraphBorderTopLineWeight": "1", "ParagraphBorderBottomLineWeight": "1", "ParagraphBorderLeftLineWeight": "1", "ParagraphBorderRightLineWeight": "1", "ParagraphBorderDisplayIfSplits": "false", "MergeConsecutiveParaBorders": "true", "ProviderHyphenationStyle": "HyphAll", "DigitsType": "DefaultDigits", "Kashidas": "DefaultKashidas", "DiacriticPosition": "OpentypePositionFromBaseline", "CharacterDirection": "DefaultDirection", "ParagraphDirection": "LeftToRightDirection", "ParagraphJustification": "DefaultJustification", "ParagraphKashidaWidth": "2", "XOffsetDiacritic": "0", "YOffsetDiacritic": "0", "OTFOverlapSwash": "false", "OTFStylisticAlternate": "false", "OTFJustificationAlternate": "false", "OTFStretchedAlternate": "false", "KeyboardDirection": "DefaultDirection", "_subElements":[{"_tag": "Properties", "_subElements":[{"_tag": "Leading", "_text": "Auto", "type": "enumeration"}, {"_tag": "TabList", "type": "list"}, {"_tag": "AppliedFont", "_text": "Times New Roman", "type": "string"}, {"_tag": "RuleAboveColor", "_text": "Text Color", "type": "string"}, {"_tag": "RuleBelowColor", "_text": "Text Color", "type": "string"}, {"_tag": "RuleAboveType", "_text": "StrokeStyle/$ID/Solid", "type": "object"}, {"_tag": "RuleBelowType", "_text": "StrokeStyle/$ID/Solid", "type": "object"}, {"_tag": "BalanceRaggedLines", "_text": "NoBalancing", "type": "enumeration"}, {"_tag": "RuleAboveGapColor", "_text": "Swatch/None", "type": "object"}, {"_tag": "RuleBelowGapColor", "_text": "Swatch/None", "type": "object"}, {"_tag": "UnderlineColor", "_text": "Text Color", "type": "string"}, {"_tag": "UnderlineGapColor", "_text": "Swatch/None", "type": "object"}, {"_tag": "UnderlineType", "_text": "StrokeStyle/$ID/Solid", "type": "object"}, {"_tag": "StrikeThroughColor", "_text": "Text Color", "type": "string"}, {"_tag": "StrikeThroughGapColor", "_text": "Swatch/None", "type": "object"}, {"_tag": "StrikeThroughType", "_text": "StrokeStyle/$ID/Solid", "type": "object"}, {"_tag": "SpanSplitColumnCount", "_text": "All", "type": "enumeration"}, {"_tag": "ParagraphShadingColor", "_text": "Color/Black", "type": "object"}, {"_tag": "ParagraphBorderColor", "_text": "Color/Black", "type": "object"}, {"_tag": "ParagraphBorderGapColor", "_text": "Swatch/None", "type": "object"}, {"_tag": "ParagraphBorderType", "_text": "StrokeStyle/$ID/Solid", "type": "object"}, {"_tag": "Mojikumi", "_text": "Nothing", "type": "enumeration"}, {"_tag": "KinsokuSet", "_text": "Nothing", "type": "enumeration"}, {"_tag": "RubyFont", "_text": "$ID/", "type": "string"}, {"_tag": "RubyFontStyle", "_text": "Nothing", "type": "enumeration"}, {"_tag": "RubyFill", "_text": "Text Color", "type": "string"}, {"_tag": "RubyStroke", "_text": "Text Color", "type": "string"}, {"_tag": "KentenFont", "_text": "$ID/", "type": "string"}, {"_tag": "KentenFontStyle", "_text": "Nothing", "type": "enumeration"}, {"_tag": "KentenFillColor", "_text": "Text Color", "type": "string"}, {"_tag": "KentenStrokeColor", "_text": "Text Color", "type": "string"}, {"_tag": "BulletChar", "BulletCharacterType": "UnicodeOnly", "BulletCharacterValue": "8226"}, {"_tag": "NumberingFormat", "_text": "1, 2, 3, 4...", "type": "string"}, {"_tag": "BulletsFont", "_text": "$ID/", "type": "string"}, {"_tag": "BulletsFontStyle", "_text": "Nothing", "type": "enumeration"}, {"_tag": "AppliedNumberingList", "_text": "NumberingList/$ID/[Default]", "type": "object"}, {"_tag": "NumberingRestartPolicies", "RestartPolicy": "AnyPreviousLevel", "LowerLevel": "0", "UpperLevel": "0"}, {"_tag": "BulletsCharacterStyle", "_text": "CharacterStyle/$ID/[No character style]", "type": "object"}, {"_tag": "NumberingCharacterStyle", "_text": "CharacterStyle/$ID/[No character style]", "type": "object"}, {"_tag": "SameParaStyleSpacing", "_text": "SetIgnore", "type": "enumeration"} ] } ] } ] },
            {"_tag": "RootCellStyleGroup", "Self": "u86", "_subElements":[{"_tag": "CellStyleGroup", "Self": "CellStyleGroup/$ID/Generated", "Name": "$ID/Generated", "_subElements":[{"_tag": "CellStyle", "Self": "CellStyle/Generated%3aOption0", "ExtendedKeyboardShortcut": "0 0 0", "TextTopInset": "4", "TextLeftInset": "4", "TextBottomInset": "4", "TextRightInset": "4", "AppliedParagraphStyle": "ParagraphStyle/$ID/[No paragraph style]", "TopInset": "4", "LeftInset": "4", "BottomInset": "4", "RightInset": "4", "LeftEdgeStrokeWeight": "0", "LeftEdgeStrokeColor": "Swatch/None", "RightEdgeStrokeWeight": "0.25", "RightEdgeStrokeColor": "Color/Black", "BottomEdgeStrokeWeight": "0", "BottomEdgeStrokeColor": "Swatch/None", "KeyboardShortcut": "0 0", "Name": "Generated:Option0", "_subElements":[{"_tag": "Properties", "_subElements":[{"_tag": "BasedOn", "_text": "$ID/[None]", "type": "string"} ] } ] }, {"_tag": "CellStyle", "Self": "CellStyle/Generated%3aNone", "ExtendedKeyboardShortcut": "0 0 0", "TextTopInset": "4", "TextLeftInset": "4", "TextBottomInset": "4", "TextRightInset": "4", "AppliedParagraphStyle": "ParagraphStyle/$ID/[No paragraph style]", "TopInset": "4", "LeftInset": "4", "BottomInset": "4", "RightInset": "4", "LeftEdgeStrokeWeight": "0", "TopEdgeStrokeWeight": "0", "RightEdgeStrokeWeight": "0", "BottomEdgeStrokeWeight": "0", "KeyboardShortcut": "0 0", "Name": "Generated:None", "_subElements":[{"_tag": "Properties", "_subElements":[{"_tag": "BasedOn", "_text": "$ID/[None]", "type": "string"} ] } ] }, {"_tag": "CellStyle", "Self": "CellStyle/Generated%3aHeader 1", "ExtendedKeyboardShortcut": "0 0 0", "TextTopInset": "11.338582677165356", "TextLeftInset": "2.834645669291339", "TextBottomInset": "2.834645669291339", "TextRightInset": "2.834645669291339", "AppliedParagraphStyle": "ParagraphStyle/$ID/[No paragraph style]", "TopInset": "11.338582677165356", "LeftInset": "2.834645669291339", "BottomInset": "2.834645669291339", "RightInset": "2.834645669291339", "LeftEdgeStrokeWeight": "0", "TopEdgeStrokeWeight": "0", "RightEdgeStrokeWeight": "0", "BottomEdgeStrokeWeight": "0.5", "BottomEdgeStrokeColor": "Color/Black", "KeyboardShortcut": "0 0", "Name": "Generated:Header 1", "_subElements":[{"_tag": "Properties", "_subElements":[{"_tag": "BasedOn", "_text": "$ID/[None]", "type": "string"} ] } ] } ] } ] },
            {"_tag": "RootTableStyleGroup", "Self": "u88", "_subElements":[{"_tag": "TableStyleGroup", "Self": "TableStyleGroup/$ID/Generated", "Name": "$ID/Generated", "_subElements":[{"_tag": "TableStyle", "Self": "TableStyle/Generated%3aBasic Table", "ExtendedKeyboardShortcut": "0 0 0", "Name": "Generated:Basic Table", "SpaceBefore": "0", "SpaceAfter": "0", "KeyboardShortcut": "0 0", "_subElements":[{"_tag": "Properties", "_subElements":[{"_tag": "BasedOn", "_text": "$ID/[No table style]", "type": "string"} ] } ] } ] } ] },
            {"_tag": "TinDocumentDataObject", "_subElements":[{"_tag": "Properties", "_subElements":[{"_tag": "GaijiRefMaps", "_text": "/////wAAAAAAAAAA"} ] } ] },
            {"_tag": "CrossReferenceFormat", "Self": "u97", "Name": "Full Paragraph & Page Number", "AppliedCharacterStyle": "n", "_subElements":[{"_tag": "BuildingBlock", "Self": "u97BuildingBlock0", "BlockType": "CustomStringBuildingBlock", "AppliedCharacterStyle": "n", "CustomText": "\"", "AppliedDelimiter": "$ID/", "IncludeDelimiter": "false"}, {"_tag": "BuildingBlock", "Self": "u97BuildingBlock1", "BlockType": "FullParagraphBuildingBlock", "AppliedCharacterStyle": "n", "CustomText": "$ID/", "AppliedDelimiter": "$ID/", "IncludeDelimiter": "false"}, {"_tag": "BuildingBlock", "Self": "u97BuildingBlock2", "BlockType": "CustomStringBuildingBlock", "AppliedCharacterStyle": "n", "CustomText": "\" on page ", "AppliedDelimiter": "$ID/", "IncludeDelimiter": "false"}, {"_tag": "BuildingBlock", "Self": "u97BuildingBlock3", "BlockType": "PageNumberBuildingBlock", "AppliedCharacterStyle": "n", "CustomText": "$ID/", "AppliedDelimiter": "$ID/", "IncludeDelimiter": "false"} ] },
            {"_tag": "CrossReferenceFormat", "Self": "u98", "Name": "Full Paragraph", "AppliedCharacterStyle": "n", "_subElements":[{"_tag": "BuildingBlock", "Self": "u98BuildingBlock0", "BlockType": "CustomStringBuildingBlock", "AppliedCharacterStyle": "n", "CustomText": "\"", "AppliedDelimiter": "$ID/", "IncludeDelimiter": "false"}, {"_tag": "BuildingBlock", "Self": "u98BuildingBlock1", "BlockType": "FullParagraphBuildingBlock", "AppliedCharacterStyle": "n", "CustomText": "$ID/", "AppliedDelimiter": "$ID/", "IncludeDelimiter": "false"}, {"_tag": "BuildingBlock", "Self": "u98BuildingBlock2", "BlockType": "CustomStringBuildingBlock", "AppliedCharacterStyle": "n", "CustomText": "\"", "AppliedDelimiter": "$ID/", "IncludeDelimiter": "false"} ] },
            {"_tag": "CrossReferenceFormat", "Self": "u99", "Name": "Paragraph Text & Page Number", "AppliedCharacterStyle": "n", "_subElements":[{"_tag": "BuildingBlock", "Self": "u99BuildingBlock0", "BlockType": "CustomStringBuildingBlock", "AppliedCharacterStyle": "n", "CustomText": "\"", "AppliedDelimiter": "$ID/", "IncludeDelimiter": "false"}, {"_tag": "BuildingBlock", "Self": "u99BuildingBlock1", "BlockType": "ParagraphTextBuildingBlock", "AppliedCharacterStyle": "n", "CustomText": "$ID/", "AppliedDelimiter": "$ID/", "IncludeDelimiter": "false"}, {"_tag": "BuildingBlock", "Self": "u99BuildingBlock2", "BlockType": "CustomStringBuildingBlock", "AppliedCharacterStyle": "n", "CustomText": "\" on page ", "AppliedDelimiter": "$ID/", "IncludeDelimiter": "false"}, {"_tag": "BuildingBlock", "Self": "u99BuildingBlock3", "BlockType": "PageNumberBuildingBlock", "AppliedCharacterStyle": "n", "CustomText": "$ID/", "AppliedDelimiter": "$ID/", "IncludeDelimiter": "false"} ] },
            {"_tag": "CrossReferenceFormat", "Self": "u9a", "Name": "Paragraph Text", "AppliedCharacterStyle": "n", "_subElements":[{"_tag": "BuildingBlock", "Self": "u9aBuildingBlock0", "BlockType": "CustomStringBuildingBlock", "AppliedCharacterStyle": "n", "CustomText": "\"", "AppliedDelimiter": "$ID/", "IncludeDelimiter": "false"}, {"_tag": "BuildingBlock", "Self": "u9aBuildingBlock1", "BlockType": "ParagraphTextBuildingBlock", "AppliedCharacterStyle": "n", "CustomText": "$ID/", "AppliedDelimiter": "$ID/", "IncludeDelimiter": "false"}, {"_tag": "BuildingBlock", "Self": "u9aBuildingBlock2", "BlockType": "CustomStringBuildingBlock", "AppliedCharacterStyle": "n", "CustomText": "\"", "AppliedDelimiter": "$ID/", "IncludeDelimiter": "false"} ] },
            {"_tag": "CrossReferenceFormat", "Self": "u9b", "Name": "Paragraph Number & Page Number", "AppliedCharacterStyle": "n", "_subElements":[{"_tag": "BuildingBlock", "Self": "u9bBuildingBlock0", "BlockType": "ParagraphNumberBuildingBlock", "AppliedCharacterStyle": "n", "CustomText": "$ID/", "AppliedDelimiter": "$ID/", "IncludeDelimiter": "false"}, {"_tag": "BuildingBlock", "Self": "u9bBuildingBlock1", "BlockType": "CustomStringBuildingBlock", "AppliedCharacterStyle": "n", "CustomText": " on page ", "AppliedDelimiter": "$ID/", "IncludeDelimiter": "false"}, {"_tag": "BuildingBlock", "Self": "u9bBuildingBlock2", "BlockType": "PageNumberBuildingBlock", "AppliedCharacterStyle": "n", "CustomText": "$ID/", "AppliedDelimiter": "$ID/", "IncludeDelimiter": "false"} ] },
            {"_tag": "CrossReferenceFormat", "Self": "u9c", "Name": "Paragraph Number", "AppliedCharacterStyle": "n", "_subElements":[{"_tag": "BuildingBlock", "Self": "u9cBuildingBlock0", "BlockType": "ParagraphNumberBuildingBlock", "AppliedCharacterStyle": "n", "CustomText": "$ID/", "AppliedDelimiter": "$ID/", "IncludeDelimiter": "false"} ] },
            {"_tag": "CrossReferenceFormat", "Self": "u9d", "Name": "Text Anchor Name & Page Number", "AppliedCharacterStyle": "n", "_subElements":[{"_tag": "BuildingBlock", "Self": "u9dBuildingBlock0", "BlockType": "CustomStringBuildingBlock", "AppliedCharacterStyle": "n", "CustomText": "\"", "AppliedDelimiter": "$ID/", "IncludeDelimiter": "false"}, {"_tag": "BuildingBlock", "Self": "u9dBuildingBlock1", "BlockType": "BookmarkNameBuildingBlock", "AppliedCharacterStyle": "n", "CustomText": "$ID/", "AppliedDelimiter": "$ID/", "IncludeDelimiter": "false"}, {"_tag": "BuildingBlock", "Self": "u9dBuildingBlock2", "BlockType": "CustomStringBuildingBlock", "AppliedCharacterStyle": "n", "CustomText": "\" on page ", "AppliedDelimiter": "$ID/", "IncludeDelimiter": "false"}, {"_tag": "BuildingBlock", "Self": "u9dBuildingBlock3", "BlockType": "PageNumberBuildingBlock", "AppliedCharacterStyle": "n", "CustomText": "$ID/", "AppliedDelimiter": "$ID/", "IncludeDelimiter": "false"} ] },
            {"_tag": "CrossReferenceFormat", "Self": "u9e", "Name": "Text Anchor Name", "AppliedCharacterStyle": "n", "_subElements":[{"_tag": "BuildingBlock", "Self": "u9eBuildingBlock0", "BlockType": "CustomStringBuildingBlock", "AppliedCharacterStyle": "n", "CustomText": "\"", "AppliedDelimiter": "$ID/", "IncludeDelimiter": "false"}, {"_tag": "BuildingBlock", "Self": "u9eBuildingBlock1", "BlockType": "BookmarkNameBuildingBlock", "AppliedCharacterStyle": "n", "CustomText": "$ID/", "AppliedDelimiter": "$ID/", "IncludeDelimiter": "false"}, {"_tag": "BuildingBlock", "Self": "u9eBuildingBlock2", "BlockType": "CustomStringBuildingBlock", "AppliedCharacterStyle": "n", "CustomText": "\"", "AppliedDelimiter": "$ID/", "IncludeDelimiter": "false"} ] },
            {"_tag": "CrossReferenceFormat", "Self": "u9f", "Name": "Page Number", "AppliedCharacterStyle": "n", "_subElements":[{"_tag": "BuildingBlock", "Self": "u9fBuildingBlock0", "BlockType": "CustomStringBuildingBlock", "AppliedCharacterStyle": "n", "CustomText": "page ", "AppliedDelimiter": "$ID/", "IncludeDelimiter": "false"}, {"_tag": "BuildingBlock", "Self": "u9fBuildingBlock1", "BlockType": "PageNumberBuildingBlock", "AppliedCharacterStyle": "n", "CustomText": "$ID/", "AppliedDelimiter": "$ID/", "IncludeDelimiter": "false"} ] },
        ]
        self.subElement_story = [
            {"_tag": "Story", "Self": "u27835", "AppliedTOCStyle": "n", "UserText": "true", "IsEndnoteStory": "false", "TrackChanges": "false", "StoryTitle": "Template", "AppliedNamedGrid": "n", "_subElements": self.subElement_storyContent},
        ]
        self.subElement_last = [
            {"_tag": "ColorGroup", "Self": "ColorGroup/[Root Color Group]", "Name": "[Root Color Group]", "IsRootColorGroup": "true", "_subElements":[{"_tag": "ColorGroupSwatch", "Self": "ud0d3ColorGroupSwatch0", "SwatchItemRef": "Swatch/None"}, {"_tag": "ColorGroupSwatch", "Self": "ud0d3ColorGroupSwatch3", "SwatchItemRef": "Color/Black"}, {"_tag": "ColorGroupSwatch", "Self": "ud0d3ColorGroupSwatch9", "SwatchItemRef": "Color/C=100 M=0 Y=0 K=0"} ] }, {"_tag": "ColorGroup", "Self": "ColorGroup/Feature Colours", "Name": "Feature Colours", "IsRootColorGroup": "false", "_subElements":[
            {"_tag": "ColorGroupSwatch", "Self": "u16018ColorGroupSwatch1", "SwatchItemRef": "Color/C=30 M=90 Y=19 K=0"} ] }
        ]
        self.documentSubelements = self.subElement_first+self.subElement_story+self.subElement_last

        self.attrib = {
            "_tag": "Document", "DOMVersion": "20.4", "Self": "d", "_subElements":self.documentSubelements
        }
    @property
    def __dict__(self):
        return self.attrib

data = json.loads(DA)
#print(table().element)
#print(table(data).XML)
#print(cell({"value":"TEXT"}).__dict__)

#XML = table(data).element
#ET.indent(XML, space="\t", level=0)
#TA = ET.tostring(XML, encoding='utf-8', xml_declaration=True).decode('utf-8')

documentOb = document(data)
XML = dict_to_element(documentOb.__dict__)
ET.indent(XML, space="\t", level=0)
ETString  = ET.tostring(XML, encoding='utf-8', xml_declaration=True).decode('utf-8')
ETString = ETString.split("\n")
ETString = [ETString[0]]+[
'<?aid style="50" type="snippet" readerVersion="6.0" featureSet="257" product="20.4(4)" ?>',
'<?aid SnippetType="InCopyInterchange"?>'
]+ETString[1:]
TA = ETString
# ---------- end icml_generator_v2 ----------
py3 = Python3Script(OP=list, y=list)  # -> out, a
# ---------- py3: Python ----------
import Rhino
import Grasshopper as gh
from ghpythonlib.componentbase import executingcomponent as component
dropDownGUID = None
for input in ghenv.Component.Params.Input:
    for s in input.Sources:
        # names.append(input.Name)
        if input.Name != "OP": continue
        attr = s.Attributes
        if (attr is None) or (attr.GetTopLevel is None):
            pass
        else:
            print(type(component))
            component = attr.GetTopLevel.DocObject
            if str(component.GetType()) != "Grasshopper.Kernel.Special.GH_ValueList": continue
            #print("Name: ",input.Name)
            #print("Nickname: ",component.NickName)
            #print("GUID: ",component.InstanceGuid)
            dropDownGUID = component.InstanceGuid
            #print("Instance Description: ",component.GetType())


for obj in ghenv.Component.OnPingDocument().Objects:
    #print(obj)
    if obj.InstanceGuid == dropDownGUID:
        #print(obj)
        value_list_component = obj
        print(type(value_list_component))
        print(dir(obj))
        #value_list_component.ListItems.Clear()
        break
# ---------- end py3 ----------
pvl = PopulateValueList(OP=list, y=list)  # -> out, a
# ---------- pvl: Python ----------
print(ghenv.Component.Params.Input[0])
print(dir(ghenv.Component.Params.Input[0]))
# ---------- end pvl ----------
panel_20 = Panel("testing\ICMLTEST.icml")
pln = Plane()  # disabled
txt = Text(m_objects)
constructlocation = Ladybug_ConstructLocation(locationName="unknown_Location", latitude=lat_dº, longitude=lon_dº, timeZone=panel_19, elevation=0)  # -> location; disabled; plug-in component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
object_2 = ModelObject(Object=dpipeline_2)  # -> Object, Layer
pt = ConstructPoint(XCoordinate=0, YCoordinate=0, ZCoordinate=0)  # disabled
deplane = DeconstructPlane(Plane=pln)  # -> Origin, XAxis, YAxis, ZAxis; disabled
series_3 = Series(Start=starting_hour, Step=1, Count=number_of_hours_to_analyse)  # disabled
icml = IronPython2Script(DA=graft_5, CS=panel_15)  # -> TA; inputs OP: list, CS: list; disabled
# ---------- icml: IronPython ----------
#! python 2
global __var__
__var__ = {
	"guid":"89da792a-24b2-41fa-a674-20d9df2b5b6f",
	
	"name":"ICML Generator",
	"nickname":"ICML",
	"description":"Takes JSON data formated as a lists of lists and creates a InCopy Markup Language format of a table.",
	"icon": "ghContent\\Icon-TableMaker.png",

	"tabname":"Redback",
	"section":"Tables",

	"inputs":[
		{"name":"Data",		"nickname":"D",	"objectAccess":"item",	"description":"Table data formated as a JSON list of lists", },
		{"name":"Options",	"nickname":"O",	"objectAccess":"list",	"description":"Table options as a JSON dictionary"},
		{"name":"CSS",		"nickname":"C",	"objectAccess":"list",	"description":"CSS to apply styles to the table"}
	],
	"outputs":[
		{"name":"Table",	"nickname":"T",	"description":"ICML Table"}
	]
}
__author__ = "Andrew.Butler"
__version__ = "2024.02.02"

import sys
import os
user = os.environ['USERPROFILE']
import json
try:    sys.path.append(r"\\sydsrv01\projects\Computational Design Group\93_Development\PackageManager\redback\py".format(**{'user':user}))
except: pass
try:    sys.path.append(r"E:\mydev\redback\py".format(**{'user':user}))
except: pass
import pyTableMaker as tm
from pyCSSParser import parseCSS


D = DA
O = OP
C = CS

__log__ = []


__log__.append(str(C))




D = json.loads(D)
if not O:
	O = {"css":[]}
else:
	O = json.loads("".join(O))

if C:
	C = "".join(C)
	C = parseCSS(C)
	O["css"] = C
print("OPTIONS",O)


TA = tm.table(D, O)
# ---------- end icml ----------
tmatch = MatchText(Text=txt, RegEx="Model Block Instance", Case=True)
sunpathscale = Slider(2, range=0..10)  # disabled
sunscale = Slider(0.5, range=0..1)  # disabled
layer_path = LayerPath(Layer=object_2.Layer)
py3_2 = Python3Script()  # -> out, a
# ---------- py3_2: Python ----------
import Rhino
import Grasshopper as gh
from ghpythonlib.componentbase import executingcomponent as component
dropDownGUID = None

### CHECK THIS version, it might be faster: ghenv.Component.Params.Input[0]
def alterValueList(variableName, values=[{"A":"B"}]):
    for input in ghenv.Component.Params.Input:
        for s in input.Sources:
            if input.Name != variableName: continue
            
            
            attr = s.Attributes
            if (attr is None) or (attr.GetTopLevel is None): continue
            component = attr.GetTopLevel.DocObject
            if str(component.GetType()) != "Grasshopper.Kernel.Special.GH_ValueList": continue

            checkDefault = {}
            for item in component.ListItems:
                checkDefault[item.Name] = item.Expression
            if checkDefault != {"One": "1", "Two": "2", "Three": "2² - 1", "Four": "Sqrt(16)"}: break
            component.ListItems.Clear()
            for line in values:
                new_item = gh.Kernel.Special.GH_ValueListItem(line["key"], '"%s"'%(line["value"]))
                component.ListItems.Add(new_item)
            component.ExpireSolution(True)
            print("-"*10)

def alterPenel(variableName, values=""):
    import System.Drawing as sd
    for input in ghenv.Component.Params.Input:
        for s in input.Sources:
            if input.Name != variableName: continue
            
            
            attr = s.Attributes
            if (attr is None) or (attr.GetTopLevel is None): continue
            component = attr.GetTopLevel.DocObject
            #print(component.GetType())
            if str(component.GetType()) != "Grasshopper.Kernel.Special.GH_Panel": continue

            #print(dir(component))
            #print(component.UserText)

            checkDefault = {}
            #for d in dir(component.Properties):
                #print(d)
            #print(component.Attributes.Bounds)
            


            if component.UserText != "Double click to edit panel content…": break
            width= 340
            current_bounds = component.Attributes.Bounds
            new_bounds = sd.RectangleF(current_bounds.X, current_bounds.Y, width, 200)
            component.Attributes.Bounds = new_bounds
            component.Attributes.ExpireLayout()

            component.UserText = values
            component.Properties.Multiline = False
            component.Properties.Wrap = False
            component.ExpireSolution(True)
            print("-"*10)
optionValues = [{"key":"Guide", "value":'''# This is a guide for setting options
#  for the ICML generation component
# Use a Value List to select pregenerated
#  options
columnWidths:
- 20
variables:
  line-thick: 2
  line-medium: 1
  line-thin: 0.5'''}
]
cssValues = [
    {"key":"Default","value":'''*{paragraphStyle:Table - Small; cellStyle:Inner;}border[xPos=0]{weight:0;}\nborder[yPos=0]{weight:0;}\nborder[xPosRev=-1]{weight:0;}\nborder[yPosRev=-1]{weight:0;}'''}
]
alterValueList("OP",optionValues)
alterPenel("OP",optionValues[0]["value"])
alterValueList("CS",cssValues)
alterPenel("CS",cssValues[0]["value"])
# ---------- end py3_2 ----------
panel_21 = Panel("""{"test":"Hello"}
{"test":"World"}
{"test":"Hello World"}""")
number_slider_2 = Slider(12, range=0..100)  # disabled
path_2 = FilePath("K:\2025\225028.00\04.0 DOCUMENTS\4.4 Drawings\4.4.3 Revit Model\2-Ref\Scripts\UG RDS\ICML\Template\Template.icml")
month = Slider(6, range=1..12)  # disabled
day = Slider(21, range=1..31)  # disabled
line = LineSDL(Start=pt, Direction=deplane.YAxis, Length=50000)  # disabled
crv = Curve(<curve referenced from the Rhino model>)  # disabled
dispatch = Dispatch(List=m_objects, DispatchPattern=tmatch)  # -> ListA, ListB
panel_22 = Panel("""*{paragraphStyle:Table - Small; cellStyle:Inner;}border[xPos=0]{weight:0;}
border[yPos=0]{weight:0;}
border[xPosRev=-1]{weight:0;}
border[yPosRev=-1]{weight:0;}""")
panel_23 = Panel("""# This is a guide for setting options
#  for the ICML generation component
# Use a Value List to select pregenerated
#  options
columnWidths:
- 20
variables:
  line-thick: 2
  line-medium: 1
  line-thin: 0.5""")
tmatch_2 = MatchText(Text=layer_path, RegEx="Hidden", Case=True)
lon_dº_2 = Panel("151.198885")
lat_dº_2 = Panel("-33.826260")
end = EndPoints(Curve=crv)  # -> Start, End; disabled
icml_templater = Python3Script(T=path_2)  # -> out, R; inputs C: list
# ---------- icml_templater: Python ----------
import xml.etree.ElementTree as ET
import os, json
import uuid
from jinja2 import Template
import ghpythonlib.treehelpers as th
import copy


global treeId
treeId = 0
def dict_to_element(d):
    element = ET.Element(d["_tag"])
    if "_subElements" in d:
        for subElement in d["_subElements"]:
            element.append(dict_to_element(subElement))
        del d["_subElements"]
    if "_text" in d:
        element.text = d["_text"]
        del d["_text"]
    del d["_tag"]
    
    element.attrib = d
    return element
def mapElementTree(root, parent=""):
    global treeId
    rootId = str(treeId)
    treeId += 1
    root.set('uuid',rootId)
    root.set('parent',parent)
    for element in root:
        mapElementTree(element, rootId)


class element():
    def __init__(self, elementOb, root):
        self.element = elementOb
        self.root = root
        self.parent = self.getParent()
        
    def __str__(self):
        returnString = "{tag} - {text}".format(**{"text":self.element.text, "tag":self.element.tag})
        return returnString
    def __repr__(self):
        return str(self)
    def getParent(self):
        parent = None
        parentUuid = None
        breakIndex = 0
        while True:
            if not parentUuid:
                parentUuid = self.element.attrib["parent"]
            try:    parent = root.find('.//*[@uuid="%s"]'%(parentUuid))
            except: pass
            if parent.tag == "ParagraphStyleRange": break
            parentUuid = parent.attrib["parent"]
            if parentUuid == "": break
            if breakIndex >= 100: break
            breakIndex += 1


        return parent
    def renderTemplate(self, context):
        template = Template(self.element.text)
        rendered_output = template.render(**context)
        #print(rendered_output)
        self.element.text = rendered_output
    def assignChange(self):
        # <CharacterStyleRange AppliedCharacterStyle="CharacterStyle/$ID/[No character style]" AppliedLanguage="$ID/English: USA" uuid="426" parent="423">
        appendElement = ET.Element("CharacterStyleRange")
        appendElement.attrib = {
            "AppliedCharacterStyle":"CharacterStyle/CHANGE"}
        content = ET.Element("Content")
        content.text = "00.00"
        appendElement.append(content)
        self.parent.insert(1,appendElement)
        
        appendElement = ET.Element("CharacterStyleRange")
        appendElement.attrib = {
            "AppliedCharacterStyle":"CharacterStyle/$ID/[No character style]"}
        content = ET.Element("Content")
        content.text = " "
        appendElement.append(content)
        self.parent.insert(2,appendElement)
returnbOb = None
def __main__():
    if os.path.exists(T):
        tree = ET.parse(T)
    else:
        try:
            tree = ET.fromstring(T)
        except:
            tree = None
    root = tree.getroot()
    mapElementTree(root)



    returnbOb = []
    #print(C)

    for contextString in C:
        rootClone = copy.deepcopy(root)
        elements = []



        for elementOb in rootClone.iter():
            if not elementOb.text: continue
            if "{{" in elementOb.text:
                apOb = element(elementOb, root)
                elements.append(apOb)

        context = json.loads(contextString)
        print("Number: ",context["Number"])
        for elementItem in elements:
            #if "area" in  element.element.text.lower():
                #element.assignChange()
            elementItem.renderTemplate(context)
            


        ## <CharacterStyle Self="CharacterStyle/CHANGE" Imported="false" SplitDocument="false" EmitCss="true" StyleUniqueId="b7777f5a-b2e2-41dd-923b-a36b7a2ff1cc" IncludeClass="true" ExtendedKeyboardShortcut="0 0 0" KeyboardShortcut="0 0" Name="CHANGE" FillColor="Color/C=15 M=100 Y=100 K=0" AppliedLanguage="$ID/English: USA">
        #			<Properties>
        #				<BasedOn type="string">$ID/[No character style]</BasedOn>
        #				<PreviewColor type="enumeration">Nothing</PreviewColor>
        #			</Properties>
        #		</CharacterStyle>

        extraStyleDict = {"_tag": "CharacterStyle",
        "Self": "CharacterStyle/CHANGE",
        "Imported":"false",
        "SplitDocument":"false",
        "EmitCss":"true",
        "StyleUniqueId":"b7777f5a-b2e2-41dd-923b-a36b7a2ff1cc",
        "IncludeClass":"true",
        "ExtendedKeyboardShortcut":"0 0 0",
        "KeyboardShortcut":"0 0",
        "Name":"CHANGE",
        "FillColor":"Color/C=15 M=100 Y=100 K=0",
        "AppliedLanguage":"$ID/English: USA",
        "_subElements":[{"_tag":"Properties", "_subElements":[{"_tag":"BasedOn", "type":"string","_text":"$ID/[No character style]"},{"_tag":"PreviewColor", "type":"enumeration", "_text":"Nothing"}]}]}

        extraStyle = dict_to_element(extraStyleDict)
        styleGroup = rootClone.find('RootCharacterStyleGroup')
        styleGroup.append(extraStyle)

        ETString = ET.tostring(rootClone, encoding='utf-8', xml_declaration=True).decode('utf-8')
        ETString = ETString.split("\n")
        ETString = [ETString[0]]+[
        '<?aid style="50" type="snippet" readerVersion="6.0" featureSet="257" product="20.4(4)" ?>',
        '<?aid SnippetType="InCopyInterchange"?>'
        ]+ETString[1:]

        print(ETString[603])
        returnbOb.append(ETString)
    return returnbOb

returnbOb = None
if T and C:
    returnbOb = __main_()

R = th.list_to_tree(returnbOb)
# ---------- end icml_templater ----------
dispatch_2 = Dispatch(List=dpipeline_2, DispatchPattern=tmatch_2)  # -> ListA, ListB
cls = Closed(Curve=graft(dpipeline_2))  # -> Closed, Periodic
m_objects_2 = QueryModelObjects(Layer="*::90 N D", Locked=True, Hidden=True, AutoUpdateState=True)
object_3 = ModelObject(Object=dispatch_2.ListB)  # -> Object, Layer
panel_24 = Panel(tmatch)
vec2pt = Vector2Pt(PointA=end.Start, PointB=end.End, Unitize=False)  # -> Vector, Length; disabled
number_of_hours_to_analyse_2 = Slider(7, range=0..10)
graft_6 = GraftTree(Tree=m_objects_2, IncludeEmptyLists=True, IncludeNullItems=True)  # -> simplify(Tree)
sunpath = Ladybug_SunPath(
    location=constructlocation,
    hour=series_3,
    day=day,
    month=month,
    timeStep=number_slider_2,
    sunPathScale=sunpathscale,
    sunScale=sunscale,
    dailyOrAnnualSunPath=True)  # -> readMe, sunVectors, sunAltitudes, sunAzimuths, port, sunSpheresMesh, sunPathCrvs, compassCrvs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; disabled; plug-in component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
c_units = ConvertUnits(Data=1, Source=1, Target=1)
starting_hour_2 = Slider(9, range=0..10)
icml_to_json = Python3Script(T=path_2)  # -> out, R
# ---------- icml_to_json: Python ----------
import xml.etree.ElementTree as ET
import os, json
import uuid
from jinja2 import Template
import ghpythonlib.treehelpers as th
import copy


def convertToJSON(root, willBreak=False):
    returnOb = {}
    returnOb["_tag"] = root.tag
    text = root.text
    if text not in ["\n\t",None]:
        returnOb["_text"] = text
    returnOb.update(root.attrib)
    subElements = list(root)
    if len(subElements) != 0:
        returnOb["_subElements"] = []
    for subElement in subElements:
        returnOb["_subElements"].append(convertToJSON(subElement))
    return returnOb
tree = ET.parse(T)
root = tree.getroot()
data = json.dumps(convertToJSON(root))
print(data)
# ---------- end icml_to_json ----------
layer = ModelLayer(Layer=object_3.Layer)  # -> Layer, simplify(graft(Name))
filter_json_list = Python3Script(D=panel_21, F="\"He\" in &[\"test\"] and \"ld\" in &[\"test\"]")  # -> out, D, I, P; inputs D: list, F: list
# ---------- filter_json_list: Python ----------
import json
from itertools import compress

def filterDict(testOb,filterOb):
    willReturn = False
    for i in filterOb:
        i = i.replace("&", "testOb")
        try:
            result = eval(i)
            if result:
                willReturn = True
                continue
        except: pass
        
        
    return willReturn
def filterMap(index, M):
    return M[index]

D = list(map(lambda x: json.loads(x), D))


P = list(map(lambda x: filterDict(x, F), D))

indexList = list(range(len(D)))

I = list(compress(indexList,P))
D = list(compress(D,P))

D = list(map(lambda x: json.dumps(x), D))
# ---------- end filter_json_list ----------
bool = Boolean(invert(cls.Closed))
object_4 = ModelObject(Object=graft_6)  # -> Object, Name, Layer
panel_25 = Panel(icml_to_json.R)
dispatch_3 = Dispatch(List=layer.Name, DispatchPattern=bool)  # -> ListA, ListB
toggle = BooleanToggle(True)
item_3 = ListItem(List=m_objects_2, Index=0, Wrap=True)
layer_2 = ModelLayer(Layer=object_4.Layer)  # -> Layer, Name, DisplayColour
layer_path_2 = Python3Script(L=object_4.Layer)  # -> out, P
# ---------- layer_path_2: Python ----------
P = str(L.Path)
# ---------- end layer_path_2 ----------
constructlocation_2 = Ladybug_ConstructLocation(locationName="unknown_Location", latitude=lat_dº_2, longitude=lon_dº_2, timeZone="10", elevation=0)  # -> location; plug-in component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
eval = EvaluateLength(Curve=graft(dpipeline_2), Length=0, Normalized=True)  # -> Point, Tangent, Parameter
expression_2 = Expression(x=dispatch_3.ListA, Expression="Format(\"line {0}\", x)")
series_4 = Series(Start=starting_hour_2, Step=1, Count=number_of_hours_to_analyse_2)
object_5 = ModelObject(Object=item_3)  # -> Object, Geometry, Name, Layer, Visibility, Display, Drafting, Render
panel_26 = Panel("""RH_Name
RH_LayerName
RH_LayerPath
RH_LayerColour""")
ladybug_2 = Ladybug_Ladybug()  # -> Vviiiiiiiiiizzz; plug-in component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
panel_27 = Panel(filter_json_list.D)
vec = Vector(sunpath.sunVectors)  # disabled
object_6 = ModelObject()  # -> Object, Geometry, Name, Layer, Visibility, Display, Drafting, Render
sunpathscale_2 = Slider(2, range=0..10)
sunscale_2 = Slider(0.5, range=0..1)
pdecon = Deconstruct(Point=eval.Point)  # -> XComponent, YComponent, simplify(ZComponent)
graft_7 = GraftTree(Tree=layer_2.Name, IncludeEmptyLists=True, IncludeNullItems=True)  # -> simplify(Tree)
graft_8 = GraftTree(Tree=layer_path_2.P, IncludeEmptyLists=True, IncludeNullItems=True)  # -> simplify(Tree)
graft_9 = GraftTree(Tree=layer_2.DisplayColour, IncludeEmptyLists=True, IncludeNullItems=True)  # -> simplify(Tree)
graft_10 = GraftTree(Tree=object_4.Name, IncludeEmptyLists=True, IncludeNullItems=True)  # -> simplify(Tree)
number_slider_3 = Slider(12, range=0..100)
month_2 = Slider(6, range=1..12)
panel_28 = Panel("testing\serialize.jsonl")
day_2 = Slider(21, range=1..31)
rev = ReverseList(List=vec)  # disabled
icml_generator = Python3Script(DA=graft_5, OP=panel_23, CS=panel_22)  # -> out, TA; inputs OP: list, CS: list
# ---------- icml_generator: Python ----------
# r: PyYAML

__author__ = "Andrew.Butler"
__version__ = "2024.02.02"
import yaml
import sys
import os
user = os.environ['USERPROFILE']
import json
try:    sys.path.append(r"\\sydsrv01\projects\Computational Design Group\93_Development\PackageManager\redback\py".format(**{'user':user}))
except: pass
try:    sys.path.append(r"E:\mydev\redback\py".format(**{'user':user}))
except: pass
import pyTableMaker as tm
from pyCSSParser import parseCSS



import Rhino
import Grasshopper as gh
from ghpythonlib.componentbase import executingcomponent as component

### CHECK THIS version, it might be faster: ghenv.Component.Params.Input[0]
def alterValueList(variableName, values=[{"A":"B"}]):
    for inputOb in ghenv.Component.Params.Input:
        for s in inputOb.Sources:
            if inputOb.NickName != variableName: continue
            
            
            attr = s.Attributes
            if (attr is None) or (attr.GetTopLevel is None): continue
            component = attr.GetTopLevel.DocObject
            if str(component.GetType()) != "Grasshopper.Kernel.Special.GH_ValueList": continue

            checkDefault = {}
            for item in component.ListItems:
                checkDefault[item.Name] = item.Expression
            if checkDefault != {"One": "1", "Two": "2", "Three": "2² - 1", "Four": "Sqrt(16)"}: break
            component.ListItems.Clear()
            for line in values:
                new_item = gh.Kernel.Special.GH_ValueListItem(line["key"], '"%s"'%(line["value"]))
                component.ListItems.Add(new_item)
            component.ExpireSolution(True)


def alterPanel(variableName, values=""):
    import System.Drawing as sd
    for inputOb in ghenv.Component.Params.Input:
        for s in inputOb.Sources:
            if inputOb.NickName != variableName: continue
            
            
            attr = s.Attributes
            if (attr is None) or (attr.GetTopLevel is None): continue
            component = attr.GetTopLevel.DocObject
            #print(component.GetType())
            if str(component.GetType()) != "Grasshopper.Kernel.Special.GH_Panel": continue

            #print(dir(component))
            #print(component.UserText)

            checkDefault = {}
            #for d in dir(component.Properties):
                #print(d)
            #print(component.Attributes.Bounds)
            


            if component.UserText != "Double click to edit panel content…": break
            width= 340
            current_bounds = component.Attributes.Bounds
            new_bounds = sd.RectangleF(current_bounds.X, current_bounds.Y, width, 200)
            component.Attributes.Bounds = new_bounds
            component.Attributes.ExpireLayout()

            values = values.replace("\n","\r\n")
            
            component.UserText = values
            component.Properties.Multiline = False
            component.Properties.Wrap = False
            component.ExpireSolution(True)
            print("-"*10)




optionValues = [{"key":"Guide", "value":'''# This is a guide for setting options
#  for the ICML generation component
# Use a Value List to select pregenerated
#  options
columnWidths:
- 20
variables:
  line-thick: 2
  line-medium: 1
  line-thin: 0.5'''}
]

cssValues = [
    {"key":"Default","value":'''*{paragraphStyle:Table - Small; cellStyle:Inner;}border[xPos=0]{weight:0;}
border[yPos=0]{weight:0;}
border[xPosRev=-1]{weight:0;}
border[yPosRev=-1]{weight:0;}'''}
]

alterValueList("OP",optionValues)
alterPanel("OP",optionValues[0]["value"])

alterValueList("CS",cssValues)
alterPanel("CS",cssValues[0]["value"])








D = DA
O = OP
C = CS

__log__ = []


__log__.append(str(C))




D = json.loads(D)
if not O:
	O = {"css":[]}
else:
	O = yaml.safe_load("\n".join(O))

if C:
    C = "".join(C)
    C = parseCSS(C)
    try:    O["css"] = C
    except: pass
#print("OPTIONS",O)
#print("DATA",D)
try:    TA = str(tm.table(D, O))
except: TA = None
# ---------- end icml_generator ----------
import_excel_2 = ImportExcel()  # -> Sheets, Data
serialize_model_object = Python3Script(OB=dispatch.ListB)  # -> out, JO
# ---------- serialize_model_object: Python ----------
import json
import rhinoscriptsyntax as rs
import Grasshopper as gh
layer = OB.Layer
outOB = {
    "geometry":{},
    "properties":{
        "_rhino3D_layerName": str(layer.Name),
        "_rhino3D_layerPath": str(layer.Path),
        "_rhino3D_objectName": str(OB.Name),
    }
}


geom = gh.Kernel.GH_Convert.ToGeometryBase(OB.Id)
try:    outOB["geometry"] = json.loads(geom.ToJSON(None))
except: pass
outOB["properties"].update(dict(OB.UserText))






JO = json.dumps(outOB)
# ---------- end serialize_model_object ----------
u_text_2 = UserText(Content=dispatch_2.ListB, UserTextMode=1)  # -> Content, Keys, Values
split = SplitList(List=rev, Index=expr("x-1", number_slider_2))  # -> ListA, ListB; disabled
graft_11 = GraftTree(Tree=m_objects_2, IncludeEmptyLists=True, IncludeNullItems=True)  # -> simplify(Tree)
merge_3 = Merge(Data1=graft_10, Data2=graft_7, Data3=graft_8, Data4=graft_9)
weave = Weave(Pattern=bool, Stream0=dispatch_3.ListB, Stream1=expression_2, NullGaps=False)
material_3 = ModelMaterial()  # -> Material, Name, Shader
toggle_2 = BooleanToggle(True)
serialize_geometry = Python3Script(GE=object_5.Geometry, PR="{\"class\":\"rod\"}")  # -> out, JO; inputs GE: GeometryBase
# ---------- serialize_geometry: Python ----------
import json
if not PR:
    PR = "{}"

PR = json.loads(PR)

data = json.loads(GE.ToJSON(None))
data["properties"] = PR
#print(list(data))

JO = json.dumps(data)
# ---------- end serialize_geometry ----------
rev_2 = ReverseList(List=split.ListB)  # disabled
short = ShortestList(ListA=u_text_2.Keys, ListB="class", ListC="z-index", TrimMode=2)  # -> ListA, ListB, ListC
u_text_3 = UserText(Content=graft_11, Keys=panel_26, Values=merge_3, UserTextMode=1)
sunpath_2 = Ladybug_SunPath(
    location=constructlocation_2,
    hour=series_4,
    day=day_2,
    month=month_2,
    timeStep=number_slider_3,
    sunPathScale=sunpathscale_2,
    sunScale=sunscale_2,
    dailyOrAnnualSunPath=True)  # -> readMe, sunVectors, sunAltitudes, sunAzimuths, port, sunSpheresMesh, sunPathCrvs, compassCrvs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; plug-in component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
panel_29 = Panel(icml_generator.TA)
merge_4 = Merge(Data1=simplify(u_text_2.Values), Data2=simplify(weave), Data3=simplify(pdecon.ZComponent))
merge_5 = Merge(Data1=u_text_2.Keys, Data2=short.ListB, Data3=short.ListC)
panel_30 = Panel("""*{stroke-width:0;}
.fill-white{fill:white;}
.fill-red{fill:#ed1c24;}
.Magenta{fill:#ec008c; stroke:#ec008c;}
.White{fill:#ffffff;}
.Black{fill:#000000;}
.Grey{fill:#bbbbbb;}
.Shade{opacity:0.2;}
.Highlight{fill: #ffffff; opacity:0.2;}
.Outline{fill:none; stroke: #000; stroke-width: 0.2mm;}
.Edge{fill:none; stroke: #000; stroke-width: 0.1mm;}
.Hidden{opacity:0;}
.line{fill:none; stroke-width:0.5px; stroke-linecap: round;}""")
deserialize_geometry_json = Python3Script(JO=serialize_geometry.JO)  # -> out, GE, PR; inputs JO: String
# ---------- deserialize_geometry_json: Python ----------
import json
import Rhino as rh

PR = json.dumps(json.loads(JO)["properties"])

GE = rh.Geometry.GeometryBase.FromJSON(JO)
# ---------- end deserialize_geometry_json ----------
read_json = IronPython2Script(JO=serialize_model_object.JO, K="properties")  # -> V; inputs JO: list of String, K: String; disabled
# ---------- read_json: IronPython ----------
#### Constants ####
global __var__
__var__ = {
	"guid":"33f7772a-c9ff-4356-915e-6a0b99bf4fcc",
	
	"name":"Read JSON",
	"nickname":"Read JSON",
	"description":"Reads keys from a JSON string. It can use javascript style key notation (a.b.c)",
	"icon": "ghContent\\Icon-ReadJSON.png",

	"tabname":"Redback",
	"section":"JSON",

	"inputs":[
		{"name":"JSON",			"nickname":"J",	"objectAccess":"list",	"description":"JSON object to read", },
		{"name":"Key",			"nickname":"K",	"objectAccess":"item",	"description":"Key to access from JSON", },
	],
	"outputs":[
		{"name":"Value",	"nickname":"V",	"description":"Returned value from JSON"}
	]
}
__author__ = "Andrew.Butler"
__version__ = "2024.02.02"
import json
def deepGet(key, object):
	try:
		keylist = key.split(".")
		for ki, k in enumerate(keylist):
			try: k = int(k)
			except: pass
			#print(k,type(k))
			if ki < len(keylist)-1:
				if type(k) == type("") and k not in object:
					object[k] = {}
				object = object[k]
			else:
				#print("last",k, object)
				returnOb = object[k]
				return returnOb
	except Exception as e:
		#print(e)
		return None
		
		
out = []
if not JO:
	JO = []
for o in JO:
	o = json.loads(o)
	#apob = list(map(lambda x: deepGet(x,o), K))
	apob = deepGet(K,o)
	if type(apob) == type([]) or type(apob) == type({}):
		apob = json.dumps(apob, ensure_ascii=False)
	
	#for i, ob in enumerate(apob):
		#if type(ob) == type([]) or type(ob) == type({}):
			#ob = json.dumps(ob)
		#apob[i] = ob
	#print(apob)
	out.append(apob)
		
V = out
# ---------- end read_json ----------
json = CreateJSON(Keys=merge_5, Values=merge_4)

# ---- group: Downgraded : Content Cache
cache = ContentCache(Content=u_text_3)
A = Action(Button())  # disabled
R = Result()  # disabled

# ----
panel_31 = Panel("{\"geometry\": {\"version\": 10000, \"archive3dm\": 80, \"opennurbs\": -1876652887, \"data\": \"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\"}, \"properties\": {\"_rhino3D_layerName\": \"First Layer - Vertical\", \"_rhino3D_layerPath\": \"Substructure::First Layer - Vertical\", \"_rhino3D_objectName\": \"Kreuzrost 1 Lage\", \"CW_Name\": \"Kreuzrost 1 Lage\", \"\\ufeffCW_Group\": \"1.Lage\", \"\\ufeffCW_Subgroup\": \"3 Nord-Ost\", \"\\ufeffCW_Comment\": \"-\", \"\\ufeffCW_EdvCode\": \"-\", \"\\ufeffCW_User1\": \"-\", \"\\ufeffCW_User2\": \"-\", \"\\ufeffCW_User3\": \"-\", \"\\ufeffCW_User4\": \"-\", \"\\ufeff\\ufeffCW_User5\": \"-\", \"\\ufeff\\ufeffCW_User6\": \"-\", \"\\ufeff\\ufeffCW_User7\": \"Werk\", \"\\ufeff\\ufeffCW_User8\": \"-\", \"\\ufeff\\ufeffCW_User9\": \"-\", \"\\ufeff\\ufeffCW_User10\": \"-\", \"\\ufeff\\ufeffCW_User11\": \"Intern\", \"\\ufeff\\ufeffCW_User12\": \"ET Ost 1\"}}")
vec_2 = Vector(sunpath_2.sunVectors)
mesh = Mesh()  # disabled
read_json_2 = ReadJSON(JSONObject=json, Keys="z-index")
flatten = FlattenTree(Tree=json, Path="{0}")
rev_3 = ReverseList(List=vec_2)
nullrep = ReplaceNulls(Items=read_json_2, Replacements=0)  # -> flatten(Items), Count
split_2 = SplitList(List=rev_3, Index=expr("x-1", number_slider_3))  # -> ListA, ListB
xy_5 = XYPlane(Origin=Point(0, 0, 0))
sort = SortList(Keys=nullrep.Items, ValuesA=dispatch_2.ListB, ValuesB=flatten)  # -> Keys, ValuesA, ValuesB
rev_4 = ReverseList(List=split_2.ListB)
svg_layout_3 = SVGLayout(P=xy_5, D="24,24", S="1:1", L=Toggle(True))  # -> L, R
topoly_2 = CurveToPolyline(Curve=sort.ValuesA, ToleranceDistance=0.01, ToleranceAngle=0)  # -> Polyline, Segments
geo2arch_2 = Geo2Arch(Geometry=topoly_2.Polyline, Properties=sort.ValuesB)
deserialize_model_object_json = Python3Script(JO=panel_31)  # -> out, OB
# ---------- deserialize_model_object_json: Python ----------
import json
import rhinoscriptsyntax as rs
import Grasshopper as gh
import scriptcontext as sc
import Rhino as rh

#sc.doc = rh.RhinoDoc.ActiveDoc
activeDoc = rh.RhinoDoc.ActiveDoc

JO = json.loads(JO)

geometry = rh.Geometry.GeometryBase.FromJSON(json.dumps(JO["geometry"]))
objectAttributes = rh.DocObjects.ObjectAttributes()
print(objectAttributes.LayerIndex)
#print(dir(objectAttributes))
for k,v in JO["properties"].items():
    if not k.startswith("_"):
        objectAttributes.SetUserString(k,v)
#print(JO["properties"])
objectAttributes.Name = JO["properties"]["_rhino3D_objectName"]

newModelObject = gh.Rhinoceros.Model.ModelObject(activeDoc, objectAttributes, geometry)


OB = newModelObject

#sc.doc = ghdoc
# ---------- end deserialize_model_object_json ----------
panel_32 = Panel(sort.ValuesB)
lng_3 = ListLength(List=panel_31)
panel_33 = Panel("112900")  # disabled
crv_2 = Curve(svg_layout_3.R)
svg_2 = SVGGenerator(JO=geo2arch_2, LA=svg_layout_3.L, CSS=panel_30)
offset = OffsetCurve(Curve=crv_2, Distance=-2, Corners=1)
number_slider_4 = Slider(3100, range=0..10000)  # disabled
geo = Geometry([<surface referenced from the Rhino model> x3])  # disabled
area = Area(Geometry=geo)  # -> Area, Centroid; disabled
pdecon_2 = Deconstruct(Point=area.Centroid)  # -> XComponent, YComponent, ZComponent; disabled
cache_2 = ContentCache(Content=[crv_2, offset])
expression_3 = Expression(x=pdecon_2.ZComponent, y=panel_33, Expression="x-y")  # disabled
rep = ReplaceText(Text=".\.\components\ghContent\Icon-#.svg", Find="#", Replace="Replace Text", RecursiveReplace=False)
c_units_2 = ConvertUnits(Data=1, Source=1, Target=1)
object_7 = ModelObject(Object=deserialize_model_object_json.OB, Layer="Test")  # -> Object, Geometry, Name, Layer, Visibility, Display, Drafting, Render
u_text_4 = UserText(Content=deserialize_model_object_json.OB, UserTextMode=1)  # -> Content, Keys, Values
expression_4 = Expression(x=expression_3, y=number_slider_4, Expression="round(x/y)")  # disabled
rel_path = RelativePath(Path=Toggle(False), RelativePath=rep)  # -> FullPath, Directory, FileName
objdet = ObjectDetails(Object=geo)  # -> Referenced, Available, Name, Layer, Colour, Guid; disabled
brep = Brep(object_7.Geometry)
write = WriteFile(Run=Toggle(True), Content=svg_2, FileDirectory=rel_path.Directory, FileName=rel_path.FileName)
list2tree_2 = List2Tree()
import_excel_3 = ImportExcel()  # -> Sheets, Data
panel_34 = Panel(rel_path.Directory)
int_3 = Integer(expression_4)  # disabled

# ---- group: Downgraded : Content Cache
cache_3 = ContentCache(Name="Test", Content=object_7.Object)
R_2 = Result()  # disabled

# ----
cluster = Cluster()
panel_35 = Panel(write)
concat = Concatenate(FragmentA=int_3, FragmentB=objdet.Name)  # disabled
cset = CreateSet(List=concat)  # -> Set, Map; disabled
panel_36 = Panel(object_7.Geometry)
pt_2 = Point(<point referenced from the Rhino model>)  # disabled
mindex = MemberIndex(Set=concat, Member=cset.Set)  # -> Index, Count; disabled
number_slider_5 = Slider(4, range=0..10)  # disabled
rep_2 = ReplaceText(RecursiveReplace=False)
geo_2 = Geometry([<extrusion referenced from the Rhino model> x5])  # disabled
item_4 = ListItem(List=geo, Index=mindex.Index, Wrap=True)  # disabled
crv_3 = Curve(item_4)  # disabled
replace_text = Python3Script()  # -> out, V, O; inputs V: list, F: list, T: list
# ---------- replace_text: Python ----------
chars = []
for fromValue in F:
    chars = list(set(chars+list(fromValue)))
chars.sort()

O = []
for char in chars:
    O.append("&#"+str(ord(char))+";")


for index, value in enumerate(V):
    try:
        for fromValue, toValue in zip(F,T):
            value = value.replace(fromValue, toValue)
        V[index] = value
    except: pass
# ---------- end replace_text ----------
mjoin = MeshJoin(Meshes=geo_2)  # disabled
boundary = BoundarySurfaces(Edges=graft(crv_3))  # disabled
python = GhPythonScript(samplePoints=pt_2, Rays=rev_2, SampleLevel=number_slider_5)  # -> out, a, sumHits, score, hitMatch, hitPoints; inputs samplePoints: list of Point3d, Obstruction: Mesh, Rays: list; disabled
# ---------- python: Python ----------
__author__ = "Andrew.Butler"
__version__ = "2024.05.22"

import rhinoscriptsyntax as rs
import ghpythonlib.components as ghp

totalSolar = 72
raysNeeded = 24
solarThreshold = totalSolar-raysNeeded
score = 0
sumHits = totalSolar
hitMatch = [1]*totalSolar
hitPoints = []
Rays = ghp.Reverse(Rays)
#print(len(AnSrf),AnSrf)
if True:
    sumHits = totalSolar
    sumMatch = [1]*totalSolar
    rangeBreak = False
    print("=")*200
    #print(r)
    #samplePoints = []
    #for s in AnSrf:
        #if r == 0:
            #samplePoints = [ghp.Area(s)["centroid"]]
            #print(samplePoints, type(samplePoints))
        #else:
            #points = ghp.DivideSurface(s, r, r)
            #samplePoints = samplePoints+points["points"]
    a = samplePoints
    for pt in samplePoints:
        #print("-"*100)
        meshRay =  ghp.MeshXRay(Obstruction, [pt], Rays)
        #print(meshRay)
        hitPoints = meshRay["point"]
        hits = meshRay["hit"]
        hitsA = hits[:-1]
        hitsB = hits[0:]
        #print("###")
        #print(hitsA, hitsB)
        hits = list(map(lambda (x,y): int(x or y), zip(hitsA,hitsB)))
        #print(hits)
        #print(hitMatch)
        hits = list(map(lambda (x, y): y*x, zip(hits, hitMatch)))
        print(hits)
        hitMatch = hits
        print("-"*100)
        
        sumHits = sum(hits)
        if sumHits <= solarThreshold:
            print(hits, sumHits)
            rangeBreak = True
            score = 2
            #break
        if sumHits < totalSolar:
            score = 1
    #if rangeBreak:
        #break
# ---------- end python ----------
svgtopdf = Python3Script()  # -> out, FP
# ---------- svgtopdf: Python ----------
# r: svglib
from svglib.svglib import svg2rlg
from reportlab.graphics import renderPDF#, renderPM
drawing = svg2rlg(SVG)
newFileName = SVG.replace(".svg",".pdf")
renderPDF.drawToFile(drawing, newFileName)
FP = newFileName
# ---------- end svgtopdf ----------
divide = DivideDomain²(UCount=10, VCount=10)  # disabled
python_2 = GhPythonScript(Rays=rev_2, SampleLevel=number_slider_5)  # -> out, a, sumHits, score, hitMatch, hitPoints; inputs samplePoints: list of Point3d, Obstruction: Mesh, Rays: list; disabled; same code as python
mesh_2 = MeshBrep(
    Brep=boundary,
    Settings={GridMaxCount=0, GridMinCount=16, JaggedSeams=False, MaxEdgeLength=0, MinEdgeLength=0.0001, MinTolerance=0, Refine=True, RefineAngle=0, RelativeTolerance=0.65, SimplePlanes=True, Tolerance=0})  # disabled
subsrf = Isotrim()  # disabled
gradient = Gradient(
    LowerLimit=0,
    UpperLimit=48.5,
    Parameter=python_2.sumHits,
    stops=[0: RGB(234, 38, 0), 0.25: RGB(234, 126, 0), 0.5: RGB(254, 244, 84), 0.75: RGB(173, 203, 249), 1: RGB(75, 107, 169)])  # disabled
conmesh = ConstructMesh(
    Vertices=flatten([Point(0, 0, 0), Point(10, 0, 0), Point(10, 10, 0), Point(0, 10, 0)]),
    Faces=flatten({A=0, B=1, C=2, D=3}),
    Colours=flatten(gradient))  # disabled
python_3 = GhPythonScript(AnSrf=boundary, Rays=rev_2, SampleLevel=number_slider_5)  # -> out, a, sumHits, score, hitMatch, hitPoints; inputs AnSrf: list of Surface, Obstruction: Mesh, Rays: list; disabled
# ---------- python_3: Python ----------
__author__ = "Andrew.Butler"
__version__ = "2024.05.22"

import rhinoscriptsyntax as rs
import ghpythonlib.components as ghp

totalSolar = 72
raysNeeded = 24
solarThreshold = totalSolar-raysNeeded
score = 0
sumHits = totalSolar
hitMatch = [1]*totalSolar
hitPoints = []
Rays = ghp.Reverse(Rays)
print(len(AnSrf),AnSrf)
for r in range(int(SampleLevel)):
    sumHits = totalSolar
    sumMatch = [1]*totalSolar
    rangeBreak = False
    print("=")*200
    print(r)
    samplePoints = []
    for s in AnSrf:
        if r == 0:
            samplePoints = [ghp.Area(s)["centroid"]]
            #print(samplePoints, type(samplePoints))
        else:
            points = ghp.DivideSurface(s, r, r)
            samplePoints = samplePoints+points["points"]
    a = samplePoints
    for pt in samplePoints:
        #print("-"*100)
        meshRay =  ghp.MeshXRay(Obstruction, [pt], Rays)
        #print(meshRay)
        hitPoints = meshRay["point"]
        hits = meshRay["hit"]
        hitsA = hits[:-1]
        hitsB = hits[0:]
        #print("###")
        #print(hitsA, hitsB)
        hits = list(map(lambda (x,y): int(x or y), zip(hitsA,hitsB)))
        #print(hits)
        #print(hitMatch)
        hits = list(map(lambda (x, y): y*x, zip(hits, hitMatch)))
        print(hits)
        hitMatch = hits
        print("-"*100)
        
        sumHits = sum(hits)
        if sumHits <= solarThreshold:
            print(hits, sumHits)
            rangeBreak = True
            score = 2
            break
        if sumHits < totalSolar:
            score = 1
    if rangeBreak:
        break
# ---------- end python_3 ----------
panel_37 = Panel(svgtopdf.FP)
geo_3 = Geometry(<brep referenced from the Rhino model>)  # disabled
triangle = MeshTriangle(CornerA=0, CornerB=1, CornerC=2)  # disabled
number_slider_6 = Slider(72, range=0..72)  # disabled
int_4 = Integer()  # disabled
item_5 = ListItem(Index=int_4, Wrap=True)  # disabled
number_slider_7 = Slider(27510.02, range=0..100000)  # disabled
item_6 = ListItem(List=rev_2, Index=number_slider_6, Wrap=True)  # disabled
pt_3 = ConstructPoint(XCoordinate=0, YCoordinate=10, ZCoordinate=0)
colour_swatch = ColourSwatch(SwatchColor=RGB(171, 72, 189))
colour_swatch_2 = ColourSwatch(SwatchColor=RGB(92, 107, 191))
colour_swatch_3 = ColourSwatch(SwatchColor=RGB(255, 201, 41))
panel_38 = Panel(python_2.sumHits)  # disabled
python_4 = GhPythonScript(AnSrf=geo_3, Obstruction=mesh, Rays=rev_2, SampleLevel=number_slider_5)  # -> out, a, sumHits, score, hitMatch, hitPoints; inputs AnSrf: list of Surface, Obstruction: Mesh, Rays: list; disabled
# ---------- python_4: Python ----------
__author__ = "Andrew.Butler"
__version__ = "2024.05.22"

import rhinoscriptsyntax as rs
import ghpythonlib.components as ghp

totalSolar = 72
raysNeeded = 24
solarThreshold = totalSolar-raysNeeded
score = 0
sumHits = totalSolar
hitMatch = [1]*totalSolar
hitPoints = []
Rays = ghp.Reverse(Rays)
print(len(AnSrf),AnSrf)
for r in range(int(SampleLevel)):
    sumHits = totalSolar
    sumMatch = [1]*totalSolar
    rangeBreak = False
    print("=")*200
    print(r)
    samplePoints = []
    for s in AnSrf:
        if r == 0:
            samplePoints = [ghp.Area(s)["centroid"]]
            #print(samplePoints, type(samplePoints))
        else:
            points = ghp.DivideSurface(s, r, r)
            samplePoints = samplePoints+points["points"]
    a = samplePoints
    for pt in samplePoints:
        print("-"*100)
        meshRay =  ghp.MeshXRay(Obstruction, [pt], Rays)
        print(meshRay)
        hitPoints = meshRay["point"]
        hits = meshRay["hit"]
        hits = list(map(lambda x: int(x), hits))
        print(hits)
        print(hitMatch)
        hits = list(map(lambda (x, y): y*x, zip(hits, hitMatch)))
        print(hits)
        hitMatch = hits
        print("-"*100)
        
        sumHits = sum(hits)
        if sumHits <= solarThreshold:
            print(hits, sumHits)
            rangeBreak = True
            score = 2
            break
        if sumHits < totalSolar:
            score = 1
    if rangeBreak:
        break
# ---------- end python_4 ----------
panel_39 = Panel("""NO SOLAR
UNDER 2 HOURS
OVER 2 HOURS""")  # disabled
series_5 = Series(Start=0, Step=21, Count=4)
xz = XZPlane(Origin=Point(0, 0, 0))
panel_40 = Panel("Number")  # disabled
xz_2 = XZPlane(Origin=pt_3)
rev_5 = Reverse(Vector=rev_2)  # disabled
rev_6 = Reverse(Vector=item_6)  # disabled
Z = UnitZ(Factor=series_5)
pt_4 = Point(python_3.a)  # disabled
planesrf = PlaneSurface(Plane=xz, XSize=Domain(-10, 10), YSize=Domain(-10, 10))
planesrf_2 = PlaneSurface(Plane=xz_2, XSize=Domain(-100, 100), YSize=Slider(67.922, range=0..100))
merge_6 = Merge(Data1=colour_swatch, Data2=colour_swatch_2, Data3=colour_swatch_3)  # disabled
pt_5 = Point(python_3.hitPoints)  # disabled
amp = Amplitude(Vector=rev_6, Amplitude=number_slider_7)  # disabled
rotate = Rotate(Geometry=planesrf_2, Angle=degrees(Slider(94.646, range=-180..180)), Plane=xz_2)  # -> Geometry, Transform
move = Move(Geometry=planesrf, Motion=Z)  # -> Geometry, Transform
panel_41 = Panel(python_4.score)  # disabled
item_7 = ListItem(List=panel_39, Index=python_3.score, Wrap=True)  # -> flatten(Item); disabled
txt_2 = Text(cset.Set)  # disabled
mjoin_2 = MeshJoin(Meshes=mesh_2)  # disabled
geo_4 = Geometry(rotate.Geometry)
item_8 = ListItem(List=merge_6, Index=python_3.score, Wrap=True)  # disabled
panel_42 = Panel([colour_swatch, colour_swatch_2, colour_swatch_3, ColourSwatch(SwatchColor=RGB(245, 67, 54))])
move_2 = Move(Geometry=pt_2, Motion=amp)  # -> Geometry, Transform; disabled
partition_4 = PartitionList(List=move.Geometry, Size=2)
mindex_2 = MemberIndex(Set=txt_2)  # -> Index, Count; disabled
srf_2 = Surface(Tree({0;0}: [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], {0;1}: [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]))
mjoin_3 = MeshJoin(Meshes=geo_4)
mcol = MeshColours(Mesh=mjoin_2, Colours=item_8)  # disabled
item_9 = ListItem(List=item_7, Index=mindex_2.Index, Wrap=True)  # disabled
int_5 = Integer(4)
item_10 = ListItem(Index=0, Wrap=True)  # disabled
int_6 = Integer(24)
expression_5 = Expression(x=flatten(python_3.score), Expression="x=0")  # disabled
expression_6 = Expression(x=flatten(python_3.score), Expression="x=2")  # disabled
relay = Relay()  # disabled
join_2 = TextJoin(Text=item_9)  # disabled
build_solar_options = IronPython2Script(SampleLevel=int_5, RaysNeeded=int_6)  # -> O; inputs SampleLevel: Int32, RaysNeeded: Int32
# ---------- build_solar_options: IronPython ----------
class solarOptions():
    def __init__(self, *arg, **kw):
        #super(solarOptions, self).__init__(*arg, **kw)
        self.SampleLevel = SampleLevel
        self.clearCache = True
        self.raysNeeded = RaysNeeded
    def __str__(self):
        return ("Solar Options")

calcOptions = {
            "rayTime": 5,
            "raysNeeded": 24,
            "SampleLevel": 4,
            "clearCache": True
}
O = solarOptions(SampleLevel,RaysNeeded)
# ---------- end build_solar_options ----------
graft_12 = GraftTree(Tree=relay, IncludeEmptyLists=True, IncludeNullItems=True)  # disabled
panel_43 = Panel("Solar Access Time")  # disabled
nullrep_2 = ReplaceNulls(Items=join_2, Replacements="N/A")  # -> Items, Count; disabled
lng_4 = ListLength(List=flatten(python_3.score))  # disabled
ma = MassAddition(Input=flatten(expression_5))  # -> Result, PartialResults; disabled
ma_2 = MassAddition(Input=flatten(expression_6))  # -> Result, PartialResults; disabled
solarwindowanalysis = IronPython2Script(AnGeo=srf_2, Obstruction=mjoin_3, Rays=rev_4, Options=build_solar_options)  # -> Results; inputs AnGeo: list of GeometryBase, Obstruction: list of Mesh, Rays: list of Vector3d, Options: list
# ---------- solarwindowanalysis: IronPython ----------
__author__ = "Andrew.Butler"
__version__ = "2024.05.22"

import rhinoscriptsyntax as rs
import ghpythonlib.components as ghp
import Rhino as rh
import datetime
import scriptcontext as sc
import ghpythonlib.treehelpers as th
debug = False

if len(Obstruction) == 1:
    Obstruction = Obstruction[0]
if len(Options) == 1:
    Options = Options[0]
def pprint(*arg):
    global debug
    if debug:
        print(arg)
def divideSurface(surface, division):
    divNum = 2**division
    #baseDomain = ghp.ConstructDomain2(0,1,0,1)
    dividedDomain = ghp.DivideDomain2(surface,divNum,divNum)
    subSurfaces = ghp.Isotrim(surface, dividedDomain)
    areaResult = ghp.Area(subSurfaces)
    #pprint(areaResult)
    result = areaResult["centroid"]
    if type(result) != type([]):
        result = [result]
    return result
    #pprint(subSurfaces)
    #pprint("dD",dividedDomain)



if not Options:
    calcOptions = {
            "rayTime": 5,
            "totalSolar" : 72,
            "raysNeeded": 24,
            "SampleLevel": 4,
            "clearCache": True
        }
else:
    calcOptions = Options.__dict__

calcOptions["totalSolar"] = len(Rays)-1

class resultsObject():
    def __init__(self, sumHits, hitMatch, pointsTested, samplePoints):
        self.raysNeeded = calcOptions["raysNeeded"]
        #self.scoreIcon = ["✗","🗌","✓"][self.score]
        #self.scoreText = ["    0 mins", " <120 mins", ">=120 mins"][self.score]
        self.totalHits = sumHits
        self.totalRays = calcOptions["totalSolar"]-self.totalHits
        self.hitPattern = hitMatch

        self.pointsTested = pointsTested
        self.samplePoints = samplePoints
    def __str__(self):
        return "Solar Analysis Results"
    @property
    def score(self):
        totalSolar = len(self.hitPattern)-1
        solarThreshold = totalSolar-self.raysNeeded
        allHits = self.hitPattern
        sumAllHits = sum(allHits)
        hitsA = allHits[:-1]
        hitsB = allHits[1:]
        hits = list(map(lambda (x,y): int(x or y), zip(hitsA,hitsB)))
        
        
        
        sumHits = sum(hits)
        if sumHits <= solarThreshold:
            rangeBreak = True
            return 2
        if sumAllHits < totalSolar+1:
            return 1
        return 0
    @property
    def solarPattern(self):
        flipPattern = ""
        print("hello",self.hitPattern)
        for i in self.hitPattern:
            if i == 0:
                flipPattern += "1"
                continue
            flipPattern += "0"
        return flipPattern
    def combinePatterns(self,pattern=[1]*73):
        newPattern = [1]*len(self.hitPattern)
        for index, (u,v) in enumerate(zip(self.hitPattern, pattern)):
            if u == 0:
                newPattern[index] = 0
                continue
            if v == 0:
                newPattern[index] = 0
                continue
        self.hitPattern = newPattern
class sampleRayObject():
    def __init__(self, origin, ray1, ray2, index):
        self.ray1 = ray1
        self.ray2 = ray2
        self.rayMesh = self.makeRay(origin, ray1, ray2)
        self.index = index
        self.startTime = datetime.datetime(2024,06,21,9,0,0)+datetime.timedelta(minutes=5*index)
        self.endTime = self.startTime+datetime.timedelta(minutes=5)

    def makeRay(self,origin, ray1, ray2):
        #pprint("+"*100)
        #pprint(ray1, ray2)
        ray1 = ghp.Amplitude(ray1, 100000)
        ray2 = ghp.Amplitude(ray2, 100000)
        point1 = ghp.Move(origin, ray1)["geometry"]
        point2 = ghp.Move(origin, ray2)["geometry"]
        #pprint("-"*100)
        #pprint(origin, point1, point2)
        faces = ghp.MeshTriangle(0,1,2)
        mesh = ghp.ConstructMesh([origin,point1,point2],faces)
        #mesh =  rs.AddMesh([origin,point1,point2],[[0,1,2,0]])
        return mesh
    def __str__(self):
        return "<SampleRT> %s %s-%s"%(self.index, self.startTime.strftime("%H:%M"),self.endTime.strftime("%H:%M"))

class samplePointObject():
    def __init__(self, point, occlusionPattern, rays):
        self.point = point
        self.occlusionPattern = occlusionPattern
        self.occlusionScore = sum(self.occlusionPattern)
        self.rayScore = calcOptions["totalSolar"]-self.occlusionScore
        self.rayTime = self.rayScore*rayTime
        self.allRays = list(map(lambda (i,(x,y)): sampleRayObject(self.point, x, y,i), enumerate(zip(rays[:-1],rays[1:]))))
        self.solarRays = []
        for b, r in zip(self.occlusionPattern, self.allRays):
            if b == 0:
                self.solarRays.append(r)

    def __str__(self):
        return "<SampleP>"
#pprint(sc.sticky["SolarAnalysis"]["{2}"].score)

if calcOptions["clearCache"]:
    pprint("clearing cache")
    sc.sticky["SolarAnalysis"] = {}
    pass
try:    sc.sticky["SolarAnalysis"]

except: sc.sticky["SolarAnalysis"] = {}
results = []


pprint("-"*200)

# branchPath = str(AnGeo[i])
#pprint(str(branchPath))

run = True
#if branchPath in sc.sticky["SolarAnalysis"]:
    #pprint("%s is in sticky"%(branchPath))
    #cached = sc.sticky["SolarAnalysis"][branchPath]
    #pprint(" "*5+"score: %s"%(cached.score))
    #pprint(dir(cached))
    #pprint()
    
    #if cached.score == 2:
        #results.append([cached])
        #pprint(" "*5+"skipping unit")
        #pprint("=")*200
        #run = False
    #else:
        #results.append([cached])
        #score.append([cached.score])
        #continue
        #pass
#branchList = i
AnGeometry = AnGeo
#totalSolar = 72

rayTime = 5
solarThreshold = calcOptions["totalSolar"]-calcOptions["raysNeeded"]
scoreOut = 0
sumHits = calcOptions["totalSolar"]
hitMatch = [1]*calcOptions["totalSolar"]
allHits = []
cumulativeAllHits = []
pprint("allHits:", allHits)
hitPoints = []
AnSrf = []
AnPts = []

for i in AnGeometry:
    #pprint(type(i).__name__)
    if type(i).__name__ == "Brep":
        AnSrf.append(i)
    if type(i).__name__ == "Point":
        AnPts.append(i)
if len(AnSrf) == 0:
    AnSrf = [None]

Rays = ghp.Reverse(Rays)


pointsTested = []
#pprint(AnPts)

if run:
    for r in range(int(calcOptions["SampleLevel"])+1):
        sumHits = calcOptions["totalSolar"]
        sumMatch = [1]*calcOptions["totalSolar"]
        rangeBreak = False
        #pprint("$")*200
        #pprint(r)
        samplePoints = []

        for surface_index, s in enumerate(AnSrf):
            #pprint("="*100)
            try:    isTrimmed = rs.IsSurfaceTrimmed(s)
            except: isTrimmed = False
            if r == 0:
                samplePoints = samplePoints+list(AnPts)
            if r == 1:
                if not isTrimmed:
                    samplePoints = samplePoints+divideSurface(s,r-1)
                if isTrimmed:
                    samplePoints = samplePoints+[ghp.PopulateGeometry(s,1,2,[])]
            if r == 2:
                if not isTrimmed:
                    samplePoints = samplePoints+ghp.DivideSurface(s, 1, 1)["points"]
                if isTrimmed:
                    samplePoints = samplePoints+ghp.PopulateGeometry(s,4,2,[])
            if r > 2:
                if not isTrimmed:
                    samplePoints = samplePoints+divideSurface(s,r-2) #+ samplePoints
                if isTrimmed:
                    samplePoints = samplePoints+ghp.PopulateGeometry(s,2**(r-1),2,[])
        pt = None
        meshRay = None
        for pt in samplePoints:
            #pprint(pt)
            #pprint("-"*100)
            meshRay =  ghp.MeshXRay(Obstruction, [pt], Rays)
            #pprint(meshRay)
            #pprint("meshRay")
            #pprint(meshRay)
            hitPoints = meshRay["point"]
            hits = meshRay["hit"]
            
            #pprint(hitPoints)
            if not hits:
                hits = [True]
            allHits = list(map(lambda x: int(x), hits))
            if cumulativeAllHits == []:
                cumulativeAllHits = allHits
            else:
                for i, hit in enumerate(allHits):
                    if hit == 0:
                        cumulativeAllHits[i] = 0
            sumAllHits = sum(allHits)
            hitsA = hits[:-1]
            hitsB = hits[1:]
            #pprint("###")
            #pprint(hitsA, hitsB)
            hits = list(map(lambda (x,y): int(x or y), zip(hitsA,hitsB)))
            #pprint(hits)
            #pprint(hitMatch)
            pointScore = sum(hits)
            #pprint(pointScore)
            if pointScore < calcOptions["totalSolar"]:
                pointsTested.append(samplePointObject(pt,hits, Rays))
            totalHits = list(map(lambda (x, y): y*x, zip(hits, hitMatch)))
            #pprint(hits)
            hitMatch = totalHits
            #pprint("-"*100)
            
            sumHits = sum(hitMatch)
            if sumHits <= solarThreshold:
                #pprint(totalHits, sumHits)
                rangeBreak = True
                scoreOut = 2
                break
            if sumAllHits < calcOptions["totalSolar"]+1:
                scorescoreOut = 1
        if rangeBreak:
            break

    resultOut = resultsObject(sumHits,cumulativeAllHits, pointsTested, samplePoints)
    #sc.sticky["SolarAnalysis"][branchPath] = resultOut
    #pprint("!",sc.sticky["SolarAnalysis"])
    results.append([resultOut])
    pprint(resultOut.score)
    pprint(resultOut.hitPattern)
    pprint("="*200)
    #results.combinePatterns([1]*73)
    #pprint(results.pattern)

pprint(results)
Results = th.list_to_tree(results)
# ---------- end solarwindowanalysis ----------
expression_7 = Expression(x=lng_4, y=ma.Result, Expression="(y/x)*100")  # disabled
expression_8 = Expression(x=lng_4, y=ma_2.Result, Expression="(y/x)*100")  # disabled
dispatch_4 = Dispatch(List=graft_12, DispatchPattern=[True, False])  # -> ListA, ListB; disabled
panel_44 = Panel(":")  # disabled
item_11 = ListItem(List=pt_4, Index=1, Wrap=True)  # -> simplify(Item); disabled
series_6 = Series(Start=0, Step=2.5, Count=24)  # disabled
panel_45 = Panel(expression_7)  # disabled
series_7 = Series(Start=9, Step=1, Count=6)  # disabled
panel_46 = Panel(lng_4)  # disabled
panel_47 = Panel([expression_8, ma_2.Result])  # disabled
move_3 = Move(Motion=item_11)  # -> Geometry, Transform; disabled
pt_6 = ConstructPoint(XCoordinate=0, YCoordinate=0, ZCoordinate=0)  # disabled
rev_7 = Reverse(Vector=rev_2)  # disabled
extract_solar_result_geometry = IronPython2Script(R=simplify(solarwindowanalysis))  # -> out, P, S, Y; inputs R: list
# ---------- extract_solar_result_geometry: IronPython ----------
import ghpythonlib.treehelpers as th

Y = []
for r in R:
    for i in r.pointsTested:
        print(i.rayScore)
        print(dir(i))
        print(i.solarRays)
        Y.append(i.solarRays)
    P = list(map(lambda x: x.point, r.pointsTested))
    S = r.samplePoints
    

print(dir(R[0]))
Y = th.list_to_tree(Y)
# ---------- end extract_solar_result_geometry ----------
extract_solar_result_data = IronPython2Script(R=solarwindowanalysis)  # -> S, C, P
#   port P: Ray Interval Pattern
# ---------- extract_solar_result_data: IronPython ----------
print(dir(R))
S = R.score
C = R.totalRays
P = R.solarPattern
# ---------- end extract_solar_result_data ----------
concat_2 = Concatenate(FragmentA=graft(series_7), FragmentC=panel_44, FragmentB=series_6)  # -> flatten(Result); disabled
line_2 = LineSDL(Start=pt_6, Direction=rev_7, Length=100000)  # disabled
dispatch_5 = Dispatch(List=concat_2, DispatchPattern=[True, False])  # -> ListA, ListB; disabled
pt_7 = Point(extract_solar_result_geometry.P)
pt_8 = Point(extract_solar_result_geometry.S)
shift_2 = ShiftList(List=line_2, Shift=-1, Wrap=False)  # disabled
shift_3 = ShiftList(List=line_2, Shift=1, Wrap=False)  # disabled
extract_ray_geometry = IronPython2Script(Y=extract_solar_result_geometry.Y)  # -> out, M, R1, R2, T1, T2
# ---------- extract_ray_geometry: IronPython ----------
print(dir(Y))

M = Y.rayMesh
R1 = Y.ray1
R2 = Y.ray2
T1 = Y.startTime
T2 = Y.endTime
# ---------- end extract_ray_geometry ----------
lng_5 = ListLength(List=python.hitMatch)  # disabled
rulesrf = RuledSurface(CurveA=shift_2, CurveB=shift_3)  # disabled
series_8 = Series(Start=0, Step=1, Count=lng_5)  # disabled
evalsrf = EvaluateSurface(Surface=reparameterize(rulesrf), Point=Point(1, 0.5, 0))  # -> Point, Normal, UDirection, VDirection, Frame; disabled
smesh = SimpleMesh(Brep=rulesrf)  # disabled
panel_48 = Panel(extract_solar_result_data.S)
dispatch_6 = Dispatch(List=evalsrf.Frame, DispatchPattern=python.hitMatch)  # -> ListA, simplify(ListB); disabled
dispatch_7 = Dispatch(List=smesh, DispatchPattern=python.hitMatch)  # -> ListA, simplify(ListB); disabled
dispatch_8 = Dispatch(List=series_8, DispatchPattern=python.hitMatch)  # -> ListA, simplify(ListB); disabled
move_4 = Move(Geometry=line_2, Motion=python.a)  # -> Geometry, Transform; disabled
move_5 = Move(Geometry=dispatch_6.ListB, Motion=python.a)  # -> Geometry, Transform; disabled
mesh_3 = Mesh(dispatch_7.ListB)  # disabled
move_6 = Move(Geometry=mesh_3, Motion=python.a)  # -> Geometry, Transform; disabled
swatch = ColourSwatch(SwatchColor=RGB(0, 0, 0))  # disabled
lng_6 = ListLength(List=move_5.Geometry)  # disabled
series_9 = Series(Start=1, Step=1, Count=lng_6)  # disabled
int_7 = Integer(series_9)  # disabled
tag = TextTag3D(Location=move_5.Geometry, Text=dispatch_8.ListB, Size=1000, Colour=swatch, Justification=7)  # disabled
tag_2 = TextTag(Location=move_5.Geometry, Text=int_7, Colour=swatch)  # disabled

# ==== cluster Cluster
import_excel = ImportExcel()  # -> Sheets, Data
