# Grasshopper definition SolarWindowAnalysis.gh (Grasshopper 1.0.8)
# plug-ins: treesloth01, Redback-Beta.GH

mesh = Mesh(<mesh referenced from the Rhino model>)
srf = Surface(<surface referenced from the Rhino model>)
obstructions = GetGeometry(mesh, AnnotationTypeFilter=0, AtLeast=1, AtMost=1, DeleteInput=False, Filter=262144, TreeAccess=False)
vec = Vector([Vector(0.1020026477, -0.9402453337, -0.324860235), Vector(0.1173337485, -0.9344081476, -0.3363245533), Vector(0.1327272387, -0.9282299775, -0.3475235086), Vector(0.1481757941, -0.9217137631, -0.3584517723), Vector(0.1636720643, -0.9148626049, -0.3691041447), Vector(0.1792086761, -0.9076797628, -0.3794755574)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])
pt = Point(vec)
divide = DivideDomain²(Domain=srf, UCount=20, VCount=20)
subsrf = Isotrim(Surface=srf, Domain=divide)  # -> simplify(graft(Surface))
item = ListItem(List=flatten(subsrf), Index=0, Wrap=True)
solarwindowanalysis = SolarWindowAnalysis(AnGeo=item, Obstructions=mesh, Sample=Slider(1, range=0..5), Rays=pt)
pt_2 = Point([<point referenced from the Rhino model> x2])
geo = Geometry(subsrf)
merge = Merge(Data1=geo, Data2=pt_2)
rays = GetGeometry(pt, AnnotationTypeFilter=0, AtLeast=1, AtMost=1, DeleteInput=False, Filter=3, TreeAccess=False)
angeo = GetGeometry(merge, AnnotationTypeFilter=0, AtLeast=1, AtMost=1, DeleteInput=False, Filter=11, TreeAccess=False)
rev = Reverse(Vector=rays)
geo_2 = Geometry(angeo)
sample = GetInteger(Slider(1, range=0..5), AtLeast=1, AtMost=1, Maximum=2147483647, Minimum=-2147483648, TreeAccess=False)
pt_3 = Point(geo_2)
srf_2 = Surface(geo_2)
clean = CleanTree(RemoveNulls=True, RemoveInvalid=True, RemoveEmpty=False, Tree=srf_2)
clean_2 = CleanTree(RemoveNulls=True, RemoveInvalid=True, RemoveEmpty=False, Tree=pt_3)
int = Integer(0)
expression = Expression(x=int, y=sample, Expression="x≤y")
dispatch = Dispatch(List=clean, DispatchPattern=expression)  # -> ListA, ListB
dispatch_2 = Dispatch(List=clean_2, DispatchPattern=expression)  # -> ListA, ListB
graft = GraftTree(Tree=dispatch_2.ListA, IncludeEmptyLists=True, IncludeNullItems=True)
meshray = MeshRay(Mesh=obstructions, Point=graft, Direction=rev)  # -> Point, Hit
bool = Boolean(invert(meshray.Hit))
int_2 = Integer(bool)
expression_2 = Expression(x=int_2, Expression="x*1")
nullrep = ReplaceNulls(Items=expression_2, Replacements=0)  # -> Items, Count
flip_last = FlipLast(Data=simplify(nullrep.Items))
ma = MassAddition(Input=flip_last)  # -> Result, PartialResults
bool_2 = Boolean(invert(simplify(meshray.Hit)))
bool_3 = Boolean(ma.Result)
int_3 = Integer(24)
shift = ShiftPaths(Data=bool_3, Offset=-1)
cluster = Cluster(bool=shift, int=int_3)  # -> R, bool_4
dispatch_3 = Dispatch(List=dispatch.ListA, DispatchPattern=cluster.R)  # -> ListA, ListB
geo_3 = Geometry(dispatch_3.ListB)
int_4 = Integer(1)
expression_3 = Expression(x=int_4, y=sample, Expression="x≤y")
dispatch_4 = Dispatch(List=geo_3, DispatchPattern=expression_3)  # -> ListA, ListB
evalsrf = EvaluateSurface(Surface=reparameterize(dispatch_4.ListA), Point="0.5,0.5,0")  # -> Point, Normal, UDirection, VDirection, Frame
graft_2 = GraftTree(Tree=evalsrf.Point, IncludeEmptyLists=True, IncludeNullItems=True)
meshray_2 = MeshRay(Mesh=obstructions, Point=graft_2, Direction=rev)  # -> Point, Hit
bool_4 = Boolean(invert(meshray_2.Hit))
int_5 = Integer(2)
int_6 = Integer(24)
expression_4 = Expression(x=int_5, y=sample, Expression="x≤y")
cluster_2 = Cluster(bool=bool_4, int=int_6)  # -> R, bool_4
dispatch_5 = Dispatch(List=dispatch_4.ListA, DispatchPattern=cluster_2.R)  # -> ListA, ListB
geo_4 = Geometry(dispatch_5.ListB)
dispatch_6 = Dispatch(List=geo_4, DispatchPattern=expression_4)  # -> ListA, ListB
panel = Panel("""0,0,0
0,1,0
1,1,0
1,0,0""")
geo_5 = Geometry(dispatch_6.ListA)
evalsrf_2 = EvaluateSurface(Surface=reparameterize(geo_5), Point=panel)  # -> Point, Normal, UDirection, VDirection, Frame
graft_3 = GraftTree(Tree=evalsrf_2.Point, IncludeEmptyLists=True, IncludeNullItems=True)  # -> simplify(Tree)
meshray_3 = MeshRay(Mesh=obstructions, Point=graft_3, Direction=rev)  # -> Point, Hit
bool_5 = Boolean(invert(meshray_3.Hit))
flip_last_2 = FlipLast(Data=simplify(bool_5))
ma_2 = MassAddition(Input=flip_last_2)  # -> Result, PartialResults
int_7 = Integer(24)
bool_6 = Boolean(ma_2.Result)
shift_2 = ShiftPaths(Data=bool_6, Offset=-1)
planesrf = PlaneSurface(Plane=PlaneXY(0, 0, 0), XSize=Domain(-10, 10), YSize=Domain(-10, 10))
int_8 = Integer(3)
divide_2 = DivideDomain²(Domain=planesrf, UCount=2, VCount=2)
cluster_3 = Cluster(bool=shift_2, int=int_7)  # -> R, bool_4
expression_5 = Expression(x=int_8, y=sample, Expression="x≤y")
subsrf_2 = Isotrim(Surface=planesrf, Domain=divide_2)
dispatch_7 = Dispatch(List=dispatch_6.ListA, DispatchPattern=cluster_3.R)  # -> ListA, ListB
geo_6 = Geometry(dispatch_7.ListB)
area = Area(Geometry=subsrf_2)  # -> Area, Centroid
dispatch_8 = Dispatch(List=geo_6, DispatchPattern=expression_5)  # -> ListA, ListB
srf_cp = SurfaceClosestPoint(Point=area.Centroid, Surface=reparameterize(planesrf))  # -> Point, UVPoint, Distance
panel_2 = Panel(dispatch_7.ListA)
evalsrf_3 = EvaluateSurface(Surface=reparameterize(dispatch_8.ListA), Point=srf_cp.UVPoint)  # -> Point, Normal, UDirection, VDirection, Frame
graft_4 = GraftTree(Tree=evalsrf_3.Point, IncludeEmptyLists=True, IncludeNullItems=True)
pt_4 = Point(evalsrf_3.Point)
meshray_4 = MeshRay(Mesh=obstructions, Point=graft_4, Direction=rev)  # -> Point, Hit
pt_5 = Point(meshray_4.Point)
bool_7 = Boolean(invert(meshray_4.Hit))
flip_last_3 = FlipLast(Data=simplify(bool_7))
int_9 = Integer(24)
ma_3 = MassAddition(Input=flip_last_3)  # -> Result, PartialResults
int_10 = Integer(3)
bool_8 = Boolean(ma_3.Result)
U = UCount(4)
expression_6 = Expression(x=int_10, y=sample, Expression="x≤y")
shift_3 = ShiftPaths(Data=bool_8, Offset=-1)
planesrf_2 = PlaneSurface(Plane=PlaneXY(0, 0, 0), XSize=Domain(-10, 10), YSize=Domain(-10, 10))
divide_3 = DivideDomain²(Domain=planesrf_2, UCount=U, VCount=U)
cluster_4 = Cluster(bool=shift_3, int=int_9)  # -> R, bool_4
subsrf_3 = Isotrim(Surface=planesrf_2, Domain=divide_3)
dispatch_9 = Dispatch(List=dispatch_8.ListA, DispatchPattern=cluster_4.R)  # -> ListA, ListB
geo_7 = Geometry(dispatch_9.ListB)
area_2 = Area(Geometry=subsrf_3)  # -> Area, Centroid
dispatch_10 = Dispatch(List=geo_7, DispatchPattern=expression_6)  # -> ListA, ListB
srf_cp_2 = SurfaceClosestPoint(Point=area_2.Centroid, Surface=reparameterize(planesrf_2))  # -> Point, UVPoint, Distance
evalsrf_4 = EvaluateSurface(Surface=reparameterize(dispatch_10.ListA), Point=srf_cp_2.UVPoint)  # -> Point, Normal, UDirection, VDirection, Frame
graft_5 = GraftTree(Tree=evalsrf_4.Point, IncludeEmptyLists=True, IncludeNullItems=True)
pt_6 = Point(evalsrf_4.Point)
meshray_5 = MeshRay(Mesh=obstructions, Point=graft_5, Direction=rev)  # -> Point, Hit
bool_9 = Boolean(invert(meshray_5.Hit))
flip_last_4 = FlipLast(Data=simplify(bool_9))
int_11 = Integer(24)
ma_4 = MassAddition(Input=flip_last_4)  # -> Result, PartialResults
int_12 = Integer(5)
bool_10 = Boolean(ma_4.Result)
shift_4 = ShiftPaths(Data=bool_10, Offset=-1)
expression_7 = Expression(x=int_12, y=sample, Expression="x≤y")
U_2 = UCount(8)
planesrf_3 = PlaneSurface(Plane=PlaneXY(0, 0, 0), XSize=Domain(-10, 10), YSize=Domain(-10, 10))
cluster_5 = Cluster(bool=shift_4, int=int_11)  # -> R, bool_4
divide_4 = DivideDomain²(Domain=planesrf_3, UCount=U_2, VCount=U_2)
dispatch_11 = Dispatch(List=dispatch_10.ListA, DispatchPattern=cluster_5.R)  # -> ListA, ListB
geo_8 = Geometry(dispatch_11.ListB)
subsrf_4 = Isotrim(Surface=planesrf_3, Domain=divide_4)
area_3 = Area(Geometry=subsrf_4)  # -> Area, Centroid
dispatch_12 = Dispatch(List=geo_8, DispatchPattern=expression_7)  # -> ListA, ListB
srf_cp_3 = SurfaceClosestPoint(Point=area_3.Centroid, Surface=reparameterize(planesrf_3))  # -> Point, UVPoint, Distance
evalsrf_5 = EvaluateSurface(Surface=reparameterize(dispatch_12.ListA), Point=srf_cp_3.UVPoint)  # -> Point, Normal, UDirection, VDirection, Frame
graft_6 = GraftTree(Tree=evalsrf_5.Point, IncludeEmptyLists=True, IncludeNullItems=True)
pt_7 = Point(evalsrf_5.Point)
meshray_6 = MeshRay(Mesh=obstructions, Point=graft_6, Direction=rev)  # -> Point, Hit
pt_8 = Point(meshray_6.Point)
bool_11 = Boolean(invert(meshray_6.Hit))
flip_last_5 = FlipLast(Data=simplify(bool_11))
int_13 = Integer(24)
ma_5 = MassAddition(Input=flip_last_5)  # -> Result, PartialResults
bool_12 = Boolean(ma_5.Result)
shift_5 = ShiftPaths(Data=bool_12, Offset=-1)
cluster_6 = Cluster(bool=shift_5, int=int_13)  # -> R, bool_4
merge_2 = Merge(
    Data1=cluster.bool_4,
    Data2=cluster_2.bool_4,
    Data3=cluster_3.bool_4,
    Data4=cluster_4.bool_4,
    Data5=cluster_5.bool_4,
    Data6=cluster_6.bool_4)
geo_9 = Geometry(dispatch_3.ListA)
geo_10 = Geometry(dispatch_5.ListA)
geo_11 = Geometry(dispatch_11.ListA)
geo_12 = Geometry(dispatch_7.ListA)
geo_13 = Geometry(dispatch_9.ListA)
clean_3 = CleanTree(RemoveNulls=True, RemoveInvalid=True, RemoveEmpty=False, Tree=merge_2)
item_2 = ListItem(List=clean_3, Index=-1, Wrap=True)
dispatch_13 = Dispatch(List=dispatch_12.ListA, DispatchPattern=cluster_6.R)  # -> ListA, ListB
geo_14 = Geometry(dispatch_13.ListA)
merge_3 = Merge(Data1=geo_9, Data2=geo_10, Data3=geo_12, Data4=geo_13, Data5=geo_11, Data6=geo_14)
int_14 = Integer(item_2)
clean_4 = CleanTree(RemoveNulls=True, RemoveInvalid=True, RemoveEmpty=False, Tree=int_14)
panel_3 = Panel(int_14)
lng = ListLength(List=merge_3)
repeat = RepeatData(Data="2", Length=lng)  # -> simplify(Data)
merge_4 = Merge(Data1=repeat, Data2=clean_4)
item_3 = ListItem(List=merge_4, Index=0, Wrap=True)
area_4 = Area(Geometry=angeo)  # -> Area, Centroid
tag = TextTag(Location=area_4.Centroid, Text=item_3)
S = ContextPrint(Text=item_3)

# ==== cluster Cluster
bool = ClusterInput()
int = ClusterInput()
bool_2 = Boolean(bool)
int_2 = Integer(int)
shift = ShiftList(List=bool_2, Shift=1, Wrap=True)
shift_2 = ShiftList(List=bool_2, Shift=-1, Wrap=True)
and = GateAnd(A=shift, B=shift_2)  # -> simplify(Result)
ma = MassAddition(Input=and)  # -> Result, PartialResults
expression = Expression(x=ma.Result, y=int_2, Expression="x≥y")
bool_3 = Boolean(ma.Result)
R = ClusterOutput(expression)
bool_4 = ClusterOutput(bool_3)
