# Grasshopper definition svgToPDF Test.ghx (Grasshopper 1.0.8)
# plug-ins: RhinoCodePluginGH, Redback.GH

crv = Curve([<curve referenced from the Rhino model> x3])
xy = XYPlane(Origin=Point(0, 0, 0))
geo2arch = Geo2Arch(Geometry=crv, Properties="{}")
svg_layout = SVGLayout(P=xy, D="A4", S="1:1", L=True)  # -> L, R
svg = SVGGenerator(JO=geo2arch, LA=svg_layout.L)
rel_path = RelativePath(Path=False, RelativePath="TEST.svg")  # -> FullPath, Directory, FileName
convertsvgunits = ConvertSVGUnits(CSS="*{fill:none; stroke-width: 0.5mm; stroke: #FF0000;}")
write = WriteFile(Run=Toggle(True), Content=svg, FileDirectory=rel_path.Directory, FileName=rel_path.FileName)
py3 = Python3Script(x=write)  # -> out, a
# ---------- py3: Python ----------
# r: svglib
from svglib.svglib import svg2rlg
from reportlab.graphics import renderPDF#, renderPM
drawing = svg2rlg(x)
newFileName = x.replace(".svg",".pdf")
renderPDF.drawToFile(drawing, newFileName)
a = newFileName
# ---------- end py3 ----------
panel = Panel(convertsvgunits)
